# Dynamo custom node FamilyDocSsGetParameterFormulae.dyf "© FamilyDoc.SS_GetParameterFormulae" (Dynamo 2.12.1.8246)
# category: Crumple.Revit.Query
# Given a family document or list of them, attempts to get parameter formulae in them. Input structures should be in the form of one sub-list per family document, in a list (but the node will try to create this data structure if not, as well as repeat the last list if they are shorter than the family document list).
# packages: Crumple 2024.3.1

familyDocs = Input(familyDocs: var[]..[])  # A family document or list of family documents. If multiple family documents, you should provide a list of list with branches equal to the family documents. If you do not the node will apply longest lacing to the last list for each excess family document.
nameOrParamLists = Input(nameOrParamLists: var[]..[])  # Lists of family parameters or parameter names. (per family document, ideally)
list_graftbyprimary = Custom[© List.GraftByPrimary](primary=familyDocs, listA=nameOrParamLists)  # package Crumple; Given a first input, the node will assess how many items it contains (if one, it will make it a list of 1 item). Remaining branches will be forced into a list of lists, where the last branch will be repeated to a longest length as the first list (if one list or item is provided, it will repeat as the list of lists).
python_script_get_parameters = Python(IN[0]=list_graftbyprimary.primary, IN[1]=list_graftbyprimary.listA)  # IronPython2
# ---------- python_script_get_parameters.python (80 lines) ----------
# Made by Gavin Crump
# Free for use
# BIM Guru, www.bimguru.com.au

# Boilerplate text
import clr

clr.AddReference("RevitServices")
import RevitServices
from RevitServices.Persistence import DocumentManager 

clr.AddReference('RevitAPI')
import Autodesk 
from Autodesk.Revit.DB import *

# Get Revit build version
uiapp = DocumentManager.Instance.CurrentUIApplication
app = uiapp.Application

# Define list/unwrap list functions
def tolist(input):
    result = input if isinstance(input, list) else [input]
    return result

def getParameterFormula(par):
	if par.IsDeterminedByFormula:
		return par.Formula
	else:
		return ""

def parameterOrName(par):
	# If it isn't a string, try to get its definition name
	if not isinstance(parName, str):
		try:
			return parName.Definition.Name
		except:
			return ""
	else:
		return par

#Inputdoc
docs_list = IN[0]
paramName_lists = IN[1]

paramLists, formulaLists = [],[]

# For each document...
for doc, nameList in zip(docs_list, paramName_lists):
	# Storage lists
	paramList, formulaList = [],[]
	# If a family document...
	if doc.IsFamilyDocument:
		# Get parameters
		famMan = doc.FamilyManager
		params = famMan.Parameters
		parNames = [p.Definition.Name for p in params]
		# For each parameter name...
		for parName in nameList:
			parName = parameterOrName(parName)
			# If name is in names...
			if parName in parNames:
				# Find it using a zip loop
				for p,n in zip(params, parNames):
					if n == parName:
						par = p
						break
				paramList.append(par)
				# Return the formula
				formulaList.append(getParameterFormula(par))
			# Otherwise, no parameter or values
			else:
				paramList.append(None)
				formulaList.append(None)
			
	# Append the lists
	paramLists.append(paramList)
	formulaLists.append(formulaList)

# Output the lists
OUT = docs_list, paramLists, formulaLists
# ----------------------------------------
code_block = CodeBlock(out=python_script_get_parameters) { doc = out[0]; par = out[1]; frm = out[2]; }
familyDocs_2 = Output(code_block.doc)  # "familyDocs"; The original family document(s).
Lists_of_parameters_list_per_family_docu = Output(code_block.par)  # "/*Lists of parameters (list per family document).*/ paramLists"
Lists_of_formulae_if_any_list_per_family = Output(code_block.frm)  # "/*Lists of formulae, if any (list per family document).*/ formulaeLists"
