# Dynamo custom node FamilyDocSsReplaceParameter.dyf "© FamilyDoc.SS_ReplaceParameter" (Dynamo 2.3.1.11775)
# category: Crumple.Revit.Create
# Given some family parameters in a document, replace them with new shared parameters with the chosen external definitions.
# packages: Crumple 2022.2.13

familyDocument = Input(familyDocument: var[]..[] = null)  # Uses current if none provided.
revit_getdocument = Custom[© Revit.GetDocument](docOrLink=familyDocument)  # package Crumple; If no input is specified or an invalid one is, returns current document. If a link instance is provided, it returns the linked document. If a document is provided it will pass it through.
parameters = Input(parameters: var[]..[])  # A parameter or list of parameters for conversion.
exDefs = Input(exDefs: var[]..[])  # External parameter definitions.
python_script = Python(IN[0]=revit_getdocument.document, IN[1]=parameters, IN[2]=exDefs)
# ---------- python_script.python (51 lines) ----------
# Made by Gavin Crump
# Free for use
# BIM Guru, www.bimguru.com.au

#Credit to Joshua Budarick for his assistance with this workflow!
# https://www.linkedin.com/in/joshua-budarick-9bb50b4b/

# Boilerplate text
import clr
clr.AddReference('RevitAPI')
from Autodesk.Revit.DB import *

clr.AddReference("RevitServices")
import RevitServices
from RevitServices.Persistence import DocumentManager
from RevitServices.Transactions import TransactionManager

#Inputdoc
doc = IN[0]

# Functions
def uwlist(input):
    result = input if isinstance(input, list) else [input]
    return UnwrapElement(input)

#unwrap all elements to use with API
params       = uwlist(IN[1])
definitions  = uwlist(IN[2])

params_new, names_new = [],[]

# Collect values
if doc.IsFamilyDocument:

	# "Start" the transaction
	TransactionManager.Instance.EnsureInTransaction(doc)
	
	for p,d in zip(params, definitions):
		try:
			new = doc.FamilyManager.ReplaceParameter(p, d, p.Definition.ParameterGroup, p.IsInstance)
			params_new.append(new)
		except:
			params_new.append(None)

	# "End" the transaction
	TransactionManager.Instance.TransactionTaskDone()

	OUT = params_new
	
else:
	OUT = ["Document is not a family."]
# ----------------------------------------
elements = Output(python_script)  # The parameters as elements
