# Dynamo custom node FamilyDocSsReplaceSharedParameter.dyf "© FamilyDoc.SS_ReplaceSharedParameter" (Dynamo 2.3.1.11775)
# category: Crumple.Revit.Create
# Given some shared parameters in a family document, replaces them with new family parameters with the chosen names.
# packages: Crumple 2022.2.13

familyDocument = Input(familyDocument: var[]..[] = null)  # Uses current if none provided.
revit_getdocument = Custom[© Revit.GetDocument](docOrLink=familyDocument)  # package Crumple; If no input is specified or an invalid one is, returns current document. If a link instance is provided, it returns the linked document. If a document is provided it will pass it through.
parameters = Input(parameters: var[]..[])  # A parameter or list of parameters for conversion.
newNames = Input(newNames: var[]..[])  # New parameters names (must be different)
python_script = Python(IN[0]=revit_getdocument.document, IN[1]=parameters, IN[2]=newNames)
# ---------- python_script.python (53 lines) ----------
# Made by Gavin Crump
# Free for use
# BIM Guru, www.bimguru.com.au

#Credit to Joshua Budarick for his assistance with this workflow!
# https://www.linkedin.com/in/joshua-budarick-9bb50b4b/

# Boilerplate text
import clr
clr.AddReference('RevitAPI')
from Autodesk.Revit.DB import *

clr.AddReference("RevitServices")
import RevitServices
from RevitServices.Persistence import DocumentManager
from RevitServices.Transactions import TransactionManager

#Inputdoc : Part of script by Andreas Dieckmann
doc = IN[0]

# Functions
def uwlist(input):
    result = input if isinstance(input, list) else [input]
    return UnwrapElement(input)

#unwrap all elements to use with API
params = uwlist(IN[1])
names  = uwlist(IN[2])

params_new, names_new = [],[]

# Collect values
if doc.IsFamilyDocument:

	# "Start" the transaction
	TransactionManager.Instance.EnsureInTransaction(doc)
	
	for p,n in zip(params, names):
		try:
			new = doc.FamilyManager.ReplaceParameter(p, n, p.Definition.ParameterGroup, p.IsInstance)
			params_new.append(new)
			names_new.append(n)
		except:
			params_new.append(None)
			names_new.append(None)

	# "End" the transaction
	TransactionManager.Instance.TransactionTaskDone()

	OUT = [params_new, names]
	
else:
	OUT = ["Document is not a family.",""]
# ----------------------------------------
code_block = CodeBlock(out=python_script) { params = out[0]; names = out[1]; }
elements = Output(code_block.params)  # The parameters as elements
names = Output(code_block.names)  # The names of the parameters
