# Dynamo custom node AboutAussieBimGuru.dyf "© About.AussieBIMGuru" (Dynamo 2.12.1.8246)
# category: Crumple.Query
# Opens the Aussie BIM Guru YouTube channel.

runMe = Input(runMe: bool = false)
python_script = Python(IN[0]=runMe)  # CPython3
# ---------- python_script.python (13 lines) ----------
# Made by Gavin Crump
# Free for use
# BIM Guru, www.bimguru.com.au

# Boilerplate text
import os

# Open URL
if IN[0]:
	os.system("start \"\" https://www.youtube.com.au/aussiebimguru")
	OUT = "Enjoy!"
else:
	OUT = "Set runMe to True!"
# ----------------------------------------
Output = Output(python_script)  # "=)"
