# Dynamo custom node AboutBimGuruEducation.dyf "© About.BIMGuruEducation" (Dynamo 2.16.2.5624)
# category: Crumple.Query
# Takes you to my course and content platform, courses.bimguru.education.

runMe = Input(runMe: bool = false)
python_script = Python(IN[0]=runMe)  # CPython3
# ---------- python_script.python (13 lines) ----------
# Made by Gavin Crump
# Free for use
# BIM Guru, www.bimguru.com.au

# Boilerplate text
import os

# Open URL
if IN[0]:
	os.system("start \"\" https://courses.bimguru.education")
	OUT = "Enjoy!"
else:
	OUT = "Set runMe to True!"
# ----------------------------------------
Output = Output(python_script)  # "=)"
