# Dynamo custom node Alphabet.dyf "© String.Alphabet" (Dynamo 2.3.0.5885)
# category: Crumple.Data.Create
# Generates an upper or lower case alphabet.

upper = Input(upper: bool = false)
code_block = CodeBlock { "a".."z"..1; }
toUpper = String.ToUpper(str=code_block)
if_ = If(test=upper, true=toUpper, false=code_block)
alphabet = Output(if_)
