# Dynamo custom node ApplicationFilterBackups.dyf "© Windows.FilterBackups" (Dynamo 2.16.2.5624)
# category: Crumple.Application.Actions
# Given a filepath or list of filepaths, separate out any backup file paths.

filePaths = Input(filePaths: var[]..[])
python_script = Python(IN[0]=filePaths)  # CPython3
# ---------- python_script.python (38 lines) ----------
# Made by Gavin Crump
# Free for use
# BIM Guru, www.bimguru.com.au

# Boilerplate text
import clr

# Define list/unwrap list functions
def tolist(input):
    result = input if isinstance(input, list) else [input]
    return result

# Preparing input from dynamo to revit
filePaths = tolist(IN[0])

# Return only non-backup
def isBackup(fp):
	fp1 = fp.rsplit(".", 1)[0]
	fp2 = fp1.rsplit(".",1)[-1]
	try:
		int(fp2)
		return True
	except:
		return False

pathsOut, bkpPaths, mask = [],[],[]

for fp in filePaths:
	bkp = isBackup(fp)
	if bkp:
		bkpPaths.append(fp)
		mask.append(True)
	else:
		pathsOut.append(fp)
		mask.append(False)

# Preparing output to Dynamo
OUT = pathsOut, bkpPaths, mask
# ----------------------------------------
code_block = CodeBlock(out=python_script) { fps = out[0]; bkp = out[1]; mask = out[2]; }
validPaths = Output(code_block.fps)
backupPaths = Output(code_block.bkp)
isBackupPath = Output(code_block.mask)
