# Dynamo custom node AreaCreate.dyf "© Area.Create" (Dynamo 2.16.2.5624)
# category: Crumple.Revit.Create
# Given a view and a list of points, will create new areas at them. Note that you will need to provide a single view and list of points, or apply @levels to your inputs to have them work.

point = Input(point: var[]..[])
view = Input(view: var[]..[])
python_script = Python(IN[0]=point, IN[1]=view)  # CPython3
# ---------- python_script.python (75 lines) ----------
# Made by Gavin Crump
# Free for use
# BIM Guru, www.bimguru.com.au

# Boilerplate text
import clr

clr.AddReference('ProtoGeometry')
from Autodesk.DesignScript.Geometry import *

clr.AddReference("RevitNodes")
import Revit
clr.ImportExtensions(Revit.Elements)
clr.ImportExtensions(Revit.GeometryConversion)

clr.AddReference("RevitServices")
import RevitServices
from RevitServices.Persistence import DocumentManager 
from RevitServices.Transactions import TransactionManager 

clr.AddReference("RevitAPI")
import Autodesk 
from Autodesk.Revit.DB import UV

# Define list/unwrap list functions
def tolist(input):
    result = input if isinstance(input, list) else [input]
    return result

def uwlist(input):
    result = input if isinstance(input, list) else [input]
    return UnwrapElement(result)

def objOrList(input, initial = IN[0]):
	if isinstance(initial, list):
		return input
	else:
		return input[0]

def matchLength(list1, list2):
    len1 = len(list1)
    len2 = len(list2)
    if len1 == len2:
        return list1
    elif len1 > len2:
        return list1[:len2]
    else:
        for i in range(0, len2-len1, 1):
            list1.append(list1[-1])
        return list1

# Current doc/app/ui
doc = DocumentManager.Instance.CurrentDBDocument

# Get inputs
points = tolist(IN[0])
views = matchLength(uwlist(IN[1]), point_lst)

areas = []

# Start Transaction
TransactionManager.Instance.EnsureInTransaction(doc)

for p,v in zip(points, views):
    try:
        p = p.ToXyz()
        u = UV(p.X,p.Y)
        a = doc.Create.NewArea(v, u)
        areas.append(a)
    except:
        areas.append(None)

TransactionManager.Instance.TransactionTaskDone()

OUT = objOrList(areas)
# ----------------------------------------
area = Output(python_script)
