# Dynamo custom node AreaCreateByRooms.dyf "© Area.CreateByRooms" (Dynamo 2.16.2.5624)
# category: Crumple.Revit.Create
# Given a list of rooms, the node will create areas in the same position for an area plan view. The areas will have their name and number set to match their respective room.

room = Input(room: var[]..[])  # Rooms to base the areas from.
view = Input(view: var[]..[])  # The view to place the areas in.
python_script = Python(IN[0]=room, IN[1]=view)  # CPython3
# ---------- python_script.python (73 lines) ----------
# Made by Gavin Crump
# Free for use
# BIM Guru, www.bimguru.com.au

# Boilerplate text
import clr

clr.AddReference("RevitNodes")
import Revit
clr.ImportExtensions(Revit.Elements)
clr.ImportExtensions(Revit.GeometryConversion)

clr.AddReference("RevitServices")
import RevitServices
from RevitServices.Persistence import DocumentManager 
from RevitServices.Transactions import TransactionManager 

clr.AddReference("RevitAPI")
import Autodesk 
from Autodesk.Revit.DB import UV

# Current doc/app/ui
doc = DocumentManager.Instance.CurrentDBDocument

# Unwrapped list function
def uwlist(input):
	result = input if isinstance(input, list) else [input]
	return UnwrapElement(result)

def objOrList(input, initial = IN[0]):
	if isinstance(initial, list):
		return input
	else:
		return input[0]

def matchLength(list1, list2):
    len1 = len(list1)
    len2 = len(list2)
    if len1 == len2:
        return list1
    elif len1 > len2:
        return list1[:len2]
    else:
        for i in range(0, len2-len1, 1):
            list1.append(list1[-1])
        return list1

# Preparing input from dynamo to revit
rooms = uwlist(IN[0])
views = matchLength(uwlist(IN[1]), rooms)

# Start making Transaction
TransactionManager.Instance.EnsureInTransaction(doc)

# Make areas from rooms, matching names and numbers
areas, nums, nams = [], [], []

for r,v in zip(rooms, views):
	loc = r.Location.Point
	area = doc.Create.NewArea(v, UV(loc.X, loc.Y))
	numb = room.GetParameters("Number")[0].AsString()
	area.Number = numb
	name = room.GetParameters("Name")[0].AsString()
	area.Name = name
	nums.append(numb)
	nams.append(name)
	areas.append(area.ToDSType(False))
		
# Finish making transaction
TransactionManager.Instance.TransactionTaskDone()

# Preparing output to Dynamo
OUT = [objOrList(o) for o in [areas, nums, names]]
# ----------------------------------------
code_block = CodeBlock(lst=python_script) { area = lst[0]; num = lst[1]; nam = lst[2]; }
area = Output(code_block.area)  # The areas as elements.
number = Output(code_block.num)  # Area numbers as strings.
name = Output(code_block.nam)  # Area names as strings.
