# Dynamo custom node AreaCreateSeparators.dyf "© Area.CreateSeparators" (Dynamo 2.16.2.5624)
# category: Crumple.Revit.Create
# Given a list of Dynamo curves, the node generates area boundary lines along them in the given view. For convenience of iterability, this node flattens the curve list by default.

curve = Input(curve: var[]..[])  # Curves to base the area separation lines from.
view = Input(view: var[]..[])  # The view to place the lines in.
python_script = Python(IN[0]=curve, IN[1]=view)  # CPython3
# ---------- python_script.python (70 lines) ----------
# Made by Gavin Crump
# Free for use
# BIM Guru, www.bimguru.com.au

# Boilerplate text
import clr

clr.AddReference("RevitNodes")
import Revit
clr.ImportExtensions(Revit.Elements)
clr.ImportExtensions(Revit.GeometryConversion)

clr.AddReference("RevitServices")
import RevitServices
from RevitServices.Persistence import DocumentManager 
from RevitServices.Transactions import TransactionManager 

clr.AddReference("RevitAPI")
import Autodesk 
from Autodesk.Revit.DB import SketchPlane

# Define list/unwrap list functions
def uwlist(input):
    result = input if isinstance(input, list) else [input]
    return UnwrapElement(result)

def objOrList(input, initial = IN[0]):
	if isinstance(initial, list):
		return input
	else:
		return input[0]

def matchLength(list1, list2):
    len1 = len(list1)
    len2 = len(list2)
    if len1 == len2:
        return list1
    elif len1 > len2:
        return list1[:len2]
    else:
        for i in range(0, len2-len1, 1):
            list1.append(list1[-1])
        return list1

# Current doc/app/ui
doc = DocumentManager.Instance.CurrentDBDocument

# Preparing input from dynamo to revit
curves = uwlist(IN[0])
views = matchLength(uwlist(IN[1]),curves)

bounds = []

# Start making Transaction
TransactionManager.Instance.EnsureInTransaction(doc)

for c,v in zip(curves, views):
    
    view_level = v.GenLevel
    view_plane = SketchPlane.Create(doc, view_level.Id)
    
    crv = curve.ToRevitType()
    line = doc.Create.NewAreaBoundaryLine(view_plane, crv, v)
    bounds.append(line.ToDSType(False))
		
# Finish making transaction
TransactionManager.Instance.TransactionTaskDone()

# Preparing output to Dynamo
OUT = objOrList(bounds)
# ----------------------------------------
areaSeparationLine = Output(python_script)  # The model curves as elements.
