# Dynamo custom node AreasByPointsAndView.dyf "© AreasByPointsAndView" (Dynamo 2.3.0.5885)
# category: Crumple.Revit.Areas
# Given a view and a list of points, will create new areas at them. Note that you will need to provide a single view and list of points, or apply @levels to your inputs to have them work.

view = Input(view: var[]..[])
points = Input(points: var[]..[])
python_script = Python(IN[0]=view, IN[1]=points)
# ---------- python_script.python (46 lines) ----------
# Made by Gavin Crump
# Free for use
# BIM Guru, www.bimguru.com.au

# Boilerplate text
import clr

clr.AddReference('ProtoGeometry')
from Autodesk.DesignScript.Geometry import *

clr.AddReference("RevitNodes")
import Revit
clr.ImportExtensions(Revit.Elements)
clr.ImportExtensions(Revit.GeometryConversion)

clr.AddReference("RevitServices")
import RevitServices
from RevitServices.Persistence import DocumentManager 
from RevitServices.Transactions import TransactionManager 

clr.AddReference("RevitAPI")
import Autodesk 
from Autodesk.Revit.DB import *

# Current doc/app/ui
doc = DocumentManager.Instance.CurrentDBDocument

# Get inputs
view = UnwrapElement(IN[0])
point_lst = IN[1]
area_list=[]

# Start Transaction
TransactionManager.Instance.EnsureInTransaction(doc)

for v, pts in zip(view,point_lst):
	for pt in pts:
		p = UnwrapElement(pt).ToXyz()
		u = UV(p.X,p.Y)
		a = doc.Create.NewArea(v,u)
		area_list.append(a)

# End Transaction
TransactionManager.Instance.TransactionTaskDone()

OUT = area_list
# ----------------------------------------
areas = Output(python_script)
