# Dynamo custom node AreasCreate.dyf "© Areas.Create" (Dynamo 2.12.1.8246)
# category: Crumple.Revit.Create
# Given a view and a list of points, will create new areas at them. Note that you will need to provide a single view and list of points, or apply @levels to your inputs to have them work.

view = Input(view: var = Revit.Application.Document.Current.ActiveView)
points = Input(points: var[]..[])
python_script = Python(IN[0]=view, IN[1]=points)  # IronPython2
# ---------- python_script.python (60 lines) ----------
# Made by Gavin Crump
# Free for use
# BIM Guru, www.bimguru.com.au

# Boilerplate text
import clr

clr.AddReference('ProtoGeometry')
from Autodesk.DesignScript.Geometry import *

clr.AddReference("RevitNodes")
import Revit
clr.ImportExtensions(Revit.Elements)
clr.ImportExtensions(Revit.GeometryConversion)

clr.AddReference("RevitServices")
import RevitServices
from RevitServices.Persistence import DocumentManager 
from RevitServices.Transactions import TransactionManager 

clr.AddReference("RevitAPI")
import Autodesk 
from Autodesk.Revit.DB import ViewType, UV

# Define list/unwrap list functions
def tolist(input):
    result = input if isinstance(input, list) else [input]
    return result

def objOrList(input, initial = IN[0]):
	if isinstance(initial, list):
		return input
	else:
		return input[0]

# Current doc/app/ui
doc = DocumentManager.Instance.CurrentDBDocument

# Get inputs
view = UnwrapElement(IN[0])
point_lst = tolist(IN[1])

# Start Transaction
TransactionManager.Instance.EnsureInTransaction(doc)

if v.ViewType == ViewType.AreaPlan:
	area_list=[]
	for v, pts in zip(view,point_lst):
		for pt in pts:
			p = UnwrapElement(pt).ToXyz()
			u = UV(p.X,p.Y)
			a = doc.Create.NewArea(v,u)
			area_list.append(a)
else:
	area_list = [None for p in point_lst]

# End Transaction
TransactionManager.Instance.TransactionTaskDone()

OUT = objOrList(area_list)
# ----------------------------------------
areas = Output(python_script)
