# Dynamo custom node AreasCreateByRooms.dyf "© Areas.CreateByRooms" (Dynamo 2.12.1.8246)
# category: Crumple.Revit.Create
# Given a list of rooms, the node will create areas in the same position for an area plan view. The areas will have their name and number set to match their respective room.

rooms = Input(rooms: var[]..[])  # Rooms to base the areas from.
view = Input(view: var = Revit.Application.Document.Current.ActiveView)  # The view to place the areas in.
python_script = Python(IN[0]=rooms, IN[1]=view)  # IronPython2
# ---------- python_script.python (61 lines) ----------
# Made by Gavin Crump
# Free for use
# BIM Guru, www.bimguru.com.au

# Boilerplate text
import clr

clr.AddReference("RevitNodes")
import Revit
clr.ImportExtensions(Revit.Elements)
clr.ImportExtensions(Revit.GeometryConversion)

clr.AddReference("RevitServices")
import RevitServices
from RevitServices.Persistence import DocumentManager 
from RevitServices.Transactions import TransactionManager 

clr.AddReference("RevitAPI")
import Autodesk 
from Autodesk.Revit.DB import UV

# Current doc/app/ui
doc = DocumentManager.Instance.CurrentDBDocument

# Unwrapped list function
def uwlist(input):
	result = input if isinstance(input, list) else [input]
	return UnwrapElement(result)

def objOrList(input, initial = IN[0]):
	if isinstance(initial, list):
		return input
	else:
		return input[0]

# Preparing input from dynamo to revit
rooms_list  = uwlist(IN[0])
view_r      = UnwrapElement(IN[1])

# Start making Transaction
TransactionManager.Instance.EnsureInTransaction(doc)

# Make areas from rooms, matching names and numbers
areas, nums, nams = [], [], []

for room in rooms_list:
	loc = room.Location.Point
	area = doc.Create.NewArea(view_r, UV(loc.X, loc.Y))
	numb = room.GetParameters("Number")[0].AsString()
	area.Number = numb
	name = room.GetParameters("Name")[0].AsString()
	area.Name = name
	nums.append(numb)
	nams.append(name)
	areas.append(area.ToDSType(False))
		
# Finish making transaction
TransactionManager.Instance.TransactionTaskDone()

# Preparing output to Dynamo
OUT = objOrList(areas), objOrList(nums), objOrList(nams)
# ----------------------------------------
code_block = CodeBlock(lst=python_script) { area = lst[0]; nums = lst[1]; nams = lst[2]; }
areas = Output(code_block.area)  # The areas as elements.
numbers = Output(code_block.nums)  # Area numbers as strings.
names = Output(code_block.nams)  # Area names as strings.
