# Dynamo custom node AuditElevationMarkers.dyf "© Audit.ElevationMarkers" (Dynamo 2.12.1.8246)
# category: Crumple.Revit.Actions
# Returns all elevation markers with no active elevations in them. If you set the purge to true, it will attempt to delete them also.
# packages: Crumple 2022.5.27

docOrLink = Input(docOrLink: var[]..[] = null)  # Uses current if none provided. Accepts document or link instance.
revit_getdocument = Custom[© Revit.GetDocument](docOrLink=docOrLink)  # package Crumple; If no input is specified or an invalid one is, returns current document. If a link instance is provided, it returns the linked document. If a document is provided it will pass it through.
purge = Input(purge: bool = false)
python_script = Python(IN[0]=revit_getdocument.document, IN[1]=purge)  # IronPython2
# ---------- python_script.python (46 lines) ----------
# Made by Gavin Crump
# Free for use
# BIM Guru, www.bimguru.com.au

# Boilerplate text
import clr

clr.AddReference("RevitServices")
import RevitServices
from RevitServices.Transactions import TransactionManager 

clr.AddReference("RevitAPI")
import Autodesk 
from Autodesk.Revit.DB import FilteredElementCollector, ElevationMarker

# Current doc/app/ui
doc = IN[0]
purge = IN[1]

# Get all elevation markers
markers_all = FilteredElementCollector(doc).OfClass(ElevationMarker).ToElements()

# Get all empty elevation markers
empty_markers = []

for m in markers_all:
	if not m.HasElevations():
		empty_markers.append(m)

marker_ids = [m.Id for m in empty_markers]

# Preparing output to Dynamo
if purge:
	# Do some action in a Transaction
	outList = []
	TransactionManager.Instance.EnsureInTransaction(doc)
	for i,m in zip(marker_ids, empty_markers):
		try:
			doc.Delete(i)
			outList.append(None)
		except:
			outList.append(m)
	TransactionManager.Instance.TransactionTaskDone()
	OUT = outList, marker_ids
else:
	OUT = empty_markers, marker_ids
# ----------------------------------------
code_block = CodeBlock(x=python_script) { x[0]; x[1]; }
elevationMarkers = Output(code_block.out0)
ids = Output(code_block.out1)
