# Dynamo custom node AuditImportedPatterns.dyf "© Audit.ImportedPatterns" (Dynamo 2.12.1.8246)
# category: Crumple.Revit.Actions
# Returns all fill and line patterns with 'import' in their name (case insensitive). If you set the purge to true, it will attempt to delete them also.
# packages: Crumple 2022.5.27

docOrLink = Input(docOrLink: var[]..[] = null)  # Uses current if none provided. Accepts document or link instance.
revit_getdocument = Custom[© Revit.GetDocument](docOrLink=docOrLink)  # package Crumple; If no input is specified or an invalid one is, returns current document. If a link instance is provided, it returns the linked document. If a document is provided it will pass it through.
purge = Input(purge: bool = false)
python_script = Python(IN[0]=revit_getdocument.document, IN[1]=purge)  # IronPython2
# ---------- python_script.python (48 lines) ----------
# Made by Gavin Crump
# Free for use
# BIM Guru, www.bimguru.com.au

# Boilerplate text
import clr

clr.AddReference("RevitServices")
import RevitServices
from RevitServices.Transactions import TransactionManager 

clr.AddReference("RevitAPI")
import Autodesk 
from Autodesk.Revit.DB import FilteredElementCollector, LinePatternElement, FillPatternElement

# Current doc/app/ui
doc = IN[0]
purge = IN[1]

# get all pattern objects
linePatterns_all = FilteredElementCollector(doc).OfClass(LinePatternElement).ToElements()
fillPatterns_all = FilteredElementCollector(doc).OfClass(FillPatternElement).ToElements()
patterns_all     = list(linePatterns_all) + list(fillPatterns_all)

# Get imported patterns only
patterns_import = []

for p in patterns_all:
	if "IMPORT" in p.Name.upper():
		patterns_import.append(p)

pattern_ids = [p.Id for p in patterns_import]

# Preparing output to Dynamo
if purge:
	# Do some action in a Transaction
	outList = []
	TransactionManager.Instance.EnsureInTransaction(doc)
	for i,p in zip(pattern_ids, patterns_import):
		try:
			doc.Delete(i)
			outList.append(None)
		except:
			outList.append(p)
	TransactionManager.Instance.TransactionTaskDone()
	OUT = outList, pattern_ids
else:
	OUT = patterns_import, pattern_ids
# ----------------------------------------
code_block = CodeBlock(x=python_script) { x[0]; x[1]; }
importedPatterns = Output(code_block.out0)
ids = Output(code_block.out1)
