# Dynamo custom node AuditScheduleTypes.dyf "© Audit.ScheduleTypes" (Dynamo 2.12.1.8246)
# category: Crumple.Revit.Actions
# Returns all fill and line patterns with 'import' in their name (case insensitive). If you set the purge to true, it will attempt to delete them also.
# packages: Crumple 2022.5.27

docOrLink = Input(docOrLink: var[]..[] = null)  # Uses current if none provided. Accepts document or link instance.
revit_getdocument = Custom[© Revit.GetDocument](docOrLink=docOrLink)  # package Crumple; If no input is specified or an invalid one is, returns current document. If a link instance is provided, it returns the linked document. If a document is provided it will pass it through.
purge = Input(purge: bool = false)
python_script = Python(IN[0]=revit_getdocument.document, IN[1]=purge)  # IronPython2
# ---------- python_script.python (69 lines) ----------
# Made by Gavin Crump
# Free for use
# BIM Guru, www.bimguru.com.au

# Boilerplate text
import clr

clr.AddReference("RevitServices")
import RevitServices
from RevitServices.Transactions import TransactionManager 

clr.AddReference("RevitAPI")
import Autodesk 
from Autodesk.Revit.DB import FilteredElementCollector, ViewSchedule, ScheduleSheetInstance

# Current doc/app/ui
doc = IN[0]
purge = IN[1]

# Get all schedule types/instances
schedTypes_all = FilteredElementCollector(doc).OfClass(ViewSchedule).ToElements()
schedInsts_all = FilteredElementCollector(doc).OfClass(ScheduleSheetInstance).ToElements()

# Function: Return if not key or revision schedule
def isRegularSchedule(schedType):
	if schedType.Definition.IsKeySchedule:
		return False
	elif "<Revision" in schedType.Name:
		return False
	else:
		return True

# Get all schedule types used by instances (placed)
schedTypeIds_used, schedTypes_unused = [],[]

for s in schedInsts_all:
	# Get schedule type of instance
	type_id   = s.ScheduleId
	schedType = doc.GetElement(s.ScheduleId)
	# If not in list and regular schedule, append to used
	if isRegularSchedule(schedType) and type_id not in schedTypeIds_used:
		schedTypeIds_used.append(type_id)

# For each schedule type...
for st in schedTypes_all:
	# If a regular schedule...
	if isRegularSchedule(st):
		# Get its Id
		type_id = st.Id
		if type_id not in schedTypeIds_used and not st.IsTemplate:
			schedTypes_unused.append(st)

ids_unused = [s.Id for s in schedTypes_unused]

# Preparing output to Dynamo
if purge:
	# Do some action in a Transaction
	outList = []
	TransactionManager.Instance.EnsureInTransaction(doc)
	for i,s in zip(ids_unused, schedTypes_unused):
		try:
			doc.Delete(i)
			outList.append(None)
		except:
			outList.append(s)
	TransactionManager.Instance.TransactionTaskDone()
	OUT = schedTypes_unused, ids_unused
else:
	OUT = schedTypes_unused, ids_unused
# ----------------------------------------
code_block = CodeBlock(x=python_script) { x[0]; x[1]; }
scheduleTypes = Output(code_block.out0)
ids = Output(code_block.out1)
