# Dynamo custom node AuditViewFilters.dyf "© Audit.ViewFilters" (Dynamo 2.12.1.8246)
# category: Crumple.Revit.Actions
# Returns all view filters in the document which are not in use by views or view templates. If you set the purge to true, it will attempt to delete them also.
# packages: Crumple 2022.5.27

docOrLink = Input(docOrLink: var[]..[] = null)  # Uses current if none provided. Accepts document or link instance.
revit_getdocument = Custom[© Revit.GetDocument](docOrLink=docOrLink)  # package Crumple; If no input is specified or an invalid one is, returns current document. If a link instance is provided, it returns the linked document. If a document is provided it will pass it through.
purge = Input(purge: bool = false)
python_script = Python(IN[0]=revit_getdocument.document, IN[1]=purge)  # IronPython2
# ---------- python_script.python (61 lines) ----------
# Made by Gavin Crump
# Free for use
# BIM Guru, www.bimguru.com.au

# Boilerplate text
import clr

clr.AddReference("RevitServices")
import RevitServices
from RevitServices.Transactions import TransactionManager 

clr.AddReference("RevitAPI")
import Autodesk 
from Autodesk.Revit.DB import FilteredElementCollector, View, FilterElement, ViewType

# Current doc/app/ui
doc = IN[0]
purge = IN[1]

# get all views and view types
views = FilteredElementCollector(doc).OfClass(View).ToElements()
filterIds_all = FilteredElementCollector(doc).OfClass(FilterElement).ToElementIds()

ignoreTypes = [ViewType.ProjectBrowser, ViewType.SystemBrowser, ViewType.Undefined]

# Get relevant templates and views
filterIds_used, filterIds_unused, filters_unused = [],[],[]

for v in views:
	if v.ViewType in ignoreTypes:
		pass
	else:
		# Get its filters
		try:
			view_filterIds = v.GetFilters()
			for f in view_filterIds:
				if f not in filterIds_used:
					filterIds_used.append(f)
		except:
			pass

for f in filterIds_all:
	if f not in filterIds_used:
		filterIds_unused.append(f)
		filters_unused.append(doc.GetElement(f).Name)

# Preparing output to Dynamo
if purge:
	# Do some action in a Transaction
	outList = []
	TransactionManager.Instance.EnsureInTransaction(doc)
	for i,f in zip(filterIds_unused,filters_unused):
		try:
			doc.Delete(i)
			outList.append(None)
		except:
			outList.append(f)
	TransactionManager.Instance.TransactionTaskDone()
	OUT = outList, filterIds_unused
else:
	OUT = filters_unused, filterIds_unused
# ----------------------------------------
code_block = CodeBlock(x=python_script) { x[0]; x[1]; }
viewFilters = Output(code_block.out0)
ids = Output(code_block.out1)
