# Dynamo custom node AuditViewTemplates.dyf "© Audit.ViewTemplates" (Dynamo 2.12.1.8246)
# category: Crumple.Revit.Actions
# Returns all view templates in the document which are not in use by views or view types. If you set the purge to true, it will attempt to delete them also.
# packages: Crumple 2022.5.27

docOrLink = Input(docOrLink: var[]..[] = null)  # Uses current if none provided. Accepts document or link instance.
revit_getdocument = Custom[© Revit.GetDocument](docOrLink=docOrLink)  # package Crumple; If no input is specified or an invalid one is, returns current document. If a link instance is provided, it returns the linked document. If a document is provided it will pass it through.
purge = Input(purge: bool = false)
python_script = Python(IN[0]=revit_getdocument.document, IN[1]=purge)  # IronPython2
# ---------- python_script.python (65 lines) ----------
# Made by Gavin Crump
# Free for use
# BIM Guru, www.bimguru.com.au

# Boilerplate text
import clr

clr.AddReference("RevitServices")
import RevitServices
from RevitServices.Transactions import TransactionManager 

clr.AddReference("RevitAPI")
import Autodesk 
from Autodesk.Revit.DB import FilteredElementCollector, View, ViewFamilyType, ViewType

# Current doc/app/ui
doc = IN[0]
purge = IN[1]

# get all views and view types
views = FilteredElementCollector(doc).OfClass(View).ToElements()
vfts  = FilteredElementCollector(doc).OfClass(ViewFamilyType).ToElements()

ignoreTypes = [ViewType.ProjectBrowser, ViewType.SystemBrowser, ViewType.Undefined]

# Get relevant templates and views
templates_used, templates_all, templates_unused, ids_unused = [],[],[],[]

for v in views:
	if v.IsTemplate:
		templates_all.append(v)
	elif v.ViewType in ignoreTypes:
		pass
	else:
		tid = v.ViewTemplateId.ToString()
		if tid not in templates_used and tid != -1:
			templates_used.append(tid)

# Get view type templates
for vft in vfts:
	tid = vft.DefaultTemplateId.ToString()
	if tid not in templates_used and tid != -1:
		templates_used.append(tid)

# Get unused templates
for vt in templates_all:
	if vt.Id.ToString() not in templates_used:
		templates_unused.append(vt)
		ids_unused.append(vt.Id)

# Preparing output to Dynamo
if purge:
	# Do some action in a Transaction
	outList = []
	TransactionManager.Instance.EnsureInTransaction(doc)
	for i,t in zip(ids_unused,templates_unused):
		try:
			doc.Delete(i)
			outList.append(None)
		except:
			outList.append(t)
	TransactionManager.Instance.TransactionTaskDone()
	OUT = outList, ids_unused
else:
	OUT = templates_unused, ids_unused
# ----------------------------------------
code_block = CodeBlock(x=python_script) { x[0]; x[1]; }
viewTemplates = Output(code_block.out0)
ids = Output(code_block.out1)
