# Dynamo custom node AuditViews.dyf "© Audit.Views" (Dynamo 2.12.1.8246)
# category: Crumple.Revit.Actions
# Returns all views in the document which are not placed on sheets or dependent upon views placed on sheets (callout, dependent views). If you set the purge to true, it will attempt to delete them also.
# packages: Crumple 2022.5.27

docOrLink = Input(docOrLink: var[]..[] = null)  # Uses current if none provided. Accepts document or link instance.
revit_getdocument = Custom[© Revit.GetDocument](docOrLink=docOrLink)  # package Crumple; If no input is specified or an invalid one is, returns current document. If a link instance is provided, it returns the linked document. If a document is provided it will pass it through.
purge = Input(purge: bool = false)
python_script = Python(IN[0]=revit_getdocument.document, IN[1]=purge)  # IronPython2
# ---------- python_script.python (134 lines) ----------
# Made by Gavin Crump
# Free for use
# BIM Guru, www.bimguru.com.au

# Boilerplate text
import clr

clr.AddReference("RevitServices")
import RevitServices
from RevitServices.Transactions import TransactionManager 
from RevitServices.Persistence import DocumentManager 

clr.AddReference("RevitAPI")
import Autodesk 
from Autodesk.Revit.DB import FilteredElementCollector, View, ViewType,\
Viewport, BuiltInParameter, ParameterUtils

# Current doc/app/ui
doc = IN[0]
purge = IN[1]

# Get revit version
uiapp = DocumentManager.Instance.CurrentUIApplication 
app = uiapp.Application 
REVIT_VER = int(app.VersionNumber)

# get all views in document
views_used, vp_views, views_unused = [],[],[]

views = FilteredElementCollector(doc).OfClass(View).ToElements()

types_views = [ViewType.FloorPlan,
               ViewType.CeilingPlan,
               ViewType.Elevation,
               ViewType.ThreeD,
               ViewType.DraftingView,
               ViewType.EngineeringPlan,
               ViewType.AreaPlan,
               ViewType.Section,
               ViewType.Detail,
               ViewType.Rendering]

views_valid = []

for v in views:
	if v.ViewType in types_views and not v.IsTemplate:
		views_valid.append(v)

# get all viewports and views in them
viewports_all = FilteredElementCollector(doc).OfClass(Viewport).WhereElementIsNotElementType().ToElements()

for vp in viewports_all:
    # Get viewport view
    vp_view = doc.GetElement(vp.ViewId)
    vp_views.append(vp_view)
    views_used.append(vp_view)

# Function: Get all callout views to any depth
BIP_PARENT = BuiltInParameter.SECTION_PARENT_VIEW_NAME

def getBip(element, bip):
    # RVT < 2022
    if REVIT_VER < 2022:
        return element.get_Parameter(bip)
    # RVT >= 2022
    else:
        id_forgeType = ParameterUtils.GetParameterTypeId(bip)
        return element.GetParameter(id_forgeType)

# Function: Exhaust view ancestry
def viewAncestry(view, myDoc = doc):
    # Set the base variables
    views_out       = []
    circuit_breaker = 0
    view_check   = view
    run_continue = True
    # While we keep going...
    while run_continue and circuit_breaker < 99:
        # Uptick the breaker
        circuit_breaker += 1
        # Try to get a parent view
        try:
            # Get the next view
            safe_bip   = getBip(view_check, BIP_PARENT)
            parent_id  = safe_bip.AsElementId()
            view_check = myDoc.GetElement(parent_id)
            # if a parent is found, append and then check it
            if view_check:
                views_out.append(view_check)
            # otherwise, stop
            else:
                run_continue = False
        # If it fails, stop
        except:
            run_continue = False
    # Return the views
    return views_out

# Exhaust viewport view ancestry
for v in vp_views:
    # Get primary view
    view_primary = doc.GetElement(v.GetPrimaryViewId())
    # If it exists, add it
    if view_primary:
        views_used.append(view_primary)
    # Add the dependent views
    views_used.extend(viewAncestry(v, doc))

# Get used view Ids
viewsIds_used = [v.Id for v in views_used]

# Assess unused views
for v in views_valid:
	# If view Id not used, append it
	if v.Id not in viewsIds_used:
		views_unused.append(v)

viewIds_unused = [v.Id for v in views_unused]

# Preparing output to Dynamo
if purge:
	# Do some action in a Transaction
	outList = []
	TransactionManager.Instance.EnsureInTransaction(doc)
	for i,v in zip(viewIds_unused, views_unused):
		try:
			doc.Delete(i)
			outList.append(None)
		except:
			outList.append(v)
	TransactionManager.Instance.TransactionTaskDone()
	OUT = outList, viewIds_unused
else:
	OUT = views_unused, viewIds_unused
# ----------------------------------------
code_block = CodeBlock(x=python_script) { x[0]; x[1]; }
views = Output(code_block.out0)
ids = Output(code_block.out1)
