# Dynamo custom node BIMGuru.dyf "© About.BIMGuru" (Dynamo 2.3.0.5885)
# category: Crumple.Query
# Opens the BIM Guru website. Here you can access custom content built by the package author, as well as consult his services.

runMe = Input(runMe: bool = false)
python_script = Python(IN[0]=runMe)
# ---------- python_script.python (13 lines) ----------
# Made by Gavin Crump
# Free for use
# BIM Guru, www.bimguru.com.au

# Boilerplate text
import os

# Open URL
if IN[0]:
	os.system("start \"\" https://www.bimguru.com.au")
	OUT = "Enjoy!"
else:
	OUT = "Set runMe to True!"
# ----------------------------------------
Output = Output(python_script)  # "=)"
