# Dynamo custom node BoundingBoxFrame.dyf "© BoundingBox.Frame" (Dynamo 2.16.2.5624)
# category: Crumple.Geometry.Query
# Given a bounding box, returns the frame curves around it.

boundingBox = Input(boundingBox: var[]..[])
code_block = CodeBlock(boundingBox=boundingBox)
# ---------- code_block.designscript (3 lines) ----------
cuboid = Autodesk.DesignScript.Geometry.BoundingBox.ToCuboid(boundingBox);
edges = Autodesk.Topology.Edges(cuboid);
Autodesk.Edge.CurveGeometry(edges);
# ----------------------------------------
curves = Output(code_block.out2)
