# Dynamo custom node BoundingBoxProperties.dyf "© BoundingBox.Properties" (Dynamo 2.12.1.8246)
# category: Crumple.Geometry.Query
# Returns the width, depth, height and centroid of provided bounding boxes.

boundingBox = Input(boundingBox: var[]..[])
code_block = CodeBlock(bb=boundingBox)
# ---------- code_block.designscript (8 lines) ----------
bbMax = Autodesk.DesignScript.BoundingBox.MaxPoint(bb);
bbMin = Autodesk.DesignScript.BoundingBox.MinPoint(bb);

bbMax.X - bbMin.X;
bbMax.Y - bbMin.Y;
bbMax.Z - bbMin.Z;

Point.ByCoordinates((bbMin.X + bbMax.X)/2, (bbMin.Y + bbMax.Y)/2, (bbMin.Z + bbMax.Z)/2);
# ----------------------------------------
width = Output(code_block.out2)
depth = Output(code_block.out3)
height = Output(code_block.out4)
centroid = Output(code_block.out5)
