# Dynamo custom node BoundingBoxUnion.dyf "© BoundingBox.Union" (Dynamo 2.3.0.5885)
# category: Crumple.Geometry.Create
# Given a list of bounding boxes, form the overall bounding box of those boxes.

boundingBoxes = Input(boundingBoxes: var[]..[])
code_block = CodeBlock(bbs=boundingBoxes)
# ---------- code_block.designscript (10 lines) ----------
//Get the min and max points for each bb
min = Autodesk.BoundingBox.MinPoint(bbs);
max = Autodesk.BoundingBox.MaxPoint(bbs);

//Find the min and max values, build points from them
min_bb = Autodesk.Point.ByCoordinates(DSCore.List.MinimumItem(min.X),DSCore.List.MinimumItem(min.Y),DSCore.List.MinimumItem(min.Z));
max_bb = Autodesk.Point.ByCoordinates(DSCore.List.MaximumItem(max.X),DSCore.List.MaximumItem(max.Y),DSCore.List.MaximumItem(max.Z));

//Make a new bb by the min/max results
Autodesk.BoundingBox.ByCorners(min_bb, max_bb);
# ----------------------------------------
unionBox = Output(code_block.out4)
