# Dynamo custom node BoundingFrame.dyf "© BoundingFrame" (Dynamo 2.3.0.5885)
# category: Crumple.Geometry.Abstract.BoundingBox
# Given a bounding box, returns the frame curves around it.

boundingBox = Input(boundingBox: var[]..[])
code_block = CodeBlock(boundingBox=boundingBox)
# ---------- code_block.designscript (3 lines) ----------
cuboid = Autodesk.DesignScript.Geometry.BoundingBox.ToCuboid(boundingBox);
edges = Autodesk.Topology.Edges(cuboid);
Autodesk.Edge.CurveGeometry(edges);
# ----------------------------------------
frameCurves = Output(code_block.out2)
