# Dynamo custom node BuiltInParameterGroups.dyf "© BIPGs" (Dynamo 2.3.0.5885)
# category: Crumple.Revit.BuiltInParameterGroups
# Returns all BuiltIn Parameter Groups by group and type.

Refresh = Input(Refresh: bool = true)  # Toggle to refresh
python_script = Python(IN[0]=Refresh)
# ---------- python_script.python (17 lines) ----------
# Made by Gavin Crump
# Free for use
# BIM Guru, www.bimguru.com.au

# Boilerplate text
import clr
import System

clr.AddReference("RevitAPI")
import Autodesk 
from Autodesk.Revit.DB import *

# Enumerate over all BIPG types
pgnms = [(a, a.ToString()) for a in System.Enum.GetValues(BuiltInParameterGroup)]

# Preparing output to Dynamo
OUT = zip(*pgnms)
# ----------------------------------------
code_block = CodeBlock(lst=python_script) { pg = lst[0]; nm = lst[1]; }
groups = Output(code_block.pg)  # The parameter groups.
names = Output(code_block.nm)  # The parameter group names.
