# Dynamo custom node CADLinks.dyf "© CADLinks" (Dynamo 2.3.0.5885)
# category: Crumple.Revit.LinkedFiles
# Return all CAD linked instances as well as their types and owner views.

Refresh = Input(Refresh: bool = true)
python_script = Python(IN[0]=Refresh)
# ---------- python_script.python (38 lines) ----------
# Made by Gavin Crump
# Free for use
# BIM Guru, www.bimguru.com.au

# Boilerplate text
import clr

clr.AddReference("RevitServices")
import RevitServices
from RevitServices.Persistence import DocumentManager

clr.AddReference("RevitNodes")
import Revit
clr.ImportExtensions(Revit.Elements)

clr.AddReference("RevitAPI")
import Autodesk
from Autodesk.Revit.DB import *

doc = DocumentManager.Instance.CurrentDBDocument

# Collect all imports
col = FilteredElementCollector(doc).OfClass(ImportInstance).ToElements()

# Get instance properties
cadLnk, cadLnkType, cadLnkView = [], [], []

for i in col:
	try:
		if i.IsLinked == True:
			cadLnk.append(i)
			cadLnkType.append(i.Document.GetElement(i.GetTypeId()))
			cadLnkView.append(doc.GetElement(i.OwnerViewId))
	except:
		pass

# Preparing output to Dynamo
OUT = [cadLnk, cadLnkType, cadLnkView]
# ----------------------------------------
code_block = CodeBlock(out=python_script) { out[0]; out[1]; out[2]; }
instance = Output(code_block.out0)
type = Output(code_block.out1)
ownerView = Output(code_block.out2)
