# Dynamo custom node CeilingsByCurveloops.dyf "© CeilingsByCurveloops" (Dynamo 2.10.1.3976)
# category: Crumple.Revit.Ceilings
# A new method unique to Revit 2022 that enables ceilings via the sketch API to support internal loops. Will not work in previous versions, and works best when the curves are in the form of list of lists of curves in continuous order.

curvelists = Input(curvelists: var[]..[])  # List of list of curves. The curves must be in a continuous/closed order.
ceilingtypes = Input(ceilingtypes: var[]..[])  # List of types to be applied each set of curves as a ceilings. Note that if you provide a shorter list of types than the curve lists it will behave as longest lacing.
levels = Input(levels: var[]..[])  # Levels for the elements to be created at.
variable_size_lists = Python(IN[0]=curvelists, IN[1]=ceilingtypes, IN[2]=levels)  # CPython3
# ---------- variable_size_lists.python (65 lines) ----------
# Made by Gavin Crump
# Free for use
# BIM Guru, www.bimguru.com.au

# Boilerplate text
import clr

clr.AddReference("RevitNodes")
import Revit
clr.ImportExtensions(Revit.Elements)
clr.ImportExtensions(Revit.GeometryConversion)

clr.AddReference("RevitServices")
import RevitServices
from RevitServices.Persistence import DocumentManager
from RevitServices.Transactions import TransactionManager

clr.AddReference("RevitAPI")
import Autodesk
from Autodesk.Revit.DB import *

# Current doc/app/ui
doc = DocumentManager.Instance.CurrentDBDocument

# Define list/unwrap list functions
def uwlist(input):
	result = input if isinstance(input, list) else [input]
	return UnwrapElement(result)

def listpad(lst,count):
	padded = []
	length = len(lst)
	for i in range(0,count):
		if i < length:
			padded.append(lst[i])
		else:
			padded.append(lst[-1])
	return padded

# Preparing input from dynamo to revit
roomset = IN[0]
maxlst = len(roomset)

types  = listpad(uwlist(IN[1]),maxlst)
levels = listpad(uwlist(IN[2]),maxlst)

ceilings = []

TransactionManager.Instance.EnsureInTransaction(doc)

for rm,f,l in zip(roomset,types,levels):
	curveloops = []
	for crv_setd in rm:
		crv_setr = []
		for crv_d in crv_setd:
			crv_setr.append(crv_d.ToRevitType())
		curveloop = CurveLoop.Create(crv_setr)
		curveloops.append(curveloop)
	clg = Ceiling.Create(doc, curveloops, f.Id, l.Id)
	ceilings.append(clg)

TransactionManager.Instance.TransactionTaskDone()

# Preparing output to Dynamo
OUT = ceilings
# ----------------------------------------
code_block = CodeBlock { "Height Offset From Level"; }
offset = Input(offset: var[]..[] = [2700])  # Height offset.
setParameterByName = Element.SetParameterByName(element=variable_size_lists, parameterName=code_block, value=offset, lacing=Longest)
ceilings = Output(setParameterByName)
