# Dynamo custom node CipherFrom.dyf "© String.CipherFrom" (Dynamo 2.3.0.5885)
# category: Crumple.Data.Actions
# Converts numbers (or numbers as strings) from 'CipherTo' or from an alternative means back to lower case strings, including spaces.

data = Input(data: var[]..[] = tTypedIdent0)  # Converts numerical indices back into their respective alpha characters. Cipher: 00 = " " (Space) 01 = a/A 02 = b/B 03 = c/C etc... 26 = z/Z
toNumber = String.ToNumber(str=data)
code_block = CodeBlock(data=toNumber) { low = "a".."z"..1; lower = DSCore.List.Insert(low, " ", 0); DSCore.List.GetItemAtIndex(lower, data); }
strings = Output(code_block.out2)  # Decoded strings
