# Dynamo custom node CollectCadImports.dyf "© Collect.CADImports" (Dynamo 2.12.1.8246)
# category: Crumple.Revit.Query
# Returns all CAD import instances as well as their type and view.
# packages: Crumple 2022.2.13

docOrLink = Input(docOrLink: var[]..[] = null)  # Uses current if none provided. Accepts document or link instance.
revit_getdocument = Custom[© Revit.GetDocument](docOrLink=docOrLink)  # package Crumple; If no input is specified or an invalid one is, returns current document. If a link instance is provided, it returns the linked document. If a document is provided it will pass it through.
python_script = Python(IN[0]=revit_getdocument.document)  # IronPython2
# ---------- python_script.python (34 lines) ----------
# Made by Gavin Crump
# Free for use
# BIM Guru, www.bimguru.com.au

# Boilerplate text
import clr

clr.AddReference("RevitNodes")
import Revit
clr.ImportExtensions(Revit.Elements)

clr.AddReference("RevitAPI")
import Autodesk
from Autodesk.Revit.DB import FilteredElementCollector, ImportInstance

doc = IN[0]

# Collect all imports
col = FilteredElementCollector(doc).OfClass(ImportInstance).ToElements()

# Get instance properties
cadImp, cadImpType, cadImpView = [], [], []

for i in col:
	try:
		if i.IsLinked != True:
			cadImp.append(i)
			cadImpType.append(i.Document.GetElement(i.GetTypeId()))
			cadImpView.append(doc.GetElement(i.OwnerViewId))
	except:
		pass

# Preparing output to Dynamo
OUT = [cadImp, cadImpType, cadImpView]
# ----------------------------------------
code_block = CodeBlock(out=python_script) { out[0]; out[1]; out[2]; }
instance = Output(code_block.out0)
type = Output(code_block.out1)
ownerView = Output(code_block.out2)
