# Dynamo custom node CollectDesignOptionsBySet.dyf "© Collect.DesignOptionsBySet" (Dynamo 2.12.1.8246)
# category: Crumple.Revit.Query
# Returns all design options broken down by primary and secondary, as well as their related option set.
# packages: Crumple 2022.2.13

docOrLink = Input(docOrLink: var[]..[] = null)  # Uses current if none provided. Accepts document or link instance.
collect_designoptions = Custom[© Collect.DesignOptions](docOrLink=docOrLink)  # package Crumple; Returns all design options in a document.
designoptions_optionset = Custom[© DesignOptions.OptionSet](designOption=collect_designoptions)  # package Crumple; For a given design option, return its related set.
groupByKey = List.GroupByKey(list=collect_designoptions, keys=designoptions_optionset)
code_block = CodeBlock(t1=groupByKey.groups) { DSCore.List.FirstItem(t1@L2<1>); DSCore.List.RestOfItems(t1@L2<1>); }
primaryOptions = Output(code_block.out0)
secondaryOptions = Output(code_block.out1)
optionSets = Output(groupByKey.uniqueKeys)
