# Dynamo custom node CollectDimensionTypes.dyf "© Collect.DimensionTypes" (Dynamo 2.12.1.8246)
# category: Crumple.Revit.Query
# Returns all dimension and spot dimension types (aka styles) in a document.
# packages: Crumple 2022.2.13

docOrLink = Input(docOrLink: var[]..[] = null)  # Uses current if none provided. Accepts document or link instance.
revit_getdocument = Custom[© Revit.GetDocument](docOrLink=docOrLink)  # package Crumple; If no input is specified or an invalid one is, returns current document. If a link instance is provided, it returns the linked document. If a document is provided it will pass it through.
python_script = Python(IN[0]=revit_getdocument.document)  # IronPython2
# ---------- python_script.python (31 lines) ----------
# Made by Gavin Crump
# Free for use
# BIM Guru, www.bimguru.com.au

# Boilerplate text
import clr

clr.AddReference("RevitServices")
import RevitServices
from RevitServices.Persistence import DocumentManager
doc = IN[0]

clr.AddReference("RevitAPI")
import Autodesk
from Autodesk.Revit.DB import FilteredElementCollector, DimensionType, SpotDimensionType

#Dimension types
dTypes = FilteredElementCollector(doc).OfClass(DimensionType).ToElements()
sTypes = FilteredElementCollector(doc).OfClass(SpotDimensionType).ToElements()

dNames,sNames = [],[]

#Get names
for i in dTypes:
	dNames.append(i.FamilyName)
	
for i in sTypes:
	sNames.append(i.FamilyName)

#Set output
OUT = [dTypes, dNames, sTypes, sNames]
# ----------------------------------------
code_block = CodeBlock(out=python_script) { out[0]; out[1]; out[2]; out[3]; }
dimTypes = Output(code_block.out0)
dimNames = Output(code_block.out1)
spotTypes = Output(code_block.out2)
spotNames = Output(code_block.out3)
