# Dynamo custom node CollectElementTypes.dyf "🐍 Collect.ElementTypes" (Dynamo 2.12.1.8246)
# category: Crumple.IronPython.Query
# Returns all element types and their names in the active document.

refresh = Input(refresh: bool = true)
python_script = Python(IN[0]=refresh)  # IronPython2
# ---------- python_script.python (17 lines) ----------
# Boilerplate text
import clr

import System.Reflection
import System.AppDomain

clr.AddReference('RevitNodes')
import Revit
clr.ImportExtensions(Revit.Elements)

rAssembly = [x for x in System.AppDomain.CurrentDomain.GetAssemblies() if x.GetName().Name == 'RevitAPI'][0]
rElement = [x for x in rAssembly.GetTypes() if x.Name == 'Element' and x.Namespace == 'Autodesk.Revit.DB'][0]

etypes = [x for x in rAssembly.GetTypes() if x.IsClass and x.IsSubclassOf(rElement)]
enames = [t.Name for t in etypes]

OUT = [etypes, enames]
# ----------------------------------------
code_block = CodeBlock(out=python_script) { out[0]; out[1]; }
sortByKey = List.SortByKey(list=code_block.out0, keys=code_block.out1)
elementTypes = Output(sortByKey.sortedList)
typeNames = Output(sortByKey.sortedKeys)
