# Dynamo custom node CollectFamilies.dyf "© Collect.Families" (Dynamo 2.12.1.8246)
# category: Crumple.Revit.Query
# Returns all families in the document. Families are sorted into user created, inplace and internal.
# packages: Crumple 2024.3.1

docOrLink = Input(docOrLink: var[]..[] = null)  # Uses current if none provided. Accepts document or link instance.
revit_getdocument = Custom[© Revit.GetDocument](docOrLink=docOrLink)  # package Crumple; If no input is specified or an invalid one is, returns current document. If a link instance is provided, it returns the linked document. If a document is provided it will pass it through.
python_script = Python(IN[0]=revit_getdocument.document)  # IronPython2
# ---------- python_script.python (30 lines) ----------
# Made by Gavin Crump
# Free for use
# BIM Guru, www.bimguru.com.au

# Boilerplate text
import clr

clr.AddReference("RevitAPI")
import Autodesk 
from Autodesk.Revit.DB import FilteredElementCollector, Family

# Current doc/app/ui
doc = IN[0]

# Collect all sheets
fams = FilteredElementCollector(doc).OfClass(Family).WhereElementIsNotElementType().ToElements()

# Build output
userCreated, inPlace, internal = [],[],[]

for f in fams:
	if f.IsInPlace:
		inPlace.append(f)
	elif f.IsUserCreated:
		userCreated.append(f)
	else:
		internal.append(f)

# Preparing output to Dynamo
OUT = userCreated, inPlace, internal
# ----------------------------------------
code_block = CodeBlock(out=python_script) { f_u = out[0]; f_p = out[1]; f_i = out[2]; }
userCreated = Output(code_block.f_u)
inPlace = Output(code_block.f_p)
internal = Output(code_block.f_i)
