# Dynamo custom node CollectFillPatterns.dyf "© Collect.FillPatterns" (Dynamo 2.12.1.8246)
# category: Crumple.Revit.Query
# Returns all fill patterns in a document.
# packages: Crumple 2022.2.13

docOrLink = Input(docOrLink: var[]..[] = null)  # Uses current if none provided. Accepts document or link instance.
revit_getdocument = Custom[© Revit.GetDocument](docOrLink=docOrLink)  # package Crumple; If no input is specified or an invalid one is, returns current document. If a link instance is provided, it returns the linked document. If a document is provided it will pass it through.
python_script = Python(IN[0]=revit_getdocument.document)  # IronPython2
# ---------- python_script.python (29 lines) ----------
# Made by Gavin Crump
# Free for use
# BIM Guru, www.bimguru.com.au

# Boilerplate text
import clr

clr.AddReference('RevitAPI')
import Autodesk
from Autodesk.Revit.DB import FilteredElementCollector, FillPatternElement, FillPatternTarget

clr.AddReference("RevitServices")
import RevitServices
from RevitServices.Persistence import DocumentManager

# Current document
doc = IN[0]

# Get all patterns
patterns_all = FilteredElementCollector(doc).OfClass(FillPatternElement).ToElements()
names_all    = [p.Name for p in patterns_all]

PAT_DRAFTING = FillPatternTarget.Drafting

def isDrafting(p):
	fpt = p.GetFillPattern()
	return fpt.Target == FillPatternTarget.Drafting

OUT = patterns_all, names_all, [isDrafting(p) for p in patterns_all]
# ----------------------------------------
code_block = CodeBlock(out=python_script) { ele = out[0]; nam = out[1]; drf = out[2]; }
patternElements = Output(code_block.ele)  # The patterns as elements
names = Output(code_block.nam)  # The names of the patterns
isDrafting = Output(code_block.drf)  # Are the patterns drafting?
