# Dynamo custom node CollectGroupTypeIds.dyf "© Collect.GroupTypeIds" (Dynamo 2.12.1.8246)
# category: Crumple.Revit.Query
# Returns all group type Id objects and their names.

refresh = Input(refresh: bool = true)
python_script = Python(IN[0]=refresh)  # IronPython2
# ---------- python_script.python (21 lines) ----------
# Made by Gavin Crump
# Free for use
# BIM Guru, www.bimguru.com.au

# Boilerplate text
import clr

clr.AddReference("RevitServices")
import RevitServices
from RevitServices.Persistence import DocumentManager 

clr.AddReference("RevitAPI")
import Autodesk 
from Autodesk.Revit.DB import ParameterUtils, LabelUtils

# Get grouptypeIds and names
group_ids = ParameterUtils.GetAllBuiltInGroups()
group_names = [LabelUtils.GetLabelForGroup(g) for g in group_ids]

# Return output
OUT = [group_ids, group_names]
# ----------------------------------------
code_block = CodeBlock(x=python_script) { x[0]; x[1]; }
groupTypeIds = Output(code_block.out0)
names = Output(code_block.out1)
