# Dynamo custom node CollectImages.dyf "© Collect.Images" (Dynamo 2.12.1.8246)
# category: Crumple.Revit.Query
# Returns all image instances in a document as well as their names, types and owner views.
# packages: Crumple 2022.2.13

docOrLink = Input(docOrLink: var[]..[] = null)  # Uses current if none provided. Accepts document or link instance.
revit_getdocument = Custom[© Revit.GetDocument](docOrLink=docOrLink)  # package Crumple; If no input is specified or an invalid one is, returns current document. If a link instance is provided, it returns the linked document. If a document is provided it will pass it through.
python_script = Python(IN[0]=revit_getdocument.document)  # IronPython2
# ---------- python_script.python (30 lines) ----------
# Made by Gavin Crump
# Free for use
# BIM Guru, www.bimguru.com.au

# Boilerplate text
import clr

clr.AddReference("RevitAPI")
import Autodesk
from Autodesk.Revit.DB import FilteredElementCollector, BuiltInCategory

doc = IN[0]

# Collect all images
images = FilteredElementCollector(doc).OfCategory(BuiltInCategory.OST_RasterImages).ToElements()

# Get instance properties
imageEle, imageName, imageView, imageId = [], [], [], []

for i in images:
	try:
		imageName.append(i.Name)
		imageView.append(doc.GetElement(i.OwnerViewId))
		imageId.append(i.Document.GetElement(i.GetTypeId()))
		imageEle.append(i)
	except:
		pass

# Preparing output to Dynamo
OUT = [imageEle, imageName, imageView , imageId]
# ----------------------------------------
code_block = CodeBlock(out=python_script) { out[0]; out[1]; out[2]; out[3]; }
instance = Output(code_block.out0)
fileName = Output(code_block.out1)
type = Output(code_block.out3)
ownerView = Output(code_block.out2)
