# Dynamo custom node CollectKeynotes.dyf "© Collect.Keynotes" (Dynamo 2.12.1.8246)
# category: Crumple.Revit.Query
# Returns all keynotes connected to the document, including their descriptions and first parent keynote. You can choose to exclude any parent keynotes from the outputs.
# packages: Crumple 2022.5.27

excludeParents = Input(excludeParents: bool = True)
docOrLink = Input(docOrLink: var[]..[] = null)  # Uses current if none provided. Accepts document or link instance.
revit_getdocument = Custom[© Revit.GetDocument](docOrLink=docOrLink)  # package Crumple; If no input is specified or an invalid one is, returns current document. If a link instance is provided, it returns the linked document. If a document is provided it will pass it through.
python_script = Python(IN[0]=excludeParents, IN[1]=revit_getdocument.document)  # IronPython2
# ---------- python_script.python (53 lines) ----------
# Made by Gavin Crump
# Free for use
# BIM Guru, www.bimguru.com.au

# Boilerplate text
import clr

clr.AddReference("RevitAPI")
import Autodesk 
from Autodesk.Revit.DB import KeynoteTable

# Current doc/app/ui
doc = IN[1]
uniqueOnly = IN[0]

try:
	keynoteTable = KeynoteTable.GetKeynoteTable(doc)
except:
	keynoteTable = None

# Lists to build
keyValues   = []
keyParents  = []
keyDescs    = []
baseKeys    = []
baseDescs   = []
baseParents = []

# If we found a keynote table
if keynoteTable:
	# Get the iterator
	keynoteEntry = keynoteTable.GetKeyBasedTreeEntries()
	keynoteEnum  = keynoteEntry.GetKeyBasedTreeEntriesIterator()
	counter = 0
	# Get the keys from keynote file
	while keynoteEnum.MoveNext() and counter < 9999:
		tbe = keynoteEnum.Current
		keyValues.append(tbe.Key)
		keyParents.append(tbe.ParentKey)
		keyDescs.append(tbe.KeynoteText)
		counter += 1
	# Get the unique keys only
	for k,d,p in zip(keyValues, keyDescs, keyParents):
		if k not in keyParents:
			baseKeys.append(k)
			baseDescs.append(d)
			baseParents.append(p)

# Preparing output to Dynamo
if uniqueOnly:
	OUT = baseKeys, baseDescs, baseParents
else:
	OUT = keyValues, keyDescs, keyParents
# ----------------------------------------
code_block = CodeBlock(x=python_script) { x[0]; x[1]; x[2]; }
keyValues = Output(code_block.out0)
keynoteText = Output(code_block.out1)
keyParents = Output(code_block.out2)
