# Dynamo custom node CollectLegendTypes.dyf "© Collect.LegendTypes" (Dynamo 2.12.1.8246)
# category: Crumple.Revit.Query
# Returns all legend types in a document.
# packages: Crumple 2022.2.13

docOrLink = Input(docOrLink: var[]..[] = null)  # Uses current if none provided. Accepts document or link instance.
revit_getdocument = Custom[© Revit.GetDocument](docOrLink=docOrLink)  # package Crumple; If no input is specified or an invalid one is, returns current document. If a link instance is provided, it returns the linked document. If a document is provided it will pass it through.
python_script = Python(IN[0]=revit_getdocument.document)  # IronPython2
# ---------- python_script.python (30 lines) ----------
# Made by Gavin Crump
# Free for use
# BIM Guru, www.bimguru.com.au

# Boilerplate text
import clr

# Import RevitAPI
clr.AddReference("RevitAPI")
import Autodesk
from Autodesk.Revit.DB import FilteredElementCollector, View, ViewType

# Get the project document.
doc = IN[0]

# Get all views
views_doc = FilteredElementCollector(doc).OfClass(View).ToElements()

VIEWTYPE_LEGEND = ViewType.Legend

# Create empty lists
legends= []

# Find views that aren't legends, then non-template
for view in views_doc:
	if view.ViewType == VIEWTYPE_LEGEND:
		legends.append(view)

# Output cleaned view lists
OUT = legends
# ----------------------------------------
legendTypes = Output(python_script)  # All legends in the current document.
