# Dynamo custom node CollectLinePatterns.dyf "© Collect.LinePatterns" (Dynamo 2.12.1.8246)
# category: Crumple.Revit.Query
# Returns all line patterns in a document.
# packages: Crumple 2022.2.13

docOrLink = Input(docOrLink: var[]..[] = null)  # Uses current if none provided. Accepts document or link instance.
revit_getdocument = Custom[© Revit.GetDocument](docOrLink=docOrLink)  # package Crumple; If no input is specified or an invalid one is, returns current document. If a link instance is provided, it returns the linked document. If a document is provided it will pass it through.
python_script = Python(IN[0]=revit_getdocument.document)  # IronPython2
# ---------- python_script.python (18 lines) ----------
# Made by Gavin Crump
# Free for use
# BIM Guru, www.bimguru.com.au

# Boilerplate text
import clr

clr.AddReference('RevitAPI')
import Autodesk
from Autodesk.Revit.DB import FilteredElementCollector, LinePatternElement

# Current document
doc = IN[0]

allLinePatterns = FilteredElementCollector(doc).OfClass(LinePatternElement).ToElements()
names = [p.Name for p in allLinePatterns]

OUT = allLinePatterns, names
# ----------------------------------------
code_block = CodeBlock(out=python_script) { ele = out[0]; nam = out[1]; }
elements = Output(code_block.ele)  # The patterns as elements
names = Output(code_block.nam)  # The names of the patterns
