# Dynamo custom node CollectLineStyles.dyf "© Collect.LineStyles" (Dynamo 2.16.2.5624)
# category: Crumple.Revit.Query
# Returns all the line styles in a document as well as their graphic styles, names, ids and whether a user made them.
# packages: Crumple 2022.2.13

docOrLink = Input(docOrLink: var[]..[] = null)  # Uses current if none provided. Accepts document or link instance.
revit_getdocument = Custom[© Revit.GetDocument](docOrLink=docOrLink)  # package Crumple; If no input is specified or an invalid one is, returns current document. If a link instance is provided, it returns the linked document. If a document is provided it will pass it through.
python_script = Python(IN[0]=revit_getdocument.document)  # CPython3
# ---------- python_script.python (64 lines) ----------
# Made by Gavin Crump
# Free for use
# BIM Guru, www.bimguru.com.au

# Credit
# Large in part borrows ideas from Genius Loci (Alban de Chasteigner)
# twitter : @geniusloci_bim

# Boilerplate text
import clr

clr.AddReference("RevitNodes")
import Revit
clr.ImportExtensions(Revit.Elements)

clr.AddReference("RevitAPI")
import Autodesk 
from Autodesk.Revit.DB import FilteredElementCollector, BuiltInCategory, GraphicsStyleType

clr.AddReference("RevitServices")
import RevitServices
from RevitServices.Persistence import DocumentManager 

# Current doc/app/ui
doc = IN[0]

# Get app version
uiapp = DocumentManager.Instance.CurrentUIApplication 
app = uiapp.Application
rvt_year = int(app.VersionNumber)

# Collect the BIC
collector = FilteredElementCollector(doc).OfCategory(BuiltInCategory.OST_Lines).ToElements()

# Isolate BIC from collection
bic = collector[0].Category
subcats = bic.SubCategories

# Collect subcategory data
elements, styles, ids, names, user = [],[],[],[],[]

for subcat in subcats:
	if rvt_year > 2024:
		subcatidasint = subcat.Id.Value
	else:
		subcatidasint = subcat.Id.IntegerValue
	ids.append(subcatidasint)
	
	if subcatidasint > 0:
		user.append(True)
	else:
		user.append(False)
	
	subcatele = Revit.Elements.Category.ById(subcatidasint)
	elements.append(subcatele)
	
	style = subcat.GetGraphicsStyle(GraphicsStyleType.Projection)
	styles.append(style)
	
	subcatname = style.Name
	names.append(subcatname)

# Outputs for Dynamo
OUT = elements, styles, ids, names, user
# ----------------------------------------
code_block = CodeBlock(out=python_script) { ele = out[0]; gfx = out[1]; sid = out[2]; nam = out[3]; use = out[4]; }
lineStyles = Output(code_block.ele)  # The line styles as elements
graphicStyles = Output(code_block.gfx)  # The related graphic styles
lineStyleIds = Output(code_block.sid)  # The ids of the line styles
styleNames = Output(code_block.nam)  # The names of the graphic styles
userMade = Output(code_block.use)  # Is the style user made?
