# Dynamo custom node CollectLines.dyf "© Collect.Lines" (Dynamo 2.12.1.8246)
# category: Crumple.Revit.Query
# Returns all lines in a document, with the option to exclude or include detail/model lines in the output. By default will return all of them.
# packages: Crumple 2022.2.13

includeDetail = Input(includeDetail: bool = true)
includeModel = Input(includeModel: bool = true)
docOrLink = Input(docOrLink: var[]..[] = null)  # Uses current if none provided. Accepts document or link instance.
revit_getdocument = Custom[© Revit.GetDocument](docOrLink=docOrLink)  # package Crumple; If no input is specified or an invalid one is, returns current document. If a link instance is provided, it returns the linked document. If a document is provided it will pass it through.
python_script = Python(IN[0]=includeDetail, IN[1]=includeModel, IN[2]=revit_getdocument.document)  # IronPython2
# ---------- python_script.python (37 lines) ----------
# Made by Gavin Crump
# Free for use
# BIM Guru, www.bimguru.com.au

# Boilerplate text
import clr

clr.AddReference("RevitNodes")
import Revit
clr.ImportExtensions(Revit.Elements)

clr.AddReference("RevitAPI")
import Autodesk 
from Autodesk.Revit.DB import FilteredElementCollector, BuiltInCategory

# Current doc/app/ui
detail = IN[0]
model  = IN[1]
doc    = IN[2]

# Collect all lines in project and build output lists
allLines = FilteredElementCollector(doc).OfCategory(BuiltInCategory.OST_Lines).ToElements()

curvesOut, isDetail = [], []

for i in allLines:
	if i.Name == "Detail Lines":
		if detail:
			curvesOut.append(i.ToDSType(True))
			isDetail.append(True)
	else:
		if model:
			curvesOut.append(i.ToDSType(True))
			isDetail.append(False)

# Preparing output to Dynamo
OUT = curvesOut, isDetail
# ----------------------------------------
code_block = CodeBlock(out=python_script) { curves = out[0]; isDetail = out[1]; }
lines = Output(code_block.curves)
isDetail = Output(code_block.isDetail)
