# Dynamo custom node CollectMaterials.dyf "© Collect.Materials" (Dynamo 2.12.1.8246)
# category: Crumple.Revit.Query
# Returns all materials in the given document.
# packages: Crumple 2022.2.13

docOrLink = Input(docOrLink: var[]..[] = null)  # Uses current if none provided. Accepts document or link instance.
revit_getdocument = Custom[© Revit.GetDocument](docOrLink=docOrLink)  # package Crumple; If no input is specified or an invalid one is, returns current document. If a link instance is provided, it returns the linked document. If a document is provided it will pass it through.
python_script = Python(IN[0]=revit_getdocument.document)  # IronPython2
# ---------- python_script.python (20 lines) ----------
# Made by Gavin Crump
# Free for use
# BIM Guru, www.bimguru.com.au

# Boilerplate text
import clr

clr.AddReference('RevitAPI')
import Autodesk
from Autodesk.Revit.DB import FilteredElementCollector, Material

# Current document
doc = IN[0]

# Get materials in document
mats = FilteredElementCollector(doc).OfClass(Material).ToElements()
nams = [m.Name for m in mats]

# Outputs
OUT = [mats,nams]
# ----------------------------------------
code_block = CodeBlock(x=python_script) { x[0]; x[1]; }
materials = Output(code_block.out0)
names = Output(code_block.out1)
