# Dynamo custom node CollectPhases.dyf "© Collect.Phases" (Dynamo 2.3.1.11775)
# category: Crumple.Revit.Query
# Returns all phases in a document.
# packages: Crumple 2022.2.13

docOrLink = Input(docOrLink: var[]..[] = null)  # Uses current if none provided. Accepts document or link instance.
revit_getdocument = Custom[© Revit.GetDocument](docOrLink=docOrLink)  # package Crumple; If no input is specified or an invalid one is, returns current document. If a link instance is provided, it returns the linked document. If a document is provided it will pass it through.
python_script = Python(IN[0]=revit_getdocument.document)
# ---------- python_script.python (32 lines) ----------
# Made by Gavin Crump
# Free for use
# BIM Guru, www.bimguru.com.au

# Boilerplate text
import clr

clr.AddReference("RevitNodes")
import Revit
clr.ImportExtensions(Revit.Elements)
clr.ImportExtensions(Revit.GeometryConversion)

clr.AddReference("RevitServices")
import RevitServices
from RevitServices.Persistence import DocumentManager 

clr.AddReference("RevitAPI")
import Autodesk 
from Autodesk.Revit.DB import *

# Current doc/app/ui
doc = IN[0]

# Do some action in a Transaction
phaselist, namelist = [],[]

for phase in doc.Phases:
	phaselist.append(phase.ToDSType(True))
	namelist.append(phase.Name)
	
# Preparing output to Dynamo
OUT = [phaselist, namelist]
# ----------------------------------------
code_block = CodeBlock(x=python_script) { x[0]; x[1]; }
phases = Output(code_block.out0)
names = Output(code_block.out1)
