# Dynamo custom node CollectRegions.dyf "© Collect.Regions" (Dynamo 2.12.1.8246)
# category: Crumple.Revit.Query
# Returns all filled and/or masking regions in a document.
# packages: Crumple 2022.2.13

includeFilled = Input(includeFilled: bool = true)
includeMasking = Input(includeMasking: bool = true)
docOrLink = Input(docOrLink: var[]..[] = null)  # Uses current if none provided. Accepts document or link instance.
revit_getdocument = Custom[© Revit.GetDocument](docOrLink=docOrLink)  # package Crumple; If no input is specified or an invalid one is, returns current document. If a link instance is provided, it returns the linked document. If a document is provided it will pass it through.
python_script = Python(IN[0]=includeFilled, IN[1]=includeMasking, IN[2]=revit_getdocument.document)  # IronPython2
# ---------- python_script.python (35 lines) ----------
# Made by Gavin Crump
# Free for use
# BIM Guru, www.bimguru.com.au

# Boilerplate text
import clr

clr.AddReference("RevitNodes")
import Revit
clr.ImportExtensions(Revit.Elements)

clr.AddReference("RevitAPI")
import Autodesk 
from Autodesk.Revit.DB import FilteredElementCollector, FilledRegion

# Current doc/app/ui
doc = IN[2]

# Collect and construct list of regions
collector = FilteredElementCollector(doc).OfClass(FilledRegion)

filled, masking, type, regionout = IN[0], IN[1], [], []

for i in collector:
	if i.Name == "Masking Region":
		if masking:
			regionout.append(i.ToDSType(True))
			type.append(False)
	else:
		if filled:
			regionout.append(i.ToDSType(True))
			type.append(True)

# Preparing output to Dynamo
OUT = [regionout, type]
# ----------------------------------------
code_block = CodeBlock(out=python_script) { regions = out[0]; types = out[1]; }
regions = Output(code_block.regions)
isFilledRegion = Output(code_block.types)
