# Dynamo custom node CollectRevisions.dyf "© Collect.Revisions" (Dynamo 2.12.1.8246)
# category: Crumple.Revit.Query
# Returns all revisions in a document.
# packages: Crumple 2022.2.13

sortBySequence = Input(sortBySequence: bool = true)
docOrLink = Input(docOrLink: var[]..[] = null)  # Uses current if none provided. Accepts document or link instance.
revit_getdocument = Custom[© Revit.GetDocument](docOrLink=docOrLink)  # package Crumple; If no input is specified or an invalid one is, returns current document. If a link instance is provided, it returns the linked document. If a document is provided it will pass it through.
python_script = Python(IN[0]=sortBySequence, IN[1]=revit_getdocument.document)  # IronPython2
# ---------- python_script.python (24 lines) ----------
# Made by Gavin Crump
# Free for use
# BIM Guru, www.bimguru.com.au

# Boilerplate text
import clr

clr.AddReference("RevitAPI")
import Autodesk 
from Autodesk.Revit.DB import FilteredElementCollector, BuiltInCategory

# Current doc/app/ui
doc = IN[1]
getSorted = IN[0]

# Collect revisions
revisions = FilteredElementCollector(doc).OfCategory(BuiltInCategory.OST_Revisions).WhereElementIsNotElementType().ToElements()

# Preparing output to Dynamo
if getSorted:
	revSorted = sorted(revisions, key = lambda r: r.SequenceNumber)
	OUT = revSorted
else:
	OUT = revisions
# ----------------------------------------
revisions = Output(python_script)
