# Dynamo custom node CollectRevitLinks.dyf "© Collect.RevitLinks" (Dynamo 2.3.1.11775)
# category: Crumple.Revit.Query
# Returns all Revit link types in the current document, as well as all instance elements of those types.
# packages: Crumple 2022.2.13

docOrLink = Input(docOrLink: var[]..[] = null)  # Uses current if none provided. Accepts document or link instance.
revit_getdocument = Custom[© Revit.GetDocument](docOrLink=docOrLink)  # package Crumple; If no input is specified or an invalid one is, returns current document. If a link instance is provided, it returns the linked document. If a document is provided it will pass it through.
python_script = Python(IN[0]=revit_getdocument.document)  # graph output
# ---------- python_script.python (28 lines) ----------
import clr

# Import DocumentManager and TransactionManager
clr.AddReference("RevitServices")
import RevitServices
from RevitServices.Persistence import DocumentManager

# Import RevitAPI
clr.AddReference("RevitAPI")
import Autodesk
from Autodesk.Revit.DB import *

doc = DocumentManager.Instance.CurrentDBDocument

# Import ToDSType(bool) extension method
clr.AddReference("RevitNodes")
import Revit
clr.ImportExtensions(Revit.Elements)

coll = FilteredElementCollector(doc).OfCategory(BuiltInCategory.OST_RvtLinks).WhereElementIsNotElementType().ToElements()

insts, types = [], []

for c in coll:
	insts.append(c.ToDSType(True))
	types.append(doc.GetElement(c.GetTypeId()))

OUT = [insts,types]
# ----------------------------------------
code_block = CodeBlock(data=python_script) { inst = data[0]; type = data[1]; }
groupByKey = List.GroupByKey(list=code_block.inst, keys=code_block.type)
linkTypes = Output(groupByKey.unique_keys)
linkInstances = Output(groupByKey.groups)
