# Dynamo custom node CollectRooms.dyf "© Collect.Rooms" (Dynamo 2.12.1.8246)
# category: Crumple.Revit.Query
# Collects all valid/invalid rooms as two lists. Invalid rooms are not placed, or have issues that make their area invalid (not enclosed, redundant etc.).
# packages: Crumple 2022.2.13

docOrLink = Input(docOrLink: var[]..[] = null)  # Uses current if none provided. Accepts document or link instance.
revit_getdocument = Custom[© Revit.GetDocument](docOrLink=docOrLink)  # package Crumple; If no input is specified or an invalid one is, returns current document. If a link instance is provided, it returns the linked document. If a document is provided it will pass it through.
python_script = Python(IN[0]=revit_getdocument.document)  # IronPython2
# ---------- python_script.python (28 lines) ----------
# Made by Gavin Crump
# Free for use
# BIM Guru, www.bimguru.com.au

# Boilerplate text
import clr

clr.AddReference("RevitAPI")
import Autodesk 
from Autodesk.Revit.DB import FilteredElementCollector, BuiltInCategory

# Current doc/app/ui
doc = IN[0]

# Filtered element collector (all rooms)
rooms = FilteredElementCollector(doc).OfCategory(BuiltInCategory.OST_Rooms).ToElements()

# Filter rooms to those with area more than 0
placed, unplaced = [], []

for rm in rooms:
	if rm.Area > 0:
		placed.append(rm)
	else:
		unplaced.append(rm)

# Preparing output to Dynamo
OUT = [placed, unplaced]
# ----------------------------------------
code_block = CodeBlock(lst=python_script) { placed   = lst[0]; unplaced = lst[1]; }
valid = Output(code_block.placed)  # "valid: Rooms"; All rooms validly placed in the model
invalid = Output(code_block.unplaced)  # "invalid: Rooms"; All unplaced or unbound rooms
