# Dynamo custom node CollectScheduleInstances.dyf "© Collect.ScheduleInstances" (Dynamo 2.12.1.8246)
# category: Crumple.Revit.Query
# Returns all schedule sheet instances as well as their types. Optional exclusions for each schedule type (schedule, key, revision).
# packages: Crumple 2022.2.13

includeStandard = Input(includeStandard: bool = true)
includeKey = Input(includeKey: bool = false)
includeRevision = Input(includeRevision: bool = false)
docOrLink = Input(docOrLink: var[]..[] = null)  # Uses current if none provided. Accepts document or link instance.
revit_getdocument = Custom[© Revit.GetDocument](docOrLink=docOrLink)  # package Crumple; If no input is specified or an invalid one is, returns current document. If a link instance is provided, it returns the linked document. If a document is provided it will pass it through.
python_script = Python(IN[0]=includeStandard, IN[1]=includeKey, IN[2]=includeRevision, IN[3]=revit_getdocument.document)  # IronPython2
# ---------- python_script.python (39 lines) ----------
# Made by Gavin Crump
# Free for use
# BIM Guru, www.bimguru.com.au

# Boilerplate text
import clr

clr.AddReference('RevitAPI')
from Autodesk.Revit.DB import FilteredElementCollector, ScheduleSheetInstance

# Current doc/app/ui
doc = IN[3]

# Preparing input from dynamo to revit
incstd, inckey, increv = IN[0],IN[1],IN[2]

schedules, revschedules, keyschedules = [],[],[]

coll = FilteredElementCollector(doc).OfClass(ScheduleSheetInstance).ToElements()

schedInsts, schedTypes, schedNames = [],[],[]

for s in coll:
	schedType = doc.GetElement(s.ScheduleId)
	if schedType.Definition.IsKeySchedule and inckey:
		schedTypes.append(schedType)
		schedInsts.append(s)
		schedNames.append("Key Schedule")
	elif "<Revision Schedule>" in schedType.Name and increv:
		schedTypes.append(schedType)
		schedInsts.append(s)
		schedNames.append("Revision Schedule")
	elif incstd and not schedType.Definition.IsKeySchedule and not "<Revision Schedule>" in schedType.Name:
		schedTypes.append(schedType)
		schedInsts.append(s)
		schedNames.append("Schedule")

# Preparing output to Dynamo
OUT = schedInsts, schedTypes, schedNames
# ----------------------------------------
code_block = CodeBlock(x=python_script) { x[0]; x[1]; x[2]; }
schedInstances = Output(code_block.out0)
schedTypes = Output(code_block.out1)
schedTypeNames = Output(code_block.out2)
