# Dynamo custom node CollectScheduleTypes.dyf "© Collect.ScheduleTypes" (Dynamo 2.12.1.8246)
# category: Crumple.Revit.Query
# Returns all standard schedule types in a document, excluding key and revision schedules.
# packages: Crumple 2022.2.13

docOrLink = Input(docOrLink: var[]..[] = null)  # Uses current if none provided. Accepts document or link instance.
revit_getdocument = Custom[© Revit.GetDocument](docOrLink=docOrLink)  # package Crumple; If no input is specified or an invalid one is, returns current document. If a link instance is provided, it returns the linked document. If a document is provided it will pass it through.
python_script = Python(IN[0]=revit_getdocument.document)  # CPython3
# ---------- python_script.python (29 lines) ----------
# Made by Gavin Crump
# Free for use
# BIM Guru, www.bimguru.com.au

# Boilerplate text
import clr

clr.AddReference('RevitAPI')
from Autodesk.Revit.DB import *

# Current doc/app/ui
doc = IN[0]

# Preparing input from dynamo to revit
schedules = []

coll = FilteredElementCollector(doc).OfClass(ViewSchedule).ToElements()

# Filter the schedules
for s in coll:
	if s.Definition.IsKeySchedule:
		pass
	elif "<Revision Schedule>" in s.Name:
		pass
	else:
		schedules.append(s)

# Preparing output to Dynamo
OUT = schedules
# ----------------------------------------
scheduleTypes = Output(python_script)
