# Dynamo custom node CollectSchedulesByType.dyf "© Collect.SchedulesByType" (Dynamo 2.12.1.8246)
# category: Crumple.Revit.Query
# Returns all schedules in a document, separated into key and non-key schedules.
# packages: Crumple 2022.2.13

docOrLink = Input(docOrLink: var[]..[] = null)  # Uses current if none provided. Accepts document or link instance.
revit_getdocument = Custom[© Revit.GetDocument](docOrLink=docOrLink)  # package Crumple; If no input is specified or an invalid one is, returns current document. If a link instance is provided, it returns the linked document. If a document is provided it will pass it through.
python_script = Python(IN[0]=revit_getdocument.document)  # CPython3
# ---------- python_script.python (29 lines) ----------
# Made by Gavin Crump
# Free for use
# BIM Guru, www.bimguru.com.au

# Boilerplate text
import clr

clr.AddReference('RevitAPI')
from Autodesk.Revit.DB import *

# Current doc/app/ui
doc = IN[0]

# Preparing input from dynamo to revit
schedules, revschedules, keyschedules = [],[],[]

coll = FilteredElementCollector(doc).OfClass(ViewSchedule).ToElements()

# Filter the schedules
for s in coll:
	if s.Definition.IsKeySchedule:
		keyschedules.append(s)
	elif "<Revision Schedule>" in s.Name:
		revschedules.append(s)
	else:
		schedules.append(s)

# Preparing output to Dynamo
OUT = [schedules, keyschedules, revschedules]
# ----------------------------------------
code_block = CodeBlock(out=python_script) { scheds = out[0]; keyscs = out[1]; revscs = out[2]; }
schedules = Output(code_block.scheds)
keySchedules = Output(code_block.keyscs)
revSchedules = Output(code_block.revscs)
