# Dynamo custom node CollectSheets.dyf "© Collect.Sheets" (Dynamo 2.12.1.8246)
# category: Crumple.Revit.Query
# Returns all the sheets in a document, with the option to omit any placeholder sheets.
# packages: Crumple 2022.2.13

includePlaceholders = Input(includePlaceholders: bool = false)
docOrLink = Input(docOrLink: var[]..[] = null)  # Uses current if none provided. Accepts document or link instance.
revit_getdocument = Custom[© Revit.GetDocument](docOrLink=docOrLink)  # package Crumple; If no input is specified or an invalid one is, returns current document. If a link instance is provided, it returns the linked document. If a document is provided it will pass it through.
python_script = Python(IN[0]=includePlaceholders, IN[1]=revit_getdocument.document)  # IronPython2
# ---------- python_script.python (27 lines) ----------
# Made by Gavin Crump
# Free for use
# BIM Guru, www.bimguru.com.au

# Boilerplate text
import clr

clr.AddReference("RevitAPI")
import Autodesk 
from Autodesk.Revit.DB import FilteredElementCollector, BuiltInCategory

# Inputs from Dynamo
doc     = IN[1]
include = IN[0]

# Collect all sheets
sheets = FilteredElementCollector(doc).OfCategory(BuiltInCategory.OST_Sheets).WhereElementIsNotElementType().ToElements()

# Preparing output to Dynamo
if include:
	OUT = sheets
else:
	sheetsOut = []
	for s in sheets:
		if not(s.IsPlaceholder):
			sheetsOut.append(s)
	OUT = sheetsOut
# ----------------------------------------
sheets = Output(python_script)
