# Dynamo custom node CollectSpaceSchedules.dyf "© Collect.SpaceSchedules" (Dynamo 2.12.1.8246)
# category: Crumple.Revit.Query
# Gets all occupancy, power and lighting schedules currently applied to any Space Types in a document. Also returns their name and Id.
# packages: Crumple 2022.2.13

docOrLink = Input(docOrLink: var[]..[] = null)  # Uses current if none provided. Accepts document or link instance.
revit_getdocument = Custom[© Revit.GetDocument](docOrLink=docOrLink)  # package Crumple; If no input is specified or an invalid one is, returns current document. If a link instance is provided, it returns the linked document. If a document is provided it will pass it through.
python_script = Python(IN[0]=revit_getdocument.document)  # IronPython2
# ---------- python_script.python (44 lines) ----------
# Made by Gavin Crump
# Free for use
# BIM Guru, www.bimguru.com.au

# Boilerplate text
import clr

clr.AddReference("RevitNodes")
import Revit
clr.ImportExtensions(Revit.Elements)
clr.ImportExtensions(Revit.GeometryConversion)

clr.AddReference("RevitAPI")
from Autodesk.Revit.DB import FilteredElementCollector
from Autodesk.Revit.DB.Analysis import HVACLoadSpaceType

# Current doc/app/ui
doc = IN[0]

# Collect all Space types
spaces = FilteredElementCollector(doc).OfClass(HVACLoadSpaceType).ToElements()

def getScheduleId(s, par):
	return s.LookupParameter(par).AsElementId()

def returnElements(eIds):
	return [doc.GetElement(i) for i in eIds]

# Get unique Ids for schedule types
occIds, ligIds, powIds = [],[],[]

for s in spaces:
	occId = getScheduleId(s, "Occupancy Schedule")
	ligId = getScheduleId(s, "Lighting Schedule")
	powId = getScheduleId(s, "Power Schedule")
	if occId not in occIds:
		occIds.append(occId)
	if ligId not in ligIds:
		ligIds.append(ligId)
	if powId not in powIds:
		powIds.append(powId)
	
# Outputs
OUT = returnElements(occIds), returnElements(ligIds), returnElements(powIds)
# ----------------------------------------
code_block = CodeBlock(lst=python_script) { os = lst[0]; ls = lst[1]; ps = lst[2]; }
occupancy = Output(code_block.os)  # Schedule as an element.
lighting = Output(code_block.ls)  # Schedule as an element.
power = Output(code_block.ps)  # Schedule as an element.
