# Dynamo custom node CollectSpaceTypes.dyf "© Collect.SpaceTypes" (Dynamo 2.3.1.11775)
# category: Crumple.Revit.Query
# Collects all space types as well as their names from a document.
# packages: Crumple 2022.2.13

docOrLink = Input(docOrLink: var[]..[] = null)  # Uses current if none provided. Accepts document or link instance.
revit_getdocument = Custom[© Revit.GetDocument](docOrLink=docOrLink)  # package Crumple; If no input is specified or an invalid one is, returns current document. If a link instance is provided, it returns the linked document. If a document is provided it will pass it through.
python_script = Python(IN[0]=revit_getdocument.document)
# ---------- python_script.python (35 lines) ----------
# Made by Gavin Crump
# Free for use
# BIM Guru, www.bimguru.com.au

# Boilerplate text
import clr

clr.AddReference("RevitNodes")
import Revit
clr.ImportExtensions(Revit.Elements)
clr.ImportExtensions(Revit.GeometryConversion)

clr.AddReference("RevitAPI")
from Autodesk.Revit.DB import *
from Autodesk.Revit.DB.Analysis import *

# Current doc/app/ui
doc = IN[0]

# Collect all Space types
spaces = FilteredElementCollector(doc).OfClass(HVACLoadSpaceType).ToElements()

# Prepare empty lists
ids = []

# Find space type Id and convert to element
for s in spaces:
	uw = UnwrapElement(s)
	id_uwr = uw.Id
	id_str = id_uwr.ToString()
	id_int = int(id_str)
	ids.append(id_int)
	
# Outputs
OUT = [spaces, ids]
# ----------------------------------------
code_block = CodeBlock(lst=python_script) { styp = lst[0]; stid = lst[1]; }
space_types = Output(code_block.styp)  # Space types as elements.
name = Element.Name(element=code_block.styp)
type_names = Output(name)  # Type names as strings.
type_ids = Output(code_block.stid)  # Space types ids as integers.
