# Dynamo custom node CollectViewFamilyTypes.dyf "© Collect.ViewFamilyTypes" (Dynamo 2.16.2.5624)
# category: Crumple.Revit.Query
# Returns all view family type objects and names.
# packages: Crumple 2024.4.3

docOrLink = Input(docOrLink: var[]..[] = null)  # Uses current if none provided. Accepts document or link instance.
revit_getdocument = Custom[© Revit.GetDocument](docOrLink=docOrLink)  # package Crumple; If no input is specified or an invalid one is, returns current document. If a link instance is provided, it returns the linked document. If a document is provided it will pass it through.
python_script = Python(IN[0]=revit_getdocument.document)  # CPython3
# ---------- python_script.python (36 lines) ----------
# Made by Gavin Crump
# Free for use
# BIM Guru, www.bimguru.com.au

# Boilerplate text
import clr
import System

clr.AddReference("RevitAPI")
import Autodesk 
from Autodesk.Revit.DB import FilteredElementCollector, ViewFamilyType, BuiltInParameter, ViewFamily

# Current doc/app/ui
doc = IN[0]

# Get enum name
def enumGetName(enum, enumClass):
    return System.Enum.GetName(enumClass,enum)

vfts = FilteredElementCollector(doc).OfClass(ViewFamilyType).ToElements()

types, names = [],[]

for v in vfts:
    vf = v.ViewFamily
    vfn = enumGetName(vf, ViewFamily)
    if vfn not in names:
        names.append(vfn)
        types.append(vf)

# Get enum name
def enumGetName(enum, enumClass):
    return System.Enum.GetName(enumClass,enum)

# Preparing output to Dynamo
OUT = types, names
# ----------------------------------------
code_block = CodeBlock(lst=python_script) { pg = lst[0]; nm = lst[1]; }
sortByKey = List.SortByKey(list=code_block.pg, keys=code_block.nm)
viewFamilyTypes = Output(sortByKey.sortedList)  # The types.
names = Output(sortByKey.sortedKeys)  # The names.
