# Dynamo custom node CollectViewTemplates.dyf "© Collect.ViewTemplates" (Dynamo 2.16.2.5624)
# category: Crumple.Revit.Query
# Returns all view templates in a document. Due to API/Dynamo limitations, 3D view templates are excluded from the list.
# packages: Crumple 2026.7.1

include3dTemplates = Input(include3dTemplates: bool = false)  # 3D Templates return nulls in Dynamo
docOrLink = Input(docOrLink: var[]..[] = null)  # Uses current if none provided. Accepts document or link instance.
revit_getdocument = Custom[© Revit.GetDocument](docOrLink=docOrLink)  # package Crumple; If no input is specified or an invalid one is, returns current document. If a link instance is provided, it returns the linked document. If a document is provided it will pass it through.
python_script = Python(IN[0]=include3dTemplates, IN[1]=revit_getdocument.document)  # CPython3
# ---------- python_script.python (33 lines) ----------
# Made by Gavin Crump
# Free for use
# BIM Guru, www.bimguru.com.au

# Boilerplate text
import clr

clr.AddReference("RevitAPI")
import Autodesk 
from Autodesk.Revit.DB import FilteredElementCollector, View, ViewType

# Current doc/app/ui
doc = IN[1]
incThreed = IN[0]

# Get view templates
views_all = FilteredElementCollector(doc).OfClass(View).ToElements()

VIEWTYPE_3D = ViewType.ThreeD

viewTemplates, ids = [],[]

for v in views_all:
	if v.IsTemplate:
		if v.ViewType != VIEWTYPE_3D:
			viewTemplates.append(v)
			ids.append(v.Id)
		elif incThreed:
			viewTemplates.append(None)
			ids.append(v.Id)

# Preparing output to Dynamo
OUT = viewTemplates, ids
# ----------------------------------------
code_block = CodeBlock(x=python_script) { x[0]; x[1]; }
viewTemplates = Output(code_block.out0)
elementIds = Output(code_block.out1)
