# Dynamo custom node CollectViewportTypes.dyf "© Collect.ViewportTypes" (Dynamo 2.16.2.5624)
# category: Crumple.Revit.Query
# Returns all viewport types and their names in the provided document.
# packages: Crumple 2022.5.27

docOrLink = Input(docOrLink: var[]..[] = null)  # Uses current if none provided. Accepts document or link instance.
revit_getdocument = Custom[© Revit.GetDocument](docOrLink=docOrLink)  # package Crumple; If no input is specified or an invalid one is, returns current document. If a link instance is provided, it returns the linked document. If a document is provided it will pass it through.
python_script = Python(IN[0]=revit_getdocument.document)  # CPython3
# ---------- python_script.python (38 lines) ----------
# Made by Gavin Crump
# Free for use
# BIM Guru, www.bimguru.com.au

# Boilerplate text
import clr

clr.AddReference("RevitAPI")
import Autodesk 
from Autodesk.Revit.DB import BuiltInParameter, ParameterFilterRuleFactory, ElementId, ElementParameterFilter, FilteredElementCollector, Element

clr.AddReference("RevitServices")
import RevitServices
from RevitServices.Persistence import DocumentManager

# Get app version
uiapp = DocumentManager.Instance.CurrentUIApplication 
app = uiapp.Application
rvt_year = int(app.VersionNumber)

# Current doc/app/ui
doc = IN[0]

# Get all viewport types
BIP_FAMILYNAME = BuiltInParameter.SYMBOL_FAMILY_NAME_PARAM

if rvt_year > 2025:
    col_rule  = ParameterFilterRuleFactory.CreateEqualsRule(ElementId(BIP_FAMILYNAME), "Viewport")
else:
    col_rule  = ParameterFilterRuleFactory.CreateEqualsRule(ElementId(BIP_FAMILYNAME), "Viewport", False)


col_filt  = ElementParameterFilter(col_rule)

viewportTypes_all = FilteredElementCollector(doc).WhereElementIsElementType().WherePasses(col_filt).ToElements()

# Preparing output to Dynamo
OUT = viewportTypes_all
# ----------------------------------------
viewportTypes = Output(python_script)
name = Element.Name(element=python_script)
names = Output(name)
