# Dynamo custom node CollectViews.dyf "© Collect.Views" (Dynamo 2.12.1.8246)
# category: Crumple.Revit.Query
# Returns all views in a document. Excludes system views, templates, legends and schedule instances.
# packages: Crumple 2022.2.13

docOrLink = Input(docOrLink: var[]..[] = null)  # Uses current if none provided. Accepts document or link instance.
revit_getdocument = Custom[© Revit.GetDocument](docOrLink=docOrLink)  # package Crumple; If no input is specified or an invalid one is, returns current document. If a link instance is provided, it returns the linked document. If a document is provided it will pass it through.
python_script = Python(IN[0]=revit_getdocument.document)  # IronPython2
# ---------- python_script.python (34 lines) ----------
# Made by Gavin Crump
# Free for use
# BIM Guru, www.bimguru.com.au

# Boilerplate text
import clr

# Import RevitAPI
clr.AddReference("RevitAPI")
import Autodesk
from Autodesk.Revit.DB import FilteredElementCollector, View, ViewType

# Get the project document.
doc = IN[0]

# Get all views
Views_doc = FilteredElementCollector(doc).OfClass(View).ToElements()

# Create empty lists
View_list = []

ignoreTypes = [ViewType.Legend, ViewType.Schedule, ViewType.DrawingSheet, ViewType.ProjectBrowser, ViewType.SystemBrowser, ViewType.Undefined]

# Find views that aren't legends, then non-template
for v in Views_doc:
	if v.ViewType in ignoreTypes:
		pass
	elif v.IsTemplate:
		pass
	else:
		View_list.append(v)

# Output cleaned view lists
OUT = View_list
# ----------------------------------------
views = Output(python_script)  # All views in the current document.
