# Dynamo custom node ColourDesaturate.dyf "© Colour.Desaturate" (Dynamo 2.3.0.5885)
# category: Crumple.Data.Actions
# Converts RGB colours to their average aggregate brightness (R+G+B / 3) and retains their alpha value.

colour = Input(colour: DSCore.Color = tTypedIdent0)  # Colours to desaturate. Grey = (R+G+B)/3.
code_block = CodeBlock(colour=colour)
# ---------- code_block.designscript (6 lines) ----------
a = Color.Alpha(colour);
r = Color.Red(colour);
g = Color.Blue(colour);
b = Color.Green(colour);
d = (r+g+b)/3;
DSCore.Color.ByARGB(a,d,d,d);
# ----------------------------------------
colour_2 = Output(code_block.out5)  # "colour"; Desaturated colours.
