# Dynamo custom node ColourOverrideAlpha.dyf "© Colour.OverrideAlpha" (Dynamo 2.12.1.8246)
# category: Crumple.Data.Actions
# Overrides the alpha value (transparency) of all colours fed into the node. The transparency value should be between 0 and 255.

alpha = Input(alpha: int = 255)  # Alpha override value. Should be between 0 and 255. 255 = Fully Opaque 0 = Fully transparent
colour = Input(colour: var[]..[])  # Colours to override
code_block = CodeBlock(v=alpha, colour=colour)
# ---------- code_block.designscript (10 lines) ----------
// Alpha override
a = v>255 || v<0 ? 255 : v;

// Get RGB values
r = Color.Red(colour);
g = Color.Blue(colour);
b = Color.Green(colour);

// Get new colours
DSCore.Color.ByARGB(a,r,g,b);
# ----------------------------------------
colour_2 = Output(code_block.out4)  # "colour"; Overriden colours
