# Dynamo custom node CoordinatesGetLinkTransform.dyf "© Coordinates.GetLinkTransform" (Dynamo 2.12.1.8246)
# category: Crumple.Revit.Query
# Given a Revit link instance, returns the coordinate system for transformation of location.

linkInstance = Input(linkInstance: var[]..[])
python_script = Python(IN[0]=linkInstance)  # IronPython2
# ---------- python_script.python (31 lines) ----------
# Made by Gavin Crump
# Free for use
# BIM Guru, www.bimguru.com.au

# Boilerplate text
import clr

clr.AddReference("RevitAPI")
from Autodesk.Revit.DB import RevitLinkInstance

clr.AddReference("RevitNodes")
import Revit
clr.ImportExtensions(Revit.GeometryConversion)

# Define list/unwrap list functions
def uwlist(input):
	result = input if isinstance(input, list) else [input]
	return UnwrapElement(result)

def objOrList(input, initial = IN[0]):
	if isinstance(initial, list):
		return input
	else:
		return input[0]

# Get link transform
links  = uwlist(IN[0])
xForms = [l.GetTotalTransform().ToCoordinateSystem(True) for l in links]

# Preparing output to Dynamo
OUT = objOrList(xForms)
# ----------------------------------------
coordinateSystem = Output(python_script)
