# Dynamo custom node CoordinatesOrigin.dyf "© Coordinates.Origin" (Dynamo 2.12.1.8246)
# category: Crumple.Revit.Query
# This node will return the Revit project origin as well as the NS, EW and elevation values.
# packages: Crumple 2022.2.13

docOrLink = Input(docOrLink: var[]..[] = null)  # Uses current if none provided. Accepts document or link instance.
revit_getdocument = Custom[© Revit.GetDocument](docOrLink=docOrLink)  # package Crumple; If no input is specified or an invalid one is, returns current document. If a link instance is provided, it returns the linked document. If a document is provided it will pass it through.
python_script = Python(IN[0]=revit_getdocument.document)  # IronPython2
# ---------- python_script.python (54 lines) ----------
# Made by Gavin Crump
# Free for use
# BIM Guru, www.bimguru.com.au

# Boilerplate text
import clr

clr.AddReference("RevitNodes")
import Revit
clr.ImportExtensions(Revit.Elements)
clr.ImportExtensions(Revit.GeometryConversion)

# Revit services and API
clr.AddReference("RevitServices")
import RevitServices
from RevitServices.Persistence import DocumentManager 

clr.AddReference("RevitAPI")
import Autodesk 
from Autodesk.Revit.DB import XYZ

# Current doc/app/ui
doc = IN[0]

# Get app version
uiapp = DocumentManager.Instance.CurrentUIApplication 
app = uiapp.Application
rvt_year = int(app.VersionNumber)

if rvt_year < 2022:
	from Autodesk.Revit.DB import UnitUtils, UnitType, DisplayUnitType
else:
	from Autodesk.Revit.DB import UnitUtils, SpecTypeId

# Function: Convert to project from internal
def interalToProject(val, ver = rvt_year, myDoc = doc):
	if rvt_year < 2022:
		intUnits = doc.GetUnits().GetFormatOptions(UnitType.UT_Length).DisplayUnits
		return UnitUtils.Convert(val,DisplayUnitType.DUT_DECIMAL_FEET,intUnits)
	else:
		intUnitsId = doc.GetUnits().GetFormatOptions(SpecTypeId.Length).GetUnitTypeId()
		return UnitUtils.ConvertFromInternalUnits(val, intUnitsId)

# Get project position
ori = doc.ActiveProjectLocation.GetProjectPosition(XYZ(0,0,0))

# Get EW, NS, Elev
ori_pt = XYZ(0,0,0).ToPoint()
ori_ns = interalToProject(ori.NorthSouth)
ori_ew = interalToProject(ori.EastWest)
ori_el = interalToProject(ori.Elevation)

# Preparing output to Dynamo
OUT = [ori_pt, ori_ns, ori_ew, ori_el]
# ----------------------------------------
code_block = CodeBlock(x=python_script) { x[0]; x[1]; x[2]; x[3]; }
point = Output(code_block.out0)  # The point of the base point.
northSouth = Output(code_block.out1)  # The Northing value of the internal origin returned in Revit coordinates.
eastWest = Output(code_block.out2)  # The Easting value of the internal origin returned in Revit coordinates.
elevation = Output(code_block.out3)  # The elevation value of the internal origin returned in Revit coordinates.
