# Dynamo custom node CoordinatesSp.dyf "© Coordinates.SP" (Dynamo 2.12.1.8246)
# category: Crumple.Revit.Query
# This node will return the Revit survey point as well as the NS, EW and elevation values.
# packages: Crumple 2022.2.13

docOrLink = Input(docOrLink: var[]..[] = null)  # Uses current if none provided. Accepts document or link instance.
revit_getdocument = Custom[© Revit.GetDocument](docOrLink=docOrLink)  # package Crumple; If no input is specified or an invalid one is, returns current document. If a link instance is provided, it returns the linked document. If a document is provided it will pass it through.
python_script = Python(IN[0]=revit_getdocument.document)  # IronPython2
# ---------- python_script.python (56 lines) ----------
# Made by Gavin Crump
# Free for use
# BIM Guru, www.bimguru.com.au
# Credit to Genius Loci for much of the workflow

# Boilerplate text
import clr
import math

# Revit nodes
clr.AddReference("RevitNodes")
import Revit
clr.ImportExtensions(Revit.Elements)
clr.ImportExtensions(Revit.GeometryConversion)

# Revit services and API
clr.AddReference("RevitServices")
import RevitServices
from RevitServices.Persistence import DocumentManager 

clr.AddReference("RevitAPI")
import Autodesk 
from Autodesk.Revit.DB import BasePoint, BuiltInParameter

# Current doc/app/ui
doc = IN[0]

# Get app version
uiapp = DocumentManager.Instance.CurrentUIApplication 
app = uiapp.Application
rvt_year = int(app.VersionNumber)

if rvt_year < 2022:
	from Autodesk.Revit.DB import UnitUtils, UnitType, DisplayUnitType
else:
	from Autodesk.Revit.DB import UnitUtils, SpecTypeId

def interalToProject(val, ver = rvt_year, myDoc = doc):
	if rvt_year < 2022:
		intUnits = doc.GetUnits().GetFormatOptions(UnitType.UT_Length).DisplayUnits
		return UnitUtils.Convert(val,DisplayUnitType.DUT_DECIMAL_FEET,intUnits)
	else:
		intUnitsId = doc.GetUnits().GetFormatOptions(SpecTypeId.Length).GetUnitTypeId()
		return UnitUtils.ConvertFromInternalUnits(val, intUnitsId)

# Get survey point
svp = BasePoint.GetSurveyPoint(doc)

# Get svp values
svp_pt = svp.Position.ToPoint()
svp_ew = interalToProject(svp.get_Parameter(BuiltInParameter.BASEPOINT_EASTWEST_PARAM).AsDouble())
svp_ns = interalToProject(svp.get_Parameter(BuiltInParameter.BASEPOINT_NORTHSOUTH_PARAM).AsDouble())
svp_el = interalToProject(svp.get_Parameter(BuiltInParameter.BASEPOINT_ELEVATION_PARAM).AsDouble())

# Preparing output to Dynamo
OUT = svp_pt, svp_ns, svp_ew, svp_el
# ----------------------------------------
code_block = CodeBlock(x=python_script) { x[0]; x[1]; x[2]; x[3]; }
point = Output(code_block.out0)  # The point of the base point.
northSouth = Output(code_block.out1)  # The Northing value of the survey point returned in Revit coordinates.
eastWest = Output(code_block.out2)  # The Easting value of the survey point returned in Revit coordinates.
elevation = Output(code_block.out3)  # The Elevation value of the survey point returned in Revit coordinates.
