# Dynamo custom node CoordinatesTranslatePoints.dyf "© Coordinates.TranslatePoints" (Dynamo 2.12.1.8246)
# category: Crumple.Revit.Actions
# This node translates points in Dynamo coordinates to their respective Revit project coordinate.

code_block = CodeBlock { xy = Plane.XY(); Plane.ToCoordinateSystem(xy); Autodesk.Point.Origin(); Vector.ZAxis(); }
python_script = Python()  # IronPython2
# ---------- python_script.python (50 lines) ----------
# Made by Gavin Crump
# Free for use
# BIM Guru, www.bimguru.com.au

# Boilerplate text
import clr
import math

clr.AddReference("RevitNodes")
import Revit
clr.ImportExtensions(Revit.Elements)
clr.ImportExtensions(Revit.GeometryConversion)

# Revit services and API
clr.AddReference("RevitServices")
import RevitServices
from RevitServices.Persistence import DocumentManager 

clr.AddReference("RevitAPI")
import Autodesk 
from Autodesk.Revit.DB import *

# Current doc/app/ui
doc = DocumentManager.Instance.CurrentDBDocument

# Get app version
uiapp = DocumentManager.Instance.CurrentUIApplication 
app = uiapp.Application
rvt_year = int(app.VersionNumber)

def interalToProject(val, ver = rvt_year, myDoc = doc):
	if rvt_year < 2022:
		intUnits = doc.GetUnits().GetFormatOptions(UnitType.UT_Length).DisplayUnits
		return UnitUtils.Convert(val,DisplayUnitType.DUT_DECIMAL_FEET,intUnits)
	else:
		intUnitsId = doc.GetUnits().GetFormatOptions(SpecTypeId.Length).GetUnitTypeId()
		return UnitUtils.ConvertFromInternalUnits(val, intUnitsId)

# Get project position
ori = doc.ActiveProjectLocation.GetProjectPosition(XYZ(0,0,0))
pbp = BasePoint.GetProjectBasePoint(doc)

# Get EW, NS, Elev
ori_ns = interalToProject(ori.NorthSouth)
ori_ew = interalToProject(ori.EastWest)
ori_el = interalToProject(ori.Elevation)
pbp_an = pbp.get_Parameter(BuiltInParameter.BASEPOINT_ANGLETON_PARAM).AsDouble() * 180/math.pi

# Preparing output to Dynamo
OUT = [pbp_an, ori_ew, ori_ns, ori_el]
# ----------------------------------------
code_block_2 = CodeBlock(x=python_script) { an = x[0]; ew = x[1]*-1; ns = x[2]*-1; el = x[3]*-1; }
rotate = CoordinateSystem.Rotate(coordinateSystem=code_block.out1, origin=code_block.out2, axis=code_block.out3, degrees=code_block_2.an)
byCartesianCoordinates = Point.ByCartesianCoordinates(coordinateSystem=rotate, x=code_block_2.ew, y=code_block_2.ns, z=code_block_2.el)
byTwoPoints = Vector.ByTwoPoints(start=code_block.out2, end=byCartesianCoordinates)
distanceTo = Geometry.DistanceTo(geometry=code_block.out2, other=byCartesianCoordinates)
translate = CoordinateSystem.Translate(coordinateSystem=rotate, direction=byTwoPoints, distance=distanceTo)
pointsActual = Input(pointsActual: var[]..[])  # Points in Dynamo for relocation to suit internal Revit coordinates.
code_block_3 = CodeBlock(in_pts=pointsActual) { in_pts.X; in_pts.Y; in_pts.Z; }
byCartesianCoordinates_2 = Point.ByCartesianCoordinates(coordinateSystem=translate, x=code_block_3.out0, y=code_block_3.out1, z=code_block_3.out2)
pointsInternal = Output(byCartesianCoordinates_2)  # Points in Revit correctly aligned to the coordinates system.
