# Dynamo custom node CreateSpaceTypes.dyf "© Spaces.CreateType" (Dynamo 2.3.0.5885)
# category: Crumple.Revit.Other.Create
# Given a list of names, attempt to create new Space Types. If the name exists already, the Type will be skipped.
# 'run_me' must be set to true.

spaces = Input(spaces: var[]..[])  # A name or list of names for the Space Types.
run_me = Input(run_me: bool = false)  # Set to True to run
python_script = Python(IN[0]=spaces, IN[1]=run_me)
# ---------- python_script.python (52 lines) ----------
# Made by Gavin Crump
# Free for use
# BIM Guru, www.bimguru.com.au

# Boilerplate text
import clr

clr.AddReference("RevitNodes")
import Revit
clr.ImportExtensions(Revit.Elements)
clr.ImportExtensions(Revit.GeometryConversion)

clr.AddReference("RevitServices")
import RevitServices
from RevitServices.Persistence import DocumentManager 
from RevitServices.Transactions import TransactionManager 

clr.AddReference("RevitAPI")
import Autodesk 
from Autodesk.Revit.DB import *
from Autodesk.Revit.DB.Analysis import *

# Current doc/app/ui
doc = DocumentManager.Instance.CurrentDBDocument

# Preparing input from dynamo to revit
names = IN[0] if isinstance(IN[0], list) else [IN[0]]
runme = IN[1]

results, spaces_only = [], []

# Do some action in a Transaction
TransactionManager.Instance.EnsureInTransaction(doc)

if runme == True:
	for name in names:
		if HVACLoadSpaceType.IsNameUnique(doc, name):
			st_r = HVACLoadSpaceType.Create(doc, name)
			st_d = st_r.ToDSType(False)
			results.append(st_d)
			spaces_only.append(st_d)
		else:
			msg = "This name exists already!"
			results.append(msg)
else:
	results = "Set run_me to True!"

# Transaction complete
TransactionManager.Instance.TransactionTaskDone()

# Preparing output to Dynamo
OUT = [results, spaces_only]
# ----------------------------------------
code_block = CodeBlock(lst=python_script) { result = lst[0]; t_only = lst[1]; }
results = Output(code_block.result)  # Including error messages.
space_types = Output(code_block.t_only)  # New Space Types only.
