# Dynamo custom node CrumblebeeImport.dyf "© CrumblebeeImport" (Dynamo 2.3.1.11775)
# category: Crumple.Application.Import
# Borrows Bumblebee code in order to import Excel data even if the windows repair issue is present which often prevents the default methods from working in Dynamo for Excel Import.

filePath = Input(filePath: var[]..[])
sheetName = Input(sheetName: string = "Sheet1")
code_block = CodeBlock { false; }
python_script = Python(IN[0]=filePath, IN[1]=sheetName, IN[2]=code_block)
# ---------- python_script.python (83 lines) ----------
# Provided by Gavin Crump
# Free for use
# BIM Guru, www.bimguru.com.au

# Code borrowed and adjusted from Bumblebee
# Free for use under lisence on github
# https://github.com/ksobon/Bumblebee

# Boilerplate text
import clr
import System

# import excel for reading
clr.AddReference("Microsoft.Office.Interop.Excel")
from Microsoft.Office.Interop import Excel
System.Threading.Thread.CurrentThread.CurrentCulture = System.Globalization.CultureInfo("en-US")
from System.Runtime.InteropServices import Marshal

# sets up Excel to run not in live mode
def SetUp(xlApp):
	# supress updates and warning pop ups
	xlApp.Visible = False
	xlApp.DisplayAlerts = False
	xlApp.ScreenUpdating = False
	return xlApp

# read excel data of a worksheet
def ReadData(ws, origin, extent, byColumn):

	rng = ws.Range[origin, extent].Value2
	if not byColumn:
		dataOut = [[] for i in range(rng.GetUpperBound(0))]
		for i in range(rng.GetLowerBound(0)-1, rng.GetUpperBound(0), 1):
			for j in range(rng.GetLowerBound(1)-1, rng.GetUpperBound(1), 1):
				dataOut[i].append(rng[i,j])
		return dataOut
	else:
		dataOut = [[] for i in range(rng.GetUpperBound(1))]
		for i in range(rng.GetLowerBound(1)-1, rng.GetUpperBound(1), 1):
			for j in range(rng.GetLowerBound(0)-1, rng.GetUpperBound(0), 1):
				dataOut[i].append(rng[j,i])
		return dataOut

# exit excel once worksheet is read
def ExitExcel(xlApp, wb, ws):
	# clean up before exiting excel, if any COM object remains
	# unreleased then excel crashes on open following time
	def CleanUp(_list):
		if isinstance(_list, list):
			for i in _list:
				Marshal.ReleaseComObject(i)
		else:
			Marshal.ReleaseComObject(_list)
		return None
		
	xlApp.ActiveWorkbook.Close(False)
	xlApp.ScreenUpdating = True
	CleanUp([ws,wb,xlApp])
	return None

# inputs
filePath = IN[0]
sheetName = IN[1]
byColumn = IN[2]
report = []

# try to get Excel data
try:
	xlApp = SetUp(Excel.ApplicationClass())
	xlApp.Workbooks.open(unicode(filePath))
	wb = xlApp.ActiveWorkbook
	ws = xlApp.Sheets(sheetName)
	originGot = ws.Cells(ws.UsedRange.Row, ws.UsedRange.Column)
	extentGot = ws.Cells(ws.UsedRange.Rows(ws.UsedRange.Rows.Count).Row, ws.UsedRange.Columns(ws.UsedRange.Columns.Count).Column)
	dataOut = ReadData(ws, originGot, extentGot, byColumn)
	ExitExcel(xlApp, wb, ws)
	report = "Data retrieved successfully."
except:
	dataOut = None
	report = "Data not retrieved successfully. Make sure sheet name is correct"

# return result
OUT = [dataOut,report]
# ----------------------------------------
code_block_2 = CodeBlock(out=python_script) { data = out[0]; rept = out[1]; }
dropRows = Input(dropRows: int = 1)
takeItems = List.TakeItems(list=code_block_2.data, amount=dropRows)
headerRows = Output(takeItems)
dropItems = List.DropItems(list=code_block_2.data, amount=dropRows)
transpose = List.Transpose(lists=dropItems)
dataColumns = Output(transpose)
report = Output(code_block_2.rept)
