# Dynamo custom node Crumple.dyf "©" (Dynamo 2.3.0.5885)
# category: Crumple.About
# About the package.

code_block = CodeBlock()
# ---------- code_block.designscript (14 lines) ----------
["Crumple version 0.0.1",
"(C) 2020 Gavin Crump",
"www.bimguru.com.au",
" ",
"Thanks for installing!",
"Under development but",
"we'll be on package",
"manager eventually.",
" ",
"The package's focus is",
"on educating everyday",
"custom node development",
"and eventual exploration",
"of the Revit API."];
# ----------------------------------------
About = Output(code_block)  # Enjoy :)
