# Dynamo custom node CsvExport.dyf "© CSV.Export" (Dynamo 2.16.2.5624)
# category: Crumple.Application.Actions
# Given a matrix of strings, attempts to write them to a csv file (or make a new one if it doesn't exist.

filepath = Input(filepath: string)
stringMatrix = Input(stringMatrix: var[]..[])
delimiter = Input(delimiter: string = ",")
append = Input(append: bool = false)
python_script = Python(IN[0]=filepath, IN[1]=stringMatrix, IN[2]=delimiter, IN[3]=append)  # CPython3
# ---------- python_script.python (56 lines) ----------
# Made by Gavin Crump
# Free for use
# BIM Guru, www.bimguru.com.au

# Boilerplate text
import clr
import csv
import os

# Preparing input from dynamo to revit
filePath = IN[0]
data     = IN[1]
deLimit  = IN[2]
append   = IN[3]

# Determine writemode
if append:
	writeMode = "a"
	modeName  = "appended"
else:
	writeMode = "w"
	modeName  = "written"

# Prepare data rows
csvData = []

try:
	for row in data:
		dataRow = deLimit.join(row)
		csvData.append(dataRow)
	doProceed = True
except:
	doProceed = False

# Try to write the file
if os.path.isfile(filePath) and doProceed:
	try:
		with open(filePath, writeMode) as file:
			for row in csvData:
				file.writelines(row + "\n")
		result = "CSV data " + modeName + " to existing file."
	except:
		result = "CSV file could not be accessed."
elif doProceed:
	try:
		with open(filePath, "w") as file:
			for row in csvData:
				file.writelines(row + "\n")
		result = "CSV data written to new file."
	except:
		result = "New CSV file could not be created."
else:
	result = "Data not writeable as CSV. Check types/formatting"

# Preparing output to Dynamo
OUT = [csvData, result]
# ----------------------------------------
code_block = CodeBlock(x=python_script) { x[0]; x[1]; }
csvData = Output(code_block.out0)
report = Output(code_block.out1)
