# Dynamo custom node CurrentPath.dyf "© CurrentPath" (Dynamo 2.3.1.11775)
# category: Crumple.Application.Revit
# Returns the full file path, directory path and name of a Revit document.
# packages: Crumple 2021.8.17

docOrLink = Input(docOrLink: var[]..[] = null)  # Uses current if none provided. Accepts document or link instance.
getdocument = Custom[© GetDocument](docOrLink=docOrLink)  # package Crumple; If no input is specified or an invalid one is, returns current document. If a link instance is provided, it returns the linked document. If a document is provided it will pass it through.
python_script = Python(IN[0]=getdocument.document)
# ---------- python_script.python (21 lines) ----------
# Made by Gavin Crump
# Free for use
# BIM Guru, www.bimguru.com.au

# Boilerplate text
import clr

clr.AddReference("RevitServices")
import RevitServices
from RevitServices.Persistence import DocumentManager 

clr.AddReference("RevitAPI")
import Autodesk
from Autodesk.Revit.DB import Document

# Current doc and path
doc = DocumentManager.Instance.CurrentDBDocument
path = Document.PathName.GetValue(doc)

# Name and path
OUT = path,path.rsplit("\\",1)
# ----------------------------------------
code_block = CodeBlock(out=python_script) { out[0]; out[1][0]; out[1][1]; }
filePath = Output(code_block.out0)
directoryPath = Output(code_block.out1)
fileName = Output(code_block.out2)
