# Dynamo custom node CurrentSelection.dyf "© CurrentSelection" (Dynamo 2.3.0.5885)
# category: Crumple.Application.Revit
# Returns all elements currently selected by the user in the active document when this node ran.

refresh = Input(refresh: bool = true)
python_script = Python(IN[0]=refresh)
# ---------- python_script.python (33 lines) ----------
# Made by Gavin Crump
# Free for use
# BIM Guru, www.bimguru.com.au

# Boilerplate text
import clr

clr.AddReference("RevitNodes")
import Revit
clr.ImportExtensions(Revit.Elements)

clr.AddReference("RevitServices")
import RevitServices
from RevitServices.Persistence import DocumentManager 
from RevitServices.Transactions import TransactionManager 

# Current doc/app/ui
doc = DocumentManager.Instance.CurrentDBDocument
uiapp = DocumentManager.Instance.CurrentUIApplication 
uidoc = uiapp.ActiveUIDocument

# Get selection
selected = uidoc.Selection.GetElementIds()

# Return elements
result = []

for id in selected:
	e = doc.GetElement(id).ToDSType(True)
	result.append(e)

# Preparing output to Dynamo
OUT = result
# ----------------------------------------
elements = Output(python_script)
