# Dynamo custom node CurrentView.dyf "© CurrentView" (Dynamo 2.3.0.5885)
# category: Crumple.Application.Revit
# Given the current document, return the active view.

refresh = Input(refresh: bool = true)
code_block = CodeBlock(x=refresh) { x; document1 = Revit.Document.Current; Revit.Document.ActiveView(document1); }
activeView = Output(code_block.out2)
