# Dynamo custom node CurrentViews.dyf "© Revit.CurrentViews" (Dynamo 2.12.1.8246)
# category: Crumple.Application.Query
# Returns all views in the currently opened or specified document.
# packages: Crumple 2022.5.27

doc = Input(doc: var[]..[] = null)  # Uses current if none provided. Accepts document.
revit_getdocument = Custom[© Revit.GetDocument](docOrLink=doc)  # package Crumple; If no input is specified or an invalid one is, returns current document. If a link instance is provided, it returns the linked document. If a document is provided it will pass it through.
python_script = Python(IN[0]=revit_getdocument.document)  # IronPython2
# ---------- python_script.python (36 lines) ----------
# Made by Gavin Crump
# Free for use
# BIM Guru, www.bimguru.com.au

# Boilerplate text
import clr

clr.AddReference("RevitServices")
import RevitServices
from RevitServices.Persistence import DocumentManager 

clr.AddReference("RevitAPI")
import Autodesk 
from Autodesk.Revit.DB import *

# Current doc/app/ui
uiapp = DocumentManager.Instance.CurrentUIApplication 
uidoc = uiapp.ActiveUIDocument

# Preparing input from dynamo to revit
doc = IN[0]

# Get views
views = []

uiViews = uidoc.GetOpenUIViews()

for v in uiViews:
	try:
		view = doc.GetElement(v.ViewId)
		views.append(view)
	except:
		pass

# Preparing output to Dynamo
OUT = views
# ----------------------------------------
views = Output(python_script)
