# Dynamo custom node CurtainGridCount.dyf "© Walls.CurtainGridCount" (Dynamo 2.3.0.5885)
# category: Crumple.Revit.Other.Query
# Returns the horizontal and vertical grid counts for curtain walls. Note that sometimes the parameter does not match the model for spacing based rules!

curtain_wall = Input(curtain_wall: var[]..[])  # Revit curtain wall instance.
parameters = Element.Parameters(element=curtain_wall)
name = Parameter.Name(parameter=parameters)
code_block = CodeBlock(name=name) { name == "Number"; }
filterByBoolMask = List.FilterByBoolMask(list=parameters, mask=code_block)
string_from_object = FromObject(obj=filterByBoolMask.in)
code_block_2 = CodeBlock { 0; 9; }
remove = String.Remove(str=string_from_object, startIndex=code_block_2.out0, count=code_block_2.out1)
toNumber = String.ToNumber(str=remove)
firstItem = List.FirstItem(list=toNumber@L2)
Horizontal = Output(firstItem)  # Grid count.
lastItem = List.LastItem(list=toNumber@L2)
Vertical = Output(lastItem)  # Grid count.
