# Dynamo custom node CurveFilterByZ.dyf "© Curve.FilterByZ" (Dynamo 2.3.0.5885)
# category: Crumple.Geometry.Actions
# Given a curve or list of curves, filter from the list only those of a specific Z factor in their midpoint direction.

curves = Input(curves: var[]..[])
code_block = CodeBlock { 0.5; }
tangentAtParameter = Curve.TangentAtParameter(curve=curves, param=code_block)
z = Input(z: double = 0)
code_block_2 = CodeBlock(vec=tangentAtParameter, n=z) { vec.Z == n; }
filterByBoolMask = List.FilterByBoolMask(list=curves, mask=code_block_2)
equal = Output(filterByBoolMask.in)
notEqual = Output(filterByBoolMask.out)
