# Dynamo custom node CurvesFilterByHeight.dyf "© Curve.FilterByHeight" (Dynamo 2.3.0.5885)
# category: Crumple.Geometry.Actions
# Given a list of curves, filters them by the Z value of their mid point.

curves = Input(curves: var[]..[])
code_block = CodeBlock { 0.5; }
pointAtParameter = Curve.PointAtParameter(curve=curves, param=code_block)
code_block_2 = CodeBlock(p=pointAtParameter) { p.Z; }
groupByKey = List.GroupByKey(list=curves, keys=code_block_2)
sortByKey = List.SortByKey(list=groupByKey.groups, keys=groupByKey.unique_keys)
curves_2 = Output(sortByKey.sorted_list)  # "curves"
heights = Output(sortByKey.sorted_keys)
