# Dynamo custom node DateTimeAnalysisPeriod.dyf "🐍 DateTime.AnalysisPeriod" (Dynamo 2.12.1.8246)
# category: Crumple.IronPython.Create
# Constructs a series of DateTime objects from a year, month, day, start time, end time and time step.

year = Input(year: int)  # Enter in full year numbers.
month = Input(month: int)  # Number between 1 and 12.
day = Input(day: int)  # Number between 1 and 31.
startHour = Input(startHour: int)  # Number between 0 and 23 (24h time).
endHour = Input(endHour: int)  # Number between 0 and 23 (24h time).
timeStep = Input(timeStep: int = 1)  # Number of intervals (e.g. 1 = hourly, 4 = quarter-hourly).
python_script = Python(IN[0]=year, IN[1]=month, IN[2]=day, IN[3]=startHour, IN[4]=endHour, IN[5]=timeStep)  # IronPython2
# ---------- python_script.python (63 lines) ----------
# Made by Gavin Crump
# Free for use
# BIM Guru, www.bimguru.com.au

# Boilerplate text
import clr

import datetime

import System
from System import DateTime

KIND_LOCAL = System.DateTimeKind.Local

def objOrList(input):
    if isinstance(input, list) and len(input) == 1:
        return input[0]
    else:
        return input

# Preparing input from dynamo to revit
in_year  = int(IN[0])
in_month = int(IN[1])
in_day   = int(IN[2])
in_start = int(IN[3])
in_end   = int(IN[4])
in_step  = int(IN[5])

dateName = str(in_year) + "-" + str(in_month) + "-" + str(in_day) + "_"

# Develop hours range (excl final hour)
hours   = range(in_start, in_end, 1)

# Develop times
time_track = 0
times = []
step = 60/in_step

for i in range(0, in_step, 1):
	times.append(time_track)
	time_track += step

dateTimes, dtNames = [],[]

# Make date times
for h in hours:
	str_h = str(h).rjust(2,"0")
	for t in times:
		dt = datetime.datetime(in_year, in_month, in_day, h, t)
		loc_dt = DateTime.SpecifyKind(dt, KIND_LOCAL)
		dateTimes.append(loc_dt)
		dtName = dateName + str_h + "-" + str(t).rjust(2,"0")
		dtNames.append(dtName)
# Last time
dt = datetime.datetime(in_year, in_month, in_day, in_end, 0)
loc_dt = DateTime.SpecifyKind(dt, KIND_LOCAL)
dateTimes.append(loc_dt)
str_h = str(in_end).rjust(2,"0")
dtName = dateName + str_h + "-" + "00"
dtNames.append(dtName)

# Preparing output to Dynamo
OUT = objOrList(dateTimes), objOrList(dtNames)
# ----------------------------------------
code_block = CodeBlock(x=python_script) { x[0]; x[1]; }
dateTimes = Output(code_block.out0)
viewNames = Output(code_block.out1)
