# Dynamo custom node DateTimeSunDirection.dyf "🐍 DateTime.SunDirection" (Dynamo 2.12.1.8246)
# category: Crumple.IronPython.Actions
# Given a list of datetimes, attempts to return the direction of the sun in the model as both a vector and XYZ object (taking true north into account).
# packages: Crumple 2022.5.27

dateTimes = Input(dateTimes: var[]..[])
viewtypes_getbyname3d = Custom[© ViewTypes.GetByName3D]()  # package Crumple; Tries to return an 3D view type with the given name, if one exists in the model.
python_script = Python(IN[0]=dateTimes, IN[1]=viewtypes_getbyname3d.viewFamilyType)  # IronPython2
# ---------- python_script.python (126 lines) ----------
# Made by Gavin Crump
# Free for use
# BIM Guru, www.bimguru.com.au

# Boilerplate text
import clr
import math

clr.AddReference("RevitNodes")
import Revit
clr.ImportExtensions(Revit.GeometryConversion)

clr.AddReference("RevitServices")
import RevitServices
from RevitServices.Persistence import DocumentManager 
from RevitServices.Transactions import TransactionManager 

clr.AddReference("RevitAPI")
import Autodesk 
from Autodesk.Revit.DB import XYZ, SunAndShadowType, Transform,\
Line, ParameterUtils,BasePoint, BuiltInParameter, View3D

# Current document
doc = DocumentManager.Instance.CurrentDBDocument

# Get revit version
uiapp = DocumentManager.Instance.CurrentUIApplication 
app = uiapp.Application 
uidoc = uiapp.ActiveUIDocument
REVIT_VER = app.VersionNumber

# Define list/unwrap list functions
def tolist(input):
    result = input if isinstance(input, list) else [input]
    return result

def objOrList(input, initial = IN[0]):
	if isinstance(initial, list):
		return input
	else:
		return input[0]

# Preparing input from dynamo to revit
dateTimes   = tolist(IN[0])
viewType_id = UnwrapElement(IN[1]).Id

# Constants for geometry
AXIS_Y = XYZ.BasisY
AXIS_X = XYZ.BasisX
AXIS_Z = XYZ.BasisZ
ORIGIN = XYZ(0,0,0)

# Function to get sun vector from view
def get_Sun_Direction(view, dateTime, myDoc = doc, myUidoc = uidoc):
	# View sun shadow settings
	sunSettings = view.SunAndShadowSettings
	# Adjust shadow settings
	sunSettings.SunAndShadowType = SunAndShadowType.StillImage
	sunSettings.StartDateAndTime = dt
	# Refresh the view, regen the doc
	myUidoc.RefreshActiveView()
	myDoc.Regenerate()
	# Compute altitude
	altitude = sunSettings.Altitude
	altitude = sunSettings.GetFrameAltitude(sunSettings.ActiveFrame)
	altitudeRotation  = Transform.CreateRotation(AXIS_X, altitude)
	altitudeDirection = altitudeRotation.OfVector(AXIS_Y)
	# Compute azimuth
	azimuth = sunSettings.Azimuth
	azimuth = sunSettings.GetFrameAzimuth(sunSettings.ActiveFrame)
	actualAzimuth = 2 * math.pi - azimuth
	azimuthRotation = Transform.CreateRotation(AXIS_Z, actualAzimuth)
	# Get sun direction
	sunDirection = azimuthRotation.OfVector(altitudeDirection)
	# Return the vector
	return sunDirection

# Function to rotate vector by angle
def vector_rotateAndDerive(vec, angle):
	# Make a base curve
	tempLine = Line.CreateBound(ORIGIN, vec)
	# To radians
	rad = math.radians(angle)
	# Make transform
	rot = Transform.CreateRotation(AXIS_Z, rad)
	# Get the up and forward directions
	tranLine = tempLine.CreateTransformed(rot)
	# Return the transformed vector
	return tranLine.Direction

# Function: Get builtin parameter by enum or spec Id
def getBip(element, bip):
    # RVT < 2022
    if REVIT_VER < 2022:
        return element.get_Parameter(bip)
    # RVT >= 2022
    else:
        id_forgeType = ParameterUtils.GetParameterTypeId(bip)
        return element.GetParameter(id_forgeType)

# Get project rotation
pbp = BasePoint.GetProjectBasePoint(doc)
bip = BuiltInParameter.BASEPOINT_ANGLETON_PARAM
safe_bip = getBip(pbp, bip)
pbp_an = safe_bip.AsDouble() * (180/math.pi)

# For each date time, make a view orientation
orientations = []

# Start a transaction (in the group)
TransactionManager.Instance.EnsureInTransaction(doc)
tempView = View3D.CreateIsometric(doc, viewType_id)

for dt in dateTimes:
	# Get sun direction and convert to view facing
	vec_sun = get_Sun_Direction(tempView, dt, doc, uidoc)
	vec_neg = vec_sun.Negate()
	vec_rot = vector_rotateAndDerive(vec_neg, pbp_an)
	# Store rotation
	orientations.append(vec_rot)

# Delete the temporary view
doc.Delete(tempView.Id)
TransactionManager.Instance.TransactionTaskDone()

OUT = objOrList([o.ToVector() for o in orientations])
# ----------------------------------------
vectors = Output(python_script)
