# Dynamo custom node DesignOptions.dyf "© DesignOptions" (Dynamo 2.3.1.11775)
# category: Crumple.Revit.DesignOptions
# Returns all design options in a document.
# packages: Crumple 2021.8.17

docOrLink = Input(docOrLink: var[]..[] = null)  # Uses current if none provided. Accepts document or link instance.
getdocument = Custom[© GetDocument](docOrLink=docOrLink)  # package Crumple; If no input is specified or an invalid one is, returns current document. If a link instance is provided, it returns the linked document. If a document is provided it will pass it through.
python_script = Python(IN[0]=getdocument.document)
# ---------- python_script.python (25 lines) ----------
# Made by Gavin Crump
# Free for use
# BIM Guru, www.bimguru.com.au

# Boilerplate text
import clr

clr.AddReference("RevitServices")
import RevitServices
from RevitServices.Persistence import DocumentManager

clr.AddReference("RevitNodes")
import Revit
clr.ImportExtensions(Revit.Elements)

clr.AddReference("RevitAPI")
import Autodesk 
from Autodesk.Revit.DB import *


# Current doc/app/ui
doc = IN[0]

# Preparing output to Dynamo
OUT = FilteredElementCollector(doc).OfClass(DesignOption).ToElements()
# ----------------------------------------
designOptions = Output(python_script)
