# Dynamo custom node DesignOptionsBySet.dyf "© DesignOptionsBySet" (Dynamo 2.3.1.11775)
# category: Crumple.Revit.DesignOptions
# Returns all design options broken down by primary and secondary, as well as their related option set.
# packages: Crumple 2021.8.17

docOrLink = Input(docOrLink: var[]..[] = null)  # Uses current if none provided. Accepts document or link instance.
designOptions = Custom[DesignOptions](docOrLink=docOrLink)  # package Crumple; Returns all design options in the model.
designOptionSet = Custom[DesignOptionSet](designOption=designOptions)  # package Crumple; For a given design option, return its related set.
groupByKey = List.GroupByKey(list=designOptions, keys=designOptionSet)
code_block = CodeBlock(t1=groupByKey.groups) { DSCore.List.FirstItem(t1@L2<1>); DSCore.List.RestOfItems(t1@L2<1>); }
primaryOptions = Output(code_block.out0)
secondaryOptions = Output(code_block.out1)
optionSets = Output(groupByKey.unique_keys)
