# Dynamo custom node DesignOptionsOptionSet.dyf "© DesignOptions.OptionSet" (Dynamo 2.12.1.8246)
# category: Crumple.Revit.Query
# For a given design option, return its related set.

designOption = Input(designOption: var[]..[])
python_script = Python(IN[0]=designOption)  # IronPython2
# ---------- python_script.python (45 lines) ----------
# Made by Gavin Crump
# Free for use
# BIM Guru, www.bimguru.com.au

# Boilerplate text
import clr

clr.AddReference('RevitAPI')
import Autodesk 
from Autodesk.Revit.DB import BuiltInParameter

clr.AddReference("RevitNodes")
import Revit
clr.ImportExtensions(Revit.Elements)

# Define option set function
def GetDesignOptionSet(desOpt):
	try:
		setId = desOpt.get_Parameter(BuiltInParameter.OPTION_SET_ID).AsElementId()
		setEl = desOpt.Document.GetElement(setId)
		return setEl.ToDSType(True)
	except:
		return None

# Define list/unwrap list functions
def uwlist(input):
    result = input if isinstance(input, list) else [input]
    return UnwrapElement(result)

def objOrList(input, initial = IN[0]):
	if isinstance(initial, list):
		return input
	else:
		return input[0]

# Inputs
options_uw = uwlist(IN[0])
sets = []

# Get option sets
for o in options_uw:
	sets.append(GetDesignOptionSet(o))

# Preparing output to Dynamo
OUT = objOrList(sets)
# ----------------------------------------
optionSet = Output(python_script)
