# Dynamo custom node DimensionTypes.dyf "© DimensionTypes" (Dynamo 2.3.0.5885)
# category: Crumple.Revit.Dimensions
# Returns all dimension and spot dimension types (aka styles) in the current document.

refresh = Input(refresh: bool = True)
python_script = Python(IN[0]=refresh)
# ---------- python_script.python (31 lines) ----------
# Made by Gavin Crump
# Free for use
# BIM Guru, www.bimguru.com.au

# Boilerplate text
import clr

clr.AddReference("RevitServices")
import RevitServices
from RevitServices.Persistence import DocumentManager
doc = DocumentManager.Instance.CurrentDBDocument

clr.AddReference("RevitAPI")
import Autodesk
from Autodesk.Revit.DB import *

#Dimension types
dTypes = FilteredElementCollector(doc).OfClass(DimensionType).ToElements()
sTypes = FilteredElementCollector(doc).OfClass(SpotDimensionType).ToElements()

dNames,sNames = [],[]

#Get names
for i in dTypes:
	dNames.append(i.FamilyName)
	
for i in sTypes:
	sNames.append(i.FamilyName)

#Set output
OUT = [dTypes, dNames, sTypes, sNames]
# ----------------------------------------
code_block = CodeBlock(out=python_script) { out[0]; out[1]; out[2]; out[3]; }
dimTypes = Output(code_block.out0)
dimNames = Output(code_block.out1)
spotTypes = Output(code_block.out2)
spotNames = Output(code_block.out3)
