# Dynamo custom node DirectoryCreate.dyf "© Directory.Create" (Dynamo 2.16.2.5624)
# category: Crumple.Application.Create
# Creates a directory from a path if it does not exist.

directoryPath = Input(directoryPath: string[]..[])
createdParents = Input(createdParents: bool = true)
python_script = Python(IN[0]=directoryPath, IN[1]=createdParents)  # CPython3
# ---------- python_script.python (35 lines) ----------
# Made by Gavin Crump
# Free for use
# BIM Guru, www.bimguru.com.au

# Boilerplate text
import clr
import os

# Define list/unwrap list functions
def tolist(input):
    result = input if isinstance(input, list) else [input]
    return result

def objOrList(input):
    if isinstance(input, list) and len(input) == 1:
        return input[0]
    else:
        return input

# Preparing input from dynamo to revit
dirPaths = tolist(IN[0])
ensureParents = IN[1]

success = []

# Make directories
for dp in dirPaths:
    try:
        os.makedirs(dp, exist_ok=True)
        success.append(True)
    except:
        success.append(False)

# Preparing output to Dynamo
OUT = objOrList(success)
# ----------------------------------------
success = Output(python_script)
