# Dynamo custom node DocumentRevisions.dyf "© DocumentRevisions" (Dynamo 2.3.0.5885)
# category: Crumple.Revit.Selection
# Returns all revisions in the current document.

Refresh = Input(Refresh: bool = true)
python_script = Python(IN[0]=Refresh)
# ---------- python_script.python (23 lines) ----------
# Made by Gavin Crump
# Free for use
# BIM Guru, www.bimguru.com.au

# Boilerplate text
import clr

clr.AddReference("RevitServices")
import RevitServices
from RevitServices.Persistence import DocumentManager 

clr.AddReference("RevitAPI")
import Autodesk 
from Autodesk.Revit.DB import *

# Current doc/app/ui
doc = DocumentManager.Instance.CurrentDBDocument

# Collect revisions
revisions = FilteredElementCollector(doc).OfCategory(BuiltInCategory.OST_Revisions).WhereElementIsNotElementType().ToElements()

# Preparing output to Dynamo
OUT = revisions
# ----------------------------------------
revisions = Output(python_script)
