# Dynamo custom node DomainDeconstruct.dyf "© DomainDeconstruct" (Dynamo 2.3.0.5885)
# category: Crumple.Math.Functions
# Given a range of values, return the minimum, maximum and size of its domain.

range = Input(range: var[]..[])
code_block = CodeBlock(num1=range) { max = DSCore.List.MaximumItem(num1); min = DSCore.List.MinimumItem(num1); dom = max - min; }
min = Output(code_block.min)
max = Output(code_block.max)
size = Output(code_block.dom)
