# Dynamo custom node DoorToFrom.dyf "© Doors.ToFrom" (Dynamo 2.3.1.11775)
# category: Crumple.Revit.Other.Query
# Given a door, attempts to return its to and from room properties as well as how many rooms it relates to.

door = Input(door: var[]..[])
roomPhase = Input(roomPhase: var)
python_script = Python(IN[0]=door, IN[1]=roomPhase)
# ---------- python_script.python (48 lines) ----------
# Made by Gavin Crump
# Free for use
# BIM Guru, www.bimguru.com.au

# Boilerplate text
import clr

clr.AddReference("RevitAPI")
import Autodesk 
from Autodesk.Revit.DB import *

# Define list/unwrap list functions
def uwlist(input):
    result = input if isinstance(input, list) else [input]
    return UnwrapElement(result)

# Preparing input from dynamo to revit
doors = uwlist(IN[0])
phase = UnwrapElement(IN[1])

hasto, hasfrom, counter, torm, fromrm = [],[],[],[],[]

# Do some action in a Transaction
for d in doors:
	if hasattr(d, "FromRoom") and str(phase.GetType()) == "Autodesk.Revit.DB.Phase":
		try:
			torm.append(d.ToRoom[phase])
			fromrm.append(d.FromRoom[phase])
		except:
			torm.append(None)
			fromrm.append(None)

for t,f in zip(torm, fromrm):
	c = 0
	if t == None:
		hasto.append(False)
	else:
		hasto.append(True)
		c+=1
	if f == None:
		hasfrom.append(False)
	else:
		hasfrom.append(True)
		c+=1
	counter.append(c)

# Preparing output to Dynamo
OUT = [torm, fromrm, hasto, hasfrom, counter]
# ----------------------------------------
code_block = CodeBlock(x=python_script) { x[0]; x[1]; x[2]; x[3]; x[4]; }
toRoom = Output(code_block.out0)
fromRoom = Output(code_block.out1)
hasTo = Output(code_block.out2)
hasFrom = Output(code_block.out3)
roomCount = Output(code_block.out4)
