# Dynamo custom node DynamoCurrentScript.dyf "© Dynamo.CurrentScript" (Dynamo 2.16.2.5624)
# category: Crumple.Application.Query
# Returns the name of the currently active Dynamo script, with an optional extension.

includeExtension = Input(includeExtension: bool = false)
python_script = Python(IN[0]=includeExtension)  # CPython3
# ---------- python_script.python (22 lines) ----------
# Made by Gavin Crump
# Free for use
# BIM Guru, www.bimguru.com.au

# Boilerplate text
import clr

clr.AddReference('DynamoRevitDS')
import Dynamo

# Check Dynamo workspace properties
dynamoRevit = Dynamo.Applications.DynamoRevit()
currentWorkspace = dynamoRevit.RevitDynamoModel.CurrentWorkspace
script = currentWorkspace.Name

if IN[0]:
	ext = ".dyn"
else:
	ext = ""

# Preparing output to Dynamo
OUT = script + ext
# ----------------------------------------
scriptName = Output(python_script)
