# Dynamo custom node DynamoUserPaths.dyf "© Dynamo.UserPaths" (Dynamo 2.12.1.8246)
# category: Crumple.Application.Query
# Returns the Dynamo folder and log folder paths.

refresh = Input(refresh: bool = true)  # Toggle to refresh
python_script = Python(IN[0]=refresh)  # CPython3
# ---------- python_script.python (28 lines) ----------
# Made by Gavin Crump
# Free for use
# BIM Guru, www.bimguru.com.au
# Thanks to Sean Page for suggesting the os package

# Boilerplate text
import clr
import os

#Add Dynamo services for its API
clr.AddReference('DynamoRevitDS')
import Dynamo
from System import Environment

# access to the current Dynamo instance and workspace
DynamoCurrent = Dynamo.Applications.DynamoRevit()
DynamoVersion = DynamoCurrent.RevitDynamoModel.Version

versionSplit  = DynamoVersion.split('.')
versionString = versionSplit[0] + "." + versionSplit[1]

user = os.environ.get('USERNAME')
fl = os.environ.get('USERPROFILE')

dr = fl + "\AppData\Roaming\Dynamo\Dynamo Revit\\" + versionString
dl = fl + "\AppData\Roaming\Dynamo\Dynamo Revit\\" + versionString + "\Logs"

OUT = dr,dl
# ----------------------------------------
code_block = CodeBlock(X=python_script) { X[0]; X[1]; }
dynamoPath = Output(code_block.out0)  # The active user's Dynamo path
dynamoLogs = Output(code_block.out1)  # The active user's Dynamo logs path
