# Dynamo custom node ElementById.dyf "© Elements.ById" (Dynamo 2.3.0.5885)
# category: Crumple.Revit.Actions
# Given an Element Id as an integer, returns the corresponding element in Revit.

Id = Input(Id: int)  # The element's Id as an integer.
code_block = CodeBlock(elemId=Id) { Revit.Elements.ElementSelector.ByElementId(elemId); }
elements = Output(code_block)  # Matching Revit elements found, if any.
