# Dynamo custom node ElementByUniqueId.dyf "© Element.ByUniqueID" (Dynamo 2.16.2.5624)
# category: Crumple.Revit.Actions
# Given a Unique Id as a string, returns the corresponding element in Revit.

uniqueId = Input(uniqueId: string)  # The element's Unique Id as a string.
code_block = CodeBlock(elemId=uniqueId) { Revit.Elements.ElementSelector.ByUniqueId(elemId); }
element = Output(code_block)  # Matching Revit elements found, if any.
