# Dynamo custom node ElementCentroid.dyf "© Element.Centroid" (Dynamo 2.16.2.5624)
# category: Crumple.Revit.Query
# Returns the centroid of the element's axis-aligned bounding box.

element = Input(element: Revit.Elements.Element)  # Model element(s). Element bounding box will be used to determine the centroid. NB: Axis aligned
boundingBox = Element.BoundingBox(element=element)
code_block = CodeBlock(bb=boundingBox)
# ---------- code_block.designscript (4 lines) ----------
bbMax = Autodesk.DesignScript.BoundingBox.MaxPoint(bb);
bbMin = Autodesk.DesignScript.BoundingBox.MinPoint(bb);

Point.ByCoordinates((bbMin.X + bbMax.X)/2, (bbMin.Y + bbMax.Y)/2, (bbMin.Z + bbMax.Z)/2);
# ----------------------------------------
point = Output(code_block.out2)  # Element BB Centroid as point.
