# Dynamo custom node ElementGetLevelBelow.dyf "© Element.GetLevelBelow" (Dynamo 2.16.2.5624)
# category: Crumple.Revit.Actions
# For a list of points, returns the first provided level below that point.

level = Input(level: var[]..[])  # A list of levels to use in the study. Any levels not present here will not be considered.
elevation = Level.Elevation(level=level)
sortByKey = List.SortByKey(list=level, keys=elevation)
tolerance = Input(tolerance: double = 0)  # Applies a tolerance to the base of the study. This is typically needed for points at or just under floor level.
code_block = CodeBlock(elev=sortByKey.sortedKeys, tol=tolerance) { elev - tol; }
point = Input(point: var[]..[])  # Points for testing. Suggest using the 'Element.Centroid' node in combination.
code_block_2 = CodeBlock(pnt=point) { pnt.X; pnt.Y; pnt.Z; }
python_script = Python(IN[0]=code_block, IN[1]=code_block_2.out2)  # CPython3
# ---------- python_script.python (31 lines) ----------
# Made by Gavin Crump
# Free for use
# BIM Guru, www.bimguru.com.au

# Define list/unwrap list functions
def tolist(input):
    result = input if isinstance(input, list) else [input]
    return result

# Declare inputs, ensure values and range are iterable
elev_lvls = tolist(IN[0])
elev_eles = tolist(IN[1])

ind_lvls, ind_elevs = [],[]

# For each elevation
for e in elev_eles:
	if elev_lvls[0] > e:
		ind = 0
	else:
		ind = -1
	for l in elev_lvls:
		if l > e:
			break
		else:
			ind += 1
	ind_lvls.append(ind)
	ind_elevs.append(elev_lvls[ind])

# Outputs
OUT = ind_lvls, ind_elevs
# ----------------------------------------
code_block_3 = CodeBlock(X=python_script, tol=tolerance) { X[0]; X[1]+tol; }
getItemAtIndex = List.GetItemAtIndex(list=sortByKey.sortedList, index=code_block_3.out0)
levelBelow = Output(getItemAtIndex)  # Nearest level to the point(s).
byCoordinates = Point.ByCoordinates(x=code_block_2.out0, y=code_block_2.out1, z=code_block_3.out1)
pointAtLevel = Output(byCoordinates)  # Point(s) pulled to the level's reference plane.
