# Dynamo custom node ElementGetType.dyf "© Element.GetType" (Dynamo 2.16.2.5624)
# category: Crumple.Revit.Query
# Gets the element type of the provided element, if able.

element = Input(element: var[]..[])
python_script = Python(IN[0]=element)  # CPython3
# ---------- python_script.python (33 lines) ----------
# Made by Gavin Crump
# Free for use
# BIM Guru, www.bimguru.com.au

# Boilerplate text
import clr

# Define list/unwrap list functions
def uwlist(input):
    result = input if isinstance(input, list) else [input]
    return UnwrapElement(result)

def objOrList(input):
    if isinstance(input, list) and len(input) == 1:
        return input[0]
    else:
        return input

# Preparing input from dynamo to revit
elements = uwlist(IN[0])

# Get types
elementTypes = []

for e in elements:
    try:
        elementType = e.Document.GetElement(e.GetTypeId())
        elementTypes.append(elementType)
    except:
        elementTypes.append(None)

# Preparing output to Dynamo
OUT = objOrList(elementTypes)
# ----------------------------------------
elementType = Output(python_script)
