# Dynamo custom node ElementHandFlipped.dyf "© ElementHandFlipped" (Dynamo 2.3.0.5885)
# category: Crumple.Revit.Elements
# Returns true if an element has been hand flipped. If the element has been face flipped also, it will return false (as the element is technically not hand flipped in this case).

element = Input(element: var[]..[])  # Model element(s). Should be family instances.
python_script = Python(IN[0]=element)
# ---------- python_script.python (25 lines) ----------
# Made by Gavin Crump
# Free for use
# BIM Guru, www.bimguru.com.au

# Boilerplate text
import clr
clr.AddReference("RevitAPI")

# Define list/unwrap list functions
def uwlist(input):
    result = input if isinstance(input, list) else [input]
    return UnwrapElement(input)

# Preparing input from dynamo to revit
uw_list  = uwlist(IN[0])

flips = []

for i in uw_list:
	flip = 1 if i.HandFlipped else 0
	face = 1 if i.FacingFlipped else 0	
	flips.append(flip+face == 1)

# Preparing output to Dynamo
OUT = flips
# ----------------------------------------
flipped = Output(python_script)  # True if hand flipped.
