# Dynamo custom node ElementIsPainted.dyf "© Elements.Painted" (Dynamo 2.3.1.11775)
# category: Crumple.Revit.Query
# For an element or list of elements returns if that element is painted and the painted surface count.
# packages: Crumple 2022.2.13

element = Input(element: var[]..[])
docOrLink = Input(docOrLink: var[]..[] = null)
revit_getdocument = Custom[© Revit.GetDocument](docOrLink=docOrLink)  # package Crumple; If no input is specified or an invalid one is, returns current document. If a link instance is provided, it returns the linked document. If a document is provided it will pass it through.
python_script = Python(IN[0]=element, IN[1]=revit_getdocument.document)
# ---------- python_script.python (63 lines) ----------
# Made by Gavin Crump
# Free for use
# BIM Guru, www.bimguru.com.au

# Boilerplate text
import clr

clr.AddReference("RevitServices")
import RevitServices
from RevitServices.Persistence import DocumentManager 
from RevitServices.Transactions import TransactionManager 

clr.AddReference("RevitAPI")
import Autodesk 
from Autodesk.Revit.DB import *

# Current doc/app/ui
doc = IN[1]

# Define list/unwrap list functions
def uwlist(input):
    result = input if isinstance(input, list) else [input]
    return UnwrapElement(result)

# Preparing input from dynamo to revit
elements = uwlist(IN[0])
gOpts = Options()
paintlist,paintcounts = [],[]

# Do some action in a Transaction
for e in elements:
	count = 0
	
	geom = e.get_Geometry(gOpts)
	
	for g in geom:
	
		try:
			ele_faces = g.Faces
		
			for f in ele_faces:
			
				if f.HasRegions:
					regions = f.GetRegions()
					for r in regions:
						if doc.IsPainted(e.Id, r):
							count += 1		
			
				if doc.IsPainted(e.Id, f):
					count += 1
					
		except:
			pass
				
	paintcounts.append(count)
	
	if count > 0:
		paintlist.append(True)
	else:
		paintlist.append(False)

# Preparing output to Dynamo
OUT = [paintlist,paintcounts]
# ----------------------------------------
code_block = CodeBlock(x=python_script) { x[0]; x[1]; }
isPainted = Output(code_block.out0)
faceCount = Output(code_block.out1)
