# Dynamo custom node ElementOwners.dyf "© Elements.Owners" (Dynamo 2.3.1.11775)
# category: Crumple.Revit.Query
# Returns the creator, owner and last editor of an element in a workshared model if possible.
# packages: Crumple 2022.2.13

elements = Input(elements: var[]..[])
docOrLink = Input(docOrLink: var[]..[] = null)  # Uses current if none provided. Accepts document or link instance.
revit_getdocument = Custom[© Revit.GetDocument](docOrLink=docOrLink)  # package Crumple; If no input is specified or an invalid one is, returns current document. If a link instance is provided, it returns the linked document. If a document is provided it will pass it through.
python_script = Python(IN[0]=elements, IN[1]=revit_getdocument.document)
# ---------- python_script.python (45 lines) ----------
# Made by Gavin Crump
# Free for use
# BIM Guru, www.bimguru.com.au

# Boilerplate text
import clr

clr.AddReference("RevitNodes")
import Revit
clr.ImportExtensions(Revit.Elements)

clr.AddReference("RevitServices")
import RevitServices
from RevitServices.Persistence import DocumentManager

clr.AddReference("RevitAPI")
import Autodesk 
from Autodesk.Revit.DB import *

# Current doc/app/ui
doc = IN[1]

# Define list/unwrap list functions
def uwlist(input):
    result = input if isinstance(input, list) else [input]
    return UnwrapElement(result)

# Preparing input from dynamo to revit
elements = uwlist(IN[0])
wsu_creator, wsu_owner, wsu_change = [],[],[]

# Find last used and creator
for e in elements:
	try:
		wsu = WorksharingUtils.GetWorksharingTooltipInfo(doc, e.Id)
		wsu_creator.append(wsu.Creator)
		wsu_owner.append(wsu.Owner)
		wsu_change.append(wsu.LastChangedBy)
	except:
		wsu_creator.append(None)
		wsu_owner.append(None)
		wsu_change.append(None)

# Preparing output to Dynamo
OUT = [wsu_creator, wsu_owner, wsu_change]
# ----------------------------------------
code_block = CodeBlock(x=python_script) { cre = x[0]; own = x[1]; cha = x[2]; }
ownedBy = Output(code_block.cre)
createdBy = Output(code_block.cre)
lastEditedBy = Output(code_block.cha)
