# Dynamo custom node ElementStatus.dyf "© ElementStatus" (Dynamo 2.3.1.11775)
# category: Crumple.Revit.Elements
# Returns the creator, owner and last editor of an element in a workshared model if possible.

elements = Input(elements: var[]..[])
python_script = Python(IN[0]=elements)
# ---------- python_script.python (45 lines) ----------
# Made by Gavin Crump
# Free for use
# BIM Guru, www.bimguru.com.au

# Boilerplate text
import clr

clr.AddReference("RevitNodes")
import Revit
clr.ImportExtensions(Revit.Elements)

clr.AddReference("RevitServices")
import RevitServices
from RevitServices.Persistence import DocumentManager

clr.AddReference("RevitAPI")
import Autodesk 
from Autodesk.Revit.DB import *

# Current doc/app/ui
doc = DocumentManager.Instance.CurrentDBDocument

# Define list/unwrap list functions
def uwlist(input):
    result = input if isinstance(input, list) else [input]
    return UnwrapElement(result)

# Preparing input from dynamo to revit
elements = uwlist(IN[0])
wsu_creator, wsu_owner, wsu_change = [],[],[]

# Find last used and creator
for e in elements:
	try:
		wsu = WorksharingUtils.GetWorksharingTooltipInfo(doc, e.Id)
		wsu_creator.append(wsu.Creator)
		wsu_owner.append(wsu.Owner)
		wsu_change.append(wsu.LastChangedBy)
	except:
		wsu_creator.append(None)
		wsu_owner.append(None)
		wsu_change.append(None)

# Preparing output to Dynamo
OUT = [wsu_creator, wsu_owner, wsu_change]
# ----------------------------------------
code_block = CodeBlock(x=python_script) { cre = x[0]; own = x[1]; cha = x[2]; }
ownedBy = Output(code_block.cre)
createdBy = Output(code_block.cre)
lastEditedBy = Output(code_block.cha)
