# Dynamo custom node ElementTagInView.dyf "© Element.TagInView" (Dynamo 2.16.2.5624)
# category: Crumple.Revit.Create
# Given a set of controls, tags elements in a view. All inputs will lace longest based on the element input count.

element = Input(element: var[]..[])
point = Input(point: var[]..[])
view = Input(view: var[]..[])
tagType = Input(tagType: var[]..[])
angle = Input(angle: var[]..[] = 0)
python_script = Python(IN[0]=element, IN[1]=point, IN[2]=view, IN[3]=tagType, IN[4]=angle)  # CPython3
# ---------- python_script.python (86 lines) ----------
# Made by Gavin Crump
# Free for use
# BIM Guru, www.bimguru.com.au

# Boilerplate text
import clr
import math

clr.AddReference("RevitNodes")
import Revit
clr.ImportExtensions(Revit.Elements)
clr.ImportExtensions(Revit.GeometryConversion)

clr.AddReference("RevitServices")
import RevitServices
from RevitServices.Persistence import DocumentManager 
from RevitServices.Transactions import TransactionManager 

clr.AddReference("RevitAPI")
import Autodesk 
from Autodesk.Revit.DB import IndependentTag, Reference, TagOrientation
# Current doc/app/ui
doc = DocumentManager.Instance.CurrentDBDocument

# Define list/unwrap list functions
def tolist(input):
    result = input if isinstance(input, list) else [input]
    return result

def uwlist(input):
    result = input if isinstance(input, list) else [input]
    return UnwrapElement(result)

def objOrList(input):
    if isinstance(input, list) and len(input) == 1:
        return input[0]
    else:
        return input

def matchLength(list1, list2):
    len1 = len(list1)
    len2 = len(list2)
    if len1 == len2:
        return list1
    elif len1 > len2:
        return list1[:len2]
    else:
        for i in range(0, len2-len1, 1):
            list1.append(list1[-1])
        return list1

def angleToOrientation(angle):
    if angle % 180 == 0:
        return TagOrientation.Horizontal
    elif angle % 90 == 0:
        return TagOrientation.Vertical
    else:
        return TagOrientation.AnyModelDirection

# Preparing input from dynamo to revit
elements = uwlist(IN[0])
points = matchLength(tolist(IN[1]),elements)
views = matchLength(uwlist(IN[2]),elements)
tagTypes = matchLength(uwlist(IN[3]),elements)
angles = matchLength(tolist(IN[4]),elements)

# Do some action in a Transaction
toRads = math.pi/180
tags = []

TransactionManager.Instance.EnsureInTransaction(doc)

for e, p, v, t, a in zip(elements, points, views, tagTypes, angles):
    try:
        orientation = angleToOrientation(a)
        tag = IndependentTag.Create(doc, t.Id, v.Id, Reference(e), False, orientation, p.ToXyz())
        if orientation == TagOrientation.AnyModelDirection:
            tag.RotationAngle = angle * toRads
        tags.append(tag)
    except:
        tags.append(None)

TransactionManager.Instance.TransactionTaskDone()

# Preparing output to Dynamo
OUT = objOrList(tags)
# ----------------------------------------
tag = Output(python_script)
