# Dynamo custom node ElementTaggedInView.dyf "© Element.TaggedInView" (Dynamo 2.16.2.5624)
# category: Crumple.Revit.Query
# Returns if an element is tagged in the given view.

element = Input(element: var[]..[])
view = Input(view: Revit.Elements.Views.View)
python_script = Python(IN[0]=element, IN[1]=view)  # CPython3
# ---------- python_script.python (48 lines) ----------
# Made by Gavin Crump
# Free for use
# BIM Guru, www.bimguru.com.au

# Boilerplate text
import clr

clr.AddReference("RevitServices")
import RevitServices
from RevitServices.Persistence import DocumentManager

clr.AddReference("RevitAPI")
import Autodesk 
from Autodesk.Revit.DB import FilteredElementCollector, IndependentTag

# Current doc/app/ui
doc = DocumentManager.Instance.CurrentDBDocument

# Define list/unwrap list functions
def uwlist(input):
    result = input if isinstance(input, list) else [input]
    return UnwrapElement(result)

def objOrList(input):
    if isinstance(input, list) and len(input) == 1:
        return input[0]
    else:
        return input

# Preparing input from dynamo to revit
elements = uwlist(IN[0])
view = UnwrapElement(IN[1])

# Get all tagged Ids
tags = FilteredElementCollector(view.Document, view.Id).OfClass(IndependentTag).WhereElementIsNotElementType().ToElements()

taggedIdsList = []

for t in tags:
    taggedIds = t.GetTaggedLocalElementIds()
    for i in taggedIds:
        if i not in taggedIdsList:
            taggedIdsList.append(i)

isTagged = [e.Id in taggedIdsList for e in elements]

# Preparing output to Dynamo
OUT = objOrList(isTagged)
# ----------------------------------------
taggedInView = Output(python_script)
