# Dynamo custom node ElementTypeByName.dyf "© ElementTypes.ByName" (Dynamo 2.3.1.11775)
# category: Crumple.Revit.Other.Create
# Given an element type name, if it finds a match it will return that element type.
# packages: Crumple 2022.2.13

collect_elementtypes = Custom[© Collect.ElementTypes]()  # package Crumple; Returns all element types and their names in the active document.
name = Input(name: var[]..[])
indexOf = List.IndexOf(list=collect_elementtypes.typeNames, element=name)
getItemAtIndex = List.GetItemAtIndex(list=collect_elementtypes.elementTypes, index=indexOf)
elementType = Output(getItemAtIndex)
