# Dynamo custom node ElementTypes.dyf "© Collect.ElementTypes" (Dynamo 2.3.0.5885)
# category: Crumple.Revit.Query
# Returns all element types and their names in the active document.

refresh = Input(refresh: bool = true)
python_script = Python(IN[0]=refresh)
# ---------- python_script.python (20 lines) ----------
# This is all from the Clockwork package (document.elementtypes)
# All credit for this part of the script goes to the author

import clr
clr.AddReference('RevitAPI')
from Autodesk.Revit.DB import *
import Autodesk
clr.AddReference('RevitNodes')
import Revit
clr.ImportExtensions(Revit.Elements)
import System.Reflection
import System.AppDomain

rAssembly = [x for x in System.AppDomain.CurrentDomain.GetAssemblies() if x.GetName().Name == 'RevitAPI'][0]
rElement = [x for x in rAssembly.GetTypes() if x.Name == 'Element' and x.Namespace == 'Autodesk.Revit.DB'][0]

etypes = [x for x in rAssembly.GetTypes() if x.IsClass and x.IsSubclassOf(rElement)]
enames = [t.Name for t in etypes]

OUT = [etypes, enames]
# ----------------------------------------
code_block = CodeBlock(out=python_script) { out[0]; out[1]; }
sortByKey = List.SortByKey(list=code_block.out0, keys=code_block.out1)
elementTypes = Output(sortByKey.sorted_list)
typeNames = Output(sortByKey.sorted_keys)
