# Dynamo custom node ElementTypesByName.dyf "🐍 ElementTypes.ByName" (Dynamo 2.12.1.8246)
# category: Crumple.IronPython.Query
# Given an element type name, if it finds a match it will return that element type.
# packages: Crumple 2022.2.13

code_block = CodeBlock { null; }
collect_elementtypes = Custom[© Collect.ElementTypes]()  # package Crumple; Returns all element types and their names in the active document.
addItemToEnd = List.AddItemToEnd(item=code_block, list=collect_elementtypes.elementTypes)
typeNames = Input(typeNames: var[]..[])
indexOf = List.IndexOf(list=collect_elementtypes.typeNames, element=typeNames)
code_block_2 = CodeBlock(t=addItemToEnd, i=indexOf) { t[i]; }
elementTypes = Output(code_block_2)
