# Dynamo custom node ElementView.dyf "© ElementView" (Dynamo 2.3.1.11775)
# category: Crumple.Revit.Elements
# Returns the owner view of an element, if any. Typically only works for view specific elements.

elements = Input(elements: var[]..[])
python_script = Python(IN[0]=elements)
# ---------- python_script.python (30 lines) ----------
# Made by Gavin Crump
# Free for use
# BIM Guru, www.bimguru.com.au

# Boilerplate text
import clr

clr.AddReference("RevitAPI")
import Autodesk 
from Autodesk.Revit.DB import *

# Define list/unwrap list functions
def uwlist(input):
    result = input if isinstance(input, list) else [input]
    return UnwrapElement(result)

# Preparing input from dynamo to revit
elements = uwlist(IN[0])
owners = []

# Find view if any
for e in elements:
	if hasattr(e, "OwnerViewId"):
		ov = e.Document.GetElement(e.OwnerViewId)
		owners.append(ov)
	else:
		owners.append(None)

# Preparing output to Dynamo
OUT = owners
# ----------------------------------------
views = Output(python_script)
