# Dynamo custom node ElementWorksets.dyf "© ElementWorksets" (Dynamo 2.3.0.5885)
# category: Crumple.Revit.Elements
# Given a list of elements, return their associated workset, its name and a unique list of workset names belonging to that list of elements.

elements = Input(elements: var[]..[])  # Elements to inspect.
python_script = Python(IN[0]=elements)
# ---------- python_script.python (33 lines) ----------
# Made by Gavin Crump
# Free for use
# BIM Guru, www.bimguru.com.au

# Boilerplate text
import clr

clr.AddReference('RevitAPI')
from Autodesk.Revit.DB import *

clr.AddReference("RevitServices")
import RevitServices
from RevitServices.Persistence import DocumentManager

# Current doc/app/ui
doc = DocumentManager.Instance.CurrentDBDocument

# Preparing input from dynamo to revit
eles = IN[0] if isinstance(IN[0], list) else [IN[0]]

worksets, names = [],[]

# Get element workset properties
for e in eles:
	id = UnwrapElement(e).WorksetId
	workset = doc.GetWorksetTable().GetWorkset(id)
	worksets.append(workset)
	names.append(workset.Name)

unique = set(names)

# Preparing output to Dynamo
OUT = [worksets, names, unique]
# ----------------------------------------
code_block = CodeBlock(data=python_script) { wkst = data[0]; nams = data[1]; ids = data[2]; }
worksets = Output(code_block.wkst)  # The element worksets.
names = Output(code_block.nams)  # The workset names.
unique = Output(code_block.ids)  # The workset Ids.
