# Dynamo custom node ElementsById.dyf "© Elements.ById" (Dynamo 2.12.1.8246)
# category: Crumple.Revit.Actions
# Given an Element Id as an integer, returns the corresponding element in Revit.
# packages: Crumple 2022.5.27

elementIds = Input(elementIds: var[]..[])  # The element's Id as an integer, string or ElementId object.
docOrLink = Input(docOrLink: var[]..[] = null)  # Uses current if none provided. Accepts document or link instance.
revit_getdocument = Custom[© Revit.GetDocument](docOrLink=docOrLink)  # package Crumple; If no input is specified or an invalid one is, returns current document. If a link instance is provided, it returns the linked document. If a document is provided it will pass it through.
python_script = Python(IN[0]=elementIds, IN[1]=revit_getdocument.document)  # IronPython2
# ---------- python_script.python (54 lines) ----------
# Made by Gavin Crump
# Free for use
# BIM Guru, www.bimguru.com.au

# Boilerplate text
import clr

clr.AddReference("RevitServices")
import RevitServices
from RevitServices.Persistence import DocumentManager 

clr.AddReference("RevitAPI")
import Autodesk 
from Autodesk.Revit.DB import *

# Current doc/app/ui
doc = IN[1]

# Define list/unwrap list functions
def tolist(input):
    result = input if isinstance(input, list) else [input]
    return result

def objOrList(input):
    if isinstance(input, list) and len(input) == 1:
        return input[0]
    else:
        return input

# Preparing input from dynamo to revit
ids = tolist(IN[0])
elements = []

# For each id...
for id in ids:
	# Try to force it to a integer
	try:
		id = int(id)
	except:
		pass
	# Try to make it an element Id
	try:
		id = ElementId(id)
	except:
		pass
	# Try to get the element
	try:
		ele = doc.GetElement(id)
		elements.append(ele)
	except:
		elements.append(None)

# Preparing output to Dynamo
OUT = objOrList(elements)
# ----------------------------------------
elements = Output(python_script)  # Matching Revit elements found, if any.
