# Dynamo custom node ElementsByUniqueId.dyf "© Elements.ByUniqueID" (Dynamo 2.12.1.8246)
# category: Crumple.Revit.Actions
# Given a Unique Id as a string, returns the corresponding element in Revit.

uniqueId = Input(uniqueId: string)  # The element's Unique Id as a string.
code_block = CodeBlock(elemId=uniqueId) { Revit.Elements.ElementSelector.ByUniqueId(elemId); }
elements = Output(code_block)  # Matching Revit elements found, if any.
