# Dynamo custom node ElementsCentroid.dyf "© Elements.Centroid" (Dynamo 2.12.1.8246)
# category: Crumple.Revit.Query
# Returns the centroid of the element's axis-aligned bounding box.

element = Input(element: Revit.Elements.Element)  # Model element(s). Element bounding box will be used to determine the centroid. NB: Axis aligned
boundingBox = Element.BoundingBox(element=element)
code_block = CodeBlock(bb=boundingBox)
# ---------- code_block.designscript (4 lines) ----------
bbMax = Autodesk.DesignScript.BoundingBox.MaxPoint(bb);
bbMin = Autodesk.DesignScript.BoundingBox.MinPoint(bb);

Point.ByCoordinates((bbMin.X + bbMax.X)/2, (bbMin.Y + bbMax.Y)/2, (bbMin.Z + bbMax.Z)/2);
# ----------------------------------------
centroidPoint = Output(code_block.out2)  # Element BB Centroid as point.
