# Dynamo custom node ElementsCheckoutStatus.dyf "© Elements.CheckoutStatus" (Dynamo 2.3.1.11775)
# category: Crumple.Revit.Query
# Given an element or list of elements, returns whether they are checked out currently.

elements = Input(elements: var[]..[])
python_script = Python(IN[0]=elements)
# ---------- python_script.python (43 lines) ----------
# Made by Gavin Crump
# Free for use
# BIM Guru, www.bimguru.com.au

# Boilerplate text
import clr

clr.AddReference("RevitServices")
import RevitServices
from RevitServices.Persistence import DocumentManager 

clr.AddReference("RevitAPI")
import Autodesk 
from Autodesk.Revit.DB import *

# Current doc/app/ui
doc = DocumentManager.Instance.CurrentDBDocument

# Define list/unwrap list functions
def uwlist(input):
    result = input if isinstance(input, list) else [input]
    return UnwrapElement(result)

# Preparing input from dynamo to revit
uw_list  = uwlist(IN[0])

status,checkedOut = [],[]

# Do some action in a Transaction
if doc.IsWorkshared:

	for e in uw_list:
		cs = WorksharingUtils.GetCheckoutStatus(doc,e.Id).ToString()
		status.append(cs)
		checkedOut.append(cs != "OwnedByOtherUser")
else:
	
	for e in uw_list:
		status.append("Non-workshared")
		checkedOut.append(True)

# Preparing output to Dynamo
OUT = [status,checkedOut]
# ----------------------------------------
code_block = CodeBlock(x=python_script) { x[0]; x[1]; }
checkoutStatus = Output(code_block.out0)
editableByYou = Output(code_block.out1)
