# Dynamo custom node ElementsClosestLevel.dyf "© Elements.ClosestLevel" (Dynamo 2.3.0.5885)
# category: Crumple.Revit.Query
# For a list of points, returns the nearest level as well as the pulled point at the plane of the level. If you force the values to be below, it is recommended to apply some tolerance when you are analyzing elements at or just below the level you want them to be associated to.

levels = Input(levels: var[]..[])  # A list of levels to use in the study. Any levels not present here will not be considered.
points = Input(points: var[]..[])  # Points for testing. Suggest using the 'Element.Centroid' node in combination.
code_block = CodeBlock(pnt=points) { pnt.X; pnt.Y; pnt.Z; }
elevation = Level.Elevation(level=levels)
tolerance = Input(tolerance: double = 0)  # Applies a tolerance to the base of the study. This is typically needed for points at or just under floor level.
code_block_2 = CodeBlock(elev=elevation, tol=tolerance) { elev - tol; }
forceDown = Input(forceDown: bool = false)  # Forces points to only consider levels below them, even if they could be rounded up.
python_script = Python(IN[0]=code_block.out2, IN[1]=code_block_2, IN[2]=forceDown)
# ---------- python_script.python (39 lines) ----------
# Made by Gavin Crump
# Free for use
# BIM Guru, www.bimguru.com.au

# Declare inputs, ensure values and range are iterable
values_in = IN[0] if isinstance(IN[0], list) else [IN[0]]
range_in  = IN[1] if isinstance(IN[0], list) else [IN[1]]
forcedown = IN[2]

# Define function for finding closest number
# Note we find absolute value, then find the floor later on
def closest(list, number):
	diff = []
	for i in list:
		diff.append(abs(number-i))
	return diff.index(min(diff))

# Build empty lists
indices = []
values_out  = []

# Test all values on the range using our function 'closest'
for i in values_in:
	index = closest(range_in, i)
	# Test if the value is under the nearest
	if i - range_in[index] >= 0 and forcedown == False:
		indices.append(index)
		values_out.append(range_in[index])
	else:
		# Test if the value is the first item (can't reduce index)
		if index != 0:
			indices.append(index-1)
			values_out.append(range_in[index-1])
		else:
			indices.append(0)
			values_out.append(range_in[0])

# Outputs
OUT = [values_out, indices]
# ----------------------------------------
code_block_3 = CodeBlock(X=python_script, tol=tolerance) { X[1]; X[0]+tol; }
getItemAtIndex = List.GetItemAtIndex(list=levels, index=code_block_3.out0)
nearestLevel = Output(getItemAtIndex)  # Nearest level to the point(s).
byCoordinates = Point.ByCoordinates(x=code_block.out0, y=code_block.out1, z=code_block_3.out1)
pointAtLevel = Output(byCoordinates)  # Point(s) pulled to the level's reference plane.
