# Dynamo custom node ElementsDelete.dyf "© Elements.Delete" (Dynamo 2.3.0.5885)
# category: Crumple.Revit.Create
# Given a list of elements, attempt to delete them and then return true or false depending on whether it could be deleted. This script flattens the list structure before attempting.

elements = Input(elements: var[]..[])
flatten = List.Flatten(list=elements)
python_script = Python(IN[0]=flatten)
# ---------- python_script.python (46 lines) ----------
# Made by Gavin Crump
# Free for use
# BIM Guru, www.bimguru.com.au

# Boilerplate text
import clr

clr.AddReference("RevitServices")
import RevitServices
from RevitServices.Persistence import DocumentManager
from RevitServices.Transactions import TransactionManager

clr.AddReference("RevitAPI")
import Autodesk
from Autodesk.Revit.DB import *

doc = DocumentManager.Instance.CurrentDBDocument

# Define list/unwrap list functions
def uwlist(input):
    result = input if isinstance(input, list) else [input]
    return UnwrapElement(input)

#unwrap all elements to use with API
elements = uwlist(IN[0])

# Check and delete
TransactionManager.Instance.EnsureInTransaction(doc)

results,fails = [],[]

for e in elements:
	id = None
	try:
		id = e.Id
		del_id = doc.Delete(id)
		results.append(True)
	except:
		if id is not None:
			fails.append(e)		
		results.append(False)

TransactionManager.Instance.TransactionTaskDone()
   
# Result of transaction
OUT = [results,fails]
# ----------------------------------------
code_block = CodeBlock(out=python_script) { results = out[0]; fails = out[1]; }
results = Output(code_block.results)
failed = Output(code_block.fails)
