# Dynamo custom node ElementsEditable.dyf "© Elements.Editable" (Dynamo 2.12.1.8246)
# category: Crumple.Revit.Query
# Given an element or list of elements, returns whether they are editable.

elements = Input(elements: var[]..[])
python_script = Python(IN[0]=elements)  # IronPython2
# ---------- python_script.python (57 lines) ----------
# Made by Gavin Crump
# Free for use
# BIM Guru, www.bimguru.com.au

# Boilerplate text
import clr

clr.AddReference("RevitServices")
import RevitServices
from RevitServices.Persistence import DocumentManager 

clr.AddReference("RevitAPI")
import Autodesk 
from Autodesk.Revit.DB import CheckoutStatus, ModelUpdatesStatus, WorksharingUtils

# Current doc/app/ui
doc = DocumentManager.Instance.CurrentDBDocument

# Constants
OWNED_BYOTHERS = CheckoutStatus.OwnedByOtherUser
OWNED_BYME     = CheckoutStatus.OwnedByCurrentUser
UPDATE_CURRENT = ModelUpdatesStatus.CurrentWithCentral

# Define list/unwrap list functions
def uwlist(input):
    result = input if isinstance(input, list) else [input]
    return UnwrapElement(result)

def objOrList(input, initial = IN[0]):
	if isinstance(initial, list):
		return input
	else:
		return input[0]

def isEditable(element, myDoc = doc):
	checkout_status = WorksharingUtils.GetCheckoutStatus(myDoc, element.Id)
	update_status = WorksharingUtils.GetModelUpdatesStatus(myDoc, element.Id)
	# If owned by another user, it isn't editable
	if checkout_status == OWNED_BYOTHERS:
		return False
	# If owned by us, it is editable
	elif checkout_status == OWNED_BYME:
		return True
	# Otherwise, if it is current, it is editable
	else:
		return update_status == UPDATE_CURRENT

# Preparing input from dynamo to revit
elements = uwlist(IN[0])

status,checkedOut = [],[]

# Do some action in a Transaction
if doc.IsWorkshared:
	OUT = objOrList([isEditable(e) for e in elements])
else:
	OUT = objOrList([True for e in elements])
# ----------------------------------------
editableByYou = Output(python_script)
