# Dynamo custom node ElementsGetParameterValueByName.dyf "© Elements.GetParameterValueByName" (Dynamo 2.16.2.5624)
# category: Crumple.Revit.Query
# Returns the value of a parameter if found by instance or type.

parameterName = Input(parameterName: string)
getParameterValueByName = Element.GetParameterValueByName(parameterName=parameterName)  # unwired: element
element = Input(element: var[]..[])
python_script = Python(IN[0]=element, IN[1]=parameterName)  # CPython3
# ---------- python_script.python (48 lines) ----------
# Made by Gavin Crump
# Free for use
# BIM Guru, www.bimguru.com.au

# Boilerplate text
import clr



# Define list/unwrap list functions
def uwlist(input):
    result = input if isinstance(input, list) else [input]
    return UnwrapElement(result)

def objOrList(input):
    if isinstance(input, list) and len(input) == 1:
        return input[0]
    else:
        return input

# Preparing input from dynamo to revit
elements = uwlist(IN[0])
parameterName = IN[1]

# Get types
outElements, source = [],[]

for e in elements:
    parameter = e.LookupParameter(parameterName)
    if parameter is not None:
        outElements.append(e)
        source.append("Instance")
    else:
        try:
            et = e.Document.GetElement(e.GetTypeId())
            parameter = et.LookupParameter(parameterName)
            if parameter is not None:
                outElements.append(et)
                source.append("Type")
            else:
                outElements.append(None)
                source.append("Not found")
        except:
            outElements.append(None)
            source.append("Not found")

# Preparing output to Dynamo
OUT = objOrList(outElements), objOrList(source)
# ----------------------------------------
code_block = CodeBlock(x=python_script) { x[0]; x[1]; }
function_apply = ApplyFunction(function=getParameterValueByName, argument0=code_block.out0)
value = Output(function_apply)
valueSource = Output(code_block.out1)
