# Dynamo custom node ElementsHandFlipped.dyf "© Elements.HandFlipped" (Dynamo 2.12.1.8246)
# category: Crumple.Revit.Query
# Returns true if an element has been hand flipped. If the element has been face flipped also, it will return false (as the element is technically not hand flipped in this case).

element = Input(element: var[]..[])  # Model element(s). Should be family instances.
python_script = Python(IN[0]=element)  # CPython3
# ---------- python_script.python (33 lines) ----------
# Made by Gavin Crump
# Free for use
# BIM Guru, www.bimguru.com.au

# Boilerplate text
import clr

# Define list/unwrap list functions
def uwlist(input):
    result = input if isinstance(input, list) else [input]
    return UnwrapElement(input)

def objOrList(input, initial = IN[0]):
	if isinstance(initial, list):
		return input
	else:
		return input[0]

# Preparing input from dynamo to revit
uw_list  = uwlist(IN[0])

flips = []

for i in uw_list:
	try:
		flip = 1 if i.HandFlipped else 0
		face = 1 if i.FacingFlipped else 0	
		flips.append(flip+face == 1)
	except:
		flips.append(None)

# Preparing output to Dynamo
OUT = objOrList(flips)
# ----------------------------------------
handFlipped = Output(python_script)  # True if hand flipped.
