# Dynamo custom node ElementsIsolate.dyf "© ElementsIsolate" (Dynamo 2.3.0.5885)
# category: Crumple.Revit.Elements
# Given a list of elements and a view (optional), will temporarily isolate them. If no view is provided, the active view will be used.

elements = Input(elements: var[]..[])
view = Input(view: var = null)
python_script = Python(IN[0]=elements, IN[1]=view)
# ---------- python_script.python (50 lines) ----------
# Made by Gavin Crump
# Free for use
# BIM Guru, www.bimguru.com.au

# Boilerplate text
import clr

import System
from System import Array
from System.Collections.Generic import *

clr.AddReference("RevitServices")
import RevitServices
from RevitServices.Persistence import DocumentManager 
from RevitServices.Transactions import TransactionManager 

clr.AddReference("RevitAPI")
import Autodesk 
from Autodesk.Revit.DB import *

# Current doc/app/ui
doc = DocumentManager.Instance.CurrentDBDocument

# Define list/unwrap list functions
def uwlist(input):
    result = input if isinstance(input, list) else [input]
    return UnwrapElement(result)

# Preparing input from dynamo to revit
elements = uwlist(IN[0])
idlist = List[ElementId]()

for e in elements:
	idlist.Add(e.Id)

if IN[1] == None:
	isoView = doc.ActiveView
else:
	isoView = UnwrapElement(IN[1])

# Do some action in a Transaction
TransactionManager.Instance.EnsureInTransaction(doc)

if len(elements) > 0:
	isoView.IsolateElementsTemporary(idlist)

TransactionManager.Instance.TransactionTaskDone()

# Preparing output to Dynamo
OUT = elements
# ----------------------------------------
elements_2 = Output(python_script)  # "elements"
