# Dynamo custom node ElementsIsolateInView.dyf "© Elements.IsolateInView" (Dynamo 2.12.1.8246)
# category: Crumple.Revit.Actions
# Given a list of elements and a view (optional), will temporarily isolate them. If no view is provided, the active view will be used.

elements = Input(elements: var[]..[])
view = Input(view: var = null)
python_script = Python(IN[0]=elements, IN[1]=view)  # CPython3
# ---------- python_script.python (55 lines) ----------
# Made by Gavin Crump
# Free for use
# BIM Guru, www.bimguru.com.au

# Boilerplate text
import clr

import System
from System.Collections.Generic import List

clr.AddReference("RevitServices")
import RevitServices
from RevitServices.Persistence import DocumentManager 
from RevitServices.Transactions import TransactionManager 

clr.AddReference("RevitAPI")
import Autodesk 
from Autodesk.Revit.DB import ElementId

# Current doc/app/ui
doc = DocumentManager.Instance.CurrentDBDocument

# Define list/unwrap list functions
def uwlist(input):
    result = input if isinstance(input, list) else [input]
    return UnwrapElement(result)

def objOrList(input, initial = IN[0]):
	if isinstance(initial, list):
		return input
	else:
		return input[0]

# Preparing input from dynamo to revit
elements = uwlist(IN[0])
idlist   = List[ElementId]()

for e in elements:
	idlist.Add(e.Id)

if IN[1] == None:
	isoView = doc.ActiveView
else:
	isoView = UnwrapElement(IN[1])

# Do some action in a Transaction
TransactionManager.Instance.EnsureInTransaction(doc)

if len(elements) > 0:
	isoView.IsolateElementsTemporary(idlist)

TransactionManager.Instance.TransactionTaskDone()

# Preparing output to Dynamo
OUT = objOrList(elements)
# ----------------------------------------
elements_2 = Output(python_script)  # "elements"
