# Dynamo custom node ElementsOwners.dyf "© Elements.Owners" (Dynamo 2.12.1.8246)
# category: Crumple.Revit.Query
# Returns the creator, owner and last editor of an element in a workshared model if possible.

elements = Input(elements: var[]..[])
python_script = Python(IN[0]=elements)  # IronPython2
# ---------- python_script.python (40 lines) ----------
# Made by Gavin Crump
# Free for use
# BIM Guru, www.bimguru.com.au

# Boilerplate text
import clr

clr.AddReference("RevitAPI")
import Autodesk 
from Autodesk.Revit.DB import WorksharingUtils

# Define list/unwrap list functions
def uwlist(input):
    result = input if isinstance(input, list) else [input]
    return UnwrapElement(result)

def objOrList(input, initial = IN[0]):
	if isinstance(initial, list):
		return input
	else:
		return input[0]

# Preparing input from dynamo to revit
elements = uwlist(IN[0])
wsu_creator, wsu_owner, wsu_change = [],[],[]

# Find last used and creator
for e in elements:
	try:
		wsu = WorksharingUtils.GetWorksharingTooltipInfo(e.Document, e.Id)
		wsu_creator.append(wsu.Creator)
		wsu_owner.append(wsu.Owner)
		wsu_change.append(wsu.LastChangedBy)
	except:
		wsu_creator.append(None)
		wsu_owner.append(None)
		wsu_change.append(None)

# Preparing output to Dynamo
OUT = [objOrList(o) for o in [wsu_creator, wsu_owner, wsu_change]]
# ----------------------------------------
code_block = CodeBlock(x=python_script) { cre = x[0]; own = x[1]; cha = x[2]; }
ownedBy = Output(code_block.cre)
createdBy = Output(code_block.cre)
lastEditedBy = Output(code_block.cha)
