# Dynamo custom node ElementsPainted.dyf "© Elements.Painted" (Dynamo 2.12.1.8246)
# category: Crumple.Revit.Query
# For an element or list of elements returns if that element is painted and the painted surface count.

elements = Input(elements: var[]..[])
python_script = Python(IN[0]=elements)  # IronPython2
# ---------- python_script.python (53 lines) ----------
# Made by Gavin Crump
# Free for use
# BIM Guru, www.bimguru.com.au

# Boilerplate text
import clr

clr.AddReference("RevitAPI")
import Autodesk 
from Autodesk.Revit.DB import Options

# Define list/unwrap list functions
def uwlist(input):
    result = input if isinstance(input, list) else [input]
    return UnwrapElement(result)

def objOrList(input, initial = IN[0]):
	if isinstance(initial, list):
		return input
	else:
		return input[0]

# Preparing input from dynamo to revit
elements = uwlist(IN[0])
gOpts = Options()
paintlist,paintcounts = [],[]

# Do some action in a Transaction
for e in elements:
	count = 0
	geom = e.get_Geometry(gOpts)
	doc = e.Document
	for g in geom:
		try:
			ele_faces = g.Faces
			for f in ele_faces:
				if f.HasRegions:
					regions = f.GetRegions()
					for r in regions:
						if doc.IsPainted(e.Id, r):
							count += 1		
				if doc.IsPainted(e.Id, f):
					count += 1	
		except:
			pass
	paintcounts.append(count)
	if count > 0:
		paintlist.append(True)
	else:
		paintlist.append(False)

# Preparing output to Dynamo
OUT = objOrList(paintlist), objOrList(paintcounts)
# ----------------------------------------
code_block = CodeBlock(x=python_script) { x[0]; x[1]; }
isPainted = Output(code_block.out0)
faceCount = Output(code_block.out1)
