# Dynamo custom node ElementsPopulate.dyf "© Elements.Populate" (Dynamo 2.3.0.5885)
# category: Crumple.Revit.Create
# Distributes points randomly amongst the bounding box of an element.

element = Input(element: var[]..[])  # Element to populate. The bounding box of the element will be used.
count = Input(count: int = 1)  # The number of points to generate.
seed = Input(seed: int = 1)  # The seed of randomisation.
python_script = Python(IN[0]=element, IN[1]=count, IN[2]=seed)
# ---------- python_script.python (51 lines) ----------
# Made by Gavin Crump
# Free for use
# BIM Guru, www.bimguru.com.au

# Boilerplate text
import clr

clr.AddReference("RevitNodes")
import Revit
clr.ImportExtensions(Revit.Elements)
clr.ImportExtensions(Revit.GeometryConversion)

clr.AddReference("RevitAPI")
from Autodesk.Revit.DB import *

# Import random package
from random import seed
from random import random

# Preparing input from dynamo to revit
ele    = UnwrapElement(IN[0])
rcount = IN[1]
rseed  = IN[2]

# Process element bounding box
bb = ele.get_BoundingBox(None)
bbmin = bb.Min.ToPoint()
bbmax = bb.Max.ToPoint()

bbminx = bbmin.X
bbminy = bbmin.Y
bbminz = bbmin.Z

bbxrng = bbmax.X - bbminx
bbyrng = bbmax.Y - bbminy
bbzrng = bbmax.Z - bbminz

# Generate random XYZ values
xvals, yvals, zvals = [], [], []

for i in range(rcount):
	xval, yval, zval = random(), random(), random()
	xout = bbminx + (xval * bbxrng)
	yout = bbminy + (yval * bbyrng)
	zout = bbminz + (zval * bbzrng)
	xvals.append(xout)
	yvals.append(yout)
	zvals.append(zout)

# Preparing output to Dynamo
OUT = [xvals, yvals, zvals]
# ----------------------------------------
code_block = CodeBlock(lst=python_script) { x = lst[0]; y = lst[1]; z = lst[2]; }
byCoordinates = Point.ByCoordinates(x=code_block.x, y=code_block.y, z=code_block.z)
points = Output(byCoordinates)
