# Dynamo custom node ElementsQuarantine.dyf "© Elements.Quarantine" (Dynamo 2.12.1.8246)
# category: Crumple.Revit.Actions
# Given a list of element lists, exclude elements that wont comply with a given separation from one another. The node will return (one of) the most best possible outcomes for that group of elements.

elementClusters = Input(elementClusters: var[]..[])  # Elements to separate, in the format of a list of lists.
minSeparation = Input(minSeparation: int = 1500)  # The minimum separation.
# note: Credit to Cyril Poupin for contributing the below Python code
# Shared here via the package for others to use :)
# LINKS
# https://forum.dynamobim.com/u/c.poupin
# https://forum.dynamobim.com/t/covid-chair-spacing-iteration-challenge/57031/6
python_script = Python(IN[0]=elementClusters, IN[1]=minSeparation)  # IronPython2
# ---------- python_script.python (89 lines) ----------
# Credit to Cyril Poupin for contributing the below Python code
# Shared here via the package for others to use :)

# ORIGINAL THREAD AND USER PROFILE OF C.POUPIN
# https://forum.dynamobim.com/u/c.poupin
# https://forum.dynamobim.com/t/covid-chair-spacing-iteration-challenge/57031/6

# Thanks also to Vikram Subbaiah for his Design script alternative
# https://forum.dynamobim.com/u/Vikram_Subbaiah

# Boilerplate
import clr
clr.AddReference('ProtoGeometry')
from Autodesk.DesignScript.Geometry import *

clr.AddReference("RevitServices")
import RevitServices
from RevitServices.Persistence import DocumentManager 

# Current doc/app/ui
doc = DocumentManager.Instance.CurrentDBDocument
# Get app version
uiapp = DocumentManager.Instance.CurrentUIApplication 
app = uiapp.Application
rvt_year = int(app.VersionNumber)

# Imports by version
clr.AddReference("RevitAPI")
import Autodesk 

if rvt_year < 2022:
	from Autodesk.Revit.DB import UnitType, UnitUtils, DisplayUnitType
else:
	from Autodesk.Revit.DB import SpecTypeId, UnitUtils

# Function: Convert from project to internal
def projectToInternal(val, ver = rvt_year, myDoc = doc):
	if rvt_year < 2022:
		intUnits = myDoc.GetUnits().GetFormatOptions(UnitType.UT_Length).DisplayUnits
		return UnitUtils.Convert(val, intUnits, DisplayUnitType.DUT_DECIMAL_FEET)
	else:
		intUnitsId = myDoc.GetUnits().GetFormatOptions(SpecTypeId.Length).GetUnitTypeId()
		return UnitUtils.ConvertToInternalUnits(val, intUnitsId)

# Function for reviewing chairs
def nextSpaceChair(group = [], elemA = None, startIdx = 0):
    global margin
    group = list(group)
    if elemA is None: 
        elemA = group.pop(startIdx)
        return [elemA] + nextSpaceChair(group, elemA)
    else:   
        locPt = elemA.Location.Point
        lstPair = [[x, x.Location.Point.DistanceTo(locPt)] for x in group if x.Location.Point.DistanceTo(locPt) > margin]
        lstPair.sort(key = lambda x : x[1])
        if len(lstPair) > 0:
            #get the nearest chair >= 1.50m
            nearElem = lstPair[0][0]
            #get the rest
            group = [x[0] for x in lstPair[1:] ]
            return [nearElem] + nextSpaceChair(group = group, elemA = nearElem )
        else:
            return []   

# Force into a list of lists
clusters = UnwrapElement(IN[0])
margin   = projectToInternal(IN[1])

# Force list structure
try:
	clusters[0][0]
except:
	try:
		clusters[0]
		clusters = [clusters]
	except:
		clusters = [[clusters]]

# Build outputs
out = []

for g in clusters:
    # test with change first element, for each chair in group
    testLst = [nextSpaceChair(group = g, elemA = None, startIdx = i) for i in range(len(g))]
    maxlst = max(testLst, key = len)
    out.append(maxlst)

# Declare output
OUT = out
# ----------------------------------------
elementGroups = Output(python_script)  # Best configuration.
