# Dynamo custom node ElementsRename.dyf "© ElementsRename" (Dynamo 2.3.1.11775)
# category: Crumple.Revit.Elements
# For an element or list of elements, attempt to set the value of a given parameter (by default Name).

elements = Input(elements: var[]..[])
values = Input(values: var[]..[])
parameterName = Input(parameterName: string = "Name")
python_script = Python(IN[0]=elements, IN[1]=values, IN[2]=parameterName)
# ---------- python_script.python (73 lines) ----------
# Made by Gavin Crump
# Free for use
# BIM Guru, www.bimguru.com.au

# Boilerplate text
import clr

clr.AddReference("RevitNodes")
import Revit
clr.ImportExtensions(Revit.Elements)

clr.AddReference("RevitServices")
import RevitServices
from RevitServices.Persistence import DocumentManager 
from RevitServices.Transactions import TransactionManager 

clr.AddReference("RevitAPI")
import Autodesk 
from Autodesk.Revit.DB import *

clr.AddReference('System.Core')
from System.Collections.Generic import *

# Current doc/app/ui
doc = DocumentManager.Instance.CurrentDBDocument

# Define list/unwrap list functions
def tolist(input):
    result = input if isinstance(input, list) else [input]
    return result

def uwlist(input):
    result = input if isinstance(input, list) else [input]
    return UnwrapElement(result)

# Preparing input from dynamo to revit
elements = uwlist(IN[0])
names = tolist(IN[1])
param = IN[2]

results,sucess = [],[]

# Do some action in a Transaction
TransactionManager.Instance.EnsureInTransaction(doc)

for e,n in zip(elements,names):
	
	try:
		ename = e.LookupParameter(param)
		eval  = ename.AsString()
	
		if eval != n:

			try:
				e.Name = n
				results.append("SUCCESS: Element renamed")
				sucess.append(True)
			except:
				results.append("ERROR: Element not editable")
				sucess.append(False)
		
		else:
			results.append("ERROR: Name is the same")
			sucess.append(False)
			
	except:
		results.append("ERROR: Parameter by that name not found")
		results.append(False)

TransactionManager.Instance.TransactionTaskDone()

# Preparing output to Dynamo
OUT = [elements,sucess,results]
# ----------------------------------------
code_block = CodeBlock(x=python_script) { x[0]; x[1]; x[2]; }
elements_2 = Output(code_block.out0)  # "elements"
success = Output(code_block.out1)
report = Output(code_block.out2)
