# Dynamo custom node ElementsScopeBoxed.dyf "© Elements.ScopeBoxed" (Dynamo 2.12.1.8246)
# category: Crumple.Revit.Query
# Given an element, will check if a scope box is assigned to it and return it if so.
# packages: Crumple 2022.2.13

elements = Input(elements: var[]..[])
docOrLink = Input(docOrLink: var[]..[] = null)  # Uses current if none provided. Accepts document or link instance.
revit_getdocument = Custom[© Revit.GetDocument](docOrLink=docOrLink)  # package Crumple; If no input is specified or an invalid one is, returns current document. If a link instance is provided, it returns the linked document. If a document is provided it will pass it through.
python_script = Python(IN[0]=elements, IN[1]=revit_getdocument.document)  # IronPython2
# ---------- python_script.python (50 lines) ----------
# Made by Gavin Crump
# Free for use
# BIM Guru, www.bimguru.com.au

# Boilerplate text
import clr

clr.AddReference("RevitAPI")
import Autodesk 
from Autodesk.Revit.DB import FilteredElementCollector, BuiltInCategory

# Current doc/app/ui
doc = IN[1]

# Define list/unwrap list functions
def uwlist(input):
    result = input if isinstance(input, list) else [input]
    return UnwrapElement(result)

def objOrList(input, initial = IN[0]):
	if isinstance(initial, list):
		return input
	else:
		return input[0]

# Preparing input from dynamo to revit
elements = uwlist(IN[0])
allBoxNames, usedBoxes, indBoxes, hasBox = [],[],[],[]

# Get all scope boxes, make them a list and get their names
allBoxes = FilteredElementCollector(doc).OfCategory(BuiltInCategory.OST_VolumeOfInterest)

for s in allBoxes:
	n = s.Name
	allBoxNames.append(n)
	indBoxes.append(s)

# Check if the element has a scope box and return it if so
for e in elements:
	try:
		sn = e.GetParameters("Scope Box")[0].AsValueString()
		si = allBoxNames.index(sn)
		usedBoxes.append(indBoxes[si])
		hasBox.append(True)
	except:
		usedBoxes.append(None)
		hasBox.append(False)

# Preparing output to Dynamo
OUT = objOrList(usedBoxes), objOrList(hasBox)
# ----------------------------------------
code_block = CodeBlock(x=python_script) { x[0]; x[1]; }
scopeBox = Output(code_block.out0)
hasScopeBox = Output(code_block.out1)
