# Dynamo custom node ElementsSelect.dyf "© ElementsSelect" (Dynamo 2.3.0.5885)
# category: Crumple.Revit.Elements
# Given a list of elements, flatten them to a list and select them in the Revit document (if possible).

elements = Input(elements: var[]..[])
flatten = List.Flatten(list=elements)
uniqueItems = List.UniqueItems(list=flatten)
python_script = Python(IN[0]=uniqueItems)
# ---------- python_script.python (41 lines) ----------
# Made by Gavin Crump
# Free for use
# BIM Guru, www.bimguru.com.au

# Boilerplate text
import clr

import System
from System import Array
from System.Collections.Generic import *

clr.AddReference("RevitServices")
import RevitServices
from RevitServices.Persistence import DocumentManager 

clr.AddReference("RevitAPI")
import Autodesk
from Autodesk.Revit.DB import *

# Current doc/app/ui
doc = DocumentManager.Instance.CurrentDBDocument
uiapp = DocumentManager.Instance.CurrentUIApplication 
uidoc = uiapp.ActiveUIDocument

# Define list/unwrap list functions
def uwlist(input):
    result = input if isinstance(input, list) else [input]
    return UnwrapElement(input)

# Preparing input from dynamo to revit
uw_list  = uwlist(IN[0])
elementIds = List[ElementId]()

# Select elements
for e in uw_list:
	elementIds.Add((e).Id)

selection = uidoc.Selection.SetElementIds(elementIds)

# Preparing output to Dynamo
OUT = IN[0]
# ----------------------------------------
code_block = CodeBlock(input=python_script) { input; true; }
wasRun = Output(code_block.out1)
