# Dynamo custom node ElementsSetWorkset.dyf "© Elements.SetWorkset" (Dynamo 2.12.1.8246)
# category: Crumple.Revit.Actions
# Given a workset and a list of elements, attempt to set those elements' worksets to it.

elements = Input(elements: var[]..[])
workset = Input(workset: var[]..[])
python_script = Python(IN[0]=elements, IN[1]=workset)  # IronPython2
# ---------- python_script.python (52 lines) ----------
# Made by Gavin Crump
# Free for use
# BIM Guru, www.bimguru.com.au

# Boilerplate text
import clr

clr.AddReference("RevitAPI")
import Autodesk
from Autodesk.Revit.DB import BuiltInParameter

clr.AddReference("RevitServices")
import RevitServices
from RevitServices.Persistence import DocumentManager 
from RevitServices.Transactions import TransactionManager

# Current doc/app/ui
doc = DocumentManager.Instance.CurrentDBDocument

# Define list/unwrap list functions
def uwlist(input):
    result = input if isinstance(input, list) else [input]
    return UnwrapElement(result)

def objOrList(input, initial = IN[0]):
	if isinstance(initial, list):
		return input
	else:
		return input[0]

# Preparing input from dynamo to revit
elements = uwlist(IN[0])
workset  = UnwrapElement(IN[1])

bools = []

# Do some action in a Transaction
TransactionManager.Instance.EnsureInTransaction(doc)

for e in elements:
	try:
		wsId = workset.Id.IntegerValue
		param = e.get_Parameter(BuiltInParameter.ELEM_PARTITION_PARAM)
		param.Set(wsId)
		bools.append(True)
	except:
		bools.append(False)

TransactionManager.Instance.TransactionTaskDone()

# Preparing output to Dynamo
OUT = objOrList(elements), objOrList(bools)
# ----------------------------------------
code_block = CodeBlock(data=python_script) { data[0]; data[1]; }
elements_2 = Output(code_block.out0)  # "elements"
success = Output(code_block.out1)
