# Dynamo custom node ElementsStatus.dyf "© Elements.Status" (Dynamo 2.12.1.8246)
# category: Crumple.Revit.Query
# Returns the checkout and model update status of elements if the model is workshared.

elements = Input(elements: var[]..[])
python_script = Python(IN[0]=elements)  # CPython3
# ---------- python_script.python (45 lines) ----------
# Made by Gavin Crump
# Free for use
# BIM Guru, www.bimguru.com.au

# Boilerplate text
import clr
import System

clr.AddReference("RevitAPI")
import Autodesk 
from Autodesk.Revit.DB import WorksharingUtils, CheckoutStatus, ModelUpdatesStatus

# Define list/unwrap list functions
def uwlist(input):
    result = input if isinstance(input, list) else [input]
    return UnwrapElement(result)

def objOrList(input, initial = IN[0]):
	if isinstance(initial, list):
		return input
	else:
		return input[0]

# Get enum name
def enumGetName(enum, enumClass):
    return System.Enum.GetName(enumClass,enum)

# Preparing input from dynamo to revit
elements = uwlist(IN[0])

checkout_status, update_status = [],[]

# Do some action in a Transaction
for e in elements:
	doc = e.Document
	if doc.IsWorkshared:
		cs = WorksharingUtils.GetCheckoutStatus(doc, e.Id)
		us = WorksharingUtils.GetModelUpdatesStatus(doc, e.Id)
		checkout_status.append(enumGetName(cs, CheckoutStatus))
		update_status.append(enumGetName(us, ModelUpdatesStatus))
	else:
		checkout_status.append(None)
		update_status.append(None)

OUT = objOrList(checkout_status), objOrList(update_status)
# ----------------------------------------
code_block = CodeBlock(out=python_script) { out[0]; out[1]; }
checkoutStatus = Output(code_block.out0)
modelUpdateStatus = Output(code_block.out1)
