# Dynamo custom node ElementsUnionBox.dyf "© ElementsUnionBox" (Dynamo 2.3.0.5885)
# category: Crumple.Revit.Elements
# Given a list of elements, return the overall bounding box of all those that have a valid bounding box to return.

elements = Input(elements: var[]..[])
boundingBox = Element.BoundingBox(element=elements)
code_block = CodeBlock { false; }
clean = List.Clean(list=boundingBox, preserveIndices=code_block)
code_block_2 = CodeBlock(bbs=clean)
# ---------- code_block_2.designscript (10 lines) ----------
//Get the min and max points for each bb
min = Autodesk.BoundingBox.MinPoint(bbs);
max = Autodesk.BoundingBox.MaxPoint(bbs);

//Find the min and max values, build points from them
min_bb = Autodesk.Point.ByCoordinates(DSCore.List.MinimumItem(min.X),DSCore.List.MinimumItem(min.Y),DSCore.List.MinimumItem(min.Z));
max_bb = Autodesk.Point.ByCoordinates(DSCore.List.MaximumItem(max.X),DSCore.List.MaximumItem(max.Y),DSCore.List.MaximumItem(max.Z));

//Make a new bb by the min/max results
Autodesk.BoundingBox.ByCorners(min_bb, max_bb);
# ----------------------------------------
unionBox = Output(code_block_2.out4)
