# Dynamo custom node ElementsView.dyf "© Elements.View" (Dynamo 2.12.1.8246)
# category: Crumple.Revit.Query
# Returns the owner view of an element, if any. Typically only works for view specific elements.

elements = Input(elements: var[]..[])
python_script = Python(IN[0]=elements)  # IronPython2
# ---------- python_script.python (37 lines) ----------
# Made by Gavin Crump
# Free for use
# BIM Guru, www.bimguru.com.au

# Boilerplate text
import clr

# Define list/unwrap list functions
def uwlist(input):
    result = input if isinstance(input, list) else [input]
    return UnwrapElement(result)

def objOrList(input, initial = IN[0]):
	if isinstance(initial, list):
		return input
	else:
		return input[0]

# Preparing input from dynamo to revit
elements = uwlist(IN[0])
owners, hasView = [],[]

# Find view if any
for e in elements:
	if hasattr(e, "OwnerViewId"):
		ov = e.Document.GetElement(e.OwnerViewId)
		owners.append(ov)
		if ov:
			hasView.append(True)
		else:
			hasView.append(False)
	else:
		owners.append(None)
		hasView.append(False)

# Preparing output to Dynamo
OUT = objOrList(owners), objOrList(hasView)
# ----------------------------------------
code_block = CodeBlock(x=python_script) { x[0]; x[1]; }
ownerViews = Output(code_block.out0)
isViewSpecific = Output(code_block.out1)
