# Dynamo custom node ElevationMarkersByBody.dyf "© Views.CreateElevationMarkers" (Dynamo 2.3.1.11775)
# category: Crumple.Revit.Create
# Given elevation bodies and an equal number of lists of indices between 0 and 3, will activate those markers on that body. Indices are as follows: 0 = Right, 1 = Down, 2 = Left, 3 = Up.

elevBody = Input(elevBody: var[]..[])
indices = Input(indices: var[]..[] = None)
python_script = Python(IN[0]=elevBody, IN[1]=indices)
# ---------- python_script.python (49 lines) ----------
# Made by Gavin Crump
# Free for use
# BIM Guru, www.bimguru.com.au

# Boilerplate text
import clr

clr.AddReference("RevitNodes")
import Revit
clr.ImportExtensions(Revit.Elements)
clr.ImportExtensions(Revit.GeometryConversion)

clr.AddReference("RevitServices")
import RevitServices
from RevitServices.Persistence import DocumentManager 
from RevitServices.Transactions import TransactionManager 

clr.AddReference("RevitAPI")
import Autodesk 
from Autodesk.Revit.DB import *

# Current doc/app/ui
doc = DocumentManager.Instance.CurrentDBDocument

# Define list/unwrap list functions
def uwlist(input):
    result = input if isinstance(input, list) else [input]
    return UnwrapElement(result)

# Preparing input from dynamo to revit
elev_bodies  = uwlist(IN[0])
elev_indices = IN[1]

elev_pointers = []

# Active pointers
TransactionManager.Instance.EnsureInTransaction(doc)

for eb,el in zip(elev_bodies,elev_indices):
	pointers = []
	for i in el:
		ep = eb.CreateElevation(doc, doc.ActiveView.Id, i)
		pointers.append(ep.ToDSType(True))
	elev_pointers.append(pointers)

TransactionManager.Instance.TransactionTaskDone()

# Preparing output to Dynamo
OUT = elev_pointers
# ----------------------------------------
elevMarkers = Output(python_script)
