# Dynamo custom node ExcelExportAsFile.dyf "© Excel.ExportAsFile 🐍" (Dynamo 2.3.1.11775)
# category: Crumple.Application.Actions
# Exports a 2D matrix of data to a new file given a name and directory path. The node automatically adds a xlsx extension to the name. Credit to Cyril Poupin for most of the Python code (details in node body).

diectoryPath = Input(diectoryPath: string)
fileName = Input(fileName: string = "Workbook1")  # Not including the .xlsx extension
sheetName = Input(sheetName: string = "Sheet1")
dataRows = Input(dataRows: var[]..[])
python_script = Python(IN[0]=diectoryPath, IN[1]=fileName, IN[2]=sheetName, IN[3]=dataRows)
# ---------- python_script.python (96 lines) ----------
# Copied and pasted/modified by Gavin Crump
# Free for use (besides any terms by author below)
# BIM Guru, www.bimguru.com.au

# Based mostly on code by Cyril Poupin
# https://github.com/Cyril-Pop/IronPython-Samples/blob/master/Excel%20Interop/Import_Export_Xls_v2.0.py
# Thankyou for your ongoing contributions to the community Cyril :)

# Boilerplate text
import clr

import System
from System import Array
from System.Collections.Generic import *

clr.AddReference('System.Drawing')
import System.Drawing
from System.Drawing import *

# Try and get specific interop, if not just the general one
try:
	clr.AddReferenceByName('Microsoft.Office.Interop.Excel, Version=11.0.0.0, Culture=neutral, PublicKeyToken=71e9bce111e9429c')
except:
	clr.AddReference('Microsoft.Office.Interop.Excel')

from Microsoft.Office.Interop import Excel
from System.Runtime.InteropServices import Marshal

## CYRIL'S CODE FROM HERE (minor edits) ##

# Excel range parsers
xlDirecDown = System.Enum.Parse(Excel.XlDirection, "xlDown")
xlDirecRight = System.Enum.Parse(Excel.XlDirection, "xlToRight")
xlDirecUp = System.Enum.Parse(Excel.XlDirection, "xlUp")
xlDirecLeft = System.Enum.Parse(Excel.XlDirection, "xlToLeft")

# Excel class and exporter
class ExcelUtils():
	def __init__(self, lstData, filepath):
		self.lstData = lstData
		self.filepath = filepath

	def exportXls(self, wsName):
		ex = Excel.ApplicationClass()
		ex.Visible = True
		ex.DisplayAlerts = False
		workbook = ex.Workbooks.Add()
		ws = workbook.Worksheets[1]
		ws.Name = wsName
		nbr_row = len(self.lstData)
		nbr_colum = len(self.lstData[0])
		xlrange  = ws.Range[ws.Cells(1, 1), ws.Cells(nbr_row, nbr_colum)]
		a = Array.CreateInstance(object, nbr_row, nbr_colum)
		for indexR, row in enumerate(self.lstData):
			for indexC , value in  enumerate(row):
				a[indexR,indexC] = value
				
		#copy Array in range			
		xlrange.Value2 = a		
		used_range = ws.UsedRange	
		for column in used_range.Columns:
			column.AutoFit()
		# apply style
		missing = System.Type.Missing
		try:
			currentWs.ListObjects.Add(Excel.XlListObjectSourceType.xlSrcRange, xlrange, missing, Excel.XlYesNoGuess.xlGuess, missing).Name = "WFTableStyle"
			currentWs.ListObjects["WFTableStyle"].TableStyle = "TableStyleMedium6"
		except:
			pass

		# close Excel
		workbook.SaveAs(self.filepath)
		ex.Workbooks.Close()
		ex.Quit()
    	#other proper way to make sure that you really closed andreleased all COM objects 
		if workbook is not None:
			Marshal.ReleaseComObject(workbook)
		if ex is not None:
			Marshal.ReleaseComObject(ex)     
		workbook = None        
		ex = None

## GAVIN'S PACKAGING FROM HERE ##

# Preparing input from dynamo to revit
filepath = IN[0] + "\\" + IN[1] + ".xlsx"
sheetName = IN[2]
dataMatrix = IN[3]

# Try to export the excel file
try:
	classTry = ExcelUtils(dataMatrix,filepath)
	classTry.exportXls(sheetName)
	OUT = [filepath,"Export successful"]
except:
	OUT = [None,"Export unsuccessful"]
# ----------------------------------------
code_block = CodeBlock(x=python_script) { x[0]; x[1]; }
filePath = Output(code_block.out0)
report = Output(code_block.out1)
