# Dynamo custom node ExcelImport+.dyf "© Excel.Import+ 🐍" (Dynamo 2.3.1.11775)
# category: Crumple.Application.Query
# ImportExcel, with a few extra settings for quicker importing.
# packages: Crumple 2022.2.13

filePath = Input(filePath: string)
sheetName = Input(sheetName: string = "Sheet1")
importexcel = Custom[© ImportExcel](filePath=filePath, sheetName=sheetName)  # package Crumple; Imports a 2D matrix of data from an existing Excel file path from a given worksheet name. If a worksheet does not exist by that name it will take the data from the first worksheet instead. Credit to Cyril Poupin for most of the Python code (details in node body).
isNull = Object.IsNull(obj=importexcel.dataRows)
nullReplace = Input(nullReplace: var = "")
if_ = If(test=isNull, true=nullReplace, false=importexcel.dataRows)
headerRows = Input(headerRows: int = 1)
takeItems = List.TakeItems(list=if_, amount=headerRows)
headers = Output(takeItems)
dataAsColumns = Input(dataAsColumns: bool = true)
dropItems = List.DropItems(list=if_, amount=headerRows)
transpose = List.Transpose(lists=dropItems)
python_script = Python(IN[0]=dataAsColumns, IN[1]=transpose, IN[2]=dropItems)
# ---------- python_script.python (9 lines) ----------
# Made by Gavin Crump
# Free for use
# BIM Guru, www.bimguru.com.au

#Code
if IN[0]:
	OUT = IN[1]
else:
	OUT = IN[2]
# ----------------------------------------
data = Output(python_script)
sheetFound = Output(importexcel.sheetFound)
report = Output(importexcel.report)
