# Dynamo custom node ExcelImport.dyf "© Excel.Import 🐍" (Dynamo 2.3.1.11775)
# category: Crumple.Application.Query
# Imports a 2D matrix of data from an existing Excel file path from a given worksheet name. If a worksheet does not exist by that name it will take the data from the first worksheet instead. Credit to Cyril Poupin for most of the Python code (details in node body).

filePath = Input(filePath: string)
sheetName = Input(sheetName: string = "Sheet1")
python_script = Python(IN[0]=filePath, IN[1]=sheetName)
# ---------- python_script.python (96 lines) ----------
# Copied and pasted/modified by Gavin Crump
# Free for use (besides any terms by author below)
# BIM Guru, www.bimguru.com.au

# Based mostly on code by Cyril Poupin
# https://github.com/Cyril-Pop/IronPython-Samples/blob/master/Excel%20Interop/Import_Export_Xls_v2.0.py
# Thankyou for your ongoing contributions to the community Cyril :)

# Boilerplate text
import clr

import System
from System import Array
from System.Collections.Generic import *

clr.AddReference('System.Drawing')
import System.Drawing
from System.Drawing import *

# Try and get specific interop, if not just the general one
try:
	clr.AddReferenceByName('Microsoft.Office.Interop.Excel, Version=11.0.0.0, Culture=neutral, PublicKeyToken=71e9bce111e9429c')
except:
	clr.AddReference('Microsoft.Office.Interop.Excel')

from Microsoft.Office.Interop import Excel
from System.Runtime.InteropServices import Marshal

## CYRIL'S CODE FROM HERE (minor edits) ##

# Excel range parsers
xlDirecDown = System.Enum.Parse(Excel.XlDirection, "xlDown")
xlDirecRight = System.Enum.Parse(Excel.XlDirection, "xlToRight")
xlDirecUp = System.Enum.Parse(Excel.XlDirection, "xlUp")
xlDirecLeft = System.Enum.Parse(Excel.XlDirection, "xlToLeft")

class ExcelUtils():
	def __init__(self, lstData, filepath):
		self.lstData = lstData
		self.filepath = filepath

	def importXls(self,wsName):
			ex = Excel.ApplicationClass()
			ex.Visible = False
			lst_xls = []
			workbook = ex.Workbooks.Open(self.filepath)
			try:
				ws = ex.Sheets(wsName)
				wsFound = True
			except:
				ws = workbook.Worksheets[0]
				wsFound = False
			##get number of Rows not empty ##
			rowCountF = max(ws.Range(i).End(xlDirecUp).Row for i in ["A65536", "B65536", "C65536", "D65536", "E65536", "F65536", "G65536", "H65536"])
			# other method if column A is empty
			# rowCountF = ws.Range("B65536").End(xlDirecUp).Row
			# rowCountF = ws.Columns[1].End(xlDirecDown).Row
			##get number of Coloun not empty ##
			colCountF = max(ws.Range(i).End(xlDirecLeft).Column for i in ["ZZ1", "ZZ2", "ZZ3", "ZZ4", "ZZ5", "ZZ6", "ZZ7", "ZZ8", "ZZ9"])
			# other methods
			#colCountF = ws.Range("ZZ9").End(xlDirecLeft).Column
			# colCountF = ws.Rows[1].End(xlDirecRight).Column
			self.fullrange = ws.Range[ws.Cells(1, 1), ws.Cells(rowCountF, colCountF)]
			self.fullvalue = list(self.fullrange.Value2)
			#split list into sublist with number of colum
			n = colCountF					
			
			# close Excel
			ex.Workbooks.Close()
			ex.Quit()
    		#other proper way to make sure that you really closed and released all COM objects 
			if workbook is not None:
				Marshal.ReleaseComObject(workbook)
			if ex is not None:
				Marshal.ReleaseComObject(ex)     
			workbook = None        
			ex = None
			return [list(self.fullvalue [i:i+n] for i in range(0, len(self.fullvalue ), n)),wsFound]
	
## GAVIN'S PACKAGING FROM HERE ##

# Preparing input from dynamo to revit	
filePath = IN[0]
sheetName = IN[1]

# Try to import the excel file
try:
	xclObj = ExcelUtils([],filePath)
	xclData = xclObj.importXls(sheetName)
	result = "Import successful"
except:
	result = "Import unsuccessful"
	xclData = [None,False]

# Output
OUT = [xclData[0],xclData[1],result]
# ----------------------------------------
code_block = CodeBlock(x=python_script) { x[0]; x[1]; x[2]; }
dataRows = Output(code_block.out0)
sheetFound = Output(code_block.out1)
report = Output(code_block.out2)
