# Dynamo custom node ExcelPandasRead.dyf "© Excel.Read 🐼" (Dynamo 2.16.2.5624)
# category: Crumple.Application.Actions
# Given a excel file path, will attempt to read its contents using the pandas library. If your pandas is not valid or found, nothing will be returned.

filePath = Input(filePath: string)
workSheetNames = Input(workSheetNames: var[]..[])  # If not found, reads the first sheet
readAsText = Input(readAsText: bool = true)
replaceNullsWith = Input(replaceNullsWith: var = "")
python_script = Python(IN[0]=filePath, IN[1]=workSheetNames, IN[2]=readAsText, IN[3]=replaceNullsWith)  # CPython3
# ---------- python_script.python (76 lines) ----------
# Made by Gavin Crump
# Free for use
# BIM Guru, www.bimguru.com.au

# Define list/unwrap list functions
def tolist(input):
    result = input if isinstance(input, list) else [input]
    return result

def objOrList(input, initial = IN[1]):
    if isinstance(initial, list):
        return input
    else:
        return input[0]

# Collect inputs
sheet_names    = tolist(IN[1])
read_asStrings = IN[2]
fill_nan       = IN[3]

# Import pandas
try:
    import pandas as pd
    filePath  = IN[0]
    xcl = pd.ExcelFile(filePath)
    xcl_sheetNames = xcl.sheet_names
    
except:
    xcl = None
    xcl_sheetNames = []

# Function: Read excel
def pandas_readExcel(xclObject, sheetName, asStrings, fillNan = ""):
    # If read strings
    if asStrings:
        # Get df
        df = pd.read_excel(filePath, header=None, dtype = str, sheet_name=sheetName)
    # Otherwise, read as is
    else:
        # Get df
        df = pd.read_excel(filePath, header=None, sheet_name=sheetName)
    # Fill nan, to list
    df.fillna(fillNan, inplace=True)
    dataOut = df.values.tolist()
    # Return data
    return dataOut

# Output lists
data_list, wasRead_list, error_list = [],[],[]

# For each sheet
for s in sheet_names:
    # If we found pandas/excel
    if xcl == None:
        data_list.append(None)
        wasRead_list.append(False)
        error_list.append("ERROR: Pandas and/or file not found.")
    # If we didn't find workbook
    elif s not in xcl_sheetNames:
        data_list.append(None)
        wasRead_list.append(False)
        error_list.append("ERROR: Worksheet name not found.")
    # Otherwise read data
    else:
        try:
            data = pandas_readExcel(xcl, s, read_asStrings, fill_nan)
            data_list.append(data)
            wasRead_list.append(True)
            error_list.append("SUCCESS: Worksheet data read.")
        except:
            data_list.append(None)
            wasRead_list.append(False)
            error_list.append("ERROR: Worksheet data not read.")

# Return outputs
OUT = [objOrList(o) for o in [data_list, wasRead_list, error_list]]
# ----------------------------------------
code_block = CodeBlock(x=python_script) { x[0]; x[1]; x[2]; }
dataMatrix = Output(code_block.out0)
success = Output(code_block.out1)
errorReport = Output(code_block.out2)
