# Dynamo custom node ExcelPandasSheetNames.dyf "© Excel.SheetNames 🐼" (Dynamo 2.16.2.5624)
# category: Crumple.Application.Actions
# Returns the sheet names in an excel filepath. If pandas is not found or functioning, returns an error.

filePath = Input(filePath: string)
python_script = Python(IN[0]=filePath)  # CPython3
# ---------- python_script.python (24 lines) ----------
# Made by Gavin Crump
# Free for use
# BIM Guru, www.bimguru.com.au

# Import pandas
try:
	import pandas as pd
	filePath  = IN[0]
	xcl = pd.ExcelFile(filePath)
	pandasFound = True
except:
	pandasFound = False

# If we found pandas...
if pandasFound:
	try:
		# Get sheet names
		sheetNames = xcl.sheet_names
		# Outputs to Dynamo
		OUT = sheetNames, "SUCCESS: Worksheets read."
	except:
		OUT = [], "ERROR: Excel file not read."
else:
	OUT = [], "ERROR: pandas not found/valid."
# ----------------------------------------
code_block = CodeBlock(x=python_script) { x[0]; x[1]; }
workSheetNames = Output(code_block.out0)
errorReport = Output(code_block.out1)
