# Dynamo custom node ExcelPandasWrite.dyf "© Excel.Write 🐼" (Dynamo 2.16.2.5624)
# category: Crumple.Application.Create
# Given a file path, sheet(s) and data matrice(s) attempts to write them to those worksheets. If a file does not exist at the path one will be created. If pandas is not found or valid, an error will be returned.

filePath = Input(filePath: string)
workSheetNames = Input(workSheetNames: var[]..[])
dataMatrices = Input(dataMatrices: var[]..[])
python_script = Python(IN[0]=filePath, IN[1]=workSheetNames, IN[2]=dataMatrices)  # CPython3
# ---------- python_script.python (77 lines) ----------
# Made by Gavin Crump
# Free for use
# BIM Guru, www.bimguru.com.au

# Import os package
import os

# Define list/unwrap list functions
def tolist(input):
    result = input if isinstance(input, list) else [input]
    return result

def objOrList(input, initial = IN[1]):
    if isinstance(initial, list):
        return input
    else:
        return input[0]

# Collect inputs
file_path   = IN[0]
sheet_names = tolist(IN[1])
# If list of sheets,data is as is
if isinstance(IN[1], list):
    data_lists = IN[2]
# Otherwise, promote to list of matrix
else:
    data_lists = [IN[2]]

# Try to create excel writer (if we can't, pandas fail)
try:
    import pandas as pd
    # If file exists, append
    if os.path.isfile(file_path):
        # Excel writer append
        writer = pd.ExcelWriter(file_path, mode = "a", if_sheet_exists = 'replace')
    # Otherwise, write
    else:
        # Excel writer write
        writer = pd.ExcelWriter(file_path, mode = "w")
except:
    writer = None

# Function: Read excel
def pandas_writeExcel(dataList, sheetName, xclWriter):
    # Write data
    df = pd.DataFrame(dataList)
    df.to_excel(xclWriter, sheet_name = sheetName, header = False, index = False, na_rep = "")
    # Return nothing
    return None

# Output lists
wasWritten_list, error_list = [],[]

# For each sheet
for s,d in zip(sheet_names, data_lists):
    # If we found pandas/excel
    if writer == None:
        wasWritten_list.append(False)
        error_list.append("ERROR: Pandas and/or writer not made.")
    # Otherwise write data
    else:
        try:
            pandas_writeExcel(d, s, writer)
            wasWritten_list.append(True)
            error_list.append("SUCCESS: Data written.")
        except:
            wasWritten_list.append(False)
            error_list.append("ERROR: Data not written.")

# Try to close writer
try:
    writer.close()
except:
    pass

# Return outputs
OUT = objOrList(wasWritten_list), objOrList(error_list)
# ----------------------------------------
code_block = CodeBlock(x=python_script) { x[0]; x[1]; }
success = Output(code_block.out0)
errorReport = Output(code_block.out1)
