# Dynamo custom node ExcelWorksheets.dyf "© Excel.Worksheets🐍" (Dynamo 2.3.1.11775)
# category: Crumple.Application.Query
# Given a file path to an Excel file, return its worksheet names.

filepath = Input(filepath: var[]..[])
python_script = Python(IN[0]=filepath)
# ---------- python_script.python (29 lines) ----------
# Made by Gavin Crump
# Free for use
# BIM Guru, www.bimguru.com.au

# Boilerplate text
import clr

try:
	clr.AddReferenceByName('Microsoft.Office.Interop.Excel, Version=11.0.0.0, Culture=neutral, PublicKeyToken=71e9bce111e9429c')
except:
	clr.AddReference('Microsoft.Office.Interop.Excel')

from Microsoft.Office.Interop import Excel

# Set up conditions to read Excel
xlApp = Excel.ApplicationClass()
xlApp.Visible = False
xlApp.DisplayAlerts = False

# Open Excel file path and check worksheet names
workbk = xlApp.Workbooks.Open(IN[0])
worksheets = workbk.Worksheets
names = [w.Name for w in worksheets]

# Close Excel
workbk.Close()
xlApp.Quit()

OUT = names
# ----------------------------------------
worksheetNames = Output(python_script)
