# Dynamo custom node FamilyCategoryName.dyf "© Family.CategoryName" (Dynamo 2.12.1.8246)
# category: Crumple.Revit.Queryt
# Returns the category name a family is associated with.

families = Input(families: var[]..[])
python_script = Python(IN[0]=families)  # CPython3
# ---------- python_script.python (32 lines) ----------
# Made by Gavin Crump
# Free for use
# BIM Guru, www.bimguru.com.au

# Boilerplate text
import clr

# Define list/unwrap list functions
def uwlist(input):
    result = input if isinstance(input, list) else [input]
    return UnwrapElement(result)

def objOrList(input, initial = IN[0]):
	if isinstance(initial, list):
		return input
	else:
		return input[0]

# Preparing input from dynamo to revit
families = uwlist(IN[0])

# Try to get family categories
categories, names = [],[]

for f in families:
    try:
        names.append(f.FamilyCategory.Name)
    except:
        names.append(None)

# Preparing output to Dynamo
OUT = objOrList(names)
# ----------------------------------------
categoryNames = Output(python_script)
