# Dynamo custom node FamilyDocAddSharedParameter.dyf "© FamilyDocAddSharedParameter" (Dynamo 2.3.1.11775)
# category: Crumple.Revit.FamilyDocument
# Given a document or list of documents, attempts to add a list of shared parameters to them. Parameters should be in the form of unwrapped external definitions and BIPG's should be in unwrapped form as well.

familyDoc = Input(familyDoc: var[]..[])
exDefs = Input(exDefs: var[]..[])
bipgs = Input(bipgs: var[]..[])
isInstance = Input(isInstance: var[]..[])
python_script = Python(IN[0]=familyDoc, IN[1]=exDefs, IN[2]=bipgs, IN[3]=isInstance)
# ---------- python_script.python (62 lines) ----------
# Made by Gavin Crump
# Free for use
# BIM Guru, www.bimguru.com.au

# Boilerplate text
import clr
clr.AddReference('RevitAPI')
from Autodesk.Revit.DB import *

clr.AddReference("RevitServices")
import RevitServices
from RevitServices.Persistence import DocumentManager
from RevitServices.Transactions import TransactionManager

# Functions
def tolist(input):
    result = input if isinstance(input, list) else [input]
    return result
    
def uwlist(input):
    result = input if isinstance(input, list) else [input]
    return UnwrapElement(result)
    
#detect if document is not set
if IN[0] == None:
    docs = [DocumentManager.Instance.CurrentDBDocument]
else:
	docs = tolist(IN[0])

#unwrap all elements to use with API
definitions = tolist(IN[1])
bipgs = tolist(IN[2])
isInstance = tolist(IN[3])

outcomes = []

# Collect values
for doc in docs:

	if doc.IsFamilyDocument:
		
		outcome = []
		
		# "Start" the transaction
		TransactionManager.Instance.EnsureInTransaction(doc)
	
		for d,b,i in zip(definitions, bipgs, isInstance):
			try:
				new = doc.FamilyManager.AddParameter(d,b,i)
				outcome.append(new)
			except:
				outcome.append("Parameter not added.")

		# "End" the transaction
		TransactionManager.Instance.ForceCloseTransaction()
	
	else:
		outcome = "Document is not a family document."
	
	outcomes.append(outcome)
	
OUT = outcomes
# ----------------------------------------
outcome = Output(python_script)
