# Dynamo custom node FamilyDocAddSharedParameters.dyf "© FamilyDoc.AddSharedParameters" (Dynamo 2.17.1.4055)
# category: Crumple.Revit.Create
# Given a family document or list of them, attempts to create shared parameters in them. Input structures should be in the form of one sub-list per family document, in a list (but the node will try to create this data structure if not, as well as repeat the last list if they are shorter than the family document list).
# packages: Crumple 2024.3.1

familyDocs = Input(familyDocs: var[]..[])  # A family document or list of family documents. If multiple family documents, you should provide a list of list with branches equal to the family documents. If you do not the node will apply longest lacing to the last list for each excess family document.
exDefLists = Input(exDefLists: var[]..[])  # Lists of external definitions. (per family document, ideally)
parGroupLists = Input(parGroupLists: var[]..[])  # Lists of parameter groups. (per family document, ideally) You can also provide GroupTypeIds if you are using Revit 2022+.
isInstanceLists = Input(isInstanceLists: var[]..[])  # Lists of booleans. (per family document, ideally)
list_graftbyprimary = Custom[© List.GraftByPrimary](primary=familyDocs, listA=exDefLists, listB=parGroupLists, listC=isInstanceLists)  # package Crumple; Given a first input, the node will assess how many items it contains (if one, it will make it a list of 1 item). Remaining branches will be forced into a list of lists, where the last branch will be repeated to a longest length as the first list (if one list or item is provided, it will repeat as the list of lists).
python_script_add_shared = Python(IN[0]=list_graftbyprimary.primary, IN[1]=list_graftbyprimary.listA, IN[2]=list_graftbyprimary.listB, IN[3]=list_graftbyprimary.listC)  # "Python Script (add shared parameters)"; IronPython2
# ---------- python_script_add_shared.python (110 lines) ----------
# Made by Gavin Crump
# Free for use
# BIM Guru, www.bimguru.com.au

# Boilerplate text
import clr

clr.AddReference("RevitServices")
import RevitServices
from RevitServices.Persistence import DocumentManager
from RevitServices.Transactions import TransactionManager

clr.AddReference('RevitAPI')
import Autodesk 
from Autodesk.Revit.DB import FamilyManager, Transaction

# Get Revit build version
uiapp = DocumentManager.Instance.CurrentUIApplication
app = uiapp.Application
ver = int(app.VersionNumber)

if ver > 2023:
	from Autodesk.Revit.DB import ParameterUtils

# Function to add parameter to document
def familyDoc_addSharedParameter(exDef, parGrp, isInst, famDoc):
	# Convert bipg if higher build
	if ver > 2023:
		try:
			parGrp = ParameterUtils.GetParameterGroupTypeId(parGrp)
		except:
			pass
	# Try to add the parameter
	try:
		newPar = famDoc.FamilyManager.AddParameter(exDef, parGrp, isInst)
		return newPar
	# Except return None
	except:
		return None

# Function to get all parameter names
def familyDoc_getParamNames(famDoc):
	pars = famDoc.FamilyManager.Parameters
	nams = [p.Definition.Name for p in pars]
	return nams

#unwrap all elements to use with API
docs_list = IN[0]
defs_list = IN[1]
bipg_list = IN[2]
inst_list = IN[3]

pars_out, results, outcomes = [],[],[]

# Collect values
for doc, defs, bipgs, inst in zip(docs_list, defs_list, bipg_list, inst_list):
	# Try to get family title
	try:
		famTitle = doc.Title
	except:
		famTitle = "N/A"
	# Get param names
	parNames = familyDoc_getParamNames(doc)
	# Variables per family doc
	pars, result, outcome = [],[],[]
	# For each parameter and settings...
	for d,b,i in zip(defs, bipgs, inst):
		# Try to get def name
		try:
			defName = d.Name
		except:
			defName = "N/A"
		# Preliminary error checks
		outc = ""
		if doc == None:
			outc = 'ERROR: No document provided.'
		elif d == None:
			outc = 'ERROR: No definition provided for {}.'.format(famTitle)
		elif b == None or i == None:
			outc = 'ERROR: Invalid settings provided.'
		if defName in parNames:
			outc = 'ERROR: {} already in {}.'.format(defName, famTitle)
		# If we did not hit an error, try to add parameter
		if outc == "":
			with Transaction(doc, 'Replace parameters') as t:
				t.Start()
				par = familyDoc_addSharedParameter(d, b, i, doc)
				pars.append(par)
				# Report outcome if successful
				if par:
					result.append(True)
					outc = 'SUCCESS: {} added to {}.'.format(defName, famTitle)
				# Otherwise report if not
				else:
					result.append(False)
					outc = 'FAILURE: {} not added to {}.'.format(defName, famTitle)
				t.Commit()
		# If we hit an error, append no param and false result
		else:
			pars.append(None)
			result.append(False)
		# Append outcome
		outcome.append(outc)
	# Append to list structure
	pars_out.append(pars)
	results.append(result)
	outcomes.append(outcome)

# Outputs to Dynamo
OUT = docs_list, pars_out, results, outcomes
# ----------------------------------------
code_block = CodeBlock(OUT=python_script_add_shared) { docs = OUT[0]; pars = OUT[1]; rslt = OUT[2]; outs = OUT[3]; }
familyDocs_2 = Output(code_block.docs)  # "familyDocs"; The original family document(s).
Lists_of_parameters_made_list_per_family = Output(code_block.pars)  # "/*Lists of parameters made (list per family document). Failures will return a null.*/ parameterLists"
Lists_of_outcomes_list_per_family_docume = Output(code_block.rslt)  # "/*Lists of outcomes (list per family document). True if success, false if not.*/ resultLists"
Lists_of_outcomes_list_per_family_docume_2 = Output(code_block.outs)  # "/*Lists of outcomes (list per family document).*/ outcomeLists"
