# Dynamo custom node FamilyDocClose.dyf "© FamilyDocClose" (Dynamo 2.3.1.11775)
# category: Crumple.Revit.FamilyDocument
# Given documents in the unwrapped state, attempts to close then with the option to save them (applies to all documents, one input expected, not a list).

familyDoc = Input(familyDoc: var[]..[])
saveOption = Input(saveOption: var[]..[])
python_script = Python(IN[0]=familyDoc, IN[1]=saveOption)
# ---------- python_script.python (39 lines) ----------
# Made by Gavin Crump
# Free for use
# BIM Guru, www.bimguru.com.au

# Boilerplate text
import clr

clr.AddReference("RevitServices")
import RevitServices
from RevitServices.Persistence import DocumentManager 

clr.AddReference("RevitAPI")
import Autodesk 
from Autodesk.Revit.DB import *

currDoc = DocumentManager.Instance.CurrentDBDocument
uiapp = DocumentManager.Instance.CurrentUIApplication
app = uiapp.Application

# Define list/unwrap list functions
def tolist(input):
    result = input if isinstance(input, list) else [input]
    return result

# Current doc/app/ui
docs = tolist(IN[0])
saveOpt = IN[1]
outcomes = []

# Do some action in a Transaction
for doc in docs:
	try:
		doc.Close(saveOpt)
		outcomes.append(True)
	except:
		outcomes.append(False)

# Preparing output to Dynamo
OUT = outcomes
# ----------------------------------------
wasClosed = Output(python_script)
