# Dynamo custom node FamilyDocCloseAndSave.dyf "© FamilyDoc.CloseAndSave" (Dynamo 2.12.1.8246)
# category: Crumple.Revit.Actions
# Attempts to close a family document or list of family documents, and save the families in the process to their current location.

familyDocs = Input(familyDocs: var[]..[])  # A family document or list of family documents.
python_script = Python(IN[0]=familyDocs)  # IronPython2
# ---------- python_script.python (26 lines) ----------
# Made by Gavin Crump
# Free for use
# BIM Guru, www.bimguru.com.au

# Boilerplate text
import clr

# Define list/unwrap list functions
def tolist(input):
    result = input if isinstance(input, list) else [input]
    return result

# Current doc/app/ui
docs     = tolist(IN[0])
outcomes = []

# Do some action in a Transaction
for doc in docs:
	try:
		doc.Close(True)
		outcomes.append(True)
	except:
		outcomes.append(False)

# Preparing output to Dynamo
OUT = outcomes
# ----------------------------------------
wasClosed = Output(python_script)
