# Dynamo custom node FamilyDocCloseWithoutSave.dyf "© FamilyDoc.CloseWithoutSave" (Dynamo 2.12.1.8246)
# category: Crumple.Revit.Actions
# Attempts to close a family document or list of family documents, without saving them.

familyDocs = Input(familyDocs: var[]..[])  # A family document or list of family documents.
python_script = Python(IN[0]=familyDocs)  # IronPython2
# ---------- python_script.python (26 lines) ----------
# Made by Gavin Crump
# Free for use
# BIM Guru, www.bimguru.com.au

# Boilerplate text
import clr

# Define list/unwrap list functions
def tolist(input):
    result = input if isinstance(input, list) else [input]
    return result

# Current doc/app/ui
docs     = tolist(IN[0])
outcomes = []

# Do some action in a Transaction
for doc in docs:
	try:
		doc.Close(False)
		outcomes.append(True)
	except:
		outcomes.append(False)

# Preparing output to Dynamo
OUT = outcomes
# ----------------------------------------
wasClosed = Output(python_script)
