# Dynamo custom node FamilyDocGetAllParameters.dyf "© FamilyDoc.GetAllParameters" (Dynamo 2.12.1.8246)
# category: Crumple.Revit.Query
# Given a family document or list of them, returns all parameters and their properties in those documents. Each output will be a list of lists, where each list is per family document (even if only one document is provided).

familyDocs = Input(familyDocs: var[]..[])  # A family document or list of family documents.
python_script_get_parameters = Python(IN[0]=familyDocs)  # IronPython2
# ---------- python_script_get_parameters.python (63 lines) ----------
# Made by Gavin Crump
# Free for use
# BIM Guru, www.bimguru.com.au

# Boilerplate text
import clr

clr.AddReference("RevitServices")
import RevitServices
from RevitServices.Persistence import DocumentManager 

clr.AddReference('RevitAPI')
import Autodesk 
from Autodesk.Revit.DB import FamilyManager, Parameter

# Get Revit build version
uiapp = DocumentManager.Instance.CurrentUIApplication
app = uiapp.Application
ver = int(app.VersionNumber)

if ver > 2023:
	from Autodesk.Revit.DB import ParameterUtils

# Define list/unwrap list functions
def tolist(input):
    result = input if isinstance(input, list) else [input]
    return result

def parameterGroup(par):
	parGrp = param.Definition.ParameterGroup
	if ver > 2023:
		return ParameterUtils.GetParameterGroupTypeId(parGrp)
	else:
		return parGrp

#Inputdoc
docs_list = tolist(IN[0])

# Define lists
paramLists, nameLists, grpLists, sharedLists, instLists = [],[],[],[],[]

# For each document...
for doc in docs_list:
	paramList, nameList, grpList, sharedList, instList = [],[],[],[],[]
	# If a family document...
	if doc.IsFamilyDocument:
		# For each parameter...
		for param in doc.FamilyManager.Parameters:
			# Add its data
			paramList.append(param)
			nameList.append(param.Definition.Name)
			grpList.append(parameterGroup(param))
			sharedList.append(param.IsShared)
			instList.append(param.IsInstance)
	# Append the lists
	paramLists.append(paramList)
	nameLists.append(nameList)
	grpLists.append(grpList)
	sharedLists.append(sharedList)
	instLists.append(instList)

# Output the lists
OUT = docs_list, paramLists, nameLists, grpLists, sharedLists, instLists
# ----------------------------------------
code_block = CodeBlock(out=python_script_get_parameters) { doc = out[0]; ele = out[1]; nam = out[2]; grp = out[3]; sha = out[4]; ins = out[5]; }
familyDocs_2 = Output(code_block.doc)  # "familyDocs"; The original family document(s).
Lists_of_parameters_list_per_family_docu = Output(code_block.ele)  # "/*Lists of parameters (list per family document).*/ parameterLists"
Lists_of_parameter_names_list_per_family = Output(code_block.nam)  # "/*Lists of parameter names (list per family document).*/ parameterNameLists"
Lists_of_parameter_groups_list_per_famil = Output(code_block.grp)  # "/*Lists of parameter groups (list per family document). Will return as GroupTypeIds if you are using Revit 2024+.*/ parGroupLists"
Parameter_is_shared_list_per_family_docu = Output(code_block.sha)  # "/*Parameter is shared (list per family document).*/ isSharedLists"
Parameter_is_instance_based_list_per_fam = Output(code_block.ins)  # "/*Parameter is instance based (list per family document).*/ isInstanceLists"
