# Dynamo custom node FamilyDocGetAllTypes.dyf "© FamilyDoc.GetAllTypes" (Dynamo 2.12.1.8246)
# category: Crumple.Revit.Query
# Given a family document or list of documents, returns all types in that document and their names.

familyDocs = Input(familyDocs: var[]..[])  # A family document or list of family documents.
python_script = Python(IN[0]=familyDocs)  # IronPython2
# ---------- python_script.python (39 lines) ----------
# Made by Gavin Crump
# Free for use
# BIM Guru, www.bimguru.com.au

# Boilerplate text
import clr

clr.AddReference("RevitServices")
import RevitServices
from RevitServices.Persistence import DocumentManager 

clr.AddReference("RevitAPI")
import Autodesk 
from Autodesk.Revit.DB import *

# Define list/unwrap list functions
def tolist(input):
    result = input if isinstance(input, list) else [input]
    return result

# Current doc/app/ui
doc_list = tolist(IN[0])

# Get types and names
typeLists, nameLists = [],[]

for doc in doc_list:
	# Try to get types
	try:
		fam_types = doc.FamilyManager.Types
		fam_names = [f.Name for f in fam_types]
	except:
		fam_types = None
		fam_names = None
	typeLists.append(fam_types)
	nameLists.append(fam_names)

# Preparing output to Dynamo
OUT = doc_list, fam_types, fam_names
# ----------------------------------------
code_block = CodeBlock(x=python_script) { docs = x[0]; typs = x[1]; nams = x[2]; }
familyDocs_2 = Output(code_block.docs)  # "familyDocs"; The original family document(s).
Lists_of_types_list_per_family_document_ = Output(code_block.typs)  # "/*Lists of types (list per family document).*/ typeLists"
Lists_of_type_names_list_per_family_docu = Output(code_block.nams)  # "/*Lists of type names (list per family document).*/ nameLists"
