# Dynamo custom node FamilyDocGetParameterValues.dyf "© FamilyDoc.GetParameterValues" (Dynamo 2.16.2.5624)
# category: Crumple.Revit.Query
# Given a family document of list of them, attempts to get all parameter values of the provided types or type names.
# packages: Crumple 2024.3.1

familyDocs = Input(familyDocs: var[]..[])  # A family document or list of family documents. If multiple family documents, you should provide a list of list with branches equal to the family documents. If you do not the node will apply longest lacing to the last list for each excess family document.
nameOrParamLists = Input(nameOrParamLists: var[]..[])  # Lists of family parameters or parameter names. (per family document, ideally)
nameOrTypeLists = Input(nameOrTypeLists: var[]..[])  # Lists of family types or type names. (per family document, ideally)
list_graftbyprimary = Custom[© List.GraftByPrimary](primary=familyDocs, listA=nameOrParamLists, listB=nameOrTypeLists)  # package Crumple; Given a first input, the node will assess how many items it contains (if one, it will make it a list of 1 item). Remaining branches will be forced into a list of lists, where the last branch will be repeated to a longest length as the first list (if one list or item is provided, it will repeat as the list of lists).
python_script_get_parameters = Python(IN[0]=list_graftbyprimary.primary, IN[1]=list_graftbyprimary.listA, IN[2]=list_graftbyprimary.listB)  # CPython3
# ---------- python_script_get_parameters.python (167 lines) ----------
# Made by Gavin Crump
# Free for use
# BIM Guru, www.bimguru.com.au

# Boilerplate text
import clr

clr.AddReference("RevitServices")
import RevitServices
from RevitServices.Persistence import DocumentManager 

clr.AddReference('RevitAPI')
import Autodesk 
from Autodesk.Revit.DB import *

# Get Revit build version
uiapp = DocumentManager.Instance.CurrentUIApplication
app = uiapp.Application
rvt_year = int(app.VersionNumber)

if rvt_year < 2022:
    pt_length = ParameterType.Length
    pt_area = ParameterType.Area
else:
    pt_length = SpecTypeId.Length
    pt_area = SpecTypeId.Area

# Convert length to internal
def interalToProject_len(val, myDoc, ver = rvt_year):
	if rvt_year < 2022:
		intUnits = myDoc.GetUnits().GetFormatOptions(UnitType.UT_Length).DisplayUnits
		return UnitUtils.Convert(val,DisplayUnitType.DUT_DECIMAL_FEET,intUnits)
	else:
		intUnitsId = myDoc.GetUnits().GetFormatOptions(SpecTypeId.Length).GetUnitTypeId()
		return UnitUtils.ConvertFromInternalUnits(val, intUnitsId)

# Convert area to internal
def interalToProject_area(val, myDoc, ver = rvt_year):
	if rvt_year < 2022:
		intUnits = myDoc.GetUnits().GetFormatOptions(UnitType.UT_Area).DisplayUnits
		return UnitUtils.Convert(val,DisplayUnitType.DUT_SQUARE_FEET,intUnits)
	else:
		intUnitsId = myDoc.GetUnits().GetFormatOptions(SpecTypeId.Area).GetUnitTypeId()
		return UnitUtils.ConvertFromInternalUnits(val, intUnitsId)

# Define list/unwrap list functions
def tolist(input):
    result = input if isinstance(input, list) else [input]
    return result

def getParameterValue(par, famMan, doc, famType = None):
	# Get storage type
	st = par.StorageType
	if rvt_year < 2022:
	   pt = par.Definition.ParameterType
	else:
	   pt = par.Definition.GetDataType()
	# If no type, get current
	if famType == None:
		famType = famMan.CurrentType
	# Try each storage type
	if st == StorageType.String:
		val = famType.AsString(par)
		if not val:
			val = ""
	elif st == StorageType.Double:
		val = famType.AsDouble(par)
		if val == None:
			val = 0.00
		if pt == pt_length and val != 0.00:
			val = interalToProject_len(val, doc)
		elif pt == pt_area and val != 0.00:
			val = interalToProject_area(val, doc)
	elif st == StorageType.Integer:
		val = famType.AsInteger(par)
		if val == None:
			val = 0
	elif st == StorageType.ElementId:
		val = famType.AsElementId(par)
		if val == None:
			val = ElementId.InvalidElementId
		try:
			val = doc.GetElement(val)
		except:
			pass
	else:
		val = None
	# Return the value
	return val

def parameterOrName(par):
	# If it isn't a string, try to get its definition name
	if not isinstance(parName, str):
		try:
			return parName.Definition.Name
		except:
			return ""
	else:
		return par

def typeOrName(t, types, names):
	if isinstance(t, str):
		for ft,fn in zip(types, names):
			if fn == t:
				return ft
		return None
	else:
		return t

def isFamilyDoc(doc):
    if doc is None:
        return False
    else:
        return doc.IsFamilyDocument

#Inputdoc
docs_list = IN[0]
paramName_lists = IN[1]
type_lists = IN[2]

paramLists, valuesByFamilies = [],[]

# For each document...
for doc, nameList, typeList in zip(docs_list, paramName_lists, type_lists):
	# Storage lists
	paramList, valuesByFamily = [],[]
	# If a family document...
	if isFamilyDoc(doc):
		# Get parameters
		famMan = doc.FamilyManager
		params = famMan.Parameters
		parNames = [p.Definition.Name for p in params]
		# For each parameter name...
		for parName in nameList:
			# If it isn't a string, try to get its definition name
			parName = parameterOrName(parName)
			# If name is in names...
			if parName in parNames:
				# Find it using a zip loop
				for p,n in zip(params, parNames):
					if n == parName:
						par = p
						break
				paramList.append(par)
			else:
				paramList.append(None)
		# Get all types
		fam_types = famMan.Types
		fam_names = [f.Name for f in fam_types]
		# For each type...
		for t in typeList:
			t = typeOrName(t, fam_types, fam_names)
			valuesByType = []
			# For each parameter....
			for p in paramList:
				if p:
					valuesByType.append(getParameterValue(p, famMan, doc, famType = t))
				else:
					valuesByType.append(None)
			# Append type list of values
			valuesByFamily.append(valuesByType)
	# Append the lists
	paramLists.append(paramList)
	valuesByFamilies.append(valuesByFamily)

# Output the lists
OUT = docs_list, paramLists, valuesByFamilies
# ----------------------------------------
code_block = CodeBlock(out=python_script_get_parameters) { doc = out[0]; par = out[1]; val = out[2]; }
familyDocs_2 = Output(code_block.doc)  # "familyDocs"; The original family document(s).
Lists_of_parameters_list_per_family_docu = Output(code_block.par)  # "/*Lists of parameters (list per family document).*/ paramLists"
List_of_list_of_values_list_per_family_t = Output(code_block.val)  # "/*List of list of values (list per family type, per family document).*/ valueLists"
