# Dynamo custom node FamilyDocGetParameters.dyf "© FamilyDoc.GetParameters" (Dynamo 2.16.2.5624)
# category: Crumple.Revit.Query
# Given a family document or list of them, returns all parameters and their properties in those documents. You can provide optionally provide parameter names to get just those parameters.
# packages: Crumple 2024.3.1

familyDocs = Input(familyDocs: var[]..[])  # A family document or list of family documents.
nameLists = Input(nameLists: var[]..[] = null)  # Lists of family parameters names or family parameters. (per family document, ideally) Leave empty to get all parameters.
list_graftbyprimary = Custom[© List.GraftByPrimary](primary=familyDocs, listA=nameLists)  # package Crumple; Given a first input, the node will assess how many items it contains (if one, it will make it a list of 1 item). Remaining branches will be forced into a list of lists, where the last branch will be repeated to a longest length as the first list (if one list or item is provided, it will repeat as the list of lists).
python_script_get_parameters = Python(IN[0]=list_graftbyprimary.primary, IN[1]=list_graftbyprimary.listA)  # CPython3
# ---------- python_script_get_parameters.python (95 lines) ----------
# Made by Gavin Crump
# Free for use
# BIM Guru, www.bimguru.com.au

# Boilerplate text
import clr

clr.AddReference("RevitServices")
import RevitServices
from RevitServices.Persistence import DocumentManager 

clr.AddReference('RevitAPI')
import Autodesk 
from Autodesk.Revit.DB import *

# Get Revit build version
uiapp = DocumentManager.Instance.CurrentUIApplication
app = uiapp.Application
ver = int(app.VersionNumber)

# Function: Get param group
def parameterGroup(par):
	if ver < 2022:
		return param.Definition.ParameterGroup
	else:
		return ParameterUtils.GetParameterGroupTypeId(parGrp)

def isFamilyDoc(doc):
    if doc is None:
        return False
    else:
        return doc.IsFamilyDocument

# Function: Get parameters by name or all
def parametersGet(namesGet, myDoc):
	# Get all parameters
	paramsAll = myDoc.FamilyManager.Parameters
	# If we want all, just return them
	if namesGet is None:
		return paramsAll
	# Otherwise...
	else:
		# Get all names
		namesAll = [p.Definition.Name for p in paramsAll]
		paramsGet = []
		# For each target name...
		for n in namesGet:
			# If its a parameter, get its name
			if not isinstance(n, str):
				n = n.Definition.Name
			# Find it by zip looping
			par = None
			for nA,p in zip(namesAll, paramsAll):
				if n == nA:
					par = p
					break
			paramsGet.append(par)
		# Return the parameters
		return paramsGet

#Inputdoc
docs_list   = IN[0]
name_lists  = IN[1]

check = None

if not name_lists:
	name_lists = [None for d in docs_list]

# Define lists
paramLists, nameLists = [],[]

# For each document...
for doc, name_list in zip(docs_list, name_lists):
	paramList, nameList = [],[]
	# If a family document...
	if isFamilyDoc(doc):
		# Get parameters by name or all
		params = parametersGet(name_list, doc)
		# For each parameter...
		for param in params:
			# If we have a parameter, add its data
			if param is not None:
				# Add its data
				paramList.append(param)
				nameList.append(param.Definition.Name)
			else:
				paramList.append(None)
				nameList.append(None)
	# Append the lists
	paramLists.append(paramList)
	nameLists.append(nameList)

# Output the lists
OUT = docs_list, paramLists, nameLists
# ----------------------------------------
code_block = CodeBlock(out=python_script_get_parameters) { doc = out[0]; ele = out[1]; nam = out[2]; }
familyDocs_2 = Output(code_block.doc)  # "familyDocs"; The original family document(s).
Lists_of_parameters_list_per_family_docu = Output(code_block.ele)  # "/*Lists of parameters (list per family document).*/ parameterLists"
