# Dynamo custom node FamilyDocGetTypes.dyf "© FamilyDoc.GetTypes" (Dynamo 2.16.2.5624)
# category: Crumple.Revit.Query
# Given a family document or list of documents, returns all types in that document and their names. You can provide optionally provide type names to get just those types.
# packages: Crumple 2024.3.1

familyDocs = Input(familyDocs: var[]..[])  # A family document or list of family documents.
nameLists = Input(nameLists: var[]..[] = null)  # Lists of type names or family types. (per family document, ideally) Leave empty to get all types.
list_graftbyprimary = Custom[© List.GraftByPrimary](primary=familyDocs, listA=nameLists)  # package Crumple; Given a first input, the node will assess how many items it contains (if one, it will make it a list of 1 item). Remaining branches will be forced into a list of lists, where the last branch will be repeated to a longest length as the first list (if one list or item is provided, it will repeat as the list of lists).
python_script = Python(IN[0]=list_graftbyprimary.primary, IN[1]=list_graftbyprimary.listA)  # CPython3
# ---------- python_script.python (61 lines) ----------
# Made by Gavin Crump
# Free for use
# BIM Guru, www.bimguru.com.au

# Boilerplate text
import clr

clr.AddReference("RevitAPI")
import Autodesk 
from Autodesk.Revit.DB import FamilyManager

# Function: Get types by name or all
def typesGet(namesGet, myDoc):
	if myDoc is None:
	   typesAll = []
	else:
	   typesAll = myDoc.FamilyManager.Types
	# Get all parameters
	typesGet = []
	# If we want all, just return them
	if namesGet == None:
		for t in typesAll:
			if t.Name != "" and t.Name != " ":
				typesGet.append(t)
		return typesGet
	# Otherwise...
	else:
		# Get all names
		namesAll = [t.Name for t in typesAll]
		# For each target name...
		for n in namesGet:
			# If its a type, get its name
			if not isinstance(n, str):
				n = n.Name
			# Find it by zip looping
			ft = None
			for nA,t in zip(namesAll, typesAll):
				if n == nA:
					ft = t
					break
			typesGet.append(ft)
		# Return the parameters
		return typesGet

# Current doc/app/ui
doc_list = IN[0]
name_lists = IN[1]

if not name_lists:
	name_lists = [None for d in doc_list]

# Get types and names
typeLists = []

for doc, nameList in zip(doc_list, name_lists):
	# Get types
	fam_types = typesGet(nameList, doc)
	typeLists.append(fam_types)

# Preparing output to Dynamo
OUT = doc_list, typeLists
# ----------------------------------------
code_block = CodeBlock(x=python_script) { docs = x[0]; typs = x[1]; }
familyDocs_2 = Output(code_block.docs)  # "familyDocs"; The original family document(s).
Lists_of_types_list_per_family_document_ = Output(code_block.typs)  # "/*Lists of types (list per family document).*/ typeLists"
