# Dynamo custom node FamilyDocLoad.dyf "© FamilyDoc.Load" (Dynamo 2.12.1.8246)
# category: Crumple.Revit.Actions
# Attempts to load families from the given file paths to the current document.
# packages: Crumple 2022.5.27

filePaths = Input(filePaths: var[]..[])
doc = Input(doc: var[]..[] = null)  # Uses current if none provided. Accepts document.
revit_getdocument = Custom[© Revit.GetDocument](docOrLink=doc)  # package Crumple; If no input is specified or an invalid one is, returns current document. If a link instance is provided, it returns the linked document. If a document is provided it will pass it through.
python_script = Python(IN[0]=filePaths, IN[1]=revit_getdocument.document)  # IronPython2
# ---------- python_script.python (40 lines) ----------
# Made by Gavin Crump
# Free for use
# BIM Guru, www.bimguru.com.au

# Boilerplate text
import clr

clr.AddReference("RevitServices")
import RevitServices
from RevitServices.Transactions import TransactionManager 

clr.AddReference("RevitAPI")
import Autodesk 
from Autodesk.Revit.DB import *

# Define list/unwrap list functions
def tolist(input):
    result = input if isinstance(input, list) else [input]
    return result

# Current doc/app/ui
paths = tolist(IN[0])
doc   = IN[1]

loadOptions = FamilyOptionsProject()

# Do some action in a Transaction
TransactionManager.Instance.EnsureInTransaction(doc)

for path in paths:
	try:
		doc.LoadFamily(path, options_load)
		outcomes.append(True)
	except:
		outcomes.append(False)

TransactionManager.Instance.TransactionTaskDone()

# Preparing output to Dynamo
OUT = outcomes
# ----------------------------------------
wasLoaded = Output(python_script)
