# Dynamo custom node FamilyDocOpen.dyf "© FamilyDocOpen" (Dynamo 2.3.1.11775)
# category: Crumple.Revit.FamilyDocument
# Given a file path to a family, attempts to open that document in the background in Revit if possible. Should not be used for regular models/templates.

filePaths = Input(filePaths: var[]..[])
python_script = Python(IN[0]=filePaths)
# ---------- python_script.python (40 lines) ----------
# Made by Gavin Crump
# Free for use
# BIM Guru, www.bimguru.com.au

# Boilerplate text
import clr

clr.AddReference("RevitServices")
import RevitServices
from RevitServices.Persistence import DocumentManager 

clr.AddReference("RevitAPI")
import Autodesk 
from Autodesk.Revit.DB import *

currDoc = DocumentManager.Instance.CurrentDBDocument
uiapp = DocumentManager.Instance.CurrentUIApplication
app = uiapp.Application

# Define list/unwrap list functions
def tolist(input):
    result = input if isinstance(input, list) else [input]
    return result

# Current doc/app/ui
paths = tolist(IN[0])
docs, outcomes = [], []

# Do some action in a Transaction
for path in paths:
	try:
		doc = app.OpenDocumentFile(path)
		docs.append(doc)
		outcomes.append(True)
	except:
		docs.append(None)
		outcomes.append(False)

# Preparing output to Dynamo
OUT = [docs, outcomes]
# ----------------------------------------
code_block = CodeBlock(x=python_script) { x[0]; x[1]; }
familyDocs = Output(code_block.out0)
wasOpened = Output(code_block.out1)
