# Dynamo custom node FamilyDocParameterGet.dyf "© FamilyDoc.ParameterGet" (Dynamo 2.3.1.11775)
# category: Crumple.Revit.Actions
# For provided family types of a family document, returns the values of specified parameters by name. Currently only works for string and number based parameters.
# packages: Crumple 2022.2.13

familyDocument = Input(familyDocument: var[]..[] = null)  # Uses current if none provided.
revit_getdocument = Custom[© Revit.GetDocument](docOrLink=familyDocument)  # package Crumple; If no input is specified or an invalid one is, returns current document. If a link instance is provided, it returns the linked document. If a document is provided it will pass it through.
familyTypes = Input(familyTypes: var[]..[])
parameterNames = Input(parameterNames: var[]..[])
python_script = Python(IN[0]=revit_getdocument.document, IN[1]=familyTypes, IN[2]=parameterNames)
# ---------- python_script.python (77 lines) ----------
# Made by Gavin Crump
# Free for use
# BIM Guru, www.bimguru.com.au

# Boilerplate text
import clr

clr.AddReference("RevitServices")
import RevitServices
from RevitServices.Persistence import DocumentManager 
from RevitServices.Transactions import TransactionManager 

clr.AddReference("RevitAPI")
clr.AddReference("RevitAPIUI")

import Autodesk 
from Autodesk.Revit.DB import *
from Autodesk.Revit.UI import *

# Current doc/app/ui
doc = IN[0]
DUT = Document.GetUnits(doc).GetFormatOptions(UnitType.UT_Length).DisplayUnits

# Define list/unwrap list functions
def tolist(input):
    result = input if isinstance(input, list) else [input]
    return result

# Preparing input from dynamo to revit
types_in  = IN[1]
params_in = tolist(IN[2])

param_list = doc.FamilyManager.GetParameters()
param_names = [p.Definition.Name for p in param_list]

params_in2 = []

for p in params_in:
	try:
		p2 = param_list[param_names.index(p)]
		params_in2.append(p2)
	except:
		params_in2.append(None)

TransactionManager.Instance.EnsureInTransaction(doc)

values_out = []

for t in types_in:
	doc.FamilyManager.CurrentType = t
	values = []
	for p in params_in2:
		try:
			ptype = str(p.Definition.ParameterType)
			stype = str(p.StorageType)
			
			if ptype == "Length":
				v2 = doc.FamilyManager.CurrentType.AsDouble(p)
				v = Autodesk.Revit.DB.UnitUtils.ConvertFromInternalUnits(v2, DUT)
			elif ptype == "Integer":
				v = doc.FamilyManager.CurrentType.AsInteger(p)
			elif ptype == "Number":
				v = doc.FamilyManager.CurrentType.AsDouble(p)
			elif stype == "String":
				v = doc.FamilyManager.CurrentType.AsString(p)
				
			values.append(v)
				
		except:
			values.append(None)
			
	values_out.append(values)
	
TransactionManager.Instance.TransactionTaskDone()

# Preparing output to Dynamo
OUT = values_out
# ----------------------------------------
parameterValues = Output(python_script)
