# Dynamo custom node FamilyDocParameterRemove.dyf "© FamilyDoc.ParameterRemove" (Dynamo 2.3.1.11775)
# category: Crumple.Revit.Create
# Given a parameter or list of parameters in a family document, attempts to remove them.
# packages: Crumple 2022.2.13

familyDocument = Input(familyDocument: var[]..[] = null)  # Uses current if none provided.
revit_getdocument = Custom[© Revit.GetDocument](docOrLink=familyDocument)  # package Crumple; If no input is specified or an invalid one is, returns current document. If a link instance is provided, it returns the linked document. If a document is provided it will pass it through.
parameters = Input(parameters: var[]..[])
python_script = Python(IN[0]=revit_getdocument.document, IN[1]=parameters)
# ---------- python_script.python (46 lines) ----------
# Made by Gavin Crump
# Free for use
# BIM Guru, www.bimguru.com.au

# Boilerplate text
import clr

clr.AddReference("RevitServices")
import RevitServices
from RevitServices.Persistence import DocumentManager 
from RevitServices.Transactions import TransactionManager 

clr.AddReference("RevitAPI")
clr.AddReference("RevitAPIUI")

import Autodesk 
from Autodesk.Revit.DB import *
from Autodesk.Revit.UI import *

# Current doc/app/ui
doc = IN[0]
famMan = doc.FamilyManager

# Define list/unwrap list functions
def tolist(input):
    result = input if isinstance(input, list) else [input]
    return result

# Preparing input from dynamo to revit
params_in = tolist(IN[1])

TransactionManager.Instance.EnsureInTransaction(doc)

success = []

for p in params_in:
	try:
		famMan.RemoveParameter(p)
		success.append(True)
	except:
		success.append(False)

TransactionManager.Instance.TransactionTaskDone()

# Preparing output to Dynamo
OUT = success
# ----------------------------------------
success = Output(python_script)
