# Dynamo custom node FamilyDocParameterSet.dyf "© FamilyDocParameterSet" (Dynamo 2.3.1.11775)
# category: Crumple.Revit.FamilyDocument
# Given a list of family types, attempt to set a list of values to a list of parameters. The node expects the inputs to be a list of types, a list of parameter names and a list of lists of parameter values.

familytypes = Input(familytypes: var[]..[])
parameterNames = Input(parameterNames: var[]..[])
parameterValues = Input(parameterValues: var[]..[])
python_script = Python(IN[0]=familytypes, IN[1]=parameterNames, IN[2]=parameterValues)
# ---------- python_script.python (67 lines) ----------
# Made by Gavin Crump
# Free for use
# BIM Guru, www.bimguru.com.au

# Boilerplate text
import clr

clr.AddReference("RevitServices")
import RevitServices
from RevitServices.Persistence import DocumentManager 
from RevitServices.Transactions import TransactionManager 

clr.AddReference("RevitAPI")
clr.AddReference("RevitAPIUI")

import Autodesk 
from Autodesk.Revit.DB import *
from Autodesk.Revit.UI import *

# Current doc/app/ui
doc = DocumentManager.Instance.CurrentDBDocument
DUT = Document.GetUnits(doc).GetFormatOptions(UnitType.UT_Length).DisplayUnits

# Define list/unwrap list functions
def tolist(input):
    result = input if isinstance(input, list) else [input]
    return result

# Preparing input from dynamo to revit
types_in  = IN[0]
params_in = tolist(IN[1])
values_in = IN[2]

param_list = doc.FamilyManager.GetParameters()
param_names = [p.Definition.Name for p in param_list]

params_in2 = []

for p in params_in:
	try:
		p2 = param_list[param_names.index(p)]
		params_in2.append(p2)
	except:
		params_in2.append(None)

TransactionManager.Instance.EnsureInTransaction(doc)

values_out = []

for t,vlist in zip(types_in,values_in):

	doc.FamilyManager.CurrentType = t
	values = []
	
	for p,v in zip(params_in2,vlist):
		try:
			doc.FamilyManager.Set(p,v)
			values.append(v)
		except:
			values.append(None)
			
	values_out.append(values)
	
TransactionManager.Instance.TransactionTaskDone()

# Preparing output to Dynamo
OUT = values_out
# ----------------------------------------
valuesSet = Output(python_script)
