# Dynamo custom node FamilyDocParameters.dyf "© FamilyDocParameters" (Dynamo 2.3.0.5885)
# category: Crumple.Revit.FamilyDocument
# Obtains all parameters in the document, as well as their properties.

document = Input(document: var[]..[] = null)  # Use only if you want to query other document
Refresh = Input(Refresh: bool = true)  # Toggle to refresh
document_parameters = Python(IN[0]=document, IN[1]=Refresh)
# ---------- document_parameters.python (40 lines) ----------
# Made by Gavin Crump
# Free for use
# BIM Guru, www.bimguru.com.au

#Credit to Joshua Budarick for his assistance with this workflow!
# https://www.linkedin.com/in/joshua-budarick-9bb50b4b/

# Boilerplate text
import clr
clr.AddReference('RevitAPI')
from Autodesk.Revit.DB import *

clr.AddReference("RevitServices")
import RevitServices
from RevitServices.Persistence import DocumentManager 

#Inputdoc : Part of script by Andreas Dieckmann
inputdoc = IN[0]

if inputdoc == None:
    doc = DocumentManager.Instance.CurrentDBDocument
elif inputdoc.GetType().ToString() == "Autodesk.Revit.DB.Document":
    doc = inputdoc
else:
	doc = DocumentManager.Instance.CurrentDBDocument

# Define lists
p_ele, p_nam, p_grp, p_sha, p_ins = [],[],[],[],[]

# Collect values
if doc.IsFamilyDocument:
	for param in doc.FamilyManager.Parameters:
		p_ele.append(param)
		p_nam.append(param.Definition.Name)
		p_sha.append(param.IsShared)
		p_ins.append(param.IsInstance)
		p_grp.append(param.Definition.ParameterGroup)
	OUT = [p_ele, p_nam, p_grp, p_sha, p_ins]
else:
	OUT = ["Document is not a family."]
# ----------------------------------------
code_block = CodeBlock(out=document_parameters) { ele = out[0]; nam = out[1]; grp = out[2]; sha = out[3]; ins = out[4]; }
elements = Output(code_block.ele)  # The parameters as elements
names = Output(code_block.nam)  # The names of the parameters
groups = Output(code_block.grp)  # The parameter groups
isShared = Output(code_block.sha)  # Is the parameter shared?
isInstance = Output(code_block.ins)  # Is the parameter instance based?
