# Dynamo custom node FamilyDocReplaceWithSharedParameters.dyf "© FamilyDoc.ReplaceWithSharedParameters" (Dynamo 2.12.1.8246)
# category: Crumple.Revit.Create
# Given a family document or list of documents, as well as family parameters and shared parameter definitions, this node will attempt to replace the parameters.
# packages: Crumple 2024.3.1

familyDocs = Input(familyDocs: var[]..[])  # A family document or list of family documents. If multiple family documents, you should provide a list of list with branches equal to the family documents. If you do not the node will apply longest lacing to the last list for each excess family document.
parLists = Input(parLists: var[]..[])  # Lists of parameters. (per family document, ideally)
exDefLists = Input(exDefLists: var[]..[])  # Lists of external definitions. (per family document, ideally)
list_graftbyprimary = Custom[© List.GraftByPrimary](primary=familyDocs, listA=parLists, listB=exDefLists)  # package Crumple; Given a first input, the node will assess how many items it contains (if one, it will make it a list of 1 item). Remaining branches will be forced into a list of lists, where the last branch will be repeated to a longest length as the first list (if one list or item is provided, it will repeat as the list of lists).
python_script_replace_parameters = Python(IN[0]=list_graftbyprimary.primary, IN[1]=list_graftbyprimary.listA, IN[2]=list_graftbyprimary.listB)  # CPython3
# ---------- python_script_replace_parameters.python (125 lines) ----------
# Made by Gavin Crump
# Free for use
# BIM Guru, www.bimguru.com.au

# Boilerplate text
import clr

clr.AddReference("RevitServices")
import RevitServices
from RevitServices.Persistence import DocumentManager
from RevitServices.Transactions import TransactionManager

clr.AddReference('RevitAPI')
import Autodesk 
from Autodesk.Revit.DB import FamilyManager, Transaction

# Get Revit build version
uiapp = DocumentManager.Instance.CurrentUIApplication
app = uiapp.Application
ver = int(app.VersionNumber)

try:
	from Autodesk.Revit.DB import ParameterUtils
except:
    pass

# Function to get forge type Id if in 2024
def getParGroup(par):
    try:
        return par.Definition.GetGroupTypeId()
    except:
        try:
            return par.Definition.ParameterGroup
        except:
            return None

# Function to replace parameter
def familyDoc_replaceParameter(famMan, par, exDef, myDoc):
	# If no parameter or def, we pass
	if par == None or exDef == None:
		return None, False, 0
	# Convert parGrp
	parGrp = getParGroup(par)
	parInst = par.IsInstance
	# If parameter is shared, > family > shared
	if par.IsShared:
		try:
			par = famMan.ReplaceParameter(par, "__Temp", parGrp, parInst)
			par = famMan.ReplaceParameter(par, exDef, parGrp, parInst)
			return par, True, -1
		except:
			return None, False, 1
	# Otherwise, > shared
	else:
		try:
			par = famMan.ReplaceParameter(par, exDef, parGrp, par.IsInstance)
			return par, True, -1
		except:
			return None, False, 1

#unwrap all elements to use with API
docs_list = IN[0]
pars_list = IN[1]
defs_list = IN[2]

pars_out, results, outcomes = [],[],[]

# Collect values
for doc, pars, defs in zip(docs_list, pars_list, defs_list):
	
	# Try to get doc title
	try:
		docTitle = doc.Title
	except:
		docTitle = "N/A"
	
	# Result lists, family manager
	fam_pars, result, outcome = [],[],[]
	famMan = doc.FamilyManager
	
	# For each definition/parameter
	for d,p in zip(defs, pars):
		
		# Try to get def and parnames
		try:
			defName = d.Name
		except:
			defName = "N/A"
		try:
			parName = p.Definition.Name
		except:
			parName = "N/A"
		
		# Early error states
		if doc == None:
			msg = 'ERROR: Document not provided.'
		elif d == None:
			msg = 'ERROR: Definition not provided for {}.'.format(docTitle)
		elif p == None:
			msg = 'ERROR: Parameter not provided for {}.'.format(docTitle)
		
		# Try to replace parameter
		with Transaction(doc, 'Replace parameters') as t:
			t.Start()
			par, res, outc = familyDoc_replaceParameter(famMan, p, d, doc)
			t.Commit()
			
			# Process outc
			if outc == -1:
				msg = 'SUCCESS: {} replaced {} in {}.'.format(defName, parName, docTitle)
			elif outc == 1:
				msg = 'FAILURE: {} could not replace {} in {}.'.format(defName, parName, docTitle)
		
		# Append the result
		fam_pars.append(par)
		result.append(res)
		outcome.append(msg)
	
	# Append the results
	pars_out.append(fam_pars)
	results.append(result)
	outcomes.append(outcome)

# Outputs to Dynamo
OUT = docs_list, pars_out, results, outcomes
# ----------------------------------------
code_block = CodeBlock(out=python_script_replace_parameters) { docs = out[0]; pars = out[1]; resl = out[2]; outc = out[3]; }
familyDocs_2 = Output(code_block.docs)  # "familyDocs"; The original family document(s).
Lists_of_parameters_replaced_list_per_fa = Output(code_block.pars)  # "/*Lists of parameters replaced (list per family document). Failures will return a null.*/ parameterLists"
Lists_of_outcomes_list_per_family_docume = Output(code_block.resl)  # "/*Lists of outcomes (list per family document). True if success, false if not.*/ resultLists"
Lists_of_outcomes_list_per_family_docume_2 = Output(code_block.outc)  # "/*Lists of outcomes (list per family document).*/ outcomeLists"
