# Dynamo custom node FamilyDocReportToValues.dyf "© FamilyDoc.ReportToValues" (Dynamo 2.12.1.8246)
# category: Crumple.Revit.Actions
# Given an input from the typical valuesreport structure, attempts to prepare this data into its equivalent data structure for a SetValues node. Missing values will become nulls and Blank values will become empty strings.

familyDocs = Input(familyDocs: var[]..[])  # A list of family documents
report = Input(report: var[]..[])  # A report from Excel, structured as per that which Crumple's reportvalues node returns.
valueMissingStr = Input(valueMissingStr: string = "<N/A>")
valueBlankStr = Input(valueBlankStr: string = "<Blank>")
python_script = Python(IN[0]=familyDocs, IN[1]=report, IN[2]=valueMissingStr, IN[3]=valueBlankStr)  # CPython3
# ---------- python_script.python (94 lines) ----------
# Made by Gavin Crump
# Free for use
# BIM Guru, www.bimguru.com.au

# Boilerplate text
import clr

clr.AddReference("RevitAPI")
import Autodesk 
from Autodesk.Revit.DB import ElementId

# Define list/unwrap list functions
def tolist(input):
    result = input if isinstance(input, list) else [input]
    return result

def getByName(n, elems, names):
	for el,na in zip(elems, names):
		if na == n:
			return el
	return None

# Preparing input from dynamo to revit
docs_list     = tolist(IN[0])
report        = IN[1]
value_missing = IN[2]
value_blank   = IN[3]

# Get parameter names
param_getNames = report[0][2:]

# Empty overall lists to build
doc_paramLists, doc_typeLists, doc_valueLists = [],[],[]

# For each document...
for doc in docs_list:
	# Lists for documents
	doc_getTypes   = []
	doc_valueTypeLists = []
	# Get doc title
	doc_name    = doc.Title
	# Get document params, names
	doc_params     = doc.FamilyManager.Parameters
	doc_paramNames = [p.Definition.Name for p in doc_params]
	# Get the params for each provided name
	doc_getParams = [getByName(n, doc_params, doc_paramNames) for n in param_getNames]
	# Get document types, names
	doc_types     = doc.FamilyManager.Types
	doc_typeNames = [t.Name for t in doc_types]
	# For each row...
	for row in report:
		# If it is our document...
		if str(row[0]) == doc_name:
			# Get type value list
			type_valueList = []
			# Get the type if possible
			doc_type = getByName(row[1], doc_types, doc_typeNames)
			doc_getTypes.append(doc_type)
			# For each parameter...
			for par,val in zip(doc_getParams, row[2:]):
				# If we have a type and parameter
				if doc_type and par != None:
					# If element Id...
					if "<Id:" in str(val):
						# Try to get the element
						try:
							val = str(val)
							val = val.split("<Id:")[-1]
							val = val.replace(">", "")
							eId = int(val)
							ele = doc.GetElement(ElementId(eId))
							type_valueList.append(ele)
						except:
							type_valueList.append(None)
					# Missing check
					elif str(val) == value_missing:
						type_valueList.append(None)
					# Blank check
					elif str(val) == value_blank:
						type_valueList.append("")
					# Otherwise continue it as a string
					else:
						type_valueList.append(val)
				# Otherwise continue it as a string
				else:
					type_valueList.append(None)
			doc_valueTypeLists.append(type_valueList)
	# Append final report lists
	doc_paramLists.append(doc_getParams)
	doc_valueLists.append(doc_valueTypeLists)
	doc_typeLists.append(doc_getTypes)

# Preparing output to Dynamo
OUT = docs_list, doc_paramLists, doc_typeLists, doc_valueLists
# ----------------------------------------
code_block = CodeBlock(out=python_script) { docs = out[0]; pars = out[1]; typs = out[2]; vals = out[3]; }
familyDocs_2 = Output(code_block.docs)  # "familyDocs"; The original family document(s).
Lists_of_parameters_list_per_family_docu = Output(code_block.pars)  # "/*Lists of parameters (list per family document).*/ paramLists"
Lists_of_family_types_list_per_family_do = Output(code_block.typs)  # "/*Lists of family types (list per family document).*/ typeLists"
List_of_list_of_values_list_per_family_t = Output(code_block.vals)  # "/*List of list of values (list per family type, per family document).*/ valLists"
