# Dynamo custom node FamilyDocSetFormulae.dyf "© FamilyDoc.SetFormulae" (Dynamo 2.12.1.8246)
# category: Crumple.Revit.Actions
# Given a list of family documents, parmeters, and formula lists the node will attempt to set the parameter formulae.
# packages: Crumple 2024.3.1

familyDocs = Input(familyDocs: var[]..[])  # A list of family documents
nameOrParamLists = Input(nameOrParamLists: var[]..[])  # Lists of family parameters or parameter names. (per family document, ideally)
formulaeLists = Input(formulaeLists: var[]..[])  # Lists of formulae values. (per family document, ideally)
list_graftbyprimary = Custom[© List.GraftByPrimary](primary=familyDocs, listA=nameOrParamLists, listB=formulaeLists)  # package Crumple; Given a first input, the node will assess how many items it contains (if one, it will make it a list of 1 item). Remaining branches will be forced into a list of lists, where the last branch will be repeated to a longest length as the first list (if one list or item is provided, it will repeat as the list of lists).
python_script_set_formulae = Python(IN[0]=list_graftbyprimary.primary, IN[1]=list_graftbyprimary.listA, IN[2]=list_graftbyprimary.listB)  # CPython3
# ---------- python_script_set_formulae.python (93 lines) ----------
# Made by Gavin Crump
# Free for use
# BIM Guru, www.bimguru.com.au

# Boilerplate text
import clr

clr.AddReference("RevitServices")
import RevitServices
from RevitServices.Persistence import DocumentManager
from RevitServices.Transactions import TransactionManager

clr.AddReference('RevitAPI')
import Autodesk 
from Autodesk.Revit.DB import FamilyManager, Transaction, StorageType

# Function to set parameter formulae
def familyDoc_setParamFormula(par, formula, famMan, title):
	try:
		parName = par.Definition.Name
	except:
		return False, 'ERROR: Parameter not found in {}'.format(title)
	if formula == None:
		return False, 'ERROR: No formula provided for {} in {}'.format(parName, title)
	elif famMan == None:
		return False, 'ERROR: Document not provided'
	elif par.CanAssignFormula:
		if not isinstance(formula, str):
			formula = str(formula)
		if formula == par.Formula:
			return False, 'SKIPPED: {} already matching formula in {}'.format(parName, title)
		try:
			famMan.SetFormula(par, formula)
			return True, 'SUCCESS: {} set in {}'.format(parName, title)
		except:
			return False, 'FAILURE: {} not set in {}'.format(parName, title)
	else:
		return False, 'FAILURE: {} does not support formula in {}'.format(parName, title)

def parameterOrName(par):
	# If it isn't a string, try to get its definition name
	if not isinstance(par, str):
		try:
			return par.Definition.Name
		except:
			return ""
	else:
		return par

#unwrap all elements to use with API
docs_list = IN[0]
pars_list = IN[1]
form_list = IN[2]

results, outcomes, paramLists = [],[],[]

# For each document and the values...
for doc, param_list, formulae in zip(docs_list, pars_list, form_list):
	# Get family manager
	famMan = doc.FamilyManager
	famTitle = doc.Title
	result, outcome = [],[]
	# Get parameter names
	params = famMan.Parameters
	parNames = [p.Definition.Name for p in params]
	parNameList = [parameterOrName(p) for p in param_list]
	# Get the parameters by name
	paramList = []
	for parName in parNameList:
		if parName in parNames:
			# Find it using a zip loop
			for p,n in zip(params, parNames):
				if n == parName:
					paramList.append(p)
					break
		else:
			paramList.append(None)
	# For each parameter and formula...
	for p,f in zip(paramList, formulae):
		# Try to set it
		with Transaction(doc, 'Set formula') as t:
			t.Start()
			r, o = familyDoc_setParamFormula(p, f, famMan, famTitle)
			result.append(r)
			outcome.append(o)
			t.Commit()
	# Append to overall results
	results.append(result)
	outcomes.append(outcome)
	paramLists.append(paramList)

# Outputs to Dynamo
OUT = docs_list, paramLists, results, outcomes
# ----------------------------------------
code_block = CodeBlock(out=python_script_set_formulae) { docs = out[0]; pars = out[1]; res  = out[2]; outs = out[3]; }
familyDocs_2 = Output(code_block.docs)  # "familyDocs"; The original family document(s).
Lists_of_outcomes_list_per_family_docume = Output(code_block.res)  # "/*Lists of outcomes (list per family document). True if success, false if not.*/ resultLists"
Lists_of_outcomes_list_per_family_docume_2 = Output(code_block.outs)  # "/*Lists of outcomes (list per family document). Text descriptions.*/ outcomeLists"
