# Dynamo custom node FamilyDocSetParameterValues.dyf "© FamilyDoc.SetParameterValues" (Dynamo 2.16.2.5624)
# category: Crumple.Revit.Actions
# Given a list of family documents, parmeters, types and value lists by type the node will attempt to set the parameter values. ElementId based values should be provided in the form of elements (not Ids) respective to the family document. For best results, combine this with the ReportToValues node.
# packages: Crumple 2024.3.1

familyDocs = Input(familyDocs: var[]..[])  # A list of family documents
nameOrParamLists = Input(nameOrParamLists: var[]..[])  # Lists of family parameters or parameter names. (per family document, ideally)
nameOrTypeLists = Input(nameOrTypeLists: var[]..[])  # Lists of family types or type names. (per family document, ideally)
valueLists = Input(valueLists: var[]..[])  # Lists of parameter values. (per type, family document)
list_graftbyprimary = Custom[© List.GraftByPrimary](primary=familyDocs, listA=nameOrParamLists, listB=nameOrTypeLists, listC=valueLists)  # package Crumple; Given a first input, the node will assess how many items it contains (if one, it will make it a list of 1 item). Remaining branches will be forced into a list of lists, where the last branch will be repeated to a longest length as the first list (if one list or item is provided, it will repeat as the list of lists).
python_script_set_parameter = Python(IN[0]=list_graftbyprimary.primary, IN[1]=list_graftbyprimary.listA, IN[2]=list_graftbyprimary.listB, IN[3]=list_graftbyprimary.listC)  # "Python Script (set parameter values)"; CPython3
# ---------- python_script_set_parameter.python (301 lines) ----------
# Made by Gavin Crump
# Free for use
# BIM Guru, www.bimguru.com.au

# Boilerplate text
import clr

clr.AddReference("RevitServices")
import RevitServices
from RevitServices.Persistence import DocumentManager 
from RevitServices.Transactions import TransactionManager 

clr.AddReference("RevitAPI")
import Autodesk 
from Autodesk.Revit.DB import *

# Preparing input from dynamo to revit
docs_list          = IN[0]
params_lists       = IN[1]
type_lists         = IN[2]
values_listsByType = IN[3]

# Get Revit build version
uiapp = DocumentManager.Instance.CurrentUIApplication
app = uiapp.Application
rvt_year = int(app.VersionNumber)

if rvt_year < 2022:
	pt_length = ParameterType.Length
	pt_area = ParameterType.Area
else:
	pt_length = SpecTypeId.Length
	pt_area = SpecTypeId.Area

# Convert length from internal
def interalToProject_len(val, myDoc, ver = rvt_year):
	if rvt_year < 2022:
		intUnits = myDoc.GetUnits().GetFormatOptions(UnitType.UT_Length).DisplayUnits
		return UnitUtils.Convert(val,DisplayUnitType.DUT_DECIMAL_FEET,intUnits)
	else:
		intUnitsId = myDoc.GetUnits().GetFormatOptions(SpecTypeId.Length).GetUnitTypeId()
		return UnitUtils.ConvertFromInternalUnits(val, intUnitsId)

# Convert length to internal
def projectToInternal_len(val, myDoc, ver = rvt_year):
	if rvt_year < 2022:
		intUnits = myDoc.GetUnits().GetFormatOptions(UnitType.UT_Length).DisplayUnits
		return UnitUtils.Convert(val, intUnits, DisplayUnitType.DUT_DECIMAL_FEET)
	else:
		intUnitsId = myDoc.GetUnits().GetFormatOptions(SpecTypeId.Length).GetUnitTypeId()
		return UnitUtils.ConvertToInternalUnits(val, intUnitsId)

# Convert area from internal
def interalToProject_area(val, myDoc, ver = rvt_year):
	if rvt_year < 2022:
		intUnits = myDoc.GetUnits().GetFormatOptions(UnitType.UT_Area).DisplayUnits
		return UnitUtils.Convert(val,DisplayUnitType.DUT_SQUARE_FEET,intUnits)
	else:
		intUnitsId = myDoc.GetUnits().GetFormatOptions(SpecTypeId.Area).GetUnitTypeId()
		return UnitUtils.ConvertFromInternalUnits(val, intUnitsId)

# Convert area to internal
def projectToInternal_area(val, myDoc, ver = rvt_year):
	if rvt_year < 2022:
		intUnits = myDoc.GetUnits().GetFormatOptions(UnitType.UT_Area).DisplayUnits
		return UnitUtils.Convert(val, intUnits, DisplayUnitType.DUT_SQUARE_FEET)
	else:
		intUnitsId = myDoc.GetUnits().GetFormatOptions(SpecTypeId.Area).GetUnitTypeId()
		return UnitUtils.ConvertToInternalUnits(val, intUnitsId)

# Function to fix string to number bugs
def data_cleanString(data):
	# If it's a string, return it
	if isinstance(data, str):
		return data
	# If it's an integer, convert it
	elif isinstance(data, int):
		data = str(data)
		# Remove any trailing decimals
		if "." in data:
			return data.split(".")[-0]
		else:
			return data
	# If it's a float, convert it
	elif isinstance(data, float):
		data = str(data)
		# Strip trailing zeroes
		data = data.rstrip("0")
		# If last character is decimal, remove it
		if data[-1] == ".":
			return data[:-1]
		else:
			return data
	# Otherwise just string it
	else:
		try:
			return str(data)
		except:
			return None

# Function to get parameter value
def familyDoc_parGetValue(famDoc, famType, par):
	# Get storage type
	st = par.StorageType
	if rvt_year < 2022:
		pt = par.Definition.ParameterType
	else:
		pt = par.Definition.GetDataType()
	# Try each storage type
	if st == StorageType.String:
		val = famType.AsString(par)
		if not val:
			val = ""
	elif st == StorageType.Double:
		val = famType.AsDouble(par)
		if not val:
			val = 0.00
		if pt == pt_length and val != 0.00:
			val = interalToProject_len(val, doc)
		elif pt == pt_area and val != 0.00:
			val = interalToProject_area(val, doc)
	elif st == StorageType.Integer:
		val = famType.AsInteger(par)
		if not val:
			val = 0
	elif st == StorageType.ElementId:
		val = famType.AsElementId(par)
		if not val:
			val = ElementId.InvalidElementId
	else:
		val = None
	# Return the value
	return val

# Function to set family parameter
def familyDoc_parSetValue(famMan, famType, par, val):
	# If type is not current, set it
	if famMan.CurrentType != famType:
		famMan.CurrentType = famType
	# Try to set the parameter value
	try:
		val.IntegerValue
		val.ToString()
		id = True
	except:
		id = False
	if id:
		famMan.Set(par, val)
	try:
		famMan.Set(par, val)
		return True
	except:
		return False

# Function: Make provided value suit the parameter type
def familyDoc_alignValue(par, val, myDoc):
	# Get storage type
	st = par.StorageType
	if rvt_year < 2022:
		pt = par.Definition.ParameterType
	else:
		pt = par.Definition.GetDataType()
	# Try each storage type
	if st == StorageType.String:
		return data_cleanString(val)
	elif st == StorageType.Double:
		try:
			val = float(val)
		except:
			return None
		if pt == pt_length:
			val = projectToInternal_len(val, myDoc)
		elif pt == pt_area:
			val = projectToInternal_area(val, myDoc)
		if isinstance(val, float):
			return val
		else:
			try:
				return float(val)
			except:
				return None
	elif st == StorageType.Integer:
		if isinstance(val, int):
			return val
		else:
			try:
				return int(val)
			except:
				return None
	else:
		try:
			return ElementId(val.Id)
		except:
			return None

def parameterOrName(par):
	# If it isn't a string, try to get its definition name
	if not isinstance(par, str):
		try:
			return par.Definition.Name
		except:
			return ""
	else:
		return par

def typeOrName(t, types, names):
	if isinstance(t, str):
		for ft,fn in zip(types, names):
			if fn == t:
				return ft
		return None
	else:
		return t

# Core list of outcomes
results, outcomes = [],[]

# For each document and list...
for doc, param_list, type_list, values_listByType in zip(docs_list, params_lists, type_lists, values_listsByType):
	# Results and title
	famMan = doc.FamilyManager
	results_doc, outcomes_doc = [], []
	try:
		fam_name = doc.Title
	except:
		fam_name = "N/A"
	# Get parameter names
	params = famMan.Parameters
	parNames = [p.Definition.Name for p in params]
	parNameList = [parameterOrName(p) for p in param_list]
	# Get the parameters by name
	paramList = []
	for parName in parNameList:
		if parName in parNames:
			# Find it using a zip loop
			for p,n in zip(params, parNames):
				if n == parName:
					paramList.append(p)
					break
		else:
			paramList.append(None)
	# Get types
	types = famMan.Types
	typeNames = [f.Name for f in types]
	typeList = [typeOrName(t, types, typeNames) for t in types]
	# For each type and its value list...
	for famType, value_list, ftn in zip(typeList, values_listByType, typeNames):
		results_type = []
		outcomes_type = []
		# For each param and value...
		for par, val in zip(paramList, value_list):
			# Get existing par name
			try:
				par_name = par.Definition.Name
			except:
				par_name = "N/A"
			# Clean value and get existing value
			if par:
				val = familyDoc_alignValue(par, val, doc)
				val_existing = familyDoc_parGetValue(doc, famType, par)
			else:
				val = None
				val_existing = None
			# If not doc
			if not fam_name:
				results_type.append(False)
				outcomes_type.append("ERROR: No document ({}, {}: {}).".format(fam_name, ftn, par_name))
			# If not par
			elif not par_name:
				results_type.append(False)
				outcomes_type.append("ERROR: No parameter ({}, {}: {}).".format(fam_name, ftn, par_name))
			# If not val
			elif not val:
				results_type.append(False)
				outcomes_type.append("ERROR: Unsuitable value ({}, {}: {}).".format(fam_name, ftn, par_name))
			# If value is not the same and we have values...
			elif val != val_existing:
				# Try setting it
				result = False
				with Transaction(doc, 'Replace parameters') as t:
					t.Start()
					result = familyDoc_parSetValue(famMan, famType, par, val)
					t.Commit()
				results_type.append(result)
				if result:
					outcomes_type.append("SUCCESS Value set ({}, {}: {}).".format(fam_name, ftn, par_name))
				else:
					outcomes_type.append("FAILURE: Could not set ({}, {}: {}).".format(fam_name, ftn, par_name))
			# Otherwise, it didn't need to change
			else:
				results_type.append(False)
				outcomes_type.append("SKIPPED: No change ({}, {}: {}).".format(fam_name, ftn, par_name))
		# Append type results
		results_doc.append(results_type)
		outcomes_doc.append(outcomes_type)
	# Append doc results
	results.append(results_doc)
	outcomes.append(outcomes_doc)

# Preparing output to Dynamo
OUT = docs_list, results, outcomes
# ----------------------------------------
code_block = CodeBlock(out=python_script_set_parameter) { docs = out[0]; res  = out[1]; outc = out[2]; }
familyDocs_2 = Output(code_block.docs)  # "familyDocs"; The original family document(s).
Lists_of_outcomes_list_per_family_docume = Output(code_block.res)  # "/*Lists of outcomes (list per family document). True if success, false if not.*/ resultLists"
Lists_of_outcomes_list_per_family_docume_2 = Output(code_block.outc)  # "/*Lists of outcomes (list per family document). Text descriptions.*/ outcomeLists"
