# Dynamo custom node FamilyDocSsParameterSet.dyf "© FamilyDoc.SS_ParameterSet" (Dynamo 2.3.1.11775)
# category: Crumple.Revit.Actions
# Given a list of family types, attempt to set a list of values to a list of parameters. The node expects the inputs to be a list of types, a list of parameter names and a list of lists of parameter values.
# packages: Crumple 2022.2.13

familyDocument = Input(familyDocument: var[]..[] = null)  # Uses current if none provided.
revit_getdocument = Custom[© Revit.GetDocument](docOrLink=familyDocument)  # package Crumple; If no input is specified or an invalid one is, returns current document. If a link instance is provided, it returns the linked document. If a document is provided it will pass it through.
familytypes = Input(familytypes: var[]..[])
parameterNames = Input(parameterNames: var[]..[])
parameterValues = Input(parameterValues: var[]..[])
python_script = Python(IN[0]=revit_getdocument.document, IN[1]=familytypes, IN[2]=parameterNames, IN[3]=parameterValues)
# ---------- python_script.python (67 lines) ----------
# Made by Gavin Crump
# Free for use
# BIM Guru, www.bimguru.com.au

# Boilerplate text
import clr

clr.AddReference("RevitServices")
import RevitServices
from RevitServices.Persistence import DocumentManager 
from RevitServices.Transactions import TransactionManager 

clr.AddReference("RevitAPI")
clr.AddReference("RevitAPIUI")

import Autodesk 
from Autodesk.Revit.DB import *
from Autodesk.Revit.UI import *

# Current doc/app/ui
doc = IN[0]
DUT = Document.GetUnits(doc).GetFormatOptions(UnitType.UT_Length).DisplayUnits

# Define list/unwrap list functions
def tolist(input):
    result = input if isinstance(input, list) else [input]
    return result

# Preparing input from dynamo to revit
types_in  = IN[1]
params_in = tolist(IN[2])
values_in = IN[3]

param_list = doc.FamilyManager.GetParameters()
param_names = [p.Definition.Name for p in param_list]

params_in2 = []

for p in params_in:
	try:
		p2 = param_list[param_names.index(p)]
		params_in2.append(p2)
	except:
		params_in2.append(None)

TransactionManager.Instance.EnsureInTransaction(doc)

values_out = []

for t,vlist in zip(types_in,values_in):

	doc.FamilyManager.CurrentType = t
	values = []
	
	for p,v in zip(params_in2,vlist):
		try:
			doc.FamilyManager.Set(p,v)
			values.append(v)
		except:
			values.append(None)
			
	values_out.append(values)
	
TransactionManager.Instance.TransactionTaskDone()

# Preparing output to Dynamo
OUT = values_out
# ----------------------------------------
valuesSet = Output(python_script)
