# Dynamo custom node FamilyDocTitle.dyf "© FamilyDocTitle" (Dynamo 2.3.1.11775)
# category: Crumple.Revit.FamilyDocument
# Returns the title of a family document in the unwrapped state. Can be used in conjunction with nodes like 'FamilyDocOpen'.

familyDoc = Input(familyDoc: var[]..[])
python_script = Python(IN[0]=familyDoc)
# ---------- python_script.python (35 lines) ----------
# Made by Gavin Crump
# Free for use
# BIM Guru, www.bimguru.com.au

# Boilerplate text
import clr

clr.AddReference("RevitServices")
import RevitServices
from RevitServices.Persistence import DocumentManager 

clr.AddReference("RevitAPI")
import Autodesk 
from Autodesk.Revit.DB import *

currDoc = DocumentManager.Instance.CurrentDBDocument
uiapp = DocumentManager.Instance.CurrentUIApplication
app = uiapp.Application

# Define list/unwrap list functions
def tolist(input):
    result = input if isinstance(input, list) else [input]
    return result

# Current doc/app/ui
docs = tolist(IN[0])
titles = []

# Do some action in a Transaction
for doc in docs:
	title = doc.Title
	titles.append(title)

# Preparing output to Dynamo
OUT = [titles]
# ----------------------------------------
docTitle = Output(python_script)
