# Dynamo custom node FamilyDocTypes.dyf "© FamilyDoc.Types" (Dynamo 2.3.1.11775)
# category: Crumple.Revit.Query
# Returns all family types in a family document.
# packages: Crumple 2022.2.13

familyDocument = Input(familyDocument: var[]..[] = null)  # Uses current if none provided.
revit_getdocument = Custom[© Revit.GetDocument](docOrLink=familyDocument)  # package Crumple; If no input is specified or an invalid one is, returns current document. If a link instance is provided, it returns the linked document. If a document is provided it will pass it through.
python_script = Python(IN[0]=revit_getdocument.document)
# ---------- python_script.python (24 lines) ----------
# Made by Gavin Crump
# Free for use
# BIM Guru, www.bimguru.com.au

# Boilerplate text
import clr

clr.AddReference("RevitServices")
import RevitServices
from RevitServices.Persistence import DocumentManager 

clr.AddReference("RevitAPI")
import Autodesk 
from Autodesk.Revit.DB import *

# Current doc/app/ui
doc = IN[0]

# Preparing input from dynamo to revit
fam_types = doc.FamilyManager.Types
fam_names = [f.Name for f in fam_types]

# Preparing output to Dynamo
OUT = [fam_types, fam_names]
# ----------------------------------------
code_block = CodeBlock(x=python_script) { x[0]; x[1]; }
familyTypes = Output(code_block.out0)
typeNames = Output(code_block.out1)
