# Dynamo custom node FamilyDocTypesByNames.dyf "© FamilyDoc.GetTypesByNames" (Dynamo 2.12.1.8246)
# category: Crumple.Revit.Query
# Given a family document or list of documents, returns all family types in that document by their name if found.
# packages: Crumple 2024.3.1

familyDocs = Input(familyDocs: var[]..[])  # A family document or list of family documents. If multiple family documents, you should provide a list of list with branches equal to the family documents. If you do not the node will apply longest lacing to the last list for each excess family document.
nameLists = Input(nameLists: var[]..[])  # Lists of family parameters names. (per family document, ideally)
list_graftbyprimary = Custom[© List.GraftByPrimary](primary=familyDocs, listA=nameLists)  # package Crumple; Given a first input, the node will assess how many items it contains (if one, it will make it a list of 1 item). Remaining branches will be forced into a list of lists, where the last branch will be repeated to a longest length as the first list (if one list or item is provided, it will repeat as the list of lists).
python_script_get_parameters = Python(IN[0]=list_graftbyprimary.primary, IN[1]=list_graftbyprimary.listA)  # IronPython2
# ---------- python_script_get_parameters.python (58 lines) ----------
# Made by Gavin Crump
# Free for use
# BIM Guru, www.bimguru.com.au

# Boilerplate text
import clr

clr.AddReference("RevitServices")
import RevitServices
from RevitServices.Persistence import DocumentManager 

clr.AddReference('RevitAPI')
import Autodesk 
from Autodesk.Revit.DB import *

# Get Revit build version
uiapp = DocumentManager.Instance.CurrentUIApplication
app = uiapp.Application

# Define list/unwrap list functions
def tolist(input):
    result = input if isinstance(input, list) else [input]
    return result

#Inputdoc
docs_list = IN[0]
paramName_lists = IN[1]

paramLists = []

# For each document...
for doc, nameList in zip(docs_list, paramName_lists):
	# Storage lists
	paramList = []
	# If a family document...
	if doc.IsFamilyDocument:
		# Get parameters
		famMan = doc.FamilyManager
		params = famMan.Parameters
		parNames = [p.Definition.Name for p in params]
		# For each parameter name...
		for parName in nameList:
			# If name is in names...
			if parName in parNames:
				# Find it using a zip loop
				for p,n in zip(params, parNames):
					if n == parName:
						par = p
						break
				paramList.append(par)
			# Otherwise, no parameter or values
			else:
				paramList.append(None)
	# Append the lists
	paramLists.append(paramList)

# Output the lists
OUT = docs_list, paramLists
# ----------------------------------------
code_block = CodeBlock(out=python_script_get_parameters) { doc = out[0]; typ = out[1]; }
familyDocs_2 = Output(code_block.doc)  # "familyDocs"; The original family document(s).
Lists_of_parameters_list_per_family_docu = Output(code_block.typ)  # "/*Lists of parameters (list per family document).*/ paramLists"
