# Dynamo custom node FamilyDocValuesReport.dyf "© FamilyDoc.ValuesReport" (Dynamo 2.12.1.8246)
# category: Crumple.Revit.Actions
# Given the outputs of the family types and parmaeter values nodes, puts together an Excel valid data structure. Elements will be converted to Name/Id syntax.
# packages: Crumple 2024.3.1

byRows = Input(byRows: bool = true)
familyDocs = Input(familyDocs: var[]..[])  # Provide as comes from the GetParameterValues node
paramLists = Input(paramLists: var[]..[])  # Provide as comes from the GetParameterValues node
valLists = Input(valLists: var[]..[])  # Provide as comes from the GetParameterValues node
typeLists = Input(typeLists: var[]..[])  # Provide as comes from the GetParameterValues node
valueMissingStr = Input(valueMissingStr: string = "<N/A>")
valueBlankStr = Input(valueBlankStr: string = "<Blank>")
python_script = Python(IN[0]=familyDocs, IN[1]=paramLists, IN[2]=valLists, IN[3]=typeLists, IN[4]=valueMissingStr, IN[5]=valueBlankStr)  # CPython3
# ---------- python_script.python (89 lines) ----------
# Made by Gavin Crump
# Free for use
# BIM Guru, www.bimguru.com.au

# Import clr
import clr

# Function: Try to get parameter name
def par_getName(p):
	try:
		return p.Definition.Name
	except:
		return None

# Function: Try to get type name
def type_getName(t):
	try:
		return t.Name
	except:
		return None

# Function: Try to get element Id if not return value
def element_tryToValue(e, blankVal):
	# If no element or empty, return empty
	if e == None or e == "":
		return blankVal
	# Try to get element Id, if not return value
	try:
		ele_id = e.Id.ToString()
	except:
		return e
	# Try to get element name and Id syntax
	try:
		ele_name = '{} <Id:{}>'.format(e.Name, ele_id)
	except:
		ele_name = 'Element <Id:{}>'.format(ele_id)
	# Return element syntax
	return ele_name

# Preparing input from dynamo to revit
docs_list   = IN[0]
pars_byDoc  = IN[1]
vals_byDoc  = IN[2]
types_byDoc = IN[3]
replace_val = IN[4]
blank_val   = IN[5]

# Get unique parameter names
pars_unique = []

for pars in pars_byDoc:
	for p in pars:
		par_name = par_getName(p)
		if par_name not in pars_unique and par_name:
			pars_unique.append(par_name)

pars_unique.sort()

# Develop report
report = [["Document", "Type"] + pars_unique]

# For each document and its lists...
for doc, pars, vals_byType, types in zip(docs_list, pars_byDoc, vals_byDoc, types_byDoc):
	# Get doc title and par names per doc
	doc_title = doc.Title
	par_names = [par_getName(p) for p in pars]
	# For each type and its values...
	for t, vals in zip(types, vals_byType):
		# Try to get type name
		type_name = type_getName(t)
		# If we got a type...
		if type_name != None:
			# Begin report row
			report_row = [doc_title, type_name]
			# For each unique parameter name...
			for n in pars_unique:
				# If doc has it, get its value
				if n in par_names:
					ind = par_names.index(n)
					val = vals[ind]
					report_row.append(element_tryToValue(val, blank_val))
				# Otherwise add null value
				else:
					report_row.append(replace_val)
			# Add row to report
			report.append(report_row)

# Preparing output to Dynamo
OUT = report
# ----------------------------------------
transpose = List.Transpose(lists=python_script)
flow_ifthenelse = Custom[© Flow.IfThenElse](If=byRows, Then=python_script, Else=transpose)  # package Crumple; A simple if/then/else logic gate. If true, you get the 'then' input, otherwise you get the 'else' input. Unlike the OOTB 'If' node, this one allows differing list sizes.
report = Output(flow_ifthenelse)
