# Dynamo custom node FamilyEditDocument.dyf "© Family.EditDocument" (Dynamo 2.12.1.8246)
# category: Crumple.Revit.Actions
# Attempts to edit (open) a copy of a family in the project as a background document.
# packages: Crumple 2024.3.1

families = Input(families: var[]..[])
docOrLink = Input(docOrLink: var[]..[] = null)  # Uses current if none provided. Accepts document or link instance.
revit_getdocument = Custom[© Revit.GetDocument](docOrLink=docOrLink)  # package Crumple; If no input is specified or an invalid one is, returns current document. If a link instance is provided, it returns the linked document. If a document is provided it will pass it through.
python_script = Python(IN[0]=families, IN[1]=revit_getdocument.document)  # IronPython2
# ---------- python_script.python (47 lines) ----------
# Made by Gavin Crump
# Free for use
# BIM Guru, www.bimguru.com.au

# Boilerplate text
import clr

clr.AddReference("RevitServices")
import RevitServices
from RevitServices.Transactions import TransactionManager

# Current doc/app/ui
doc = IN[1]

# Define list/unwrap list functions
def uwlist(input):
    result = input if isinstance(input, list) else [input]
    return UnwrapElement(result)

# Function to activate family
def activateFamily(fam, myDoc = doc):
	TransactionManager.Instance.EnsureInTransaction(myDoc)
	famSymbolIds = fam.GetFamilySymbolIds()
	for i in famSymbolIds:
		fs = myDoc.GetElement(i)
		fs.Activate()
	TransactionManager.Instance.TransactionTaskDone()
	TransactionManager.Instance.ForceCloseTransaction()
	return None

# Preparing input from dynamo to revit
families = uwlist(IN[0])
famDocs, results = [],[]

# Edit families
for f in families:
	activateFamily(f, doc)
	try:
		famDoc = doc.EditFamily(f)
		famDocs.append(famDoc)
		results.append(True)
	except:
		famDocs.append(None)
		results.append(False)

# Preparing output to Dynamo
OUT = famDocs, results
# ----------------------------------------
code_block = CodeBlock(out=python_script) { out[0]; out[1]; }
familyDocs = Output(code_block.out0)
wasEdited = Output(code_block.out1)
