# Dynamo custom node FamilyFirstInstance.dyf "© Family.FirstInstance" (Dynamo 2.3.1.11775)
# category: Crumple.Revit.Actions
# Returns the first instance of a family in the model. Handy for when you know you'll be targetting an early placed object like a homescreen.

familyName = Input(familyName: string)
typeName = Input(typeName: string)
byFamilyNameAndTypeName = FamilyType.ByFamilyNameAndTypeName(familyName=familyName, typeName=typeName)
byFamilyType = FamilyInstance.ByFamilyType(familyType=byFamilyNameAndTypeName)
firstItem = List.FirstItem(list=byFamilyType)
firstInstance = Output(firstItem)
