# Dynamo custom node FamilyInstanceByViewAndPoint.dyf "© FamilyInstance.ByViewAndPoint" (Dynamo 2.16.2.5624)
# category: Crumple.Revit.Create
# Given a family type, list of views and list of points, attempts to create family instances at those points in those views.

point = Input(point: var[]..[])
familyType = Input(familyType: var[]..[])
view = Input(view: var[]..[])
python_script = Python(IN[0]=point, IN[1]=familyType, IN[2]=view)  # CPython3
# ---------- python_script.python (62 lines) ----------
# Boilerplate text
import clr

clr.AddReference("RevitNodes")
import Revit
clr.ImportExtensions(Revit.Elements)
clr.ImportExtensions(Revit.GeometryConversion)

clr.AddReference("RevitServices")
import RevitServices
from RevitServices.Persistence import DocumentManager
from RevitServices.Transactions import TransactionManager

# Current doc/app/ui
doc = DocumentManager.Instance.CurrentDBDocument

# Define list/unwrap list functions
def uwlist(input):
    result = input if isinstance(input, list) else [input]
    return UnwrapElement(result)

def objOrList(input, initial = IN[0]):
	if isinstance(initial, list):
		return input
	else:
		return input[0]

def matchLength(list1, list2):
    len1 = len(list1)
    len2 = len(list2)
    if len1 == len2:
        return list1
    elif len1 > len2:
        return list1[:len2]
    else:
        for i in range(0, len2-len1, 1):
            list1.append(list1[-1])
        return list1

# Preparing input from dynamo to revit
points   = uwlist(IN[0])
famtypes = matchLength(uwlist(IN[1]), points)
views    = matchLength(uwlist(IN[2]), points)

elementlist = []

# Do some action in a Transaction
TransactionManager.Instance.EnsureInTransaction(doc)

for p,f,v in zip(points, famtypes, views):
    
    if famtype.IsActive == False:
        famtype.Activate()
        doc.Regenerate()
    
    newFam = doc.Create.NewFamilyInstance(p.ToXyz(), famtype, view)
    elementlist.append(newFam.ToDSType(True))

TransactionManager.Instance.TransactionTaskDone()

# Preparing output to Dynamo
OUT = objOrList(elementlist)
# ----------------------------------------
familyInstance = Output(python_script)
