# Dynamo custom node FamilyInstanceSuperComponent.dyf "© FamilyInstance.SuperComponent" (Dynamo 2.16.2.5624)
# category: Crumple.Revit.Query
# Returns the family that this family instance belongs to , if any.

familyInstance = Input(familyInstance: var[]..[])
python_script = Python(IN[0]=familyInstance)  # CPython3
# ---------- python_script.python (34 lines) ----------
# Made by Gavin Crump
# Free for use
# BIM Guru, www.bimguru.com.au

# Boilerplate text
import clr

# Define list/unwrap list functions
def uwlist(input):
    result = input if isinstance(input, list) else [input]
    return UnwrapElement(result)

def objOrList(input):
    if isinstance(input, list) and len(input) == 1:
        return input[0]
    else:
        return input

# Preparing input from dynamo to revit
elements = uwlist(IN[0])

# Get super components
superComponents, hasSuper = [],[]

for e in elements:
    try:
        superComponents.append(e.SuperComponent)
        hasSuper.append(True)
    except:
        superComponents.append(None)
        hasSuper.append(False)

# Preparing output to Dynamo
OUT = objOrList(superComponents), objOrList(hasSuper)
# ----------------------------------------
code_block = CodeBlock(x=python_script) { x[0]; x[1]; }
superComponent = Output(code_block.out0)
isNested = Output(code_block.out1)
