# Dynamo custom node FamilyInstancesByViewAndPoint.dyf "© Family.InstanceByViewAndPoint" (Dynamo 2.12.1.8246)
# category: Crumple.Revit.Create
# Given a family type, list of views and list of points, attempts to create family instances at those points in those views.

points = Input(points: var[]..[])
familyType = Input(familyType: Revit.Elements.FamilyType)
view = Input(view: var = Revit.Application.Document.Current.ActiveView)
python_script = Python(IN[0]=points, IN[1]=familyType, IN[2]=view)  # IronPython2
# ---------- python_script.python (49 lines) ----------
# Boilerplate text
import clr

clr.AddReference("RevitNodes")
import Revit
clr.ImportExtensions(Revit.Elements)
clr.ImportExtensions(Revit.GeometryConversion)

clr.AddReference("RevitServices")
import RevitServices
from RevitServices.Persistence import DocumentManager
from RevitServices.Transactions import TransactionManager

# Current doc/app/ui
doc = DocumentManager.Instance.CurrentDBDocument

# Define list/unwrap list functions
def uwlist(input):
    result = input if isinstance(input, list) else [input]
    return UnwrapElement(result)

def objOrList(input, initial = IN[0]):
	if isinstance(initial, list):
		return input
	else:
		return input[0]

# Preparing input from dynamo to revit
points   = uwlist(IN[0])
famtype  = UnwrapElement(IN[1])
view    =  UnwrapElement(IN[2])

elementlist = []

# Do some action in a Transaction
TransactionManager.Instance.EnsureInTransaction(doc)

if famtype.IsActive == False:
	famtype.Activate()
	doc.Regenerate()

for p in points:
	newFam = doc.Create.NewFamilyInstance(p.ToXyz(), famtype, view)
	elementlist.append(newFam.ToDSType(True))
    
TransactionManager.Instance.TransactionTaskDone()

# Preparing output to Dynamo
OUT = objOrList(elementlist)
# ----------------------------------------
familyInstances = Output(python_script)
