# Dynamo custom node FamilyInstancesInViewAtPoints.dyf "© FamilyInstancesInViewAtPoints" (Dynamo 2.3.1.11775)
# category: Crumple.Revit.FamilyInstance
# Given a family type, list of views and list of points, attempts to create family instances at those points in those views.

familyType = Input(familyType: var)
view = Input(view: var[]..[])
point = Input(point: var[]..[])
python_script = Python(IN[0]=familyType, IN[1]=view, IN[2]=point)
# ---------- python_script.python (52 lines) ----------
# Boilerplate text
import clr

clr.AddReference("RevitNodes")
import Revit
clr.ImportExtensions(Revit.Elements)
clr.ImportExtensions(Revit.GeometryConversion)

clr.AddReference("RevitServices")
import RevitServices
from RevitServices.Persistence import DocumentManager 
from RevitServices.Transactions import TransactionManager 

clr.AddReference("RevitAPI")
import Autodesk 
from Autodesk.Revit.DB import *

# Current doc/app/ui
doc = DocumentManager.Instance.CurrentDBDocument

# Define list/unwrap list functions
def uwlist(input):
    result = input if isinstance(input, list) else [input]
    return UnwrapElement(result)
    
def tolist(input):
    result = input if isinstance(input, list) else [input]
    return result

# Preparing input from dynamo to revit
famtype  = UnwrapElement(IN[0])
views    = tolist(IN[1])
points   = uwlist(IN[2])

elementlist = []

# Do some action in a Transaction
TransactionManager.Instance.EnsureInTransaction(doc)

if famtype.IsActive == False:
	famtype.Activate()
	doc.Regenerate()

for v,p in zip(views,points):
	uwview = UnwrapElement(v)
	newobj = doc.Create.NewFamilyInstance(p.ToXyz(),famtype,uwview)
	elementlist.append(newobj.ToDSType(True))
    
TransactionManager.Instance.TransactionTaskDone()

# Preparing output to Dynamo
OUT = elementlist
# ----------------------------------------
familyInstances = Output(python_script)
