# Dynamo custom node FamilyParamFormulae.dyf "© FamilyParam.Formulae" (Dynamo 2.16.2.5624)
# category: Crumple.Revit.Query
# For a family parameter of list of them, returns their formula if any.

familyParams = Input(familyParams: var[]..[])  # Lists of family parameters.
python_script_get_formulas = Python(IN[0]=familyParams)  # CPython3
# ---------- python_script_get_formulas.python (40 lines) ----------
# Made by Gavin Crump
# Free for use
# BIM Guru, www.bimguru.com.au

# Boilerplate text
import clr

clr.AddReference('RevitAPI')
import Autodesk 
from Autodesk.Revit.DB import Parameter

# Define list/unwrap list functions
def tolist(input):
    result = input if isinstance(input, list) else [input]
    return result

def objOrList(input, initial = IN[0]):
	if isinstance(initial, list):
		return input
	else:
		return input[0]

#Inputdoc
params_list = tolist(IN[0])

paramFormulae, hasFormulae = [],[]

for p in params_list:
    if p is None:
        paramFormulae.append(None)
        hasFormulae.append(None)
    else:
        pf = p.Formula
        if not pf:
            pf = ""
        paramFormulae.append(pf)
        hasFormulae.append(pf != "")

# Output the lists
OUT = objOrList(paramFormulae), objOrList(hasFormulae)
# ----------------------------------------
code_block = CodeBlock(x=python_script_get_formulas) { x[0]; x[1]; }
Parameter_formulae_formulae = Output(code_block.out0)  # "/*Parameter formulae.*/ formulae"
Has_a_formula_hasFormula = Output(code_block.out1)  # "/*Has a formula.*/ hasFormula"
