# Dynamo custom node FamilyParamIsShared.dyf "© FamilyParam.IsShared" (Dynamo 2.16.2.5624)
# category: Crumple.Revit.Query
# For a family parameter or list of them, return if the parameters are shared.

familyParams = Input(familyParams: var[]..[])  # Lists of family parameters.
python_script_get_data = Python(IN[0]=familyParams)  # CPython3
# ---------- python_script_get_data.python (33 lines) ----------
# Made by Gavin Crump
# Free for use
# BIM Guru, www.bimguru.com.au

# Boilerplate text
import clr

clr.AddReference('RevitAPI')
import Autodesk 
from Autodesk.Revit.DB import Parameter

# Define list/unwrap list functions
def tolist(input):
    result = input if isinstance(input, list) else [input]
    return result

def objOrList(input, initial = IN[0]):
	if isinstance(initial, list):
		return input
	else:
		return input[0]

def isShared(param):
    if param is None:
        return None
    else:
        return param.IsShared

#Inputdoc
params_list = tolist(IN[0])

# Output the lists
OUT = objOrList([isShared(param) for param in params_list])
# ----------------------------------------
Parameter_is_shared_isShared = Output(python_script_get_data)  # "/*Parameter is shared.*/ isShared"
