# Dynamo custom node FamilyParamName.dyf "© FamilyParam.Name" (Dynamo 2.12.1.8246)
# category: Crumple.Revit.Query
# Given a family parameter of list of them, return the parameter names. Use @L2 levels for list of list processing.

familyParams = Input(familyParams: var[]..[])  # Lists of family parameters.
python_script_get_names = Python(IN[0]=familyParams)  # IronPython2
# ---------- python_script_get_names.python (34 lines) ----------
# Made by Gavin Crump
# Free for use
# BIM Guru, www.bimguru.com.au

# Boilerplate text
import clr

clr.AddReference('RevitAPI')
import Autodesk 
from Autodesk.Revit.DB import Parameter

# Define list/unwrap list functions
def tolist(input):
    result = input if isinstance(input, list) else [input]
    return result

def objOrList(input, initial = IN[0]):
	if isinstance(initial, list):
		return input
	else:
		return input[0]

# Try to return name
def parName(par):
	try:
		return par.Definition.Name
	except:
		return None

#Inputdoc
params_list = tolist(IN[0])

# Output the lists
OUT = objOrList([parName(par) for par in params_list])
# ----------------------------------------
Parameter_names_parameterNames = Output(python_script_get_names)  # "/*Parameter names.*/ parameterNames"
