# Dynamo custom node FamilyParamParameterGroup.dyf "© FamilyParam.ParameterGroup" (Dynamo 2.16.2.5624)
# category: Crumple.Revit.Query
# For a family parameter of list of them, returns their parmater groups. If using Revit 2022+ the node will return ForgeTypeIds instead.

familyParams = Input(familyParams: var[]..[])  # Lists of family parameters.
python_script_get_data = Python(IN[0]=familyParams)  # CPython3
# ---------- python_script_get_data.python (64 lines) ----------
# Made by Gavin Crump
# Free for use
# BIM Guru, www.bimguru.com.au

# Boilerplate text
import clr
import System

clr.AddReference("RevitServices")
import RevitServices
from RevitServices.Persistence import DocumentManager 

clr.AddReference('RevitAPI')
import Autodesk 
from Autodesk.Revit.DB import *

# Get Revit build version
uiapp = DocumentManager.Instance.CurrentUIApplication
app = uiapp.Application
ver = int(app.VersionNumber)

# Function: Get param group
def parameterGroup(par):
    if ver < 2022:
        try:
            return par.Definition.ParameterGroup
        except:
            return None
    else:
        try:
            return par.Definition.GetGroupTypeId()
        except:
            return None

def getGroupName(g):
    if g is None:
        return None
    if ver < 2022:
        return System.Enum.GetName(ParameterGroup, g)
    else:
        return LabelUtils.GetLabelForGroup(g)

# Define list/unwrap list functions
def tolist(input):
	result = input if isinstance(input, list) else [input]
	return result

def objOrList(input, initial = IN[0]):
	if isinstance(initial, list):
		return input
	else:
		return input[0]

#Inputdoc
params_list = tolist(IN[0])
groups, names = [],[]

for p in params_list:
    grp = parameterGroup(p)
    groups.append(grp)
    names.append(getGroupName(grp))

# Output the lists
OUT = [objOrList(groups), objOrList(names)]
# ----------------------------------------
code_block = CodeBlock(x=python_script_get_data) { x[0]; x[1]; }
Parameter_groups_Will_return_as_GroupTyp = Output(code_block.out0)  # "/*Parameter groups. Will return as GroupTypeIds if you are using Revit 2022+.*/ parameterGroups"
groupNames = Output(code_block.out1)
