# Dynamo custom node FamilyParamStorageType.dyf "© FamilyParam.StorageType" (Dynamo 2.16.2.5624)
# category: Crumple.Revit.Query
# For a family parameter or list of them, return their storage types.

familyParams = Input(familyParams: var[]..[])  # Lists of family parameters.
python_script_get_data = Python(IN[0]=familyParams)  # CPython3
# ---------- python_script_get_data.python (47 lines) ----------
# Made by Gavin Crump
# Free for use
# BIM Guru, www.bimguru.com.au

# Boilerplate text
import clr
import System

clr.AddReference('RevitAPI')
import Autodesk 
from Autodesk.Revit.DB import Parameter, StorageType

# Define list/unwrap list functions
def tolist(input):
    result = input if isinstance(input, list) else [input]
    return result

def objOrList(input, initial = IN[0]):
	if isinstance(initial, list):
		return input
	else:
		return input[0]

def getStorageType(par):
    if par is None:
        return None
    else:
        return par.StorageType

def getGroupName(st):
    if st is None:
        return None
    else:
        return System.Enum.GetName(StorageType, st)

#Inputdoc
params_list = tolist(IN[0])

types, names = [],[]

for p in params_list:
    st = getStorageType(p)
    types.append(st)
    names.append(getGroupName(st))

# Output the lists
OUT = [objOrList(types), objOrList(names)]
# ----------------------------------------
code_block = CodeBlock(x=python_script_get_data) { x[0]; x[1]; }
Parameter_storage_type_storageTypes = Output(code_block.out0)  # "/*Parameter storage type.*/ storageTypes"
storageTypeNames = Output(code_block.out1)
