# Dynamo custom node Fibonnaci.dyf "© Math.Fibonnaci" (Dynamo 2.3.0.5885)
# category: Crumple.Data.Create
# Returns the input number of Fibonnaci numbers.

code_block = CodeBlock()
# ---------- code_block.designscript (14 lines) ----------
def fibonnaci(N=10)
{
return [Imperative]
	{
	fib = [0,1];
	i=2;
	while (i<N)
		{
		fib[i] = fib[i-1]+fib[i-2];
		i = i+1;
		}
	return fib;
	}
};
# ----------------------------------------
num = Input(num: int = 2)  # The number of values to return.
code_block_2 = CodeBlock(x=num) { fibonnaci(x); }
fibs = Output(code_block_2)  # The corresponding sequence
