# Dynamo custom node FileOpen.dyf "© File.Open" (Dynamo 2.16.2.5624)
# category: Crumple.Application.Actions
# Attempts to open a file in Windows.

filePath = Input(filePath: string[]..[])
python_script = Python(IN[0]=filePath)  # CPython3
# ---------- python_script.python (33 lines) ----------
# Made by Gavin Crump
# Free for use
# BIM Guru, www.bimguru.com.au

# Boilerplate text
import clr
import os

# Define list/unwrap list functions
def tolist(input):
    result = input if isinstance(input, list) else [input]
    return result

def objOrList(input):
    if isinstance(input, list) and len(input) == 1:
        return input[0]
    else:
        return input

# Preparing input from dynamo to revit
filePaths = tolist(IN[0])

success = []

for fp in filePaths:
    try:
        os.startfile(fp)
        success.append(True)
    except:
        success.append(False)

# Preparing output to Dynamo
OUT = objOrList(success)
# ----------------------------------------
success = Output(python_script)
