# Dynamo custom node FileReadDelimited.dyf "© File.ReadDelimited" (Dynamo 2.16.2.5624)
# category: Crumple.Application.Query
# Attempts to read a CSV file path.

filePath = Input(filePath: string)
delimiter = Input(delimiter: string = " ")
python_script = Python(IN[0]=filePath, IN[1]=delimiter)  # CPython3
# ---------- python_script.python (25 lines) ----------
# Made by Gavin Crump
# Free for use
# BIM Guru, www.bimguru.com.au

# Boilerplate text
import clr
import csv
import os

# Preparing input from dynamo to revit
csvPath = IN[0]
deLimit = IN[1]

# Try to read the file
if os.path.isfile(csvPath):
	with open(csvPath,"r") as file:
		reader = csv.reader(file,delimiter = deLimit)
		csv_data = list(reader)
	result = "CSV contents read."
else:
	csv_data = []
	result = "CSV contents not able to be read."

# Preparing output to Dynamo
OUT = [csv_data,result]
# ----------------------------------------
code_block = CodeBlock(X=python_script) { X[0]; X[1]; }
matrix = Output(code_block.out0)
report = Output(code_block.out1)
