# Dynamo custom node FileRename.dyf "© File.Rename" (Dynamo 2.16.2.5624)
# category: Crumple.Application.Actions
# Attempts to rename a file using its before and after file paths.

beforePaths = Input(beforePaths: string[]..[])
afterPaths = Input(afterPaths: string[]..[])
python_script = Python(IN[0]=beforePaths, IN[1]=afterPaths)  # CPython3
# ---------- python_script.python (34 lines) ----------
# Made by Gavin Crump
# Free for use
# BIM Guru, www.bimguru.com.au

# Boilerplate text
import clr
import os

# Define list/unwrap list functions
def tolist(input):
    result = input if isinstance(input, list) else [input]
    return result

def objOrList(input):
    if isinstance(input, list) and len(input) == 1:
        return input[0]
    else:
        return input

# Preparing input from dynamo to revit
beforePaths = tolist(IN[0])
afterPaths = tolist(IN[1])

success = []

for bp, ap in zip(beforePaths, afterPaths):
    try:
        os.rename(bp, ap)
        success.append(True)
    except:
        success.append(False)

# Preparing output to Dynamo
OUT = objOrList(success)
# ----------------------------------------
success = Output(python_script)
