# Dynamo custom node FileSize.dyf "© Windows.FileSize" (Dynamo 2.3.1.11775)
# category: Crumple.Application.Query
# For given file objects, returns their size in bytes, kilobytes and megabytes.

file = Input(file: var[]..[])
python_script = Python(IN[0]=file)
# ---------- python_script.python (25 lines) ----------
# Made by Gavin Crump
# Free for use
# BIM Guru, www.bimguru.com.au

# Boilerplate text
import clr
import System.IO.FileInfo

# Define list/unwrap list functions
def tolist(input):
    result = input if isinstance(input, list) else [input]
    return result

files = tolist(IN[0])
bytes = []
kbytes = []
mbytes = []

for file in files:
	size = file.Length
	bytes.append(size)
	kbytes.append(float(size)/1024)
	mbytes.append(float(size)/1048576)
	
OUT = (bytes,kbytes,mbytes)
# ----------------------------------------
code_block = CodeBlock(x=python_script) { x[0]; x[1]; x[2]; }
b = Output(code_block.out0)
kb = Output(code_block.out1)
mb = Output(code_block.out2)
