# Dynamo custom node FillPatterns.dyf "© FillPatterns" (Dynamo 2.3.0.5885)
# category: Crumple.Revit.Selection
# Returns all fill patterns in the active document.

Refresh = Input(Refresh: bool = true)  # Toggle to refresh
python_script = Python(IN[0]=Refresh)
# ---------- python_script.python (36 lines) ----------
# Made by Gavin Crump
# Free for use
# BIM Guru, www.bimguru.com.au

# Boilerplate text
import clr

clr.AddReference('RevitAPI')
from Autodesk.Revit.DB import *
import Autodesk

clr.AddReference("RevitServices")
import RevitServices
from RevitServices.Persistence import DocumentManager

# Current document
doc = DocumentManager.Instance.CurrentDBDocument

bool = IN[0]

isDrafting = []

collector = FilteredElementCollector(doc)
allFillPatterns = collector.OfClass(FillPatternElement).ToElements()

fillPatterns = UnwrapElement(allFillPatterns)
Names = [p.Name for p in fillPatterns]

for p in fillPatterns:
	fpt = p.GetFillPattern()
	if fpt.Target == FillPatternTarget.Drafting :
		isDrafting.append(True)
	else:
		isDrafting.append(False)

OUT = [allFillPatterns, Names, isDrafting]
# ----------------------------------------
code_block = CodeBlock(out=python_script) { ele = out[0]; nam = out[1]; drf = out[2]; }
names = Output(code_block.nam)  # The names of the patterns
elements = Output(code_block.ele)  # The patterns as elements
drafting = Output(code_block.drf)  # Are the patterns drafting?
