# Dynamo custom node FilledRegions.dyf "© Regions" (Dynamo 2.3.0.5885)
# category: Crumple.Revit.GraphicStyles
# Returns all filled and/or masking regions in the current document.

includeFilled = Input(includeFilled: bool = true)
includeMasking = Input(includeMasking: bool = true)
refresh = Input(refresh: bool = true)
python_script = Python(IN[0]=includeFilled, IN[1]=includeMasking, IN[2]=refresh)
# ---------- python_script.python (39 lines) ----------
# Made by Gavin Crump
# Free for use
# BIM Guru, www.bimguru.com.au

# Boilerplate text
import clr

clr.AddReference("RevitNodes")
import Revit
clr.ImportExtensions(Revit.Elements)

clr.AddReference("RevitServices")
import RevitServices
from RevitServices.Persistence import DocumentManager

clr.AddReference("RevitAPI")
import Autodesk 
from Autodesk.Revit.DB import *

# Current doc/app/ui
doc = DocumentManager.Instance.CurrentDBDocument

# Collect and construct list of regions
collector = FilteredElementCollector(doc).OfClass(FilledRegion)

filled, masking, type, regionout = IN[0], IN[1], [], []

for i in collector:
	if i.Name == "Masking Region":
		if masking:
			regionout.append(i.ToDSType(True))
			type.append(False)
	else:
		if filled:
			regionout.append(i.ToDSType(True))
			type.append(True)

# Preparing output to Dynamo
OUT = [regionout, type]
# ----------------------------------------
code_block = CodeBlock(out=python_script) { regions = out[0]; types = out[1]; }
regions = Output(code_block.regions)
types = Output(code_block.types)
