# Dynamo custom node FlowFlipper.dyf "© Flow.Flipper" (Dynamo 2.12.1.8246)
# category: Crumple.Script.Actions
# If a true value is provided, return the inputs on opposite branches in the output. Otherwise returns them in the same order.

flip = Input(flip: bool = true)
in1 = Input(in1: var[]..[])
in2 = Input(in2: var[]..[])
python_script = Python(IN[0]=flip, IN[1]=in1, IN[2]=in2)  # CPython3
# ---------- python_script.python (8 lines) ----------
# Made by Gavin Crump
# Free for use
# BIM Guru, www.bimguru.com.au

if IN[0]:
	OUT = [IN[1],IN[2]]
else:
	OUT = [IN[2],IN[1]]
# ----------------------------------------
code_block = CodeBlock(x=python_script) { x[0]; x[1]; }
in2or1 = Output(code_block.out0)
in1or2 = Output(code_block.out1)
