# Dynamo custom node FlowGate.dyf "© Flow.Gate" (Dynamo 2.12.1.8246)
# category: Crumple.Script.Actions
# Unless a true value is provided, sends across an empty list instead of an input stream.

openGate = Input(openGate: var[]..[])
data = Input(data: var[]..[])
python_script = Python(IN[0]=openGate, IN[1]=data)  # CPython3
# ---------- python_script.python (8 lines) ----------
# Made by Gavin Crump
# Free for use
# BIM Guru, www.bimguru.com.au

if IN[0] != False:
	OUT = IN[1]
else:
	OUT = []
# ----------------------------------------
output = Output(python_script)
