# Dynamo custom node FlowIfThenElse.dyf "© Flow.IfThenElse" (Dynamo 2.12.1.8246)
# category: Crumple.Script.Actions
# A simple if/then/else logic gate. If true, you get the 'then' input, otherwise you get the 'else' input. Unlike the OOTB 'If' node, this one allows differing list sizes.

If = Input(If: bool = true)  # Value to determine then or else outcome. True = Then False = Else
Then = Input(Then: var[]..[])  # Outcome if True
Else = Input(Else: var[]..[])  # Outcome if False
python_script = Python(IN[0]=If, IN[1]=Then, IN[2]=Else)  # CPython3
# ---------- python_script.python (9 lines) ----------
# Made by Gavin Crump
# Free for use
# BIM Guru, www.bimguru.com.au

#Code
if IN[0]:
	OUT = IN[1]
else:
	OUT = IN[2]
# ----------------------------------------
Output = Output(python_script)  # The outcome  True  = Then False = Else
