# Dynamo custom node FlowIfZebra.dyf "© Flow.IfZebra" (Dynamo 2.3.0.5885)
# category: Crumple.Script.Actions
# Retains the functionality of the old if node (no Python used). All credit to the Zebra package - hadn't been updated since 2016 so decided to give it a new home.

code_block = CodeBlock()
# ---------- code_block.designscript (15 lines) ----------
def oldif(test,iftrue:var[]..[],
iffalse:var[]..[])
{
return = [Imperative]
{
if (test)
{
return = iftrue;
}
else
{
return = iffalse;
}
}
};
# ----------------------------------------
If = Input(If: bool = true)  # Value to determine then or else outcome. True = Then False = Else
Then = Input(Then: var[]..[])  # Outcome if True
Else = Input(Else: var[]..[])  # Outcome if False
code_block_2 = CodeBlock(test=If, iftrue=Then, iffalse=Else) { oldif(test,iftrue,iffalse); }
Output = Output(code_block_2)  # The outcome  True  = Then False = Else
