# Dynamo custom node GetDocument.dyf "© Revit.GetDocument" (Dynamo 2.3.1.11775)
# category: Crumple.Application.Actions
# If no input is specified or an invalid one is, returns current document. If a link instance is provided, it returns the linked document. If a document is provided it will pass it through.

docOrLink = Input(docOrLink: var[]..[] = null)
python_script = Python(IN[0]=docOrLink)
# ---------- python_script.python (36 lines) ----------
# Made by Gavin Crump
# Free for use
# BIM Guru, www.bimguru.com.au

# Boilerplate text
import clr

clr.AddReference("RevitServices")
import RevitServices
from RevitServices.Persistence import DocumentManager 

clr.AddReference("RevitAPI")
import Autodesk 
from Autodesk.Revit.DB import *

#Inputdoc by Andreas Dieckmann
if isinstance(IN[0], list):
	inputdoc = UnwrapElement(IN[0])
else:
	inputdoc = [UnwrapElement(IN[0])]

if inputdoc[0] == None:
	doc = DocumentManager.Instance.CurrentDBDocument
	test = "No input detected"
elif inputdoc[0].GetType().ToString() == "Autodesk.Revit.DB.Document":
	doc = inputdoc[0]
	test = "A document was provided."
elif inputdoc[0].GetType().ToString() == "Autodesk.Revit.DB.RevitLinkInstance":
	doc = inputdoc[0].GetLinkDocument()
	test = "From linked instance."
else:
	doc = DocumentManager.Instance.CurrentDBDocument
	test = "Invalid input, current document used."

# Preparing output to Dynamo
OUT = doc,test
# ----------------------------------------
code_block = CodeBlock(x=python_script) { x[0]; x[1]; }
document = Output(code_block.out0)
outcome = Output(code_block.out1)
