# Dynamo custom node GetSpaceType.dyf "© Spaces.GetType" (Dynamo 2.3.1.11775)
# category: Crumple.Revit.Other.Query
# Gets a Space's Type as well as it's name and Id.
# packages: Crumple 2022.2.13

spaces = Input(spaces: var[]..[])  # A space or list of spaces.
docOrLink = Input(docOrLink: var[]..[] = null)  # Uses current if none provided. Accepts document or link instance.
revit_getdocument = Custom[© Revit.GetDocument](docOrLink=docOrLink)  # package Crumple; If no input is specified or an invalid one is, returns current document. If a link instance is provided, it returns the linked document. If a document is provided it will pass it through.
python_script = Python(IN[0]=spaces, IN[1]=revit_getdocument.document)
# ---------- python_script.python (36 lines) ----------
# Made by Gavin Crump
# Free for use
# BIM Guru, www.bimguru.com.au

# Boilerplate text
import clr

clr.AddReference("RevitNodes")
import Revit
clr.ImportExtensions(Revit.Elements)

clr.AddReference("RevitAPI")
from Autodesk.Revit.DB import *

# Current doc/app/ui
doc = IN[1]

# Preparing input from dynamo to revit
elements = IN[0] if isinstance(IN[0], list) else [IN[0]]

# Prepare empty lists
eles, names, ids = [], [], []

# Find space type Id and convert to element
for e in elements:
	uw = UnwrapElement(e)
	id_uwr = uw.SpaceTypeId
	spt = doc.GetElement(id_uwr).ToDSType(True)
	eles.append(spt)
	names.append(spt.Name)
	id_str = id_uwr.ToString()
	id_int = int(id_str)
	ids.append(id_int)

# Preparing output to Dynamo
OUT = [eles, names, ids]
# ----------------------------------------
code_block = CodeBlock(lst=python_script) { st = lst[0]; nm = lst[1]; ID = lst[2]; }
space_type = Output(code_block.st)  # As an element.
type_name = Output(code_block.nm)  # As a string.
type_id = Output(code_block.ID)  # As an integer.
