# Dynamo custom node GetUnits.dyf "© Revit.GetUnits" (Dynamo 2.12.1.8246)
# category: Crumple.Application.Query
# Returns the unit type or forgetypeId of the document's units.
# packages: Crumple 2022.5.27

docOrLink = Input(docOrLink: var[]..[] = null)  # Uses current if none provided. Accepts document or link instance.
revit_getdocument = Custom[© Revit.GetDocument](docOrLink=docOrLink)  # package Crumple; If no input is specified or an invalid one is, returns current document. If a link instance is provided, it returns the linked document. If a document is provided it will pass it through.
python_script = Python(IN[0]=revit_getdocument.document)  # IronPython2
# ---------- python_script.python (31 lines) ----------
# Made by Gavin Crump
# Free for use
# BIM Guru, www.bimguru.com.au

# Boilerplate text
import clr

clr.AddReference("RevitServices")
import RevitServices
from RevitServices.Persistence import DocumentManager 

clr.AddReference("RevitAPI")
import Autodesk 
from Autodesk.Revit.DB import *

# Current doc/app/ui
doc = IN[0]
uiapp = DocumentManager.Instance.CurrentUIApplication 
app = uiapp.Application

# Get app version
rvt_year = int(app.VersionNumber)

# Get units
if rvt_year < 2022:
	intUnits = doc.GetUnits().GetFormatOptions(UnitType.UT_Length).DisplayUnits
else:
	intUnits = doc.GetUnits().GetFormatOptions(SpecTypeId.Length).GetUnitTypeId()

# Preparing output to Dynamo
OUT = intUnits
# ----------------------------------------
unitType = Output(python_script)
