# Dynamo custom node GroupElements.dyf "© Groups.Elements" (Dynamo 2.12.1.8246)
# category: Crumple.Revit.Actions
# Given a Revit group, return all elements in that given group if any.

groups = Input(groups: var[]..[])
python_script = Python(IN[0]=groups)  # IronPython2
# ---------- python_script.python (41 lines) ----------
# Made by Gavin Crump
# Free for use
# BIM Guru, www.bimguru.com.au

# Boilerplate text
import clr

clr.AddReference("RevitServices")
import RevitServices
from RevitServices.Persistence import DocumentManager 

# Current doc/app/ui
doc = DocumentManager.Instance.CurrentDBDocument

# Define list/unwrap list functions
def uwlist(input):
    result = input if isinstance(input, list) else [input]
    return UnwrapElement(result)

def objOrList(input):
    if isinstance(input, list) and len(input) == 1:
        return input[0]
    else:
        return input

# Preparing input from dynamo to revit
groups = uwlist(IN[0])
elementslist = []

# Get elements in groups
for grp in groups:
	
	elements = []
	for i in grp.GetMemberIds():
		e = doc.GetElement(i)
		elements.append(e)
	
	elementslist.append(elements)

# Preparing output to Dynamo
OUT = objOrList(elementslist)
# ----------------------------------------
elements = Output(python_script)
