# Dynamo custom node Images.dyf "© Images" (Dynamo 2.3.0.5885)
# category: Crumple.Revit.LinkedFiles
# Returns all image instances in the model as well as their names, types and owner views.

refresh = Input(refresh: bool = true)
python_script = Python(IN[0]=refresh)
# ---------- python_script.python (34 lines) ----------
# Made by Gavin Crump
# Free for use
# BIM Guru, www.bimguru.com.au

# Boilerplate text
import clr

clr.AddReference("RevitServices")
import RevitServices
from RevitServices.Persistence import DocumentManager

clr.AddReference("RevitAPI")
import Autodesk
from Autodesk.Revit.DB import *

doc = DocumentManager.Instance.CurrentDBDocument

# Collect all images
images = FilteredElementCollector(doc).OfCategory(BuiltInCategory.OST_RasterImages).ToElements()

# Get instance properties
imageEle, imageName, imageView, imageId = [], [], [], []

for i in images:
	try:
		imageName.append(i.Name)
		imageView.append(doc.GetElement(i.OwnerViewId))
		imageId.append(i.Document.GetElement(i.GetTypeId()))
		imageEle.append(i)
	except:
		pass

# Preparing output to Dynamo
OUT = [imageEle, imageName, imageView , imageId]
# ----------------------------------------
code_block = CodeBlock(out=python_script) { out[0]; out[1]; out[2]; out[3]; }
instance = Output(code_block.out0)
fileName = Output(code_block.out1)
type = Output(code_block.out3)
ownerView = Output(code_block.out2)
