# Dynamo custom node IsInPlace.dyf "© Family.IsInPlace" (Dynamo 2.3.0.5885)
# category: Crumple.Revit.Query
# Given a family, returns if that family is modelled in place. Noting this is for the family of an instance, not the instance itself.

family = Input(family: var[]..[])
python_script = Python(IN[0]=family)
# ---------- python_script.python (33 lines) ----------
# Made by Gavin Crump
# Free for use
# BIM Guru, www.bimguru.com.au

# Boilerplate text
import clr

clr.AddReference("RevitAPI")
import Autodesk 
from Autodesk.Revit.DB import *

# Define list/unwrap list functions
def uwlist(input):
    result = input if isinstance(input, list) else [input]
    return UnwrapElement(result)

def IsInPlace(item):
	if hasattr(item, "IsInPlace"): return item.IsInPlace
	else: return False

# Preparing input from dynamo to revit
items = uwlist(IN[0])

inPlace = []

for i in items:
	if hasattr(i, "IsInPlace"):
		inPlace.append(i.IsInPlace)
	else:
		inPlace.append(False)

# Preparing output to Dynamo
OUT = inPlace
# ----------------------------------------
isInPlace = Output(python_script)
