# Dynamo custom node IsRevisionSchedule.dyf "© Schedules.IsRevisionSchedule" (Dynamo 2.3.0.5885)
# category: Crumple.Revit.Query
# Gosh these things are annoying when we're isolating schedule types! This lets you detect if an element is a revision schedule on a sheet in the model.

elements = Input(elements: var[]..[])
python_script = Python(IN[0]=elements)
# ---------- python_script.python (30 lines) ----------
# Made by Gavin Crump
# Free for use
# BIM Guru, www.bimguru.com.au

# Boilerplate text
import clr

clr.AddReference("RevitAPI")
import Autodesk 
from Autodesk.Revit.DB import *

# Define list/unwrap list functions
def uwlist(input):
    result = input if isinstance(input, list) else [input]
    return UnwrapElement(result)

# Preparing input from dynamo to revit
uw_list  = uwlist(IN[0])
bools = []

# Do some action in a Transaction
for s in uw_list:
	try:
		bool = "<Revision Schedule>" in s.Name
		bools.append(bool)
	except:
		bools.append(False)

# Preparing output to Dynamo
OUT = bools
# ----------------------------------------
isRevschedule = Output(python_script)
