# Dynamo custom node IsWorkshared.dyf "© IsWorkshared" (Dynamo 2.3.0.5885)
# category: Crumple.Application.Revit
# If no document is provided, checks if the active document is workshared. If a document or link instance is provided it will check that instead.

document = Input(document: var = null)
refresh = Input(refresh: bool = true)
python_script = Python(IN[0]=document, IN[1]=refresh)
# ---------- python_script.python (31 lines) ----------
# Made by Gavin Crump
# Free for use
# BIM Guru, www.bimguru.com.au
# Large in part borrows from Clockwork

# Boilerplate text
import clr

clr.AddReference("RevitServices")
import RevitServices
from RevitServices.Persistence import DocumentManager 

# Inputs
inputDoc = UnwrapElement(IN[0])

# Check document type
if inputDoc == None:
	doc = DocumentManager.Instance.CurrentDBDocument
elif inputDoc.GetType().ToString() == "Autodesk.Revit.DB.Document":
	doc = inputDoc
elif inputDoc.GetType().ToString() == "Autodesk.Revit.DB.RevitLinkInstance":
	doc = inputDoc.GetLinkDocument()
else: doc = None

if doc.IsWorkshared:
	ws = True
else:
	ws = False

# Preparing output to Dynamo
OUT = ws
# ----------------------------------------
workshared = Output(python_script)
