# Dynamo custom node LegendTypes.dyf "© LegendTypes" (Dynamo 2.3.1.11775)
# category: Crumple.Revit.Views
# Returns all legend types in the current document.

Refresh = Input(Refresh: bool = true)  # Toggle to refresh
python_script = Python(IN[0]=Refresh)
# ---------- python_script.python (31 lines) ----------
# Made by Gavin Crump
# Free for use
# BIM Guru, www.bimguru.com.au

# Boilerplate text
import clr

# Import RevitAPI
clr.AddReference("RevitAPI")
import Autodesk
from Autodesk.Revit.DB import *

# Import DocumentManager
clr.AddReference("RevitServices")
from RevitServices.Persistence import DocumentManager
# Get the project document.
doc = DocumentManager.Instance.CurrentDBDocument

# Get all views
Views_doc = FilteredElementCollector(doc).OfClass(View).ToElements()

# Create empty lists
Legend_list = []

# Find views that aren't legends, then non-template
for view in Views_doc:
	if view.ViewType == ViewType.Legend:
		Legend_list.append(view)

# Output cleaned view lists
OUT = Legend_list
# ----------------------------------------
legendTypes = Output(python_script)  # All legends in the current document.
