# Dynamo custom node LevelByElevationAndName.dyf "© LevelByElevationAndName" (Dynamo 2.3.0.5885)
# category: Crumple.Revit.Levels
# Given elevations and names, create levels with those properties.

elevation = Input(elevation: var[]..[])  # Level elevations as doubles
byElevation = Level.ByElevation(elevation=elevation)
code_block = CodeBlock { "Name"; }
name = Input(name: var[]..[])  # Level names as strings
setParameterByName = Element.SetParameterByName(element=byElevation, parameterName=code_block, value=name)
level = Output(setParameterByName)  # Resultant levels
