# Dynamo custom node LevelCreate.dyf "© Level.Create" (Dynamo 2.16.2.5624)
# category: Crumple.Revit.Create
# Given elevations and names, create levels with those properties.

elevation = Input(elevation: var[]..[])  # Level elevations as doubles
byElevation = Level.ByElevation(elevation=elevation)
code_block = CodeBlock { "Name"; }
name = Input(name: var[]..[])  # Level names as strings
setParameterByName = Element.SetParameterByName(element=byElevation, parameterName=code_block, value=name)
level = Output(setParameterByName)  # Resultant levels
