# Dynamo custom node LevelsCreate.dyf "© Levels.Create" (Dynamo 2.12.1.8246)
# category: Crumple.Revit.Create
# Given elevations and names, create levels with those properties.

elevations = Input(elevations: var[]..[])  # Level elevations as doubles
byElevation = Level.ByElevation(elevation=elevations)
code_block = CodeBlock { "Name"; }
names = Input(names: var[]..[])  # Level names as strings
setParameterByName = Element.SetParameterByName(element=byElevation, parameterName=code_block, value=names)
levels = Output(setParameterByName)  # Resultant levels
