# Dynamo custom node LevelsGetByName.dyf "© Levels.GetByName" (Dynamo 2.12.1.8246)
# category: Crumple.Revit.Actions
# Given a list of names, returns the matching levels (if they exist).
# packages: Crumple 2022.2.13

name = Input(name: var[]..[])
docOrLink = Input(docOrLink: var[]..[] = null)  # Uses current if none provided. Accepts document or link instance.
revit_getdocument = Custom[© Revit.GetDocument](docOrLink=docOrLink)  # package Crumple; If no input is specified or an invalid one is, returns current document. If a link instance is provided, it returns the linked document. If a document is provided it will pass it through.
python_script = Python(IN[0]=name, IN[1]=revit_getdocument.document)  # IronPython2
# ---------- python_script.python (44 lines) ----------
# Made by Gavin Crump
# Free for use
# BIM Guru, www.bimguru.com.au

# Boilerplate text
import clr

clr.AddReference("RevitAPI")
import Autodesk 
from Autodesk.Revit.DB import FilteredElementCollector, BuiltInCategory

# Current doc/app/ui
doc = IN[1]

# Define list/unwrap list functions
def tolist(input):
    result = input if isinstance(input, list) else [input]
    return result

def objOrList(input, initial = IN[0]):
	if isinstance(initial, list):
		return input
	else:
		return input[0]

# Preparing input from dynamo to revit
names_in   = tolist(IN[0])
levels_out = []

# Get all levels in document
levels_all = FilteredElementCollector(doc).OfCategory(BuiltInCategory.OST_Levels).WhereElementIsNotElementType().ToElements()
names_all  = [l.Name for l in levels_all]

# Get matching levels by number
for n in names_in:
	if n in names_all:
		ind = names_all.index(n)
		lvl = levels_all[ind]
		levels_out.append(lvl)
	else:
		levels_out.append(None)

# Preparing output to Dynamo
OUT = objOrList(levels_out)
# ----------------------------------------
level = Output(python_script)
