# Dynamo custom node LineStyles.dyf "© LineStyles" (Dynamo 2.3.0.5885)
# category: Crumple.Revit.GraphicStyles
# Returns all the line styles in the model as well as their graphic styles, names, ids and whether a user made them.

Refresh = Input(Refresh: bool = true)  # Toggle to refresh
python_script = Python(IN[0]=Refresh)
# ---------- python_script.python (58 lines) ----------
# Made by Gavin Crump
# Free for use
# BIM Guru, www.bimguru.com.au

# Credit
# Large in part borrows ideas from Genius Loci (Alban de Chasteigner)
# twitter : @geniusloci_bim

# Boilerplate text
import clr

clr.AddReference("RevitNodes")
import Revit
clr.ImportExtensions(Revit.Elements)

clr.AddReference("RevitServices")
import RevitServices
from RevitServices.Persistence import DocumentManager 

clr.AddReference("RevitAPI")
import Autodesk 
from Autodesk.Revit.DB import *

# Current doc/app/ui
doc = DocumentManager.Instance.CurrentDBDocument

# Collect the BIC
collector = FilteredElementCollector(doc).OfCategory(BuiltInCategory.OST_Lines).ToElements()

# Isolate BIC from collection
bic = collector[0].Category
subcats = bic.SubCategories

# Collect subcategory data
elements, styles, ids, names, user = [],[],[],[],[]

for subcat in subcats:

	subcatid = subcat.Id.IntegerValue
	subcatidasint = int(subcatid.ToString())
	ids.append(subcatidasint)
	
	if subcatidasint > 0:
		user.append(True)
	else:
		user.append(False)
	
	subcatele = Revit.Elements.Category.ById(subcatid)
	elements.append(subcatele)
	
	style = subcat.GetGraphicsStyle(GraphicsStyleType.Projection)
	styles.append(style)
	
	subcatname = style.Name
	names.append(subcatname)

# Outputs for Dynamo
OUT = elements, styles, ids, names, user
# ----------------------------------------
code_block = CodeBlock(out=python_script) { ele = out[0]; gfx = out[1]; sid = out[2]; nam = out[3]; use = out[4]; }
lineStyles = Output(code_block.ele)  # The line styles as elements
graphicStyles = Output(code_block.gfx)  # The related graphic styles
lineStyleIds = Output(code_block.sid)  # The ids of the line styles
styleNames = Output(code_block.nam)  # The names of the graphic styles
userMade = Output(code_block.use)  # Is the style user made?
