# Dynamo custom node Lines.dyf "© Lines" (Dynamo 2.3.0.5885)
# category: Crumple.Revit.GraphicStyles
# Returns all lines in the current document, with the option to exclude or include detail/model lines in the output. By default will return all of them.

includeDetail = Input(includeDetail: bool = true)
includeModel = Input(includeModel: bool = true)
refresh = Input(refresh: bool = true)
python_script = Python(IN[0]=includeDetail, IN[1]=includeModel, IN[2]=refresh)
# ---------- python_script.python (39 lines) ----------
# Made by Gavin Crump
# Free for use
# BIM Guru, www.bimguru.com.au

# Boilerplate text
import clr

clr.AddReference("RevitNodes")
import Revit
clr.ImportExtensions(Revit.Elements)

clr.AddReference("RevitServices")
import RevitServices
from RevitServices.Persistence import DocumentManager

clr.AddReference("RevitAPI")
import Autodesk 
from Autodesk.Revit.DB import *

# Current doc/app/ui
doc = DocumentManager.Instance.CurrentDBDocument

# Collect all lines in project and build output lists
collector = FilteredElementCollector(doc).OfCategory(BuiltInCategory.OST_Lines)

detail, model, type, curveout = IN[0], IN[1], [], []

for i in collector:
	if i.Name == "Detail Lines":
		if detail:
			curveout.append(i.ToDSType(True))
			type.append(True)
	else:
		if model:
			curveout.append(i.ToDSType(True))
			type.append(False)

# Preparing output to Dynamo
OUT = [curveout, type]
# ----------------------------------------
code_block = CodeBlock(out=python_script) { curves = out[0]; isDetail = out[1]; }
lines = Output(code_block.curves)
isDetail = Output(code_block.isDetail)
