# Dynamo custom node LinkedElementsByCategory.dyf "© Elements.ByLinkAndCategory" (Dynamo 2.3.1.11775)
# category: Crumple.Revit.Query
# Returns all elements of any number of categories in a single Revit Model link instance.

linkInstance = Input(linkInstance: var[]..[])  # Linked Revit instance. A 'select model element' node works fine with this.
categories = Input(categories: var[]..[])  # Revit categories.
python_script = Python(IN[0]=linkInstance, IN[1]=categories)
# ---------- python_script.python (30 lines) ----------
# Made by Gavin Crump
# Free for use
# BIM Guru, www.bimguru.com.au

# Boilerplate text
import clr
import System
clr.AddReference("RevitAPI")
import Autodesk 
from Autodesk.Revit.DB import *

# Preparing input from dynamo to revit
LinkInst  = UnwrapElement(IN[0])
LinkDoc   = LinkInst.GetLinkDocument()
cats      = IN[1]

if not hasattr(cats, "__iter__"):
    cats = [cats]

elementlist = []

for cat in cats:
	collector = FilteredElementCollector(LinkDoc)
	BuiltIn = System.Enum.ToObject(BuiltInCategory, cat.Id)
	filter  = ElementCategoryFilter(BuiltIn)
	SubEles = collector.WherePasses(filter).WhereElementIsNotElementType().ToElements()
	elementlist.append(SubEles)

# Preparing output to Dynamo
OUT = elementlist
# ----------------------------------------
elements = Output(python_script)  # Linked elements by category.
