# Dynamo custom node ListCombinate.dyf "© List.Combinate" (Dynamo 2.12.1.8246)
# category: Crumple.Data.Create
# Given a list and a length, will find all combinations of that list included repetion of the elements. Takes order into consideration as well.

list = Input(list: var[]..[])
length = Input(length: int = 1)
python_script = Python(IN[0]=list, IN[1]=length)  # CPython3
# ---------- python_script.python (15 lines) ----------
# Made by Gavin Crump
# Free for use
# BIM Guru, www.bimguru.com.au

# Thanks to cpoupin for guiding a better approach
# https://forum.dynamobim.com/t/get-all-possible-combinations-of-a-list-including-repeating-element-at-a-given-lenght/66784/4

import itertools

data = IN[0];
r = int(IN[1])

combinations = list(itertools.product(data, repeat = r))
    
OUT = combinations
# ----------------------------------------
combinations = Output(python_script)
