# Dynamo custom node ListCull.dyf "© List.CullMany" (Dynamo 2.12.1.8246)
# category: Crumple.Data.Actions
# Filters up to three lists in parallel. Handy for reducing space that multiple boolean masks occupy otherwise.

listA = Input(listA: var[]..[])
mask = Input(mask: var[]..[])
filterByBoolMask = List.FilterByBoolMask(list=listA, mask=mask)
listA_2 = Output(filterByBoolMask.in)  # "listA"
listB = Input(listB: var[]..[] = [])
filterByBoolMask_2 = List.FilterByBoolMask(list=listB, mask=mask)
listB_2 = Output(filterByBoolMask_2.in)  # "listB"
listC = Input(listC: var[]..[] = [])
filterByBoolMask_3 = List.FilterByBoolMask(list=listC, mask=mask)
listC_2 = Output(filterByBoolMask_3.in)  # "listC"
