# Dynamo custom node ListForce.dyf "© List.Force" (Dynamo 2.12.1.8246)
# category: Crumple.Data.Actions
# A basic node to check if the input is in the form of a list, and if not it forces it to become one. This simple python script is useful for incorporation into larger scripts for iterating.

items = Input(items: var[]..[])  # Non-list data
python_script = Python(IN[0]=items)  # IronPython2
# ---------- python_script.python (9 lines) ----------
# Made by Gavin Crump
# Free for use
# BIM Guru, www.bimguru.com.au

#Code
if isinstance(IN[0], list):
	OUT = IN[0]
else:
	OUT = [IN[0]]
# ----------------------------------------
toList = Output(python_script)  # Data returned as a list format.
