# Dynamo custom node ListGraftAsLists.dyf "© List.GraftByPrimary" (Dynamo 2.12.1.8246)
# category: Crumple.Data.Actions
# Given a first input, the node will assess how many items it contains (if one, it will make it a list of 1 item). Remaining branches will be forced into a list of lists, where the last branch will be repeated to a longest length as the first list (if one list or item is provided, it will repeat as the list of lists).

primary = Input(primary: var[]..[])
listA = Input(listA: var[]..[] = null)
listB = Input(listB: var[]..[] = null)
listC = Input(listC: var[]..[] = null)
listD = Input(listD: var[]..[] = null)
listE = Input(listE: var[]..[] = null)
python_script_replicate_data = Python(IN[0]=primary, IN[1]=listA, IN[2]=listB, IN[3]=listC, IN[4]=listD, IN[5]=listE)  # "Python Script (replicate data structure)"; IronPython2
# ---------- python_script_replicate_data.python (48 lines) ----------
# Boilerplate text
import clr

clr.AddReference("RevitAPI")
import Autodesk 
from Autodesk.Revit.DB import Document

# Define list functions
def tolist(input):
    result = input if isinstance(input, list) else [input]
    return result

def toPaddedListOfLists(input, maxLen):
    # Force object to list
    input = tolist(input)
    # If not list of lists, make list of lists
    if not isinstance(input[0], list):
	    input = [input]
    # Check item count
    lenCheck = len(input)
    if lenCheck < maxLen:
    	result = []
    	for i in range(0, maxLen - lenCheck):
    		input.append(input[-1])
    return input

# Get family documents only
primary = tolist(IN[0])

# Length of family documents
maxLength = len(primary)

# Establish the core list
outputs = [primary]

# For each other input...
for i in (IN[1],IN[2],IN[3],IN[4],IN[5]):
	# If provided...
	if i:
		# Pad and append
		output = toPaddedListOfLists(i, maxLength)
		outputs.append(output)
	# Otherwise, append None
	else:
		outputs.append(None)

# Preparing output to Dynamo
OUT = outputs
# ----------------------------------------
code_block = CodeBlock(x=python_script_replicate_data) { x[0]; x[1]; x[2]; x[3]; x[4]; x[5]; }
primary_2 = Output(code_block.out0)  # "primary"
listA_2 = Output(code_block.out1)  # "listA"
listB_2 = Output(code_block.out2)  # "listB"
listC_2 = Output(code_block.out3)  # "listC"
listD_2 = Output(code_block.out4)  # "listD"
listE_2 = Output(code_block.out5)  # "listE"
