# Dynamo custom node ListKickFlip.dyf "© List.KickFlip" (Dynamo 2.3.0.5885)
# category: Crumple.Data.Actions
# Drops a certain number of rows from the front a list, then transposes it. Handy for pre-processing Excel data!

data = Input(data: var[]..[])  # Data for processing, most likely a set of lists derived from Excel.
kick = Input(kick: int = 1)  # The number of header rows.
code_block = CodeBlock(list=data, amount=kick) { data = DSCore.List.DropItems(list, amount); data_t = DSCore.List.Transpose(data); }
flipped = Output(code_block.data_t)  # The transposed list data as columns, without headers.
