# Dynamo custom node ListPositize.dyf "© List.Positize" (Dynamo 2.12.1.8246)
# category: Crumple.Data.Actions
# From a list of numbers, replace all negative values with a substitute value. Useful for processing those pesky -1 indices!

numberList = Input(numberList: var[]..[])  # List of numbers.
replaceItem = Input(replaceItem: var[]..[])  # Element to substitute negative numbers with.
python_script = Python(IN[0]=numberList, IN[1]=replaceItem)  # IronPython2
# ---------- python_script.python (17 lines) ----------
# Made by Gavin Crump
# Free for use
# BIM Guru, www.bimguru.com.au

lst = IN[0] if isinstance(IN[0], list) else [IN[0]]
sub = IN[1]

newlst = []

for i in lst:
	if i < 0:
		res = sub
	else:
		res = i
	newlst.append(res)

OUT = newlst
# ----------------------------------------
positizedList = Output(python_script)  # The new list.
