# Dynamo custom node ListRecursiveSquared.dyf "© List.RecursiveSquared" (Dynamo 2.12.1.8246)
# category: Crumple.Data.Actions
# This node is just here as an example of how one can use recursion in Python. Crumple generally works with assumed list shapes/structures, but that doesn't mean you have to!
# This node is just here as....
# (sorry, typical obligatory recursion joke).

numbers = Input(numbers: var[]..[])
python_script = Python(IN[0]=numbers)  # IronPython2
# ---------- python_script.python (31 lines) ----------
# Made by Gavin Crump
# Free for use
# BIM Guru, www.bimguru.com.au

# If I could see further, it is because I have stood on the shoulders of giants
# https://stackoverflow.com/questions/30060970/how-to-apply-a-function-to-each-sublist-of-a-list-in-python

# Boilerplate text
import clr

# Function to apply function recursively
# Inputs are a = input value/object
#            f = lambda function to recur
def apply_f(a,f):
	# If input is a list
	if isinstance(a, list):
		# Return the recursive function
		return map(lambda t: apply_f(t,f), a)
	# Otherwise function on lowest item
	else:
		return f(a)

# Function to apply recursively
def my_function(num):
	return num ** 2

# Preparing input from dynamo to revit
numbers = IN[0]

# Preparing output to Dynamo
OUT = apply_f(numbers, lambda n:my_function(n))
# ----------------------------------------
squared = Output(python_script)
