# Dynamo custom node ListSplitAtIndex.dyf "© List.SplitAtIndex" (Dynamo 2.12.1.8246)
# category: Crumple.Data.Actions
# Splits a list at a specific index, then returns the two lists. You may need to use levels in order for this to work properly.

lst = Input(lst: var[]..[])
index = Input(index: var[]..[])
code_block = CodeBlock(l1=lst, amt=index) { DSCore.List.TakeItems(l1, amt); DSCore.List.DropItems(l1, amt); }
lst1 = Output(code_block.out0)
lst2 = Output(code_block.out1)
