# Dynamo custom node ListStringOccurences.dyf "© ListStringOccurences" (Dynamo 2.3.0.5885)
# category: Crumple.List.Inspect
# Given a list of strings, returns the number of times each string appears in that list.

separator = Input(separator: string = "~~")  # Character used for separation of the strings in the list.
list = Input(list: var[]..[])  # The list of strings.
code_block = CodeBlock(x=separator, s=list) { x+s+x; }
concat = String.Concat(string0=code_block)
countOccurrences = String.CountOccurrences(str=concat, searchFor=list, lacing=Longest)
count = Output(countOccurrences)  # The number of times each string occurs in the list.
