# Dynamo custom node ListTryToGetItemAtIndex.dyf "© List.TryToGetItemAtIndex" (Dynamo 2.16.2.5624)
# category: Crumple.Data.Actions
# Attempts to get an item at an index of a list, and replaces it with a specified object if it is not found.

lst = Input(lst: var[]..[])
index = Input(index: var[]..[])
replaceWith = Input(replaceWith: var = null)
python_script = Python(IN[0]=lst, IN[1]=index, IN[2]=replaceWith)  # CPython3
# ---------- python_script.python (23 lines) ----------
list = IN[0]
indices = IN[1]
replaceWith = IN[2]

maxIndex = len(list) - 1

outList, bools = [],[]

def ValidIndex(i,c):
    if i is None:
        return False
    else:
        return i > 0 and i < c

for i in indices:
    if ValidIndex(i, maxIndex):
        outList.append(list[i])
        bools.append(True)
    else:
        outList.append(replaceWith)
        bools.append(False)

OUT = outList, bools
# ----------------------------------------
code_block = CodeBlock(x=python_script) { x[0]; x[1]; }
item = Output(code_block.out0)
wasFound = Output(code_block.out1)
