# Dynamo custom node LogWrite.dyf "© Log.Write" (Dynamo 2.12.1.8246)
# category: Crumple.Script.Create
# Writes the date, user name, script name and active model's name to a csv file. It will write to a specified directory, or the user's documents folder if a valid one is not provided. Will write new rows to the same file if one is found.

trigger = Input(trigger: var[]..[])
directoryName = Input(directoryName: string = "")
errorsFound = Input(errorsFound: bool = false)
python_script = Python(IN[0]=trigger, IN[1]=directoryName, IN[2]=errorsFound)  # CPython3
# ---------- python_script.python (56 lines) ----------
# Made by Gavin Crump
# Free for use
# BIM Guru, www.bimguru.com.au

# Boilerplate text
import clr
import os
import datetime

clr.AddReference("RevitServices")
import RevitServices
from RevitServices.Persistence import DocumentManager 

clr.AddReference('DynamoRevitDS')
import Dynamo

# Current doc and title
doc = DocumentManager.Instance.CurrentDBDocument
docTitle = doc.Title

# Check Dynamo workspace properties
dynamoRevit = Dynamo.Applications.DynamoRevit()
currentWorkspace = dynamoRevit.RevitDynamoModel.CurrentWorkspace
script = currentWorkspace.Name

# Get properties for writing the log file
dateStamp   = datetime.datetime.today().strftime("%d/%m/%y")
userName    = os.environ.get('USERNAME')
userProfile = os.environ.get('USERPROFILE')

# Determine the relevant path if provided
if os.path.exists(IN[1]):
	myPath = IN[1] + "\\"
else:
	myPath = userProfile + "\Documents\\"

# Error catch
if IN[2]:
	errors = "TRUE"
else:
	errors = "FALSE"

# Generate data to write
myLog   = myPath + "DynamoLog_" + userName + ".csv"
dataRow = dateStamp + "," + userName + "," + script +".dyn" + "," + docTitle + ".rvt" + "," + errors

# Adds new line to log file or creates one if doesn't exist
try:
	with open(myLog, "a") as file:
		file.writelines(dataRow + "\n")
	result = True
except:
	result = False

# Preparing output to Dynamo
OUT = dataRow, myLog, result
# ----------------------------------------
code_block = CodeBlock(out=python_script) { out[0]; out[1]; out[2]; }
logData = Output(code_block.out0)
logPath = Output(code_block.out1)
success = Output(code_block.out2)
