# Dynamo custom node MaterialsByPrefix.dyf "© MaterialsByPrefix" (Dynamo 2.3.1.11775)
# category: Crumple.Revit.Materials
# Returns all materials in a document, sorted by whether they contain a specified prefix.
# packages: Crumple 2021.8.17

Prefix = Input(Prefix: string = "BG_")  # Prefix to check for
docOrLink = Input(docOrLink: var[]..[] = null)  # Uses current if none provided. Accepts document or link instance.
getdocument = Custom[© GetDocument](docOrLink=docOrLink)  # package Crumple; If no input is specified or an invalid one is, returns current document. If a link instance is provided, it returns the linked document. If a document is provided it will pass it through.
python_script = Python(IN[0]=Prefix, IN[1]=getdocument.document)
# ---------- python_script.python (31 lines) ----------
# Made by Gavin Crump
# Free for use
# BIM Guru, www.bimguru.com.au

# Boilerplate text
import clr

clr.AddReference('RevitAPI')
from Autodesk.Revit.DB import *
import Autodesk

# Current document
doc = IN[1]

pref = IN[0]

contains,namesc,doesnot,namesd = [],[],[],[]

collector = FilteredElementCollector(doc)
allMaterials = collector.OfClass(Material).ToElements()

for m in allMaterials:
	name = UnwrapElement(m.Name)
	if name.startswith(pref):
		contains.append(m)
		namesc.append(name)
	else:
		doesnot.append(m)
		namesd.append(name)

OUT = [contains, namesc, doesnot, namesd]
# ----------------------------------------
code_block = CodeBlock(out=python_script) { mat1 = out[0]; nam1 = out[1]; mat2 = out[2]; nam2 = out[3]; }
matches = Output(code_block.mat1)  # The matches as elements
theRest = Output(code_block.mat2)  # The non-matches as elements
matchNames = Output(code_block.nam1)  # The names of matches
theRestNames = Output(code_block.nam2)  # The names of non-matches
