# Dynamo custom node MathClosestNumber.dyf "© Math.ClosestNumber" (Dynamo 2.12.1.8246)
# category: Crumple.Data.Query
# For each number, find the nearest number in another list. Values are able to be forced down.

values = Input(values: var[]..[])  # Numbers, ideally. These will be rounded to the nearest value in the range.
range = Input(range: var[]..[])  # The numerical range by which the other numbers will be rounded to.
forceFloor = Input(forceFloor: bool = false)  # If true, the rounding function will always be applied as a floor (down).
python_script = Python(IN[0]=values, IN[1]=range, IN[2]=forceFloor)  # CPython3
# ---------- python_script.python (39 lines) ----------
# Made by Gavin Crump
# Free for use
# BIM Guru, www.bimguru.com.au

# Declare inputs, ensure values and range are iterable
values_in = IN[0] if isinstance(IN[0], list) else [IN[0]]
range_in  = IN[1] if isinstance(IN[0], list) else [IN[1]]
forcedown = IN[2]

# Define function for finding closest number
# Note we find absolute value, then find the floor later on
def closest(list, number):
	diff = []
	for i in list:
		diff.append(abs(number-i))
	return diff.index(min(diff))

# Build empty lists
indices = []
values_out  = []

# Test all values on the range using our function 'closest'
for i in values_in:
	index = closest(range_in, i)
	# Test if the value is under the nearest
	if i - range_in[index] >= 0 and forcedown == False:
		indices.append(index)
		values_out.append(range_in[index])
	else:
		# Test if the value is the first item (can't reduce index)
		if index != 0:
			indices.append(index-1)
			values_out.append(range_in[index-1])
		else:
			indices.append(0)
			values_out.append(range_in[0])

# Outputs
OUT = [values_out, indices]
# ----------------------------------------
code_block = CodeBlock(out=python_script) { out[0]; out[1]; }
closest = Output(code_block.out0)  # The closest value to the number.
indices = Output(code_block.out1)  # The index of the closest value from the range.
