# Dynamo custom node MathCumulativeSum.dyf "© Math.CumulativeSum" (Dynamo 2.12.1.8246)
# category: Crumple.Data.Actions
# Continuously adds a list of numbers together, returning a list of the values in sequence.

numbers = Input(numbers: var[]..[])  # List of numbers to sum.
pad = Input(pad: double = 0)  # Additional space to add between each addition.
python_script = Python(IN[0]=numbers, IN[1]=pad)  # CPython3
# ---------- python_script.python (18 lines) ----------
# Made by Gavin Crump
# Free for use
# BIM Guru, www.bimguru.com.au

# Collect inputs
nums  = IN[0] if isinstance(IN[0], list) else [IN[0]]
space = IN[1]

# Conduct cumulative sum
acc_sum = []
val = 0

for n in nums:
	val += n + space
	acc_sum.append(val)

# Send output to Dynamo
OUT = acc_sum
# ----------------------------------------
sum = Output(python_script)  # The cumulative sum.
