# Dynamo custom node MathDenominate.dyf "© Math.Denominate" (Dynamo 2.12.1.8246)
# category: Crumple.Data.Actions
# Given a list of numbers and a denominator, return the remainder of the numbers when divided by it. If the number is less than the demoninator, it will return the same number. This can be useful for identifying parallel vectors facing different directions by their angle about axis.

numbers = Input(numbers: var[]..[])  # A list of numbers.
denominator = Input(denominator: double = 180)  # The number to divide by.
python_script = Python(IN[0]=numbers, IN[1]=denominator)  # CPython3
# ---------- python_script.python (22 lines) ----------
# Made by Gavin Crump
# Free for use
# BIM Guru, www.bimguru.com.au

# Prepare inputs
numbers = IN[0] if isinstance(IN[0], list) else [IN[0]]
limit   = IN[1]

# Process down
clamped, changed = [], []

# Find clamped values
for n in numbers:
	higher    = n > limit
	remainder = n % limit
	excess    = (n-remainder)/limit
	result    = n-(limit*excess)
	clamped.append(result)
	changed.append(higher)

# Preparing output to Dynamo
OUT = [clamped, changed]
# ----------------------------------------
code_block = CodeBlock(lst=python_script) { nums = lst[0]; lows = lst[1]; }
numbers_2 = Output(code_block.nums)  # "numbers"; The denominated values
changed = Output(code_block.lows)  # Were the numbers changed
