# Dynamo custom node MathIntegerToOrdinal.dyf "© Math.IntegerToOrdinal" (Dynamo 2.3.0.5885)
# category: Crumple.Data.Actions
# Given an integer or list of integers, convert it to its ordinal form. The node works with an inherent limit of 99, but may be expanded in future if a computationally efficient method is identified.

integer = Input(integer: int)
code_block = CodeBlock(i=integer)
# ---------- code_block.designscript (16 lines) ----------
//Set value lists for combination
one_to_nine = ["First", "Second", "Third", "Fourth", "Fifth", "Sixth", "Seventh", "Eigth", "Ninth"];
ten_to_twen = ["Tenth", "Eleventh", "Twelth", "Thirteenth", "Fourteenth", "Fifteenth", "Sixteenth", "Seventeenth", "Eigteenth", "Ninteenth"];
tens        = ["Twenty", "Thirty", "Fourty", "Fifty", "Sixty", "Seventy", "Eighty", "Ninety"];
ten_ords    = ["Twentieth", "Thirtieth", "Fourtieth", "Fiftieth", "Sixtieth", "Seventieth", "Eightieth", "Ninetieth"];

//Build up the higher values
one_to_nine_sp = " " + one_to_nine;
above_twen = tens@L1<1L> + one_to_nine_sp@L2<1L>;

//Add the tens, drop twenty and join the list
twen_n_ten = DSCore.List.Flatten(DSCore.List.AddItemToFront(ten_ords@L1<1>, above_twen@L2<1>));
ordinal_nn = DSCore.List.Join([one_to_nine, ten_to_twen, twen_n_ten]);

//Index by the ordinals
DSCore.List.GetItemAtIndex(ordinal_nn, i - 1);
# ----------------------------------------
toOrdinals = Output(code_block.out8)
