# Dynamo custom node MathRandomNumbers.dyf "© Math.RandomNumbers" (Dynamo 2.12.1.8246)
# category: Crumple.Data.Create
# Generates a list of random numbers between a minimum and maximum value.

count = Input(count: int = 10)  # The number of values to generate.
seed = Input(seed: int = 1)  # The seed of randomisation.
min = Input(min: double = 0)  # The lower value of the domain.
max = Input(max: double = 1)  # The upper value of the domain.
python_script = Python(IN[0]=count, IN[1]=seed, IN[2]=min, IN[3]=max)  # CPython3
# ---------- python_script.python (27 lines) ----------
# Made by Gavin Crump
# Free for use
# BIM Guru, www.bimguru.com.au

# Import random package
from random import seed
from random import random

# Define inputs
rcount = IN[0]
rseed  = IN[1]
rmin   = IN[2]
rmax   = IN[3]

# Set seed
seed(rseed)

# Empty list for values
nums = []

# Generate random values
for r in range(rcount):
	val = rmin + (random() * (rmax-rmin))
	nums.append(val)

# Output
OUT = nums
# ----------------------------------------
numbers = Output(python_script)
