# Dynamo custom node ModifierFilterSolids.dyf "© Modifier.FilterSolids" (Dynamo 2.12.1.8246)
# category: Crumple.Geometry.Actions
# From a list or lists of geometry, filter out anything that doesn't fall under the object type solid. This is useful for dealing with families that contain geometry like curves from model lines.

geometry = Input(geometry: var[]..[])  # Dynamo geometry for filtering.
code_block = CodeBlock(geometry=geometry)
# ---------- code_block.designscript (4 lines) ----------
//Get geometry types
types   = DSCore.Object.Type(geometry);
//Mask for solids
DSCore.String.EndsWith(types, ".Solid", false);
# ----------------------------------------
filterByBoolMask = List.FilterByBoolMask(list=code_block.types, mask=code_block.out1)
solids = Output(filterByBoolMask.in)  # Dynamo solid geometry.
nonSolids = Output(filterByBoolMask.out)  # Dynamo non-solid geometry.
