# Dynamo custom node Objectify.dyf "© List.Objectify" (Dynamo 2.12.1.8246)
# category: Crumple.Data.Actions
# Given a list object, if the list is only one object in depth it will return that object instead.

items = Input(items: var[]..[])  # List data
python_script = Python(IN[0]=items)  # IronPython2
# ---------- python_script.python (16 lines) ----------
# Made by Gavin Crump
# Free for use
# BIM Guru, www.bimguru.com.au

# Boilerplate text
import clr

# Return object or list
def objOrList(input):
    if isinstance(input, list) and len(input) == 1:
        return input[0]
    else:
        return input

# Preparing output to Dynamo
OUT = objOrList(IN[0])
# ----------------------------------------
objectOrList = Output(python_script)
