# Dynamo custom node OpenDirectory.dyf "© Windows.DirectoryOpen" (Dynamo 2.3.1.11775)
# category: Crumple.Application.Actions
# Attempts to open a directory path.

directoryPath = Input(directoryPath: string)
python_script = Python(IN[0]=directoryPath)
# ---------- python_script.python (19 lines) ----------
# Made by Gavin Crump
# Free for use
# BIM Guru, www.bimguru.com.au

# Boilerplate text
import clr
import os

# Define list/unwrap list functions
partPath = IN[0]

# Try to open path
dirPath = partPath + "\\"

try:
	os.startfile(dirPath)
	OUT = True
except:
	OUT = False
# ----------------------------------------
wasOpened = Output(python_script)
