# Dynamo custom node OpenURL.dyf "© Web.UrlOpen" (Dynamo 2.3.0.5885)
# category: Crumple.Application.Actions
# Given a URL, will attempt to open in the default web browser used by Windows.

url = Input(url: string = "www.youtube.com.au/aussiebimguru")
runMe = Input(runMe: bool = false)
python_script = Python(IN[0]=url, IN[1]=runMe)
# ---------- python_script.python (13 lines) ----------
# Made by Gavin Crump
# Free for use
# BIM Guru, www.bimguru.com.au

# Boilerplate text
import os

# Open URL
if IN[1]:
	os.system("start \"\" " + IN[0])
	OUT = "URL Opened."
else:
	OUT = "Set runMe to True!"
# ----------------------------------------
result = Output(python_script)
