# Dynamo custom node Ordinals.dyf "© Math.Ordinals" (Dynamo 2.3.0.5885)
# category: Crumple.Data.Create
# Returns a list containing 1 through to 99 in ordinal format.

refresh = Input(refresh: bool = true)
code_block = CodeBlock(refresh=refresh)
# ---------- code_block.designscript (15 lines) ----------
refresh;

//Set value lists for combination
one_to_nine = ["First", "Second", "Third", "Fourth", "Fifth", "Sixth", "Seventh", "Eigth", "Ninth"];
ten_to_twen = ["Tenth", "Eleventh", "Twelth", "Thirteenth", "Fourteenth", "Fifteenth", "Sixteenth", "Seventeenth", "Eigteenth", "Ninteenth"];
tens        = ["Twenty", "Thirty", "Fourty", "Fifty", "Sixty", "Seventy", "Eighty", "Ninety"];
ten_ords    = ["Twentieth", "Thirtieth", "Fourtieth", "Fiftieth", "Sixtieth", "Seventieth", "Eightieth", "Ninetieth"];

//Build up the higher values
one_to_nine_sp = " " + one_to_nine;
above_twen = tens@L1<1L> + one_to_nine_sp@L2<1L>;

//Add the tens, drop twenty and join the list
twen_n_ten = DSCore.List.Flatten(DSCore.List.AddItemToFront(ten_ords@L1<1>, above_twen@L2<1>));
ordinal_nn = DSCore.List.Join([one_to_nine, ten_to_twen, twen_n_ten]);
# ----------------------------------------
ordinals = Output(code_block.ordinal_nn)
