# Dynamo custom node ParameterBipgByName.dyf "© Parameter.BIPGbyName" (Dynamo 2.16.2.5624)
# category: Crumple.Revit.Query
# Given a string or list of strings, return the corresponding BuiltIn Parameter Group.
# packages: Crumple 2026.7.1

collect_bipgs = Custom[© Collect.BIPGs]()  # package Crumple; Returns all BuiltIn Parameter Groups by group and type.
code_block = CodeBlock { null; }
addItemToEnd = List.AddItemToEnd(item=code_block, list=collect_bipgs.names)
name = Input(name: var[]..[])  # Names of parameter groups as strings
indexOf = List.IndexOf(list=addItemToEnd, element=name)
code_block_2 = CodeBlock(grps=collect_bipgs.groups, i=indexOf) { grps[i]; }
group = Output(code_block_2)  # The corresponding groups. No match = Null
