# Dynamo custom node ParameterProjectInformation.dyf "© Parameter.ProjectInformation" (Dynamo 2.16.2.5624)
# category: Crumple.Revit.Query
# Retrieve project information field(s) by name.

code_block = CodeBlock { "Project Information"; }
byName = Category.ByName(name=code_block)
all_elements_of_category = ElementsOfCategory(Category=byName)
pareterName = Input(pareterName: var[]..[])  # Parameter Names
getParameterValueByName = Element.GetParameterValueByName(element=all_elements_of_category, parameterName=pareterName, lacing=Longest)
value = Output(getParameterValueByName)
