# Dynamo custom node ParameterSpecTypeIdByName.dyf "© Parameter.SpecTypeIdByName" (Dynamo 2.16.2.5624)
# category: Crumple.Revit.Query
# Given a name or list of names of spec type Ids, returns them if found.

name = Input(name: var[]..[])
python_script = Python(IN[0]=name)  # CPython3
# ---------- python_script.python (43 lines) ----------
# Made by Gavin Crump
# Free for use
# BIM Guru, www.bimguru.com.au

# Boilerplate text
import clr

clr.AddReference("RevitAPI")
import Autodesk 
from Autodesk.Revit.DB import SpecUtils, LabelUtils

# Define list/unwrap list functions
def tolist(input):
    result = input if isinstance(input, list) else [input]
    return result

def objOrList(input, initial = IN[0]):
	if isinstance(initial, list):
		return input
	else:
		return input[0]

# Inputs
names = tolist(IN[0])

# Get forgetypeids and names
spec_ids   = SpecUtils.GetAllSpecs()
spec_names = [LabelUtils.GetLabelForSpec(s) for s in spec_ids]

# Get elements
elements_out, matches = [],[]

for n in names:
	if n in spec_names:
		ind = spec_names.index(n)
		elements_out.append(spec_ids[ind])
		matches.append(True)
	else:
		elements_out.append(None)
		matches.append(False)

# Return output
OUT = objOrList(elements_out),objOrList(matches)
# ----------------------------------------
code_block = CodeBlock(x=python_script) { x[0]; x[1]; }
specTypeId = Output(code_block.out0)
matchFound = Output(code_block.out1)
