# Dynamo custom node ParametersBipgByName.dyf "© Parameters.BIPGbyName" (Dynamo 2.12.1.8246)
# category: Crumple.Revit.Query
# Given a string or list of strings, return the corresponding BuiltIn Parameter Group.

names = Input(names: var[]..[])  # Names of parameter groups as strings
python_script = Python(IN[0]=names)  # IronPython2
# ---------- python_script.python (41 lines) ----------
# Made by Gavin Crump
# Free for use
# BIM Guru, www.bimguru.com.au

# Boilerplate text
import clr
import System

clr.AddReference("RevitAPI")
import Autodesk 
from Autodesk.Revit.DB import BuiltInParameterGroup

# Define list/unwrap list functions
def tolist(input):
    result = input if isinstance(input, list) else [input]
    return result

def objOrList(input):
    if isinstance(input, list) and len(input) == 1:
        return input[0]
    else:
        return input

# Declare inputs
names = tolist(IN[0])

# Enumerate over all BIPG types
bi_groups = [a for a in System.Enum.GetValues(BuiltInParameterGroup)]
bi_names  = [a.ToString() for a in System.Enum.GetValues(BuiltInParameterGroup)]

matches = []

for n in names:
	if n in bi_names:
		ind = bi_names.index(n)
		matches.append(bi_groups[ind])
	else:
		matches.append(None)

# Preparing output to Dynamo
OUT = objOrList(matches)
# ----------------------------------------
groups = Output(python_script)  # The corresponding groups. No match = Null
