# Dynamo custom node ParametersGroupTypeIdByName.dyf "© Parameters.GroupTypeIdByName" (Dynamo 2.16.2.5624)
# category: Crumple.Revit.Query
# Given a name or list of names of group type ids, returns them if found.

names = Input(names: var[]..[])
python_script = Python(IN[0]=names)  # CPython3
# ---------- python_script.python (43 lines) ----------
# Made by Gavin Crump
# Free for use
# BIM Guru, www.bimguru.com.au

# Boilerplate text
import clr

clr.AddReference("RevitAPI")
import Autodesk 
from Autodesk.Revit.DB import ParameterUtils, LabelUtils

# Define list/unwrap list functions
def tolist(input):
    result = input if isinstance(input, list) else [input]
    return result

def objOrList(input, initial = IN[0]):
	if isinstance(initial, list):
		return input
	else:
		return input[0]

# Inputs
names = tolist(IN[0])

# Get grouptypeIds and names
group_ids = ParameterUtils.GetAllBuiltInGroups()
group_names = [LabelUtils.GetLabelForGroup(g) for g in group_ids]

# Get elements
elements_out, foundMatch = [],[]

for n in names:
	if n in group_names:
		ind = group_names.index(n)
		elements_out.append(group_ids[ind])
		foundMatch.append(True)
	else:
		elements_out.append(None)
		foundMatch.append(False)

# Return output
OUT = objOrList(elements_out),objOrList(foundMatch)
# ----------------------------------------
code_block = CodeBlock(x=python_script) { x[0]; x[1]; }
groupTypeIds = Output(code_block.out0)
matchFound = Output(code_block.out1)
