# Dynamo custom node ParametersProjectInformation.dyf "© Parameters.ProjectInformation" (Dynamo 2.16.2.5624)
# category: Crumple.Revit.Query
# Retrieve project information field(s) by name.

code_block = CodeBlock { "Project Information"; }
byName = Category.ByName(name=code_block)
all_elements_of_category = ElementsOfCategory(Category=byName)
pareterNames = Input(pareterNames: var[]..[])  # Parameter Names
getParameterValueByName = Element.GetParameterValueByName(element=all_elements_of_category, parameterName=pareterNames, lacing=Longest)
values = Output(getParameterValueByName)
