# Dynamo custom node ParametersRepath.dyf "© SharedParameters.Repath" (Dynamo 2.3.1.11775)
# category: Crumple.Revit.Actions
# Given a filepath, will attempt to change the path that the Revit session is drawing its shared parameter file from.

filePath = Input(filePath: var[]..[])
python_script = Python(IN[0]=filePath)
# ---------- python_script.python (37 lines) ----------
# Made by Gavin Crump
# Free for use
# BIM Guru, www.bimguru.com.au

# Boilerplate text
import clr

clr.AddReference("RevitServices")
import RevitServices
from RevitServices.Persistence import DocumentManager 

clr.AddReference("RevitAPI")
clr.AddReference("RevitAPIUI")

import Autodesk 
from Autodesk.Revit.DB import *
from Autodesk.Revit.UI import *

# Current doc/app/ui
doc = DocumentManager.Instance.CurrentDBDocument
uiapp = DocumentManager.Instance.CurrentUIApplication 
app = uiapp.Application 
uidoc = uiapp.ActiveUIDocument

# Preparing input from dynamo to revit
new = IN[0]

#Do some action in a Transaction
existing = uiapp.Application.SharedParametersFilename

try:
	uiapp.Application.SharedParametersFilename = new
except:
	new = existing

# Preparing output to Dynamo
OUT = [existing, new]
# ----------------------------------------
code_block = CodeBlock(out=python_script) { out[0]; out[1]; }
before = Output(code_block.out0)
after = Output(code_block.out1)
