# Dynamo custom node ParametersSpecTypeIdByName.dyf "© Parameters.SpecTypeIdByName" (Dynamo 2.12.1.8246)
# category: Crumple.Revit.Query
# Given a name or list of names of spec type Ids, returns them if found.

names = Input(names: var[]..[])
python_script = Python(IN[0]=names)  # IronPython2
# ---------- python_script.python (41 lines) ----------
# Made by Gavin Crump
# Free for use
# BIM Guru, www.bimguru.com.au

# Boilerplate text
import clr

clr.AddReference("RevitAPI")
import Autodesk 
from Autodesk.Revit.DB import SpecUtils, LabelUtils

# Define list/unwrap list functions
def tolist(input):
    result = input if isinstance(input, list) else [input]
    return result

def objOrList(input):
    if isinstance(input, list) and len(input) == 1:
        return input[0]
    else:
        return input

# Inputs
names = tolist(IN[0])

# Get forgetypeids and names
spec_ids   = SpecUtils.GetAllSpecs()
spec_names = [LabelUtils.GetLabelForSpec(s) for s in spec_ids]

# Get elements
elements_out = []

for n in names:
	if n in spec_names:
		ind = spec_names.index(n)
		elements_out.append(spec_ids[ind])
	else:
		elements_out.append(None)

# Return output
OUT = objOrList(elements_out)
# ----------------------------------------
specTypeIds = Output(python_script)
