# Dynamo custom node ParentView.dyf "© ParentView" (Dynamo 2.3.1.11775)
# category: Crumple.Revit.Views
# For a view, return it's next related parent view if any. Will only retrieve one level above (even if it's parent has a parent etc.).

views = Input(views: var[]..[])
python_script = Python(IN[0]=views)
# ---------- python_script.python (40 lines) ----------
# Boilerplate text
import clr

clr.AddReference("RevitServices")
import RevitServices
from RevitServices.Persistence import DocumentManager 

clr.AddReference("RevitAPI")
import Autodesk 
from Autodesk.Revit.DB import *

# Current doc/app/ui
doc = DocumentManager.Instance.CurrentDBDocument

# Define list/unwrap list functions
def uwlist(input):
    result = input if isinstance(input, list) else [input]
    return UnwrapElement(result)

# Preparing input from dynamo to revit
viewlist  = uwlist(IN[0])
parentlist, hasparent, onlyparents = [],[],[]

# Do some action in a Transaction
for v in viewlist:
	try:
		parentId = v.get_Parameter(BuiltInParameter.SECTION_PARENT_VIEW_NAME).AsElementId()
		parentEl = Document.GetElement(doc, parentId)
		parentlist.append(parentEl)
		if parentEl != None:
			onlyparents.append(parentEl)
			hasparent.append(True)
		else:
			hasparent.append(False)
	except:
		parentlist.append(None)
		hasparent.append(False)

# Preparing output to Dynamo
OUT = [parentlist, hasparent, onlyparents]
# ----------------------------------------
code_block = CodeBlock(x=python_script) { x[0]; x[1]; x[2]; }
parentView = Output(code_block.out0)
hasParent = Output(code_block.out1)
onlyParents = Output(code_block.out2)
