# Dynamo custom node PlaceholderSheets.dyf "© PlaceholderSheets" (Dynamo 2.3.0.5885)
# category: Crumple.Revit.Selection
# Returns all placeholder sheets in the current document.

refresh = Input(refresh: bool = true)
python_script = Python(IN[0]=refresh)
# ---------- python_script.python (30 lines) ----------
# Made by Gavin Crump
# Free for use
# BIM Guru, www.bimguru.com.au

# Boilerplate text
import clr

clr.AddReference("RevitServices")
import RevitServices
from RevitServices.Persistence import DocumentManager 

clr.AddReference("RevitAPI")
import Autodesk 
from Autodesk.Revit.DB import *

# Current doc/app/ui
doc = DocumentManager.Instance.CurrentDBDocument

# Collect all sheets
sheets = FilteredElementCollector(doc).OfCategory(BuiltInCategory.OST_Sheets).WhereElementIsNotElementType().ToElements()

# Build output
sheetsout = []

for s in sheets:
	if s.IsPlaceholder:
		sheetsout.append(s)

# Preparing output to Dynamo
OUT = sheetsout
# ----------------------------------------
sheets = Output(python_script)
