# Dynamo custom node PointDeconstruct.dyf "© Point.Deconstruct" (Dynamo 2.16.2.5624)
# category: Crumple.Geometry.Query
# Breaks a point into its respective X, Y and Z components.

point = Input(point: Autodesk.DesignScript.Geometry.Point[]..[])
code_block = CodeBlock(p=point) { p.X; p.Y; p.Z; }
x = Output(code_block.out0)
y = Output(code_block.out1)
z = Output(code_block.out2)
