# Dynamo custom node PolyCurveGreatestArea.dyf "© PolyCurveGreatestArea" (Dynamo 2.3.0.5885)
# category: Crumple.Geometry.Polycurves
# From a list of polycurves, return the one with the largest area only. Can be useful for determining the outer-most boundary in a room with internalised holes.

polycurves = Input(polycurves: var[]..[])  # A list of polycurves.
byPatch = Surface.ByPatch(closedCurve=polycurves)
area = Surface.Area(surface=byPatch)
sortByKey = List.SortByKey(list=polycurves, keys=area)
code_block = CodeBlock(x=sortByKey.sorted_list) { x[-1]; }
greatest = Output(code_block)  # The polycurve with the greatest enclosed area.
code_block_2 = CodeBlock { -1; }
dropItems = List.DropItems(list=sortByKey.sorted_list, amount=code_block_2)
the_rest = Output(dropItems)  # The remaining polycurves that were smaller.
