# Dynamo custom node PrimaryView.dyf "© Views.Primary" (Dynamo 2.3.1.11775)
# category: Crumple.Revit.Query
# For a dependent view, return it's primary view, as well as if it has one.
# packages: Crumple 2022.2.13

view = Input(view: var[]..[])
docOrLink = Input(docOrLink: var[]..[] = null)  # Uses current if none provided. Accepts document or link instance.
revit_getdocument = Custom[© Revit.GetDocument](docOrLink=docOrLink)  # package Crumple; If no input is specified or an invalid one is, returns current document. If a link instance is provided, it returns the linked document. If a document is provided it will pass it through.
python_script = Python(IN[0]=view, IN[1]=revit_getdocument.document)
# ---------- python_script.python (34 lines) ----------
# Made by Gavin Crump
# Free for use
# BIM Guru, www.bimguru.com.au

# Boilerplate text
import clr

clr.AddReference("RevitAPI")
import Autodesk 
from Autodesk.Revit.DB import *

# Current doc
doc = IN[1]

# Define list function
def uwlist(input):
    result = input if isinstance(input, list) else [input]
    return UnwrapElement(result)

# Preparing input from dynamo to revit
viewlist = uwlist(IN[0])
parentlist,hasparent = [],[]

# Find the parents
for v in viewlist:
	parent = Document.GetElement(doc, v.GetPrimaryViewId())
	parentlist.append(parent)
	if parent == None:
		hasparent.append(False)
	else:
		hasparent.append(True)

# Preparing output to Dynamo
OUT = [parentlist, hasparent]
# ----------------------------------------
code_block = CodeBlock(x=python_script) { x[0]; x[1]; }
primaryView = Output(code_block.out0)
hasPrimary = Output(code_block.out1)
