# Dynamo custom node ProjectBasePoint.dyf "© ProjectBasePoint" (Dynamo 2.3.0.5885)
# category: Crumple.Revit.Coordinates
# This node will return the Revit project base point as well as the NS, EW and elevation values.

Refresh = Input(Refresh: bool = true)  # Toggle to refresh
python_script = Python(IN[0]=Refresh)
# ---------- python_script.python (51 lines) ----------
# Made by Gavin Crump
# Free for use
# BIM Guru, www.bimguru.com.au
# Credit to Genius Loci for much of the workflow

# Boilerplate text
import clr
import math

# Revit nodes
clr.AddReference("RevitNodes")
import Revit
clr.ImportExtensions(Revit.Elements)
clr.ImportExtensions(Revit.GeometryConversion)

# Revit services and API
clr.AddReference("RevitServices")
import RevitServices
from RevitServices.Persistence import DocumentManager 

clr.AddReference("RevitAPI")
import Autodesk 
from Autodesk.Revit.DB import *

# Current doc/app/ui
doc = DocumentManager.Instance.CurrentDBDocument

# Get project base point
bps    = FilteredElementCollector(doc).OfClass(BasePoint).ToElements()
pbp    = bps[1]

# Get unit types
DUT = Document.GetUnits(doc).GetFormatOptions(UnitType.UT_Length).DisplayUnits

points = []

# Get pbp values
ew = pbp.get_Parameter(BuiltInParameter.BASEPOINT_EASTWEST_PARAM).AsDouble()
ns = pbp.get_Parameter(BuiltInParameter.BASEPOINT_NORTHSOUTH_PARAM).AsDouble()
el = pbp.get_Parameter(BuiltInParameter.BASEPOINT_ELEVATION_PARAM).AsDouble()
an = pbp.get_Parameter(BuiltInParameter.BASEPOINT_ANGLETON_PARAM).AsDouble()

# Get EW, NS, Elev
# Thanks for letting me know about the rounding issue Ruben Romero Vivancos!
pbp_ns = round(UnitUtils.ConvertFromInternalUnits(ns, DUT), 15)
pbp_ew = round(UnitUtils.ConvertFromInternalUnits(ew, DUT), 15)
pbp_el = round(UnitUtils.ConvertFromInternalUnits(el, DUT), 15)
pbp_an = round(an * 180/math.pi)

# Preparing output to Dynamo
OUT = [pbp_ns, pbp_ew, pbp_el, pbp_an]
# ----------------------------------------
code_block = CodeBlock(x=python_script) { x[0]; x[1]; x[2]; x[3]; }
NS = Output(code_block.out0)  # The Northing value of the project base point returned in Revit coordinates.
EW = Output(code_block.out1)  # The Easting value of the project base point returned in Revit coordinates.
Elevation = Output(code_block.out2)  # The Elevation value of the project base point returned in Revit coordinates.
AngleToTN = Output(code_block.out3)  # The angle between project north and true north.
