# Dynamo custom node ProjectInformation.dyf "© ProjectInformation" (Dynamo 2.3.0.5885)
# category: Crumple.Revit.ProjectInformation
# Retrieve project information field(s) by name.

code_block = CodeBlock { "Project Information"; }
byName = Category.ByName(name=code_block)
all_elements_of_category = ElementsOfCategory(Category=byName)
params = Input(params: var[]..[])  # Parameter Names
getParameterValueByName = Element.GetParameterValueByName(element=all_elements_of_category, parameterName=params, lacing=Longest)
values = Output(getParameterValueByName)
