# Dynamo custom node ProjectOrigin.dyf "© Coordinates.Origin" (Dynamo 2.3.1.11775)
# category: Crumple.Revit.Query
# This node will return the Revit project origin as well as the NS, EW and elevation values.
# packages: Crumple 2022.2.13

origin = Point.Origin()
Point = Output(origin)  # The Revit internal origin as a point in Dynamo.  NB: This is the Dynamo origin too!
unitFactor = Input(unitFactor: double = 304.8)  # Because imperial units are silly
docOrLink = Input(docOrLink: var[]..[] = null)  # Uses current if none provided. Accepts document or link instance.
revit_getdocument = Custom[© Revit.GetDocument](docOrLink=docOrLink)  # package Crumple; If no input is specified or an invalid one is, returns current document. If a link instance is provided, it returns the linked document. If a document is provided it will pass it through.
python_script = Python(IN[0]=unitFactor, IN[1]=revit_getdocument.document)
# ---------- python_script.python (30 lines) ----------
# Made by Gavin Crump
# Free for use
# BIM Guru, www.bimguru.com.au

# Boilerplate text
import clr

# Revit services and API
clr.AddReference("RevitServices")
import RevitServices
from RevitServices.Persistence import DocumentManager 

clr.AddReference("RevitAPI")
import Autodesk 
from Autodesk.Revit.DB import *

# Current doc/app/ui
doc = IN[1]

# Get project position
ori = doc.ActiveProjectLocation.GetProjectPosition(XYZ(0,0,0))

# Get EW, NS, Elev
# Thanks for letting me know about the rounding issue Ruben Romero Vivancos!
ori_ns = ori.NorthSouth * IN[0]
ori_ew = ori.EastWest * IN[0]
ori_el = ori.Elevation * IN[0]

# Preparing output to Dynamo
OUT = [ori_ns, ori_ew, ori_el]
# ----------------------------------------
code_block = CodeBlock(x=python_script) { x[0]; x[1]; x[2]; }
NS = Output(code_block.out0)  # The Northing value of the internal origin returned in Revit coordinates.
EW = Output(code_block.out1)  # The Easting value of the internal origin returned in Revit coordinates.
Elevation = Output(code_block.out2)  # The elevation value of the internal origin returned in Revit coordinates.
