# Dynamo custom node ProjectToInternal.dyf "© Revit.ProjectToInternal" (Dynamo 2.12.1.8246)
# category: Crumple.Application.Actions
# Convert values from the project unit type to internal Revit unit type (decimal feet).
# packages: Crumple 2022.5.27

projectValues = Input(projectValues: var[]..[])
docOrLink = Input(docOrLink: var[]..[] = null)  # Uses current if none provided. Accepts document or link instance.
revit_getdocument = Custom[© Revit.GetDocument](docOrLink=docOrLink)  # package Crumple; If no input is specified or an invalid one is, returns current document. If a link instance is provided, it returns the linked document. If a document is provided it will pass it through.
python_script = Python(IN[0]=projectValues, IN[1]=revit_getdocument.document)  # IronPython2
# ---------- python_script.python (47 lines) ----------
# Made by Gavin Crump
# Free for use
# BIM Guru, www.bimguru.com.au

# Boilerplate text
import clr

clr.AddReference("RevitServices")
import RevitServices
from RevitServices.Persistence import DocumentManager 

clr.AddReference("RevitAPI")
import Autodesk 
from Autodesk.Revit.DB import *

# Define list/unwrap list functions
def tolist(input):
    result = input if isinstance(input, list) else [input]
    return result

# Return object or list
def objOrList(input):
	if isinstance(input, list) and len(input) == 1:
		return input[0]
	else:
		return input

# Current doc/app/ui
val = tolist(IN[0])
doc = IN[1]

uiapp = DocumentManager.Instance.CurrentUIApplication 
app = uiapp.Application

# Get app version
rvt_year = int(app.VersionNumber)

# Get units
if rvt_year < 2022:
	intUnits = doc.GetUnits().GetFormatOptions(UnitType.UT_Length).DisplayUnits
	convertedVals = [UnitUtils.Convert(v,intUnits,DisplayUnitType.DUT_DECIMAL_FEET) for v in val]
else:
	intUnitsId = doc.GetUnits().GetFormatOptions(SpecTypeId.Length).GetUnitTypeId()
	convertedVals = [UnitUtils.ConvertToInternalUnits(v, intUnitsId) for v in val]

# Preparing output to Dynamo
OUT = objOrList(convertedVals)
# ----------------------------------------
toInternal = Output(python_script)
