# Dynamo custom node QuickImportExcel.dyf "© QuickImportExcel" (Dynamo 2.3.0.5885)
# category: Crumple.Application.Import
# The Import excel node, but with some streamlining features introduced. I mainly made this as I am constantly doing this setup and wanted to simplify it down to one node.

filePath = Input(filePath: string)
file_from_path = FileObject(path=filePath)
workSheet = Input(workSheet: string = "Sheet1")
asStrings = Input(asStrings: bool = false)
showExcel = Input(showExcel: bool = false)
importExcel = Data.ImportExcel(file=file_from_path, sheetName=workSheet, readAsStrings=asStrings, showExcel=showExcel)
isNull = Object.IsNull(obj=importExcel)
nullReplace = Input(nullReplace: var = null)
if_ = If(test=isNull, true=nullReplace, false=importExcel)
headerRows = Input(headerRows: int = 1)
takeItems = List.TakeItems(list=if_, amount=headerRows)
headers = Output(takeItems)
transpose = Input(transpose: bool = true)
dropItems = List.DropItems(list=if_, amount=headerRows)
transpose_2 = List.Transpose(lists=dropItems)
python_script = Python(IN[0]=transpose, IN[1]=transpose_2, IN[2]=dropItems)
# ---------- python_script.python (9 lines) ----------
# Made by Gavin Crump
# Free for use
# BIM Guru, www.bimguru.com.au

#Code
if IN[0]:
	OUT = IN[1]
else:
	OUT = IN[2]
# ----------------------------------------
data = Output(python_script)
