# Dynamo custom node RegexSimple.dyf "© RegexSimple" (Dynamo 2.3.0.5885)
# category: Crumple.String.Inspect
# Based on a single regex statement, check all strings against it.

strings = Input(strings: var[]..[])
regex = Input(regex: string)
python_script = Python(IN[0]=strings, IN[1]=regex)
# ---------- python_script.python (23 lines) ----------
# Made by Gavin Crump
# Free for use
# BIM Guru, www.bimguru.com.au

# Boilerplate text (re is regex)
import clr
import re

# Preparing input from dynamo to revit
str_list = IN[0] if isinstance(IN[0],list) else [IN[0]]
thisexp = re.compile(IN[1])

results = []

# Check each string against the regex
for s in str_list:
	if re.search(thisexp, s):
		results.append(True)
	else:
		results.append(False)

# Preparing output to Dynamo
OUT = results
# ----------------------------------------
passes = Output(python_script)
