# Dynamo custom node RegionEdgeStyles.dyf "© Region.EdgeStyles" (Dynamo 2.3.1.11775)
# category: Crumple.Revit.Other.Query
# Returns the graphic styles of the edges of a filled or masking region.
# packages: Crumple 2022.2.13

region = Input(region: var[]..[])
docOrLink = Input(docOrLink: var[]..[] = null)  # Uses current if none provided. Accepts document or link instance.
revit_getdocument = Custom[© Revit.GetDocument](docOrLink=docOrLink)  # package Crumple; If no input is specified or an invalid one is, returns current document. If a link instance is provided, it returns the linked document. If a document is provided it will pass it through.
python_script = Python(IN[0]=region, IN[1]=revit_getdocument.document)
# ---------- python_script.python (52 lines) ----------
# Made by Gavin Crump
# Free for use
# BIM Guru, www.bimguru.com.au

# Boilerplate text
import clr

clr.AddReference("RevitServices")
import RevitServices
from RevitServices.Persistence import DocumentManager 

clr.AddReference("RevitAPI")
import Autodesk 
from Autodesk.Revit.DB import *

# Current doc/app/ui
doc = IN[0]
uiapp = DocumentManager.Instance.CurrentUIApplication 
app = uiapp.Application 
uidoc = uiapp.ActiveUIDocument

# Define list/unwrap list functions
def uwlist(input):
    result = input if isinstance(input, list) else [input]
    return UnwrapElement(result)

# Preparing input from dynamo to revit
regions = uwlist(IN[0])

# Establish default options and prepare edge arrays
geomOption = app.Create.NewGeometryOptions()

edgeArray = []

# Construct edge array for review
for r in regions:
	geomElem = r.get_Geometry(geomOption)
	enum1 = geomElem.GetEnumerator() ; enum1.MoveNext()
	geo = enum1.Current
	edgeArray.append(geo.Edges)
	
# Get the graphic style of each edge
lineStyles = []

for i in range(0,len(edgeArray)):
	ls = []
	for edge in edgeArray[i]:
		ls.append(doc.GetElement(edge.GraphicsStyleId))
	lineStyles.append(ls)

# Preparing output to Dynamo
OUT = lineStyles
# ----------------------------------------
graphicStyles = Output(python_script)
