# Dynamo custom node ReplaceNulls.dyf "© List.ReplaceNulls" (Dynamo 2.3.1.11775)
# category: Crumple.Data.Actions
# Replaces all nulls with a given substitute.

lst = Input(lst: var[]..[])  # Data to be modified.
replace = Input(replace: var[]..[])  # What to replace nulls with.
python_script = Python(IN[0]=lst, IN[1]=replace)
# ---------- python_script.python (14 lines) ----------
# Made by Gavin Crump
# Free for use
# BIM Guru, www.bimguru.com.au

items = IN[0]
rep = IN[1]

elementlist = list()
for item in items:
	if item is None: 
		item = rep
	elementlist.append(item)
	
OUT = elementlist
# ----------------------------------------
result = Output(python_script)
