# Dynamo custom node RevitCurrentSize.dyf "© Revit.CurrentSize" (Dynamo 2.12.1.8246)
# category: Crumple.Application.Query
# Returns the size of the current model in MB. If the model is on BIM360 it will find the local cache.

refresh = Input(refresh: bool = true)
python_script = Python(IN[0]=refresh)  # IronPython2
# ---------- python_script.python (32 lines) ----------
# Made by Gavin Crump
# Free for use
# BIM Guru, www.bimguru.com.au

# Boilerplate text
import clr

import os
import System
from System import Environment

clr.AddReference('RevitServices')
from RevitServices.Persistence import DocumentManager

# Get current document path
doc = DocumentManager.Instance.CurrentDBDocument
pn = doc.PathName

# Method from Data-Shapes to get current model size
try:
	guid = doc.WorksharingCentralGUID  
	AppDataList = Environment.GetFolderPath(Environment.SpecialFolder.ApplicationData).split("\\")
	AppDataList.pop(-1)
	AppData = "\\".join(AppDataList)
	location =  AppData + "\\Local\\Autodesk\\Revit"
	cachedFile = System.IO.Directory.GetFiles(location, str(guid) + ".rvt" ,SearchOption.AllDirectories)
	size = [os.path.getsize(file) for file in cachedFile][0]
except:
	size = float(os.path.getsize(pn))

# Return size in MB
OUT = size/1000000
# ----------------------------------------
fileSize = Output(python_script)  # Returned in MB
