# Dynamo custom node RevitCurrentView.dyf "© Revit.CurrentView" (Dynamo 2.16.2.5624)
# category: Crumple.Application.Query
# Given the current document, return the active view.

refresh = Input(refresh: bool = true)
python_script = Python(IN[0]=refresh)  # CPython3
# ---------- python_script.python (18 lines) ----------
# Made by Gavin Crump
# Free for use
# BIM Guru, www.bimguru.com.au

# Boilerplate text
import clr

clr.AddReference("RevitServices")
import RevitServices
from RevitServices.Persistence import DocumentManager 

# Current doc/app/ui
doc = DocumentManager.Instance.CurrentDBDocument
uiapp = DocumentManager.Instance.CurrentUIApplication 
uidoc = uiapp.ActiveUIDocument

# Preparing output to Dynamo
OUT = uidoc.ActiveGraphicalView
# ----------------------------------------
view = Output(python_script)
