# Dynamo custom node RevitExportDwgOptions.dyf "© Revit.ExportOptionsDwg" (Dynamo 2.12.1.8246)
# category: Crumple.Application.Create
# Creates a DWG export options object, or retrieves one with the given name if found in the document.
# packages: Crumple 2024.3.1

settingsName = Input(settingsName: string = "")
useSharedCoordinates = Input(useSharedCoordinates: bool = false)
mergeViewsAsXrefs = Input(mergeViewsAsXrefs: bool = true)
docOrLink = Input(docOrLink: var[]..[] = null)  # Uses current if none provided. Accepts document or link instance.
revit_getdocument = Custom[© Revit.GetDocument](docOrLink=docOrLink)  # package Crumple; If no input is specified or an invalid one is, returns current document. If a link instance is provided, it returns the linked document. If a document is provided it will pass it through.
python_script = Python(IN[0]=settingsName, IN[1]=useSharedCoordinates, IN[2]=mergeViewsAsXrefs, IN[3]=revit_getdocument.document)  # CPython3
# ---------- python_script.python (31 lines) ----------
# Made by Gavin Crump
# Free for use
# BIM Guru, www.bimguru.com.au

# Boilerplate text
import clr

clr.AddReference("RevitAPI")
import Autodesk 
from Autodesk.Revit.DB import DWGExportOptions, BaseExportOptions

# Preparing input from dynamo to revit
settingsName = IN[0]
sharedCoords = IN[1]
mergedViews  = IN[2]
doc          = IN[3]

# Collect all sheets
options = BaseExportOptions.GetPredefinedSetupNames(doc)

if settingsName in options:
	options_dwg = DWGExportOptions.GetPredefinedOptions(doc, settingsName)
	foundSetting = True
else:
	options_dwg = DWGExportOptions()
	options_dwg.SharedCoords = sharedCoords
	options_dwg.MergedViews  = mergedViews
	foundSetting = False

# Preparing output to Dynamo
OUT = options_dwg, foundSetting
# ----------------------------------------
code_block = CodeBlock(x=python_script) { x[0]; x[1]; }
dwgExportOptions = Output(code_block.out0)
settingsFound = Output(code_block.out1)
