# Dynamo custom node RevitExportPdfOptions.dyf "© Revit.ExportOptionsPdf" (Dynamo 2.10.1.3976)
# category: Crumple.Application.Create
# Provides a list of options to be used in conjunction with the ExportPDF node. Works in Revit 2022 and later.

hideCrop = Input(hideCrop: bool = true)
hideRefPlanes = Input(hideRefPlanes: bool = true)
hideScopeBoxes = Input(hideScopeBoxes: bool = true)
hideUnreferenced = Input(hideUnreferenced: bool = true)
maskCoincident = Input(maskCoincident: bool = true)
list_create = List.Create(item0=hideCrop, item1=hideRefPlanes, item2=hideScopeBoxes, item3=hideUnreferenced, item4=maskCoincident)
options = Output(list_create)
