# Dynamo custom node RevitExportToDwg.dyf "© Revit.ExportToDwg" (Dynamo 2.12.1.8246)
# category: Crumple.Application.Create
# Given a list of views and/or sheets as well as various related settings, attempts to export them to DWG using the provided settings.

directoryPath = Input(directoryPath: string)
viewsOrSheets = Input(viewsOrSheets: var[]..[])
fileNames = Input(fileNames: var[]..[])  # Not including the extension
dwgExportOptions = Input(dwgExportOptions: var)
runMe = Input(runMe: bool = false)
python_script = Python(IN[0]=directoryPath, IN[1]=viewsOrSheets, IN[2]=fileNames, IN[3]=dwgExportOptions, IN[4]=runMe)  # IronPython2
# ---------- python_script.python (87 lines) ----------
# Made by Gavin Crump
# Free for use
# BIM Guru, www.bimguru.com.au

# Boilerplate text
import clr

# Import List class
from System.Collections.Generic import List

clr.AddReference("RevitServices")
import RevitServices
from RevitServices.Persistence import DocumentManager 
from RevitServices.Transactions import TransactionManager 

clr.AddReference("RevitAPI")
import Autodesk 
from Autodesk.Revit.DB import *

# Current doc/app/ui
doc = DocumentManager.Instance.CurrentDBDocument

# Define list/unwrap list functions
def tolist(input):
    result = input if isinstance(input, list) else [input]
    return result

def uwlist(input):
    result = input if isinstance(input, list) else [input]
    return UnwrapElement(result)

# Preparing input from dynamo to revit
directoryPath = IN[0]
viewsToPrint  = uwlist(IN[1])
fileNames     = tolist(IN[2])
exportSetting = UnwrapElement(IN[3])
confirmExport = IN[4]

# Function: Replace or remove illegal characters for windows
CHARS_ILLEGAL = ['/','?','<','>','\\',':','*','|','"','^', '.']

def legalizeString(string_check, char_replace = None):
	# New string to build
	string_legal  = ""
	# Check each character
	for c in string_check:
		if c not in CHARS_ILLEGAL:
			string_legal += c
	# Return new string
	return string_legal

# Legalize file names
legalNames = [legalizeString(fn, "") for fn in fileNames ]

# Make file paths
filePaths = []

for fn in legalNames:
	filePath = '{}\{}.dwg'.format(directoryPath, fn)
	filePaths.append(filePath)

# Function: Export a sheet to DWG
def exportSheetDwg(directory_path, file_name, revit_sheet, options_dwg, myDoc = doc):
	# Put sheet in Id list
	id_sheet = List[ElementId]()
	id_sheet.Add(revit_sheet.Id)
	# Export the sheet to DWG
	myDoc.Export(directory_path, file_name, id_sheet, options_dwg)
	# Return nothing
	return True

# If we confirmed export, try to export
if confirmExport:
	# Outcomes
	outcomes = []
	# Do some action in a Transaction
	TransactionManager.Instance.EnsureInTransaction(doc)
	# For each sheet...
	for v, f in zip(viewsToPrint, legalNames):
		exported = exportSheetDwg(directoryPath, f, v, exportSetting, doc)
		outcomes.append(exported)
	# your actions
	TransactionManager.Instance.TransactionTaskDone()
	OUT = outcomes, filePaths
# If we didn't, return message
else:
	OUT = "Set runMe to true.", []
# ----------------------------------------
code_block = CodeBlock(x=python_script) { x[0]; x[1]; }
wasExported = Output(code_block.out0)
filePaths = Output(code_block.out1)
