# Dynamo custom node RevitExportToPdf.dyf "© Revit.ExportToPdf" (Dynamo 2.12.1.8246)
# category: Crumple.Application.Create
# Given a list of sheets, names, directory and export options this node will batch export PDF files. Requires Revit 2022 or higher to work.

directoryPath = Input(directoryPath: string)
sheets = Input(sheets: var[]..[])
fileNames = Input(fileNames: var[]..[])  # Not including extension.
options = Input(options: var[]..[] = [true, true, true, true, true])
python_script = Python(IN[0]=directoryPath, IN[1]=sheets, IN[2]=fileNames, IN[3]=options)  # IronPython2
# ---------- python_script.python (71 lines) ----------
# Made by Gavin Crump
# Credit to Sean Page for sharing these methods via the forums
# https://forum.dynamobim.com/t/export-pdf-in-revit-2022-quick-example/62697
# Free for use
# BIM Guru, www.bimguru.com.au

# Boilerplate text
import clr

clr.AddReference('System')
from System.Collections.Generic import List

clr.AddReference("RevitServices")
import RevitServices
from RevitServices.Persistence import DocumentManager 

# Current doc/app/ui
doc = DocumentManager.Instance.CurrentDBDocument
uiapp = DocumentManager.Instance.CurrentUIApplication 
app = uiapp.Application
# Get revit version
revit_version = int(app.VersionNumber)

# Define list/unwrap list functions
def tolist(input):
    result = input if isinstance(input, list) else [input]
    return result

def uwlist(input):
    result = input if isinstance(input, list) else [input]
    return UnwrapElement(result)

# Preparing input from dynamo to revit
directoryPath = IN[0]
sheets        = uwlist(IN[1])
fileNames     = tolist(IN[2])
options       = IN[3]

# If we are in Revit 2022 or higher, print
if revit_version > 2021:
	# Import the references
	clr.AddReference("RevitAPI")
	import Autodesk
	from Autodesk.Revit.DB import PDFExportOptions, ElementId, ExportPaperFormat
	# Collect and set export options
	opts                          = PDFExportOptions()
	opts.HideCropBoundaries       = options[0]
	opts.HideScopeBoxes           = options[1]
	opts.HideReferencePlane       = options[2]
	opts.HideUnreferencedViewTags = options[3]
	opts.MaskCoincidentLines      = options[4]
	# This will uses the Sheet Size for Paper size, or default to Letter
	opts.PaperFormat = ExportPaperFormat.Default
	# Variables to append to
	results = []
	sheetList = List[ElementId]()
	# Execute the batch export
	for s, n in zip(sheets, fileNames):
		# Set file name
		opts.FileName = n
		# Add sheet to a list
		sheetList.Add(s.Id)
		# Export and append the result
		result = doc.Export(directoryPath, sheetList, opts)
		results.append(result)
		sheetList.Clear()
	# Preparing output to Dynamo
	OUT = results, "SUCCESS: Version is 2022 or higher."
# Otherwise tell the user we can't proceed
else:
	OUT = [False for s in sheets], "ERROR: Only works in Revit 2022 or higher.\n\nUse Revit.PrintToPdf node instead."
# ----------------------------------------
code_block = CodeBlock(x=python_script) { x[0]; x[1]; }
wasExported = Output(code_block.out0)
versionCheck = Output(code_block.out1)
