# Dynamo custom node RevitGetDocument.dyf "© Revit.GetDocument" (Dynamo 2.12.1.8246)
# category: Crumple.Application.Actions
# If no input is specified or an invalid one is, returns current document. If a link instance is provided, it returns the linked document. If a document is provided it will pass it through.

docOrLink = Input(docOrLink: var[]..[] = null)
python_script = Python(IN[0]=docOrLink)  # IronPython2
# ---------- python_script.python (55 lines) ----------
# Made by Gavin Crump
# Free for use
# BIM Guru, www.bimguru.com.au

# Boilerplate text
import clr

clr.AddReference("RevitServices")
import RevitServices
from RevitServices.Persistence import DocumentManager 

# Define list/unwrap list functions
def uwlist(input):
    result = input if isinstance(input, list) else [input]
    return UnwrapElement(result)

def objOrList(input, initial = IN[0]):
	if isinstance(initial, list):
		return input
	else:
		return input[0]

def getDocument(doc):
	# If no document, return current document
	if doc == None:
		getDoc = DocumentManager.Instance.CurrentDBDocument
		test = "Null input, current document used."
	# If a document was provided, return it
	elif doc.GetType().ToString() == "Autodesk.Revit.DB.Document":
		getDoc = doc
		test = "Document was provided and used."
	# If a link instance, return it
	elif doc.GetType().ToString() == "Autodesk.Revit.DB.RevitLinkInstance":
		getDoc = doc.GetLinkDocument()
		test = "Document from provided linked instance used."
	# Otherwise, just return current document
	else:
		getDoc = DocumentManager.Instance.CurrentDBDocument
		test = "Invalid input, current document used."
	# Return the doc
	return getDoc, test

# Get input to document
docs = uwlist(IN[0])

# Get docs and values
getDocs, tests = [],[]

for d in docs:
	getD,t = getDocument(d)
	getDocs.append(getD)
	tests.append(t)

# Preparing output to Dynamo
OUT = objOrList(getDocs), objOrList(tests)
# ----------------------------------------
code_block = CodeBlock(x=python_script) { x[0]; x[1]; }
document = Output(code_block.out0)
outcome = Output(code_block.out1)
