# Dynamo custom node RevitGetDocumentPath.dyf "© Revit.GetDocumentPath" (Dynamo 2.16.2.5624)
# category: Crumple.Application.Query
# Returns the file path of a Revit document.
# packages: Crumple 2022.2.13

docOrLink = Input(docOrLink: var[]..[] = null)  # Uses current if none provided. Accepts document or link instance.
revit_getdocument = Custom[© Revit.GetDocument](docOrLink=docOrLink)  # package Crumple; If no input is specified or an invalid one is, returns current document. If a link instance is provided, it returns the linked document. If a document is provided it will pass it through.
python_script = Python(IN[0]=revit_getdocument.document)  # CPython3
# ---------- python_script.python (43 lines) ----------
# Made by Gavin Crump
# Free for use
# BIM Guru, www.bimguru.com.au

# Boilerplate text
import clr
import os
import System
from System import Environment

clr.AddReference("RevitAPI")
import Autodesk
from Autodesk.Revit.DB import Document

# Get path function
def tolist(input):
    result = input if isinstance(input, list) else [input]
    return result

def getPath(doc):
    try:
        guid = doc.WorksharingCentralGUID
        AppDataList = Environment.GetFolderPath(Environment.SpecialFolder.ApplicationData).split("\\")
        AppDataList.pop(-1)
        AppData = "\\".join(AppDataList)
        location =  AppData + "\\Local\\Autodesk\\Revit"
        cachedFile = System.IO.Directory.GetFiles(location, str(guid) + ".rvt" ,SearchOption.AllDirectories)
        return cachedFile
    except:
        return doc.PathName

def objOrList(input, initial = IN[0]):
	if isinstance(initial, list):
		return input
	else:
		return input[0]

# Current doc and path
docs = tolist(IN[0])
paths = [getPath(d) for d in docs]

# Name and path
OUT = objOrList(paths)
# ----------------------------------------
filePath = Output(python_script)
