# Dynamo custom node RevitGetDocuments.dyf "© Revit.GetDocuments" (Dynamo 2.12.1.8246)
# category: Crumple.Application.Query
# Returns the documents currently opened in the Revit application. The current document will be in a separate output to the background opened documents.

refresh = Input(refresh: bool = true)
python_script = Python(IN[0]=refresh)  # IronPython2
# ---------- python_script.python (32 lines) ----------
# Made by Gavin Crump
# Free for use
# BIM Guru, www.bimguru.com.au

# Boilerplate text
import clr

clr.AddReference("RevitServices")
import RevitServices
from RevitServices.Persistence import DocumentManager 

# Current doc/app/ui
doc = DocumentManager.Instance.CurrentDBDocument
uiapp = DocumentManager.Instance.CurrentUIApplication 
app = uiapp.Application 

# Get documents
documents = app.Documents

# Get current and other docs
otherDocs, linkDocs, linkTitles, otherTitles = [],[],[],[]

for d in app.Documents:
	if d.Title != doc.Title:
		if d.IsLinked:
			linkDocs.append(d)
			linkTitles.append(d.Title)
		else:
			otherDocs.append(d)
			otherTitles.append(d.Title)

OUT = [doc, linkDocs, otherDocs, doc.Title, linkTitles, otherTitles]
# ----------------------------------------
code_block = CodeBlock(X=python_script) { X[0]; X[1]; X[2]; X[3]; X[4]; X[5]; }
current = Output(code_block.out0)
linkedInCurrent = Output(code_block.out1)
notCurrent = Output(code_block.out2)
currentTitle = Output(code_block.out3)
linkedTitles = Output(code_block.out4)
notCurrentTitles = Output(code_block.out5)
