# Dynamo custom node RevitGetFileVersions.dyf "© Revit.GetFileVersions" (Dynamo 2.12.1.8246)
# category: Crumple.Application.Query
# Given a file path or list of file paths, attempts to return their version as an integer.

filePaths = Input(filePaths: var[]..[])
python_script = Python(IN[0]=filePaths)  # IronPython2
# ---------- python_script.python (34 lines) ----------
# Made by Gavin Crump
# Free for use
# BIM Guru, www.bimguru.com.au

# Boilerplate text
import clr
import os

clr.AddReference("RevitAPI")
import Autodesk 
from Autodesk.Revit.DB import BasicFileInfo

# Define list/unwrap list functions
def tolist(input):
    result = input if isinstance(input, list) else [input]
    return result

def objOrList(input, initial = IN[0]):
	if isinstance(initial, list):
		return input
	else:
		return input[0]

def getVersion(filePath):
	if os.path.exists(filePath):
		try:
			info_file = BasicFileInfo.Extract(filePath)
			return int(info_file.Format)
		except:
			return None	

file_paths = tolist(IN[0])
	
OUT = objOrList([getVersion(fp) for fp in file_paths])
# ----------------------------------------
versions = Output(python_script)
