# Dynamo custom node RevitGetUnitTypes.dyf "© Revit.GetUnitTypes" (Dynamo 2.12.1.8246)
# category: Crumple.Application.Query
# Returns the unit type or forgetypeId of the document's units.
# packages: Crumple 2022.5.27

docOrLink = Input(docOrLink: var[]..[] = null)  # Uses current if none provided. Accepts document or link instance.
revit_getdocument = Custom[© Revit.GetDocument](docOrLink=docOrLink)  # package Crumple; If no input is specified or an invalid one is, returns current document. If a link instance is provided, it returns the linked document. If a document is provided it will pass it through.
python_script = Python(IN[0]=revit_getdocument.document)  # IronPython2
# ---------- python_script.python (40 lines) ----------
# Made by Gavin Crump
# Free for use
# BIM Guru, www.bimguru.com.au

# Boilerplate text
import clr

clr.AddReference("RevitServices")
import RevitServices
from RevitServices.Persistence import DocumentManager 

# Current doc/app/ui
doc = IN[0]

# Get app version
uiapp = DocumentManager.Instance.CurrentUIApplication 
app = uiapp.Application
rvt_year = int(app.VersionNumber)

# Import API references by version
clr.AddReference("RevitAPI")
import Autodesk 

if rvt_year < 2022:
	from Autodesk.Revit.DB import UnitType
else:
	from Autodesk.Revit.DB import SpecTypeId

# Get units
if rvt_year < 2022:
	intLenUnits  = doc.GetUnits().GetFormatOptions(UnitType.UT_Length).DisplayUnits
	intAreaUnits = doc.GetUnits().GetFormatOptions(UnitType.UT_Area).DisplayUnits
	intVolUnits  = doc.GetUnits().GetFormatOptions(UnitType.UT_Volume).DisplayUnits
else:
	intLenUnits  = doc.GetUnits().GetFormatOptions(SpecTypeId.Length).GetUnitTypeId()
	intAreaUnits = doc.GetUnits().GetFormatOptions(SpecTypeId.Area).GetUnitTypeId()
	intVolUnits  = doc.GetUnits().GetFormatOptions(SpecTypeId.Volume).GetUnitTypeId()

# Preparing output to Dynamo
OUT = intLenUnits, intAreaUnits, intVolUnits
# ----------------------------------------
code_block = CodeBlock(x=python_script) { x[0]; x[1]; x[2]; }
lengthType = Output(code_block.out0)
areaType = Output(code_block.out1)
volumeType = Output(code_block.out2)
