# Dynamo custom node RevitImportCad.dyf "© Revit.ImportCAD" (Dynamo 2.12.1.8246)
# category: Crumple.Application.Create
# Attempts to import CAD files from file paths to nominated views.

filePaths = Input(filePaths: var[]..[])
importView = Input(importView: Revit.Elements.Views.View)  # View to aid placement
unitType = Input(unitType: string = "Millimeter")
python_script = Python(IN[0]=filePaths, IN[1]=importView, IN[2]=unitType)  # CPython3
# ---------- python_script.python (87 lines) ----------
# Made by Gavin Crump
# Free for use
# BIM Guru, www.bimguru.com.au

# Boilerplate text
import clr
import System

clr.AddReference('RevitServices')
import RevitServices
from RevitServices.Persistence import DocumentManager
from RevitServices.Transactions import TransactionManager

clr.AddReference('RevitAPI')
import Autodesk
from Autodesk.Revit.DB import ImportUnit, DWGImportOptions, ImportColorMode, ElementId, Transaction

# Current doc
doc = DocumentManager.Instance.CurrentDBDocument

# Define list/unwrap list functions
def tolist(input):
    result = input if isinstance(input, list) else [input]
    return result

def uwlist(input):
    result = input if isinstance(input, list) else [input]
    return UnwrapElement(result)

# Get inputs
filePaths = tolist(IN[0])
views     = uwlist(IN[1])

# Get enum name
def enumGetName(enum, enumClass):
    return System.Enum.GetName(enumClass,enum)

# Get import unit types as enumeration
enums = System.Enum.GetValues(ImportUnit)
names = [enumGetName(u,ImportUnit) for u in enums]

# Find matching enum unit type
i = names.index(IN[2])
unitType = enums[i]

# CAD settings
customscale = False
colormode = "Preserve"
placement = "Origin"
allView = True

# Empty lists
results, importInstances = [],[]

# Import options
options = DWGImportOptions()
options.AutoCorrectAlmostVHLines = True
options.OrientToView = False
options.ThisViewOnly = False
options.VisibleLayersOnly = True
ImportColorMode.Preserved
options.Unit = unitType

#Do some action in a Transaction
TransactionManager.Instance.EnsureInTransaction(doc)

# Import CAD files
for fp,v in zip(filePaths,views):
	# Try to import CAD
	try:
		# Dummy Id
		dummyId = ElementId.InvalidElementId
		# Import CAD
		result_import, cad_instance_Id = doc.Import(fp, options, v, dummyId)
		# Get import instance
		importInstance = doc.GetElement(cad_instance_Id)
		importInstances.append(importInstance)
		results.append(result_import)
	# Otherwise it failed
	except:
		importInstances.append(None)
		results.append(False)

TransactionManager.Instance.TransactionTaskDone()

# Outputs
OUT = importInstances, results
# ----------------------------------------
code_block = CodeBlock(x=python_script) { x[0]; x[1]; }
importInstances = Output(code_block.out0)
wasImported = Output(code_block.out1)
