# Dynamo custom node RevitIsWorkshared.dyf "© Revit.IsWorkshared" (Dynamo 2.12.1.8246)
# category: Crumple.Application.Query
# Returns if a document is workshared.
# packages: Crumple 2022.2.13

docOrLink = Input(docOrLink: var[]..[] = null)  # Uses current if none provided. Accepts document or link instance.
revit_getdocument = Custom[© Revit.GetDocument](docOrLink=docOrLink)  # package Crumple; If no input is specified or an invalid one is, returns current document. If a link instance is provided, it returns the linked document. If a document is provided it will pass it through.
python_script = Python(IN[0]=revit_getdocument.document)  # IronPython2
# ---------- python_script.python (23 lines) ----------
# Made by Gavin Crump
# Free for use
# BIM Guru, www.bimguru.com.au
# Large in part borrows from Clockwork

# Boilerplate text
import clr

# Define list/unwrap list functions
def tolist(input):
    result = input if isinstance(input, list) else [input]
    return result

def objOrList(input, initial = IN[0]):
	if isinstance(initial, list):
		return input
	else:
		return input[0]

# Inputs
docs = tolist(IN[0])

OUT = objOrList([d.IsWorkshared for d in docs])
# ----------------------------------------
isWorkshared = Output(python_script)
