# Dynamo custom node RevitLengthToInternal.dyf "© Revit.LengthToInternal" (Dynamo 2.16.2.5624)
# category: Crumple.Application.Actions
# Convert values from the project unit type to internal Revit unit type (decimal feet).
# packages: Crumple 2022.5.27

values = Input(values: var[]..[])
docOrLink = Input(docOrLink: var[]..[] = null)  # Uses current if none provided. Accepts document or link instance.
revit_getdocument = Custom[© Revit.GetDocument](docOrLink=docOrLink)  # package Crumple; If no input is specified or an invalid one is, returns current document. If a link instance is provided, it returns the linked document. If a document is provided it will pass it through.
python_script = Python(IN[0]=values, IN[1]=revit_getdocument.document)  # CPython3
# ---------- python_script.python (46 lines) ----------
# Made by Gavin Crump
# Free for use
# BIM Guru, www.bimguru.com.au

# Boilerplate text
import clr

clr.AddReference("RevitServices")
import RevitServices
from RevitServices.Persistence import DocumentManager 

clr.AddReference("RevitAPI")
import Autodesk 
from Autodesk.Revit.DB import *

# Define list/unwrap list functions
def tolist(input):
    result = input if isinstance(input, list) else [input]
    return result

def objOrList(input, initial = IN[0]):
	if isinstance(initial, list):
		return input
	else:
		return input[0]

# Current doc/app/ui
values = tolist(IN[0])
doc    = IN[1]

# Get app version
uiapp = DocumentManager.Instance.CurrentUIApplication 
app = uiapp.Application
rvt_year = int(app.VersionNumber)

# Function: Convert from project to internal
def projectToInternal(val, ver = rvt_year, myDoc = doc):
	if rvt_year < 2022:
		intUnits = myDoc.GetUnits().GetFormatOptions(UnitType.UT_Length).DisplayUnits
		return UnitUtils.Convert(val, intUnits, DisplayUnitType.DUT_DECIMAL_FEET)
	else:
		intUnitsId = myDoc.GetUnits().GetFormatOptions(SpecTypeId.Length).GetUnitTypeId()
		return UnitUtils.ConvertToInternalUnits(val, intUnitsId)

# Preparing output to Dynamo
OUT = objOrList([projectToInternal(v) for v in values])
# ----------------------------------------
convertedValues = Output(python_script)
