# Dynamo custom node RevitLinks.dyf "© RevitLinks" (Dynamo 2.3.0.5885)
# category: Crumple.Revit.LinkedFiles
# Returns all Revit link types in the current document, as well as all instance elements of those types.

refresh = Input(refresh: bool = true)
python_script = Python(IN[0]=refresh)  # graph output
# ---------- python_script.python (28 lines) ----------
import clr

# Import DocumentManager and TransactionManager
clr.AddReference("RevitServices")
import RevitServices
from RevitServices.Persistence import DocumentManager

# Import RevitAPI
clr.AddReference("RevitAPI")
import Autodesk
from Autodesk.Revit.DB import *

doc = DocumentManager.Instance.CurrentDBDocument

# Import ToDSType(bool) extension method
clr.AddReference("RevitNodes")
import Revit
clr.ImportExtensions(Revit.Elements)

coll = FilteredElementCollector(doc).OfCategory(BuiltInCategory.OST_RvtLinks).WhereElementIsNotElementType().ToElements()

insts, types = [], []

for c in coll:
	insts.append(c.ToDSType(True))
	types.append(doc.GetElement(c.GetTypeId()))

OUT = [insts,types]
# ----------------------------------------
code_block = CodeBlock(data=python_script) { inst = data[0]; type = data[1]; }
groupByKey = List.GroupByKey(list=code_block.inst, keys=code_block.type)
linkTypes = Output(groupByKey.unique_keys)
linkInstances = Output(groupByKey.groups)
