# Dynamo custom node RevitPrintToPDF.dyf "© Revit.PrintToPdf" (Dynamo 2.12.1.8246)
# category: Crumple.Application.Create
# Given a list of views and/or sheets as well as various related settings, attempts to print them to PDF. You will need to select and adjust a suitable print driver in order to supress 'save as' dialogues and other potential interruptions the print driver may cause by default. Our suggestion is PDF24, which provides options to prevent dialogues from appearing.

directoryPath = Input(directoryPath: string)
viewsOrSheets = Input(viewsOrSheets: var[]..[])
fileNames = Input(fileNames: var[]..[])  # Not including the extension
printSetting = Input(printSetting: var)
printerName = Input(printerName: string)
runMe = Input(runMe: bool = false)
python_script = Python(IN[0]=directoryPath, IN[1]=viewsOrSheets, IN[2]=fileNames, IN[3]=printSetting, IN[4]=printerName, IN[5]=runMe)  # CPython3
# ---------- python_script.python (126 lines) ----------
# Made by Gavin Crump
# Free for use
# BIM Guru, www.bimguru.com.au

# Boilerplate text
import clr
import os

clr.AddReference("RevitServices")
import RevitServices
from RevitServices.Persistence import DocumentManager 
from RevitServices.Transactions import TransactionManager 

clr.AddReference("RevitAPI")
import Autodesk 
from Autodesk.Revit.DB import ViewSet, ViewSheetSetting, Transaction, PrintRange

# Current doc/app/ui
doc = DocumentManager.Instance.CurrentDBDocument

# Define list/unwrap list functions
def tolist(input):
    result = input if isinstance(input, list) else [input]
    return result

def uwlist(input):
    result = input if isinstance(input, list) else [input]
    return UnwrapElement(result)

# Preparing input from dynamo to revit
directoryPath = IN[0]
viewsToPrint  = uwlist(IN[1])
fileNames     = tolist(IN[2])
printSetting  = UnwrapElement(IN[3])
printerName   = IN[4]
confirmPrint  = IN[5]

# Function: Replace or remove illegal characters for windows
CHARS_ILLEGAL = ['/','?','<','>','\\',':','*','|','"','^', '.']
RANGE_SELECT  = PrintRange.Select

def legalizeString(string_check, char_replace = None):
	# New string to build
	string_legal  = ""
	# Check each character
	for c in string_check:
		if c not in CHARS_ILLEGAL:
			string_legal += c
	# Return new string
	return string_legal

# Legalize file names
legalNames = [legalizeString(fn, "") for fn in fileNames]

# Make sure printer is valid
try:
	printManager = doc.PrintManager
	printManager.SelectNewPrintDriver(printerName)
	foundPrinter = True
except:
	foundPrinter = False

# Make file paths
filePaths = []

for fn in legalNames:
	filePath = '{}\{}.pdf'.format(directoryPath, fn)
	filePaths.append(filePath)

# Function: Export a sheet to PDF
def exportSheetPdf(revit_sheet, file_path, print_setting, myDoc = doc):
	TransactionManager.Instance.EnsureInTransaction(myDoc)
	# Set print range
	print_manager = myDoc.PrintManager
	print_manager.PrintRange = RANGE_SELECT
	print_manager.Apply()
	# Define current view set as current
	viewSet_temp = ViewSet()
	viewSet_temp.Insert(revit_sheet)
	viewSheetSet_temp = print_manager.ViewSheetSetting
	viewSheetSet_temp.CurrentViewSheetSet.Views = viewSet_temp
	# Save print setting
	viewSheetSet_temp.SaveAs("_Delete me")
	# Set printer
	print_manager.SelectNewPrintDriver(printerName)
	print_manager.Apply()
	# Check if printer is virtual and set print to file
	print_manager.CombinedFile = True
	print_manager.Apply()
	print_manager.PrintToFile = True
	# Set destination filepath
	print_manager.PrintToFileName = file_path
	print_manager.Apply()
	# Set print setting
	print_setup = print_manager.PrintSetup
	print_setup.CurrentPrintSetting = print_setting
	print_manager.Apply()
	# Submit to printer
	print_manager.SubmitPrint()
	try:
		outcome = True
	except:
		outcome = False
	# Delete Current viewSheetSettings to allow new setting to be stored
	viewSheetSet_temp.Delete()
	TransactionManager.Instance.TransactionTaskDone()
	return outcome

# If we didn't find printer, cancel
if not foundPrinter:
	OUT = "Printer not found.", []
# If we confirmed print, try to print
elif confirmPrint:
	# Outcomes
	outcomes = []
	# For each sheet...
	for v, f in zip(viewsToPrint, filePaths):
		if os.path.exists(f):
			outcomes.append(None)
		else:
			printed = exportSheetPdf(v, f, printSetting, doc)
			outcomes.append(printed)
	OUT = outcomes, filePaths
# If we didn't, return message
else:
	OUT = "Set runMe to true.", []
# ----------------------------------------
code_block = CodeBlock(x=python_script) { x[0]; x[1]; }
wasPrinted = Output(code_block.out0)
filePaths = Output(code_block.out1)
