# Dynamo custom node RevitSelection.dyf "© Revit.Selection" (Dynamo 2.12.1.8246)
# category: Crumple.Application.Query
# Returns all elements currently selected by the user in the active document when this node ran.

refresh = Input(refresh: bool = true)
python_script = Python(IN[0]=refresh)  # IronPython2
# ---------- python_script.python (32 lines) ----------
# Made by Gavin Crump
# Free for use
# BIM Guru, www.bimguru.com.au

# Boilerplate text
import clr

clr.AddReference("RevitNodes")
import Revit
clr.ImportExtensions(Revit.Elements)

clr.AddReference("RevitServices")
import RevitServices
from RevitServices.Persistence import DocumentManager 

# Current doc/app/ui
doc = DocumentManager.Instance.CurrentDBDocument
uiapp = DocumentManager.Instance.CurrentUIApplication 
uidoc = uiapp.ActiveUIDocument

# Get selection
selected = uidoc.Selection.GetElementIds()

# Return elements
result = []

for id in selected:
	e = doc.GetElement(id).ToDSType(True)
	result.append(e)

# Preparing output to Dynamo
OUT = result
# ----------------------------------------
elements = Output(python_script)
