# Dynamo custom node RevitStartView.dyf "© Revit.StartView" (Dynamo 2.12.1.8246)
# category: Crumple.Application.Query
# Returns the start view of the document if there is one nominated.
# packages: Crumple 2022.5.27

docOrLink = Input(docOrLink: var[]..[] = null)  # Uses current if none provided. Accepts document or link instance.
revit_getdocument = Custom[© Revit.GetDocument](docOrLink=docOrLink)  # package Crumple; If no input is specified or an invalid one is, returns current document. If a link instance is provided, it returns the linked document. If a document is provided it will pass it through.
python_script = Python(IN[0]=revit_getdocument.document)  # IronPython2
# ---------- python_script.python (35 lines) ----------
# Made by Gavin Crump
# Free for use
# BIM Guru, www.bimguru.com.au

# Boilerplate text
import clr

clr.AddReference("RevitAPI")
import Autodesk 
from Autodesk.Revit.DB import StartingViewSettings

# Define list/unwrap list functions
def tolist(input):
    result = input if isinstance(input, list) else [input]
    return result

def objOrList(input, initial = IN[0]):
	if isinstance(initial, list):
		return input
	else:
		return input[0]

def getStartView(doc):
	try:
		startSettings = StartingViewSettings.GetStartingViewSettings(doc)
		startViewId = startSettings.ViewId
		return doc.GetElement(startViewId)
	except:
		return None	

# Preparing input from dynamo to revit
docs = tolist(IN[0])

# Get start view
OUT = objOrList([getStartView(d) for d in docs])
# ----------------------------------------
view = Output(python_script)
