# Dynamo custom node RevitVersion.dyf "© Revit.Version" (Dynamo 2.12.1.8246)
# category: Crumple.Application.Query
# Returns the build information about the active Revit session.

refresh = Input(refresh: bool = true)
python_script = Python(IN[0]=refresh)  # CPython3
# ---------- python_script.python (38 lines) ----------
# Made by Gavin Crump
# Free for use
# BIM Guru, www.bimguru.com.au
# Mostly made from Clockwork, was a useful script so absorbed

# Boilerplate text
import clr
import System

clr.AddReference("RevitServices")
import RevitServices
from RevitServices.Persistence import DocumentManager 

clr.AddReference('RevitAPI')
import Autodesk
from Autodesk.Revit.ApplicationServices import LanguageType

# Get enum name
def enumGetName(enum, enumClass):
    return System.Enum.GetName(enumClass,enum)

# Current doc/app
uiapp = DocumentManager.Instance.CurrentUIApplication 
app = uiapp.Application 

# Collect build data
if int(app.VersionNumber) > 2017:
	fullVersion = app.SubVersionNumber
else:
	fullVersion = str(app.VersionNumber)

versionName  = app.VersionName
versionBuild = app.VersionBuild
language = enumGetName(app.Language, LanguageType)
versionShort = int(app.VersionNumber)

# Preparing output to Dynamo
OUT = versionName, versionShort, fullVersion, versionBuild, language
# ----------------------------------------
code_block = CodeBlock(out=python_script) { out[0]; out[1]; out[2]; out[3]; out[4]; }
name = Output(code_block.out0)
version = Output(code_block.out1)
subVersion = Output(code_block.out2)
build = Output(code_block.out3)
language = Output(code_block.out4)
