# Dynamo custom node RoomBoundaries.dyf "© RoomBoundaries" (Dynamo 2.3.0.5885)
# category: Crumple.Revit.Elements
# For a room or list of rooms, return all boundary (and internal) curves. The curves will be based on the currently nominated project room boundary settings.

rooms = Input(rooms: var[]..[])  # A room or list of rooms.
python_script = Python(IN[0]=rooms)
# ---------- python_script.python (46 lines) ----------
# Made by Gavin Crump
# Free for use
# BIM Guru, www.bimguru.com.au

# Boilerplate text
import clr

clr.AddReference("RevitNodes")
import Revit
clr.ImportExtensions(Revit.GeometryConversion)

clr.AddReference("RevitServices")
import RevitServices
from RevitServices.Persistence import DocumentManager 

clr.AddReference("RevitAPI")

import Autodesk 
from Autodesk.Revit.DB import *

# Current doc
doc = DocumentManager.Instance.CurrentDBDocument

# Preparing input from dynamo to revit
rooms_d = IN[0] if isinstance(IN[0], list) else [IN[0]]
rooms_r = UnwrapElement(rooms_d)

# Identify the document's spatial boundary setting (finish, core etc.)
settings = Autodesk.Revit.DB.AreaVolumeSettings.GetAreaVolumeSettings(doc)
options  = Autodesk.Revit.DB.SpatialElementBoundaryOptions()
b_option = settings.GetSpatialElementBoundaryLocation(SpatialElementType.Room)
options.SpatialElementBoundaryLocation = b_option

# Create empty curves list
curveslist = []

# Obtain room boundary curves
for room in rooms_r:
	curves = []	
	for boundlist in room.GetBoundarySegments(options):
		for bound in boundlist:
			curves.append(bound.GetCurve().ToProtoType())
	curveslist.append(curves)

# Preparing output to Dynamo
OUT = curveslist
# ----------------------------------------
curves = Output(python_script)  # Room boundary curves.
