# Dynamo custom node RoomCreateUnplaced.dyf "© Room.CreateUnplaced" (Dynamo 2.16.2.5624)
# category: Crumple.Revit.Create
# Creates an unplaced room with a given name, number and phase.

name = Input(name: string[]..[])
number = Input(number: string[]..[])
phase = Input(phase: var[]..[])
python_script = Python(IN[0]=name, IN[1]=number, IN[2]=phase)  # CPython3
# ---------- python_script.python (65 lines) ----------
# Made by Gavin Crump
# Free for use
# BIM Guru, www.bimguru.com.au

# Boilerplate text
import clr

clr.AddReference("RevitServices")
import RevitServices
from RevitServices.Persistence import DocumentManager 
from RevitServices.Transactions import TransactionManager 

# Current doc/app/ui
doc = DocumentManager.Instance.CurrentDBDocument

# Define list/unwrap list functions
def tolist(input):
    result = input if isinstance(input, list) else [input]
    return result

def uwlist(input):
    result = input if isinstance(input, list) else [input]
    return UnwrapElement(result)

def objOrList(input):
    if isinstance(input, list) and len(input) == 1:
        return input[0]
    else:
        return input

def matchLength(list1, list2):
    len1 = len(list1)
    len2 = len(list2)
    if len1 == len2:
        return list1
    elif len1 > len2:
        return list1[:len2]
    else:
        for i in range(0, len2-len1, 1):
            list1.append(list1[-1])
        return list1

# Preparing input from dynamo to revit
numbers = tolist(IN[0])
names   = matchLength(tolist(IN[1]), numbers)
phases  = matchLength(uwlist(IN[2]), numbers)

rooms = []

# Do some action in a Transaction
TransactionManager.Instance.EnsureInTransaction(doc)

for nu, na, p in zip(numbers, names, phases):
    try:
        room = doc.Create.NewRoom(p)
        room.Number = nu
        room.Name = na
        rooms.append(room.ToDSType(False))
    except:
        rooms.append(None)

TransactionManager.Instance.TransactionTaskDone()

# Preparing output to Dynamo
OUT = objOrList(rooms)
# ----------------------------------------
room = Output(python_script)
