# Dynamo custom node RoomGetByNumber.dyf "© Room.GetByNumber" (Dynamo 2.16.2.5624)
# category: Crumple.Revit.Actions
# Given a number, attempts to find the room with that number in a specified document.
# packages: Crumple 2026.7.1

number = Input(number: var[]..[])
docOrLink = Input(docOrLink: var[]..[] = null)  # Uses current if none provided. Accepts document or link instance.
revit_getdocument = Custom[© Revit.GetDocument](docOrLink=docOrLink)  # package Crumple; If no input is specified or an invalid one is, returns current document. If a link instance is provided, it returns the linked document. If a document is provided it will pass it through.
python_script = Python(IN[0]=number, IN[1]=revit_getdocument.document)  # CPython3
# ---------- python_script.python (43 lines) ----------
# Made by Gavin Crump
# Free for use
# BIM Guru, www.bimguru.com.au

# Boilerplate text
import clr

clr.AddReference("RevitAPI")
import Autodesk 
from Autodesk.Revit.DB import *

# Define list/unwrap list functions
def tolist(input):
    result = input if isinstance(input, list) else [input]
    return result

def uwlist(input):
    result = input if isinstance(input, list) else [input]
    return UnwrapElement(result)

def objOrList(input):
    if isinstance(input, list) and len(input) == 1:
        return input[0]
    else:
        return input

# Preparing input from dynamo to revit
numbers = tolist(IN[0])
doc = IN[1]

allRooms = FilteredElementCollector(doc).OfCategory(BuiltInCategory.OST_Rooms).ToElements()
allNumbers = [r.Number for r in allRooms]

rooms = []

for n in numbers:
    if n in allNumbers:
        rooms.append(allRooms[allNumbers.index(n)])
    else:
        rooms.append(None)

# Preparing output to Dynamo
OUT = rooms
# ----------------------------------------
room = Output(python_script)
