# Dynamo custom node RoomLevel.dyf "© Room.Level" (Dynamo 2.16.2.5624)
# category: Crumple.Revit.Query
# Returns the level of a room as an element.

room = Input(room: var[]..[])
python_script = Python(IN[0]=room)  # CPython3
# ---------- python_script.python (24 lines) ----------
# Made by Gavin Crump
# Free for use
# BIM Guru, www.bimguru.com.au

# Boilerplate text
import clr

# Define list/unwrap list functions
def uwlist(input):
    result = input if isinstance(input, list) else [input]
    return UnwrapElement(result)

def objOrList(input):
    if isinstance(input, list) and len(input) == 1:
        return input[0]
    else:
        return input

# Preparing input from dynamo to revit
rooms = uwlist(IN[0])
levels = [r.Level for r in rooms]

# Preparing output to Dynamo
OUT = objOrList(levels)
# ----------------------------------------
level = Output(python_script)
