# Dynamo custom node RoomTagInView.dyf "© Room.TagInView" (Dynamo 2.16.2.5624)
# category: Crumple.Revit.Create
# Creates a room tag in a given view. Inputs will lace longest based on the room count.

room = Input(room: var[]..[])
point = Input(point: var[]..[])
view = Input(view: var[]..[])
tagType = Input(tagType: var[]..[])
python_script = Python(IN[0]=room, IN[1]=point, IN[2]=view, IN[3]=tagType)  # CPython3
# ---------- python_script.python (79 lines) ----------
# Made by Gavin Crump
# Free for use
# BIM Guru, www.bimguru.com.au

# Boilerplate text
import clr
import math

clr.AddReference("RevitNodes")
import Revit
clr.ImportExtensions(Revit.Elements)
clr.ImportExtensions(Revit.GeometryConversion)

clr.AddReference("RevitServices")
import RevitServices
from RevitServices.Persistence import DocumentManager 
from RevitServices.Transactions import TransactionManager 

clr.AddReference("RevitAPI")
import Autodesk 
from Autodesk.Revit.DB import UV, LinkElementId, ElementId

# Current doc/app/ui
doc = DocumentManager.Instance.CurrentDBDocument

# Define list/unwrap list functions
def tolist(input):
    result = input if isinstance(input, list) else [input]
    return result

def uwlist(input):
    result = input if isinstance(input, list) else [input]
    return UnwrapElement(result)

def objOrList(input):
    if isinstance(input, list) and len(input) == 1:
        return input[0]
    else:
        return input

def matchLength(list1, list2):
    len1 = len(list1)
    len2 = len(list2)
    if len1 == len2:
        return list1
    elif len1 > len2:
        return list1[:len2]
    else:
        for i in range(0, len2-len1, 1):
            list1.append(list1[-1])
        return list1

# Preparing input from dynamo to revit
rooms = uwlist(IN[0])
points = matchLength(tolist(IN[1]),rooms)
views = matchLength(uwlist(IN[2]),rooms)
tagTypes = matchLength(uwlist(IN[3]),rooms)

# Do some action in a Transaction
tags = []

TransactionManager.Instance.EnsureInTransaction(doc)

for r, p, v, t in zip(rooms, points, views, tagTypes):
    if 1 == 1:
        ptRvt = p.ToXyz()
        uv = UV(ptRvt.X, ptRvt.Y)
        eid = LinkElementId(r.Id)
        tag = doc.Create.NewRoomTag(eid, uv, v.Id)
        GPI = tag.GetType().GetMethod("ChangeTypeId")
        GPI.Invoke(tag, [ElementId.Parse(t.Id.ToString())])
        tags.append(tag)
    else:
        tags.append(None)

TransactionManager.Instance.TransactionTaskDone()

# Preparing output to Dynamo
OUT = objOrList(tags)
# ----------------------------------------
tag = Output(python_script)
