# Dynamo custom node RoomTaggedInView.dyf "© Room.TaggedInView" (Dynamo 2.16.2.5624)
# category: Crumple.Revit.Query
# Returns if the room is tagged in a given view.

room = Input(room: var[]..[])
view = Input(view: Revit.Elements.Views.View)
python_script = Python(IN[0]=room, IN[1]=view)  # CPython3
# ---------- python_script.python (41 lines) ----------
# Made by Gavin Crump
# Free for use
# BIM Guru, www.bimguru.com.au

# Boilerplate text
import clr

clr.AddReference("RevitServices")
import RevitServices
from RevitServices.Persistence import DocumentManager

clr.AddReference("RevitAPI")
import Autodesk 
from Autodesk.Revit.DB import FilteredElementCollector, SpatialElementTag

# Current doc/app/ui
doc = DocumentManager.Instance.CurrentDBDocument

# Define list/unwrap list functions
def uwlist(input):
    result = input if isinstance(input, list) else [input]
    return UnwrapElement(result)

def objOrList(input):
    if isinstance(input, list) and len(input) == 1:
        return input[0]
    else:
        return input

# Preparing input from dynamo to revit
rooms = uwlist(IN[0])
view = UnwrapElement(IN[1])

# Get all room tags
roomTags = FilteredElementCollector(view.Document, view.Id).OfClass(SpatialElementTag).WhereElementIsNotElementType().ToElements()
taggedIds = [t.TaggedLocalRoomId for t in roomTags]

unTaggedRooms = [r.Id in taggedIds for r in rooms]

# Preparing output to Dynamo
OUT = objOrList(unTaggedRooms)
# ----------------------------------------
taggedInView = Output(python_script)
