# Dynamo custom node RoomsBoundaries.dyf "© Rooms.Boundaries" (Dynamo 2.12.1.8246)
# category: Crumple.Revit.Actions
# For a room or list of rooms, return all boundary (and internal) curves. The curves will be based on the currently nominated project room boundary settings.

room = Input(room: var[]..[])  # A room or list of rooms.
python_script = Python(IN[0]=room)  # IronPython2
# ---------- python_script.python (55 lines) ----------
# Made by Gavin Crump
# Free for use
# BIM Guru, www.bimguru.com.au

# Boilerplate text
import clr

clr.AddReference("RevitNodes")
import Revit
clr.ImportExtensions(Revit.GeometryConversion)

clr.AddReference("RevitServices")
import RevitServices
from RevitServices.Persistence import DocumentManager 

clr.AddReference("RevitAPI")
import Autodesk
from Autodesk.Revit.DB import AreaVolumeSettings, SpatialElementBoundaryOptions, SpatialElementType

# Define list/unwrap list functions
def uwlist(input):
    result = input if isinstance(input, list) else [input]
    return UnwrapElement(result)

def objOrList(input):
    if isinstance(input, list) and len(input) == 1:
        return input[0]
    else:
        return input

# Current doc
doc = DocumentManager.Instance.CurrentDBDocument

# Preparing input from dynamo to revit
rooms = uwlist(IN[0])

# Identify the document's spatial boundary setting (finish, core etc.)
settings = AreaVolumeSettings.GetAreaVolumeSettings(doc)
options  = SpatialElementBoundaryOptions()
b_option = settings.GetSpatialElementBoundaryLocation(SpatialElementType.Room)
options.SpatialElementBoundaryLocation = b_option

# Create empty curves list
curveslist = []

# Obtain room boundary curves
for r in rooms:
	curves = []
	for boundlist in r.GetBoundarySegments(options):
		for bound in boundlist:
			curves.append(bound.GetCurve().ToProtoType())
	curveslist.append(curves)

# Preparing output to Dynamo
OUT = objOrList(curveslist)
# ----------------------------------------
curves = Output(python_script)  # Room boundary curves.
