# Dynamo custom node RoomsByPlacement.dyf "© RoomsByPlacement" (Dynamo 2.3.1.11775)
# category: Crumple.Revit.Rooms
# Collects all valid/invalid rooms as two lists. Invalid rooms are not placed, or have issues that make their area invalid (not enclosed, redundant etc.).

Refresh = Input(Refresh: bool = true)  # Toggle to refresh
python_script = Python(IN[0]=Refresh)
# ---------- python_script.python (33 lines) ----------
# Made by Gavin Crump
# Free for use
# BIM Guru, www.bimguru.com.au

# Boilerplate text
import clr

clr.AddReference("RevitServices")
import RevitServices
from RevitServices.Persistence import DocumentManager 

clr.AddReference("RevitAPI")
import Autodesk 
from Autodesk.Revit.DB import *

# Current doc/app/ui
doc = DocumentManager.Instance.CurrentDBDocument

# Filtered element collector (all rooms)
fec   = FilteredElementCollector(doc)
rooms = fec.OfCategory(BuiltInCategory.OST_Rooms).ToElements()

# Filter rooms to those with area more than 0
placed, unplaced = [], []

for rm in rooms:
	if rm.Area > 0:
		placed.append(rm)
	else:
		unplaced.append(rm)

# Preparing output to Dynamo
OUT = [placed, unplaced]
# ----------------------------------------
code_block = CodeBlock(lst=python_script) { placed   = lst[0]; unplaced = lst[1]; }
valid = Output(code_block.placed)  # "valid: Rooms"; All rooms validly placed in the model
invalid = Output(code_block.unplaced)  # "invalid: Rooms"; All unplaced or unbound rooms
