# Dynamo custom node RoomsNameNumber.dyf "© Rooms.NameNumber" (Dynamo 2.12.1.8246)
# category: Crumple.Revit.Query
# Returns the names and numbers of rooms. Typically the name property of a room in the API returns name and number, so this node works around this.

rooms = Input(rooms: var[]..[])  # A room or list of rooms.
python_script = Python(IN[0]=rooms)  # IronPython2
# ---------- python_script.python (57 lines) ----------
# Made by Gavin Crump
# Free for use
# BIM Guru, www.bimguru.com.au

# Boilerplate text
import clr

clr.AddReference("RevitServices")
import RevitServices
from RevitServices.Persistence import DocumentManager 

clr.AddReference("RevitAPI")
import Autodesk 
from Autodesk.Revit.DB import BuiltInParameter, ParameterUtils

# Current doc/app/ui
uiapp = DocumentManager.Instance.CurrentUIApplication 
app   = uiapp.Application
ver   = int(app.VersionNumber)

bip_roomName = BuiltInParameter.ROOM_NAME

# Define list/unwrap list functions
def uwlist(input):
    result = input if isinstance(input, list) else [input]
    return UnwrapElement(result)

def objOrList(input):
    if isinstance(input, list) and len(input) == 1:
        return input[0]
    else:
        return input

def getBip(element, bip):
	# RVT < 2022
	if ver < 2022:
		return element.get_Parameter(bip)
	# RVT >= 2022
	else:
		id_forgeType = ParameterUtils.GetParameterTypeId(bip)
		return element.GetParameter(id_forgeType)

def getRoomName(room):
	try:
		bip = getBip(room, bip_roomName)
		return bip.AsString()
	except:
		return ""

# Preparing input from dynamo to revit
rooms = uwlist(IN[0])

numbers = [r.Number for r in rooms]
names   = [getRoomName(r) for r in rooms]

# Preparing output to Dynamo
OUT = objOrList(numbers), objOrList(names)
# ----------------------------------------
code_block = CodeBlock(X=python_script) { X[0]; X[1]; }
numbers = Output(code_block.out0)
names = Output(code_block.out1)
