# Dynamo custom node ScheduleAsText.dyf "© Schedules.DataAsText" (Dynamo 2.3.1.11775)
# category: Crumple.Revit.Actions
# Returns the data from a Revit schedule object as strings.

schedule = Input(schedule: Revit.Elements.Views.ScheduleView)
python_script = Python(IN[0]=schedule)
# ---------- python_script.python (38 lines) ----------
# Made by Gavin Crump
# Free for use
# BIM Guru, www.bimguru.com.au

# Boilerplate text
import clr

clr.AddReference("RevitServices")
import RevitServices
from RevitServices.Persistence import DocumentManager 

clr.AddReference("RevitAPI")
from Autodesk.Revit.DB import *

# Current doc/app/ui
doc = DocumentManager.Instance.CurrentDBDocument

# Preparing input from dynamo to revit
sched = UnwrapElement(IN[0])

# Retrieve data from the schedule
tableData = sched.GetTableData()
sectionData = tableData.GetSectionData(SectionType.Body)
numbRows = sectionData.NumberOfRows
numbCols = sectionData.NumberOfColumns

# Create list with schedule data with rows as second level lists
data = []

for i in range(numbRows):
    rows = []
    for j in range(numbCols):
        content = sched.GetCellText(SectionType.Body, i, j)
        rows.append(content)
    data.append(rows)

# Preparing output to Dynamo
OUT = data
# ----------------------------------------
scheduleText = Output(python_script)
