# Dynamo custom node ScheduleAsValues.dyf "© Schedules.DataAsValues" (Dynamo 2.3.1.11775)
# category: Crumple.Revit.Actions
# Returns the data in a schedule in the form of native values.

schedule = Input(schedule: Revit.Elements.Views.ScheduleView)
python_script = Python(IN[0]=schedule)
# ---------- python_script.python (74 lines) ----------
# Made by Gavin Crump
# Free for use
# BIM Guru, www.bimguru.com.au
# Found at https://forum.dynamobim.com/t/schedule-in-revit-to-dynamo-data-maintain-data-types/48558/2

# Boilerplate text
import clr
clr.AddReference('ProtoGeometry')
from Autodesk.DesignScript.Geometry import *

clr.AddReference('RevitAPI')
import Autodesk
from Autodesk.Revit.DB import *

clr.AddReference('RevitServices')
import RevitServices
from RevitServices.Persistence import DocumentManager

doc = DocumentManager.Instance.CurrentDBDocument

# Function for getting value of parameter
def convert_Value(paraL):
	if paraL.StorageType == StorageType.Double : 
		value = paraL.AsDouble()
		unitType = paraL.Definition.UnitType
		formatOption = doc.GetUnits().GetFormatOptions(unitType)
		displayUnit = formatOption.DisplayUnits
		convert =  UnitUtils.ConvertFromInternalUnits(value,displayUnit)
		return convert
	elif paraL.StorageType == StorageType.String : 	
		value = paraL.AsString()
		if value is None:
			value = paraL.AsValueString()
		return value
	elif paraL.StorageType == StorageType.Integer: 	
		value = paraL.AsInteger()
		return value	
	elif paraL.StorageType == StorageType.ElementId: 	
		valueId = paraL.AsElementId()
		return doc.GetElement(valueId)

# Get schedule view and read data
scheduleView = UnwrapElement(IN[0])

if scheduleView.ViewType == ViewType.Schedule:	
	collinview = FilteredElementCollector(doc, scheduleView.Id).OfClass(FamilyInstance).WhereElementIsNotElementType().ToElements()
	definition = scheduleView.Definition
	ids = definition.GetFieldOrder()
	paraSchNames = []
	out = []
	for id in ids:
		field = definition.GetField(id)
		if field.FieldType  == ScheduleFieldType.Instance or field.FieldType  == ScheduleFieldType.ElementType:
			paraSchNames.append(field.GetName())
	for elem in collinview:
		temp = []
		elemType = doc.GetElement(elem.GetTypeId())
		for paraSchName in paraSchNames:
			value = None
			paraelem = elem.LookupParameter(paraSchName)
			if paraelem is not None:	
				value = convert_Value(paraelem)
				temp.append(value)
			#if value is None check if it's a Parameter Type	
			if 	value is None:
				paraelemT = elemType.LookupParameter(paraSchName)
				if paraelemT is not None:	
					value = convert_Value(paraelemT)
					temp.append(value)				
		out.append(temp)

	OUT = out
else:
	OUT = "View is not a valid view type"
# ----------------------------------------
scheduleValues = Output(python_script)
