# Dynamo custom node ScheduleHeaders.dyf "© ScheduleHeaders" (Dynamo 2.3.0.5885)
# category: Crumple.Revit.Schedules
# Given a schedule or list of schedules, return their header fields and actual/formatted names.

schedules = Input(schedules: var[]..[])
python_script = Python(IN[0]=schedules)
# ---------- python_script.python (54 lines) ----------
# Made by Gavin Crump
# Free for use
# BIM Guru, www.bimguru.com.au

# Boilerplate text
import clr

clr.AddReference("RevitNodes")
import Revit
clr.ImportExtensions(Revit.Elements)

clr.AddReference("RevitServices")
import RevitServices
from RevitServices.Persistence import DocumentManager 
from RevitServices.Transactions import TransactionManager 

clr.AddReference("RevitAPI")
import Autodesk 
from Autodesk.Revit.DB import *

# Current doc/app/ui
doc = DocumentManager.Instance.CurrentDBDocument

# Define list/unwrap list functions
def uwlist(input):
    result = input if isinstance(input, list) else [input]
    return UnwrapElement(result)

# Preparing input from dynamo to revit
scheds = uwlist(IN[0])

# Get all fields and their column headings
fields_all, names_all, headings_all = [],[],[]

# Do some action in a Transaction
TransactionManager.Instance.EnsureInTransaction(doc)

for s in scheds:
	fields,names,headings = [],[],[]
	definition  = s.Definition
	count_field = definition.GetFieldCount()	
	for i in range(0, count_field, 1):
		field = definition.GetField(i)
		fields.append(field)
		headings.append(field.ColumnHeading)
		names.append(field.GetName())
	fields_all.append(fields)
	names_all.append(names)
	headings_all.append(headings)

TransactionManager.Instance.TransactionTaskDone()

# Preparing output to Dynamo
OUT = [fields_all, names_all, headings_all]
# ----------------------------------------
code_block = CodeBlock(out=python_script) { fields = out[0]; names  = out[1]; header = out[2]; }
fields = Output(code_block.fields)
nameActual = Output(code_block.names)
nameFormatted = Output(code_block.header)
