# Dynamo custom node ScheduleInstances.dyf "© ScheduleInstances" (Dynamo 2.3.1.11775)
# category: Crumple.Revit.Schedules
# Returns all schedule sheet instances as well as their types. Optional exclusions for each schedule type (schedule, key, revision).

includeStandard = Input(includeStandard: bool = true)
includeKey = Input(includeKey: bool = false)
includeRevision = Input(includeRevision: bool = false)
python_script = Python(IN[0]=includeStandard, IN[1]=includeKey, IN[2]=includeRevision)
# ---------- python_script.python (43 lines) ----------
# Made by Gavin Crump
# Free for use
# BIM Guru, www.bimguru.com.au

# Boilerplate text
import clr

clr.AddReference('RevitAPI')
from Autodesk.Revit.DB import *

clr.AddReference('RevitServices')
import RevitServices
from RevitServices.Persistence import DocumentManager

# Current doc/app/ui
doc = DocumentManager.Instance.CurrentDBDocument

# Preparing input from dynamo to revit
incstd, inckey, increv = IN[0],IN[1],IN[2]

schedules, revschedules, keyschedules = [],[],[]

coll = FilteredElementCollector(doc).OfClass(ScheduleSheetInstance).ToElements()

schedInsts, schedTypes, schedNames = [],[],[]

for s in coll:
	schedType = Document.GetElement(doc, s.ScheduleId)
	if schedType.Definition.IsKeySchedule and inckey:
		schedTypes.append(schedType)
		schedInsts.append(s)
		schedNames.append("Key Schedule")
	elif "<Revision Schedule>" in schedType.Name and increv:
		schedTypes.append(schedType)
		schedInsts.append(s)
		schedNames.append("Revision Schedule")
	elif incstd and not schedType.Definition.IsKeySchedule and not "<Revision Schedule>" in schedType.Name:
		schedTypes.append(schedType)
		schedInsts.append(s)
		schedNames.append("Schedule")

# Preparing output to Dynamo
OUT = [schedInsts, schedTypes, schedNames]
# ----------------------------------------
code_block = CodeBlock(x=python_script) { x[0]; x[1]; x[2]; }
schedInstances = Output(code_block.out0)
schedTypes = Output(code_block.out1)
schedTypeNames = Output(code_block.out2)
