# Dynamo custom node ScheduleKeys.dyf "© ScheduleKeys" (Dynamo 2.3.0.5885)
# category: Crumple.Revit.Schedules
# Given a list of schedules, will return the key values of each schedule as elements as well as their names if that schedule is a key schedule.

schedules = Input(schedules: var[]..[])
python_script = Python(IN[0]=schedules)
# ---------- python_script.python (46 lines) ----------
# Made by Gavin Crump
# Free for use
# BIM Guru, www.bimguru.com.au

# Boilerplate text
import clr

clr.AddReference("RevitServices")
import RevitServices
from RevitServices.Persistence import DocumentManager 

clr.AddReference("RevitAPI")
import Autodesk 
from Autodesk.Revit.DB import *

# Current doc/app/ui
doc = DocumentManager.Instance.CurrentDBDocument

# Define list/unwrap list functions
def uwlist(input):
    result = input if isinstance(input, list) else [input]
    return UnwrapElement(result)

# Preparing input from dynamo to revit
uw_list  = uwlist(IN[0])

keys, keynames = [], []

# Do some action in a Transaction
for s in uw_list:
	skeys,knames = [],[]
	try:
		bool = s.Definition.IsKeySchedule
	except:
		bool = False
	if bool:
		skeys = FilteredElementCollector(doc,s.Id).ToElements()
		knames = [s.Name for s in skeys]
		keys.append(skeys)
		keynames.append(knames)
	else:
		keys.append(skeys)
		keynames.append(knames)
		
# Preparing output to Dynamo
OUT = [keys, keynames]
# ----------------------------------------
code_block = CodeBlock(out=python_script) { keys = out[0]; nams = out[1]; }
keys = Output(code_block.keys)
keyNames = Output(code_block.nams)
