# Dynamo custom node ScheduleSheetInstanceScheduleType.dyf "© ScheduleSheetInstance.ScheduleType" (Dynamo 2.16.2.5624)
# category: Crumple.Revit.Query
# Given a schedule sheet instance, returns the corresponding schedule type.

scheduleInstance = Input(scheduleInstance: var[]..[])
python_script = Python(IN[0]=scheduleInstance)  # CPython3
# ---------- python_script.python (31 lines) ----------
# Made by Gavin Crump
# Free for use
# BIM Guru, www.bimguru.com.au

# Boilerplate text
import clr

# Define list/unwrap list functions
def uwlist(input):
    result = input if isinstance(input, list) else [input]
    return UnwrapElement(result)

def objOrList(input, initial = IN[0]):
	if isinstance(initial, list):
		return input
	else:
		return input[0]

# Preparing input from dynamo to revit
schedules, revschedules, keyschedules = [],[],[]

coll = uwlist(IN[0])

schedTypes = []

for s in coll:
	master = s.Document.GetElement(s.ScheduleId)
	schedTypes.append(master)

# Preparing output to Dynamo
OUT = objOrList(schedTypes)
# ----------------------------------------
scheduleType = Output(python_script)
