# Dynamo custom node ScheduleType.dyf "© ScheduleType" (Dynamo 2.3.1.11775)
# category: Crumple.Revit.Schedules
# Given a schedule sheet instance, returns the corresponding schedule type.

scheduleInstances = Input(scheduleInstances: var[]..[])
python_script = Python(IN[0]=scheduleInstances)
# ---------- python_script.python (35 lines) ----------
# Made by Gavin Crump
# Free for use
# BIM Guru, www.bimguru.com.au

# Boilerplate text
import clr

clr.AddReference('RevitAPI')
from Autodesk.Revit.DB import *

clr.AddReference('RevitServices')
import RevitServices
from RevitServices.Persistence import DocumentManager

# Define list/unwrap list functions
def uwlist(input):
    result = input if isinstance(input, list) else [input]
    return UnwrapElement(result)

# Current doc/app/ui
doc = DocumentManager.Instance.CurrentDBDocument

# Preparing input from dynamo to revit
schedules, revschedules, keyschedules = [],[],[]

coll = uwlist(IN[0])

sched = []

for s in coll:
	master = Document.GetElement(doc, s.ScheduleId)
	sched.append(master)

# Preparing output to Dynamo
OUT = sched
# ----------------------------------------
scheduleTypes = Output(python_script)
