# Dynamo custom node ScheduleTypeHeaders.dyf "© ScheduleType.Headers" (Dynamo 2.16.2.5624)
# category: Crumple.Revit.Query
# Given a schedule or list of schedules, return their header fields and actual/formatted names.

schedule = Input(schedule: var[]..[])
python_script = Python(IN[0]=schedule)  # CPython3
# ---------- python_script.python (46 lines) ----------
# Made by Gavin Crump
# Free for use
# BIM Guru, www.bimguru.com.au

# Boilerplate text
import clr

clr.AddReference("RevitServices")
import RevitServices
from RevitServices.Persistence import DocumentManager 

# Current doc/app/ui
doc = DocumentManager.Instance.CurrentDBDocument

# Define list/unwrap list functions
def uwlist(input):
    result = input if isinstance(input, list) else [input]
    return UnwrapElement(result)

def objOrList(input, initial = IN[0]):
	if isinstance(initial, list):
		return input
	else:
		return input[0]

# Preparing input from dynamo to revit
scheds = uwlist(IN[0])

# Get all fields and their column headings
fields_all, names_all, headings_all = [],[],[]

for s in scheds:
	fields,names,headings = [],[],[]
	definition  = s.Definition
	count_field = definition.GetFieldCount()	
	for i in range(0, count_field, 1):
		field = definition.GetField(i)
		fields.append(field)
		headings.append(field.ColumnHeading)
		names.append(field.GetName())
	fields_all.append(fields)
	names_all.append(names)
	headings_all.append(headings)

# Preparing output to Dynamo
OUT = objOrList(fields_all), objOrList(names_all), objOrList(headings_all)
# ----------------------------------------
code_block = CodeBlock(out=python_script) { fields = out[0]; names  = out[1]; header = out[2]; }
fields = Output(code_block.fields)
namesActual = Output(code_block.names)
namesFormatted = Output(code_block.header)
