# Dynamo custom node ScheduleTypeIsKeySchedule.dyf "© ScheduleType.IsKeySchedule" (Dynamo 2.16.2.5624)
# category: Crumple.Revit.Query
# Given an element or list of elements, will return whether that item is a Key schedule.

schedule = Input(schedule: var[]..[])
python_script = Python(IN[0]=schedule)  # CPython3
# ---------- python_script.python (32 lines) ----------
# Made by Gavin Crump
# Free for use
# BIM Guru, www.bimguru.com.au

# Boilerplate text
import clr

# Define list/unwrap list functions
def uwlist(input):
    result = input if isinstance(input, list) else [input]
    return UnwrapElement(result)

def objOrList(input, initial = IN[0]):
	if isinstance(initial, list):
		return input
	else:
		return input[0]

# Preparing input from dynamo to revit
uw_list  = uwlist(IN[0])
bools    = []

# Do some action in a Transaction
for s in uw_list:
	try:
		isKey = s.Definition.IsKeySchedule
		bools.append(isKey)
	except:
		bools.append(False)

# Preparing output to Dynamo
OUT = objOrList(bools)
# ----------------------------------------
isKeySchedule = Output(python_script)
