# Dynamo custom node ScheduleTypeIsRevisionSchedule.dyf "© ScheduleType.IsRevisionSchedule" (Dynamo 2.16.2.5624)
# category: Crumple.Revit.Query
# Gosh these things are annoying when we're isolating schedule types! This lets you detect if an element is a revision schedule on a sheet in the model.

schedule = Input(schedule: var[]..[])
python_script = Python(IN[0]=schedule)  # CPython3
# ---------- python_script.python (32 lines) ----------
# Made by Gavin Crump
# Free for use
# BIM Guru, www.bimguru.com.au

# Boilerplate text
import clr

# Define list/unwrap list functions
def uwlist(input):
    result = input if isinstance(input, list) else [input]
    return UnwrapElement(result)

def objOrList(input, initial = IN[0]):
	if isinstance(initial, list):
		return input
	else:
		return input[0]

# Preparing input from dynamo to revit
uw_list  = uwlist(IN[0])
bools = []

# Do some action in a Transaction
for s in uw_list:
	try:
		bool = "<Revision Schedule>" in s.Name
		bools.append(bool)
	except:
		bools.append(False)

# Preparing output to Dynamo
OUT = objOrList(bools)
# ----------------------------------------
isRevschedule = Output(python_script)
