# Dynamo custom node ScheduleTypeKeys.dyf "© ScheduleType.Keys" (Dynamo 2.16.2.5624)
# category: Crumple.Revit.Query
# Given a list of schedules, will return the key values of each schedule as elements as well as their names if that schedule is a key schedule.

schedule = Input(schedule: var[]..[])
python_script = Python(IN[0]=schedule)  # CPython3
# ---------- python_script.python (45 lines) ----------
# Made by Gavin Crump
# Free for use
# BIM Guru, www.bimguru.com.au

# Boilerplate text
import clr

clr.AddReference("RevitAPI")
import Autodesk 
from Autodesk.Revit.DB import FilteredElementCollector

# Define list/unwrap list functions
def uwlist(input):
    result = input if isinstance(input, list) else [input]
    return UnwrapElement(result)

def objOrList(input, initial = IN[0]):
	if isinstance(initial, list):
		return input
	else:
		return input[0]

# Preparing input from dynamo to revit
schedules = uwlist(IN[0])

keys, keynames = [], []

# Do some action in a Transaction
for s in schedules:
	skeys,knames = [],[]
	try:
		bool = s.Definition.IsKeySchedule
	except:
		bool = False
	if bool:
		skeys = FilteredElementCollector(s.Document, s.Id).ToElements()
		knames = [s.Name for s in skeys]
		keys.append(skeys)
		keynames.append(knames)
	else:
		keys.append(skeys)
		keynames.append(knames)
		
# Preparing output to Dynamo
OUT = objOrList(keys), objOrList(keynames)
# ----------------------------------------
code_block = CodeBlock(out=python_script) { keys = out[0]; nams = out[1]; }
scheduleKeys = Output(code_block.keys)
keyNames = Output(code_block.nams)
