# Dynamo custom node ScheduleTypeResetHeaders.dyf "© ScheduleType.ResetHeaders" (Dynamo 2.16.2.5624)
# category: Crumple.Revit.Create
# Given a schedule or list of schedules, reset the names of all of their headers.

schedule = Input(schedule: var[]..[])
python_script = Python(IN[0]=schedule)  # CPython3
# ---------- python_script.python (49 lines) ----------
# Made by Gavin Crump
# Free for use
# BIM Guru, www.bimguru.com.au

# Boilerplate text
import clr

clr.AddReference("RevitServices")
import RevitServices
from RevitServices.Persistence import DocumentManager
from RevitServices.Transactions import TransactionManager

# Current doc/app/ui
doc = DocumentManager.Instance.CurrentDBDocument

# Define list/unwrap list functions
def uwlist(input):
    result = input if isinstance(input, list) else [input]
    return UnwrapElement(result)

def objOrList(input, initial = IN[0]):
	if isinstance(initial, list):
		return input
	else:
		return input[0]

# Preparing input from dynamo to revit
scheds = uwlist(IN[0])

# Get all fields and their column headings
names_all = []

# Do some action in a Transaction
TransactionManager.Instance.EnsureInTransaction(doc)

for s in scheds:
	names = []
	definition  = s.Definition
	count_field = definition.GetFieldCount()	
	for i in range(0, count_field, 1):
		field = definition.GetField(i)
		field.ColumnHeading = field.GetName()
		names.append(field.GetName())
	names_all.append(names)

TransactionManager.Instance.TransactionTaskDone()

# Preparing output to Dynamo
OUT = objOrList(names_all)
# ----------------------------------------
headerNames = Output(python_script)
