# Dynamo custom node ScheduleTypes.dyf "© ScheduleTypes" (Dynamo 2.3.1.11775)
# category: Crumple.Revit.Schedules
# Returns all standard schedule types in the document, excluding key and revision schedules.

refresh = Input(refresh: bool = true)
python_script = Python(IN[0]=refresh)
# ---------- python_script.python (33 lines) ----------
# Made by Gavin Crump
# Free for use
# BIM Guru, www.bimguru.com.au

# Boilerplate text
import clr

clr.AddReference('RevitAPI')
from Autodesk.Revit.DB import *

clr.AddReference('RevitServices')
import RevitServices
from RevitServices.Persistence import DocumentManager

# Current doc/app/ui
doc = DocumentManager.Instance.CurrentDBDocument

# Preparing input from dynamo to revit
schedules = []

coll = FilteredElementCollector(doc).OfClass(ViewSchedule).ToElements()

# Filter the schedules
for s in coll:
	if s.Definition.IsKeySchedule:
		pass
	elif "<Revision Schedule>" in s.Name:
		pass
	else:
		schedules.append(s)

# Preparing output to Dynamo
OUT = [schedules]
# ----------------------------------------
scheduleTypes = Output(python_script)
