# Dynamo custom node SchedulesByType.dyf "© SchedulesByType" (Dynamo 2.3.0.5885)
# category: Crumple.Revit.Schedules
# Returns all schedules in the model, separated into key and non-key schedules.

refresh = Input(refresh: bool = true)
python_script = Python(IN[0]=refresh)
# ---------- python_script.python (33 lines) ----------
# Made by Gavin Crump
# Free for use
# BIM Guru, www.bimguru.com.au

# Boilerplate text
import clr

clr.AddReference('RevitAPI')
from Autodesk.Revit.DB import *

clr.AddReference('RevitServices')
import RevitServices
from RevitServices.Persistence import DocumentManager

# Current doc/app/ui
doc = DocumentManager.Instance.CurrentDBDocument

# Preparing input from dynamo to revit
schedules, revschedules, keyschedules = [],[],[]

coll = FilteredElementCollector(doc).OfClass(ViewSchedule).ToElements()

# Filter the schedules
for s in coll:
	if s.Definition.IsKeySchedule:
		keyschedules.append(s)
	elif "<Revision Schedule>" in s.Name:
		revschedules.append(s)
	else:
		schedules.append(s)

# Preparing output to Dynamo
OUT = [schedules, keyschedules, revschedules]
# ----------------------------------------
code_block = CodeBlock(out=python_script) { scheds = out[0]; keyscs = out[1]; revscs = out[2]; }
schedules = Output(code_block.scheds)
keySchedules = Output(code_block.keyscs)
revSchedules = Output(code_block.revscs)
