# Dynamo custom node SchedulesDataAsText.dyf "© Schedules.DataAsText" (Dynamo 2.12.1.8246)
# category: Crumple.Revit.Actions
# Returns the data from a Revit schedule object as strings.

schedules = Input(schedules: var[]..[])
python_script = Python(IN[0]=schedules)  # IronPython2
# ---------- python_script.python (55 lines) ----------
# Made by Gavin Crump
# Free for use
# BIM Guru, www.bimguru.com.au

# Boilerplate text
import clr

clr.AddReference("RevitServices")
import RevitServices
from RevitServices.Persistence import DocumentManager 

clr.AddReference("RevitAPI")
from Autodesk.Revit.DB import SectionType

# Define list/unwrap list functions
def uwlist(input):
    result = input if isinstance(input, list) else [input]
    return UnwrapElement(result)

def objOrList(input):
    if isinstance(input, list) and len(input) == 1:
        return input[0]
    else:
        return input

# Current doc/app/ui
doc = DocumentManager.Instance.CurrentDBDocument

ST_BODY = SectionType.Body

# Preparing input from dynamo to revit
schedules = uwlist(IN[0])

# Function to return schedule data
def sched_returnData(sched):
	# Retrieve data from the schedule
	tableData   = sched.GetTableData()
	sectionData = tableData.GetSectionData(ST_BODY)
	numbRows    = sectionData.NumberOfRows
	numbCols    = sectionData.NumberOfColumns
	# Create list with schedule data with rows as second level lists
	data = []
	# Iterate through rows
	for i in range(numbRows):
	    rows = []
	    for j in range(numbCols):
	        content = sched.GetCellText(ST_BODY, i, j)
	        rows.append(content)
	    data.append(rows)
	# Return data
	return data

# Preparing output to Dynamo
dataAll = [sched_returnData(s) for s in schedules]
OUT = objOrList(dataAll)
# ----------------------------------------
dataAsText = Output(python_script)
