# Dynamo custom node SchedulesDataAsValues.dyf "© Schedules.DataAsValues" (Dynamo 2.12.1.8246)
# category: Crumple.Revit.Actions
# Returns the data in a schedule in the form of native values.

schedules = Input(schedules: var[]..[])
python_script = Python(IN[0]=schedules)  # IronPython2
# ---------- python_script.python (114 lines) ----------
# Made by Gavin Crump
# Free for use
# BIM Guru, www.bimguru.com.au
# Found at https://forum.dynamobim.com/t/schedule-in-revit-to-dynamo-data-maintain-data-types/48558/2

# Boilerplate text
import clr

clr.AddReference('RevitAPI')
import Autodesk
from Autodesk.Revit.DB import *

clr.AddReference('RevitServices')
import RevitServices
from RevitServices.Persistence import DocumentManager

# Current doc/app/ui
doc = DocumentManager.Instance.CurrentDBDocument
# Get Revit build version
uiapp = DocumentManager.Instance.CurrentUIApplication
app = uiapp.Application
rvt_year = int(app.VersionNumber)

# Convert length to internal
def interalToProject_len(val, myDoc, ver = rvt_year):
	if rvt_year < 2022:
		intUnits = myDoc.GetUnits().GetFormatOptions(UnitType.UT_Length).DisplayUnits
		return UnitUtils.Convert(val,DisplayUnitType.DUT_DECIMAL_FEET,intUnits)
	else:
		intUnitsId = myDoc.GetUnits().GetFormatOptions(SpecTypeId.Length).GetUnitTypeId()
		return UnitUtils.ConvertFromInternalUnits(val, intUnitsId)

# Convert area to internal
def interalToProject_area(val, myDoc, ver = rvt_year):
	if rvt_year < 2022:
		intUnits = myDoc.GetUnits().GetFormatOptions(UnitType.UT_Area).DisplayUnits
		return UnitUtils.Convert(val,DisplayUnitType.DUT_SQUARE_FEET,intUnits)
	else:
		intUnitsId = myDoc.GetUnits().GetFormatOptions(SpecTypeId.Area).GetUnitTypeId()
		return UnitUtils.ConvertFromInternalUnits(val, intUnitsId)

# Define list/unwrap list functions
def uwlist(input):
    result = input if isinstance(input, list) else [input]
    return UnwrapElement(result)

def objOrList(input):
    if isinstance(input, list) and len(input) == 1:
        return input[0]
    else:
        return input

# Function for getting value of parameter
def convert_Value(paraL):
	if paraL.StorageType == StorageType.Double : 
		value = paraL.AsDouble()
		pt    = paraL.Definition.ParameterType
		if value == 0.00:
			return 0.00
		elif pt == ParameterType.Length:
			return interalToProject_len(value, doc)
		elif pt == ParameterType.Area:
			return interalToProject_area(value, doc)
		else:
			return value
	elif paraL.StorageType == StorageType.String : 
		value = paraL.AsString()
		if value is None:
			value = paraL.AsValueString()
		return value
	elif paraL.StorageType == StorageType.Integer: 	
		value = paraL.AsInteger()
		return value	
	elif paraL.StorageType == StorageType.ElementId: 	
		valueId = paraL.AsElementId()
		return doc.GetElement(valueId)

# Function to return schedule data
def sched_returnData(sched):
	data = []
	if sched.ViewType != ViewType.Schedule or sched.IsTemplate:
		return data
	collinview = FilteredElementCollector(doc, sched.Id).OfClass(FamilyInstance).WhereElementIsNotElementType().ToElements()
	definition = sched.Definition
	ids = definition.GetFieldOrder()
	paraSchNames = []
	for id in ids:
		field = definition.GetField(id)
		if field.FieldType  == ScheduleFieldType.Instance or field.FieldType  == ScheduleFieldType.ElementType:
			paraSchNames.append(field.GetName())
	for elem in collinview:
		temp = []
		elemType = doc.GetElement(elem.GetTypeId())
		for paraSchName in paraSchNames:
			value = None
			paraelem = elem.LookupParameter(paraSchName)
			if paraelem is not None:	
				value = convert_Value(paraelem)
				temp.append(value)
			#if value is None check if it's a Parameter Type	
			if 	value is None:
				paraelemT = elemType.LookupParameter(paraSchName)
				if paraelemT is not None:	
					value = convert_Value(paraelemT)
					temp.append(value)				
		data.append(temp)
	return data

# Get schedule view and read data
schedules = uwlist(IN[0])

# Preparing output to Dynamo
dataAll = [sched_returnData(s) for s in schedules]
OUT     = objOrList(dataAll)
# ----------------------------------------
scheduleValues = Output(python_script)
