# Dynamo custom node SchedulesIsRevisionSchedule.dyf "© Schedules.IsRevisionSchedule" (Dynamo 2.12.1.8246)
# category: Crumple.Revit.Query
# Gosh these things are annoying when we're isolating schedule types! This lets you detect if an element is a revision schedule on a sheet in the model.

schedules = Input(schedules: var[]..[])
python_script = Python(IN[0]=schedules)  # IronPython2
# ---------- python_script.python (32 lines) ----------
# Made by Gavin Crump
# Free for use
# BIM Guru, www.bimguru.com.au

# Boilerplate text
import clr

# Define list/unwrap list functions
def uwlist(input):
    result = input if isinstance(input, list) else [input]
    return UnwrapElement(result)

def objOrList(input):
    if isinstance(input, list) and len(input) == 1:
        return input[0]
    else:
        return input

# Preparing input from dynamo to revit
uw_list  = uwlist(IN[0])
bools = []

# Do some action in a Transaction
for s in uw_list:
	try:
		bool = "<Revision Schedule>" in s.Name
		bools.append(bool)
	except:
		bools.append(False)

# Preparing output to Dynamo
OUT = objOrList(bools)
# ----------------------------------------
isRevschedule = Output(python_script)
