# Dynamo custom node SchedulesKeys.dyf "© Schedules.Keys" (Dynamo 2.12.1.8246)
# category: Crumple.Revit.Query
# Given a list of schedules, will return the key values of each schedule as elements as well as their names if that schedule is a key schedule.

schedules = Input(schedules: var[]..[])
python_script = Python(IN[0]=schedules)  # IronPython2
# ---------- python_script.python (45 lines) ----------
# Made by Gavin Crump
# Free for use
# BIM Guru, www.bimguru.com.au

# Boilerplate text
import clr

clr.AddReference("RevitAPI")
import Autodesk 
from Autodesk.Revit.DB import FilteredElementCollector

# Define list/unwrap list functions
def uwlist(input):
    result = input if isinstance(input, list) else [input]
    return UnwrapElement(result)

def objOrList(input):
    if isinstance(input, list) and len(input) == 1:
        return input[0]
    else:
        return input

# Preparing input from dynamo to revit
schedules = uwlist(IN[0])

keys, keynames = [], []

# Do some action in a Transaction
for s in schedules:
	skeys,knames = [],[]
	try:
		bool = s.Definition.IsKeySchedule
	except:
		bool = False
	if bool:
		skeys = FilteredElementCollector(s.Document, s.Id).ToElements()
		knames = [s.Name for s in skeys]
		keys.append(skeys)
		keynames.append(knames)
	else:
		keys.append(skeys)
		keynames.append(knames)
		
# Preparing output to Dynamo
OUT = objOrList(keys), objOrList(keynames)
# ----------------------------------------
code_block = CodeBlock(out=python_script) { keys = out[0]; nams = out[1]; }
scheduleKeys = Output(code_block.keys)
keyNames = Output(code_block.nams)
