# Dynamo custom node SchedulesRenameHeaders.dyf "© Schedules.RenameHeaders" (Dynamo 2.3.0.5885)
# category: Crumple.Revit.Create
# Given a schedule as well as lists of existing/new naming targets, the node will attempt to find a header with that matching name and update its name to the new one.

schedule = Input(schedule: var[]..[])
names_current = Input(names_current: var[]..[])
names_new = Input(names_new: var[]..[])
python_script = Python(IN[0]=schedule, IN[1]=names_current, IN[2]=names_new)
# ---------- python_script.python (68 lines) ----------
# Made by Gavin Crump
# Free for use
# BIM Guru, www.bimguru.com.au

# Boilerplate text
import clr

clr.AddReference("RevitNodes")
import Revit
clr.ImportExtensions(Revit.Elements)

clr.AddReference("RevitServices")
import RevitServices
from RevitServices.Persistence import DocumentManager 
from RevitServices.Transactions import TransactionManager 

clr.AddReference("RevitAPI")
import Autodesk 
from Autodesk.Revit.DB import *

# Current doc/app/ui
doc = DocumentManager.Instance.CurrentDBDocument

# Define list/unwrap list functions
def tolist(input):
    result = input if isinstance(input, list) else [input]
    return result

# Preparing input from dynamo to revit
sched       = UnwrapElement(IN[0])
definition  = sched.Definition
count_field = definition.GetFieldCount()

names_old = tolist(IN[1])
names_new = tolist(IN[2])

fields,fieldnames,hasfield,fieldmatch,results = [],[],[],[],[]

# Get all fields and their column headings
for i in range(0, count_field, 1):
	field = definition.GetField(i)
	name  = field.ColumnHeading
	fields.append(field)
	fieldnames.append(name)
	
# Find the matching fields for the existing names
for n in names_old:
	if n in fieldnames:
		ind = fieldnames.index(n)
		fieldmatch.append(fields[ind])
		hasfield.append(True)
	else:
		fieldmatch.append(None)
		hasfield.append(False)

# Do some action in a Transaction
TransactionManager.Instance.EnsureInTransaction(doc)

for field, nm_n, bool in zip(fieldmatch,names_new,hasfield):
	if bool:
		field.ColumnHeading = nm_n
	else:
		pass

TransactionManager.Instance.TransactionTaskDone()

# Preparing output to Dynamo
OUT = hasfield
# ----------------------------------------
success = Output(python_script)
