# Dynamo custom node SchedulesResetHeaders.dyf "© Schedules.ResetHeaders" (Dynamo 2.12.1.8246)
# category: Crumple.Revit.Create
# Given a schedule or list of schedules, reset the names of all of their headers.

schedules = Input(schedules: var[]..[])
python_script = Python(IN[0]=schedules)  # IronPython2
# ---------- python_script.python (49 lines) ----------
# Made by Gavin Crump
# Free for use
# BIM Guru, www.bimguru.com.au

# Boilerplate text
import clr

clr.AddReference("RevitServices")
import RevitServices
from RevitServices.Persistence import DocumentManager
from RevitServices.Transactions import TransactionManager

# Current doc/app/ui
doc = DocumentManager.Instance.CurrentDBDocument

# Define list/unwrap list functions
def uwlist(input):
    result = input if isinstance(input, list) else [input]
    return UnwrapElement(result)

def objOrList(input):
    if isinstance(input, list) and len(input) == 1:
        return input[0]
    else:
        return input

# Preparing input from dynamo to revit
scheds = uwlist(IN[0])

# Get all fields and their column headings
names_all = []

# Do some action in a Transaction
TransactionManager.Instance.EnsureInTransaction(doc)

for s in scheds:
	names = []
	definition  = s.Definition
	count_field = definition.GetFieldCount()	
	for i in range(0, count_field, 1):
		field = definition.GetField(i)
		field.ColumnHeading = field.GetName()
		names.append(field.GetName())
	names_all.append(names)

TransactionManager.Instance.TransactionTaskDone()

# Preparing output to Dynamo
OUT = objOrList(names_all)
# ----------------------------------------
headerNames = Output(python_script)
