# Dynamo custom node SchedulesType.dyf "© Schedules.Type" (Dynamo 2.12.1.8246)
# category: Crumple.Revit.Query
# Given a schedule sheet instance, returns the corresponding schedule type.

scheduleInstances = Input(scheduleInstances: var[]..[])
python_script = Python(IN[0]=scheduleInstances)  # IronPython2
# ---------- python_script.python (31 lines) ----------
# Made by Gavin Crump
# Free for use
# BIM Guru, www.bimguru.com.au

# Boilerplate text
import clr

# Define list/unwrap list functions
def uwlist(input):
    result = input if isinstance(input, list) else [input]
    return UnwrapElement(result)

def objOrList(input):
    if isinstance(input, list) and len(input) == 1:
        return input[0]
    else:
        return input

# Preparing input from dynamo to revit
schedules, revschedules, keyschedules = [],[],[]

coll = uwlist(IN[0])

schedTypes = []

for s in coll:
	master = s.Document.GetElement(s.ScheduleId)
	schedTypes.append(master)

# Preparing output to Dynamo
OUT = objOrList(schedTypes)
# ----------------------------------------
scheduleTypes = Output(python_script)
