# Dynamo custom node ScopeBoxAssigned.dyf "© ScopeBoxAssigned" (Dynamo 2.3.1.11775)
# category: Crumple.Revit.ScopeBoxes
# Given an element, will check if a scope box is assigned to it and return it if so.

elements = Input(elements: var[]..[])
python_script = Python(IN[0]=elements)
# ---------- python_script.python (48 lines) ----------
# Made by Gavin Crump
# Free for use
# BIM Guru, www.bimguru.com.au

# Boilerplate text
import clr

clr.AddReference("RevitServices")
import RevitServices
from RevitServices.Persistence import DocumentManager 

clr.AddReference("RevitAPI")
import Autodesk 
from Autodesk.Revit.DB import *

# Current doc/app/ui
doc = DocumentManager.Instance.CurrentDBDocument

# Define list/unwrap list functions
def uwlist(input):
    result = input if isinstance(input, list) else [input]
    return UnwrapElement(result)

# Preparing input from dynamo to revit
elements = uwlist(IN[0])
allBoxNames, usedBoxes, indBoxes, hasBox = [],[],[],[]

# Get all scope boxes, make them a list and get their names
allBoxes = FilteredElementCollector(doc).OfCategory(BuiltInCategory.OST_VolumeOfInterest)

for s in allBoxes:
	n = s.Name
	allBoxNames.append(n)
	indBoxes.append(s)

# Check if the element has a scope box and return it if so
for e in elements:
	try:
		sn = e.GetParameters("Scope Box")[0].AsValueString()
		si = allBoxNames.index(sn)
		usedBoxes.append(indBoxes[si])
		hasBox.append(True)
	except:
		usedBoxes.append(None)
		hasBox.append(False)

# Preparing output to Dynamo
OUT = [usedBoxes, hasBox]
# ----------------------------------------
code_block = CodeBlock(x=python_script) { x[0]; x[1]; }
scopeBox = Output(code_block.out0)
hasScopeBox = Output(code_block.out1)
