# Dynamo custom node ScopeBoxUsed.dyf "© ScopeBox.Used" (Dynamo 2.3.1.11775)
# category: Crumple.Revit.Other.Query
# Checks if a scope box is applied to any views, levels or grids in a document.
# packages: Crumple 2022.2.13

scopeBoxes = Input(scopeBoxes: var[]..[])
docOrLink = Input(docOrLink: var[]..[] = null)  # Uses current if none provided. Accepts document or link instance.
revit_getdocument = Custom[© Revit.GetDocument](docOrLink=docOrLink)  # package Crumple; If no input is specified or an invalid one is, returns current document. If a link instance is provided, it returns the linked document. If a document is provided it will pass it through.
python_script = Python(IN[0]=scopeBoxes, IN[1]=revit_getdocument.document)
# ---------- python_script.python (40 lines) ----------
# Made by Gavin Crump
# Free for use
# BIM Guru, www.bimguru.com.au

# Boilerplate text
import clr

clr.AddReference("RevitAPI")
import Autodesk
from Autodesk.Revit.DB import *

# Current doc/app/ui
doc = IN[1]

# Get scope boxes
usedScopeBoxes, inUse = [],[]
    
# Check scopebox of elements
def checkSB(elements):
	for e in elements:
		try:
			if e.GetParameters("Scope Box")[0].AsValueString() != "None":
				usedScopeBoxes.append(e.GetParameters("Scope Box")[0].AsValueString())
		except:
			pass

# Get all used scopebox names
grids = FilteredElementCollector(doc).OfCategory(BuiltInCategory.OST_Grids).OfClass(Grid)
levels = FilteredElementCollector(doc).OfCategory(BuiltInCategory.OST_Levels).OfClass(Level)
views = FilteredElementCollector(doc).OfCategory(BuiltInCategory.OST_Views)

checkSB(grids)
checkSB(levels)
checkSB(views)

# Get all scope boxes in model
allScopeBoxes = IN[0]

# Preparing output to Dynamo
OUT = [s.Name in usedScopeBoxes for s in allScopeBoxes]
# ----------------------------------------
inUse = Output(python_script)
