# Dynamo custom node ScopeBoxesViews.dyf "© ScopeBoxes.Views" (Dynamo 2.12.1.8246)
# category: Crumple.Revit.Query
# For a scope box or list of them, returns all views that are using that scope box.
# packages: Crumple 2022.2.13

scopeBoxes = Input(scopeBoxes: var[]..[])
docOrLink = Input(docOrLink: var[]..[] = null)  # Uses current if none provided. Accepts document or link instance.
revit_getdocument = Custom[© Revit.GetDocument](docOrLink=docOrLink)  # package Crumple; If no input is specified or an invalid one is, returns current document. If a link instance is provided, it returns the linked document. If a document is provided it will pass it through.
python_script = Python(IN[0]=scopeBoxes, IN[1]=revit_getdocument.document)  # IronPython2
# ---------- python_script.python (52 lines) ----------
# Made by Gavin Crump
# Free for use
# BIM Guru, www.bimguru.com.au

# Boilerplate text
import clr

clr.AddReference("RevitAPI")
import Autodesk
from Autodesk.Revit.DB import FilteredElementCollector, BuiltInCategory

# Current doc/app/ui
doc = IN[1]

# Define list/unwrap list functions
def uwlist(input):
    result = input if isinstance(input, list) else [input]
    return UnwrapElement(result)

def objOrList(input):
    if isinstance(input, list) and len(input) == 1:
        return input[0]
    else:
        return input

# Get scope boxes
sbs = uwlist(IN[0])
viewboxes,withboxes,finallist = [],[],[]

# Check all scope boxes of views
views = FilteredElementCollector(doc).OfCategory(BuiltInCategory.OST_Views).ToElements()

for v in views:
	try:
		sbname = v.GetParameters("Scope Box")[0].AsValueString()
		if sbname != "None":
			viewboxes.append(sbname)
			withboxes.append(v)
	except:
		pass

# Check which views use each scope box
for s in sbs:
	viewset = []
	sbname2 = s.Name
	for v,w in zip(viewboxes,withboxes):
		if sbname2 == v:
			viewset.append(w)
	finallist.append(viewset)

# Preparing output to Dynamo
OUT = objOrList(finallist)
# ----------------------------------------
views = Output(python_script)
