# Dynamo custom node SessionData.dyf (Dynamo 2.3.0.5885)
# category: Crumple.Application
# This node returns values about the current session, useful for tracking scripts! Username, Revit file name/path and Dynamo script name (for 2.X versions) are returned.

Refresh = Input(Refresh: bool = true)
python_script = Python(IN[0]=Refresh)
# ---------- python_script.python (49 lines) ----------
# Made by Gavin Crump
# Free for use
# BIM Guru, www.bimguru.com.au

#Reference for script name: https://github.com/Amoursol/dynamoPython/blob/master/dynamoAPI/dynamoAPICurrentGraphName.py
#Thanks to John Pierson for sharing the code for Dynamo file data

#Add CLR and Dynamo services for its API
import clr
clr.AddReference('DynamoRevitDS')
import Dynamo
from System import Environment

#Add document manager from Revit services
clr.AddReference('RevitServices')
import RevitServices
from RevitServices.Persistence import DocumentManager

# access to the current Dynamo instance and workspace
DynamoCurrent = Dynamo.Applications.DynamoRevit()
ActiveScript  = DynamoCurrent.RevitDynamoModel.CurrentWorkspace
DynamoVersion = DynamoCurrent.RevitDynamoModel.Version

# ensure version 2.X, get name
if DynamoVersion.StartsWith("2."):
	ScriptName = ActiveScript.Name + ".dyn"
else:
	ScriptName = "Version not supported"

# get system user name
UserName = Environment.UserName

# get active document name and path
doc = DocumentManager.Instance.CurrentDBDocument
DocPath = doc.PathName
# note the use of escape characters (\\)
DocName = (DocPath.split('\\')[-1]).split('.')[0]

# catch unsaved
data  = [UserName, DocName, DocPath, ScriptName]
final = []
for i in data:
	if i == "":
		final.append("Unsaved document")
	else:
		final.append(i)

# define output
OUT = final
# ----------------------------------------
code_block = CodeBlock(list=python_script) { user = list[0]; file = list[1]; path = list[2]; name = list[3]; }
UserName = Output(code_block.user)
RevitName = Output(code_block.file)
RevitPath = Output(code_block.path)
ScriptName = Output(code_block.name)
