# Dynamo custom node SharedParameterDefinitions.dyf "© SharedParameterDefinitions" (Dynamo 2.3.0.5885)
# category: Crumple.Revit.Parameters
# Returns the currently available shared parameters, their groups and the external definitions for both.

Refresh = Input(Refresh: bool = true)  # Toggle to refresh
python_script = Python(IN[0]=Refresh)
# ---------- python_script.python (58 lines) ----------
# Made by Gavin Crump
# Free for use
# BIM Guru, www.bimguru.com.au

# Boilerplate text
import clr

import sys
sys.path.append('C:\Program Files (x86)\IronPython 2.7\Lib')

import System
from System import Array
from System.Collections.Generic import *

clr.AddReference('ProtoGeometry')
from Autodesk.DesignScript.Geometry import *

clr.AddReference("RevitNodes")
import Revit
clr.ImportExtensions(Revit.Elements)
clr.ImportExtensions(Revit.GeometryConversion)

clr.AddReference("RevitServices")
import RevitServices
from RevitServices.Persistence import DocumentManager 
from RevitServices.Transactions import TransactionManager 

clr.AddReference("RevitAPI")
clr.AddReference("RevitAPIUI")

import Autodesk 
from Autodesk.Revit.DB import *
from Autodesk.Revit.UI import *

# Current doc/app/ui
doc = DocumentManager.Instance.CurrentDBDocument
uiapp = DocumentManager.Instance.CurrentUIApplication 
app = uiapp.Application 

gitem, itemg, itemd, items = [],[],[],[]

file = app.OpenSharedParameterFile()

group = file.Groups

for g in group:
	gitem.append(g.Name)
	itemg.append(g)
for ig in itemg:
	itemd.append(ig.Definitions)
for i in itemd:
	item = []
	for j in i:
		item.append(j.Name)
	items.append(item)

# Preparing output to Dynamo
OUT = [gitem,itemg,items,itemd]
# ----------------------------------------
code_block = CodeBlock(out=python_script) { par_g = out[0]; def_g = out[1]; par_p = out[2]; def_p = out[3]; }
groupNames = Output(code_block.par_g)  # The names of the parameter groups
groupDefs = Output(code_block.def_g)  # The group definitions
paramNames = Output(code_block.par_p)  # The names of the parameters
paramDefs = Output(code_block.def_p)  # The parameter definitions
