# Dynamo custom node SharedParametersCreate.dyf "© SharedParameters.Create" (Dynamo 2.16.2.5624)
# category: Crumple.Revit.Create
# Attempts to create new shared parameters in the active shared parameters file using CreationOptions and a group name.

creationOptions = Input(creationOptions: var[]..[])
groupNames = Input(groupNames: string[]..[])
python_script = Python(IN[0]=creationOptions, IN[1]=groupNames)  # CPython3
# ---------- python_script.python (67 lines) ----------
# Made by Gavin Crump
# Free for use
# BIM Guru, www.bimguru.com.au

# Boilerplate text
import clr

clr.AddReference("RevitServices")
import RevitServices
from RevitServices.Persistence import DocumentManager 

# Current doc/app/ui
doc = DocumentManager.Instance.CurrentDBDocument
uiapp = DocumentManager.Instance.CurrentUIApplication 
app = uiapp.Application 

# Define list/unwrap list functions
def tolist(input):
    result = input if isinstance(input, list) else [input]
    return result

def objOrList(input):
    if isinstance(input, list) and len(input) == 1:
        return input[0]
    else:
        return input

# Preparing input from dynamo to revit
optionsList = tolist(IN[0])
groupNames = tolist(IN[1])

# Get the shared parameters file
spFile = app.OpenSharedParameterFile()

# Get existing group names
spGroups = spFile.Groups
spGroupNames = [g.Name for g in spGroups]

# Add any missing groups
for n in groupNames:
    if n not in spGroupNames:
        spGroups.Create(n)
        spGroupNames.append(n)

# Recollect groups and group names
spGroups = [g for g in spFile.Groups]
spGroupNames = [g.Name for g in spGroups]

# Create the parameters
success = []

for options, groupName in zip(optionsList, groupNames):
    # Get the group by name
    spGroup = spGroups[spGroupNames.index(groupName)]
    
    # Get the definitions in that group
    spGroupDefs = spGroup.Definitions
    
    # Try to add the parameter to the file
    try:
        spGroupDefs.Create(options)
        success.append(True)
    except:
        success.append(False)

# Preparing output to Dynamo
OUT = objOrList(success)
# ----------------------------------------
success = Output(python_script)
