# Dynamo custom node SharedParametersCreationOptions.dyf "© SharedParameters.CreationOptions" (Dynamo 2.16.2.5624)
# category: Crumple.Revit.Create
# Establishes creation options for a new shared parameter.

parameterName = Input(parameterName: string[]..[])
specTypeId = Input(specTypeId: var[]..[])
tooltip = Input(tooltip: string[]..[] = List.Empty)
guid = Input(guid: var[]..[] = List.Empty)
hideWhenNoValue = Input(hideWhenNoValue: bool[]..[] = List.Empty)
userModifiable = Input(userModifiable: bool[]..[] = List.Empty)
visible = Input(visible: bool[]..[] = List.Empty)
python_script = Python(IN[0]=parameterName, IN[1]=specTypeId, IN[2]=tooltip, IN[3]=guid, IN[4]=hideWhenNoValue, IN[5]=userModifiable, IN[6]=visible)  # CPython3
# ---------- python_script.python (74 lines) ----------
# Made by Gavin Crump
# Free for use
# BIM Guru, www.bimguru.com.au

# Boilerplate text
import clr

clr.AddReference("RevitServices")
import RevitServices
from RevitServices.Persistence import DocumentManager

clr.AddReference("RevitAPI")
import Autodesk 
from Autodesk.Revit.DB import *

# Define list/unwrap list functions
def tolist(input):
    result = input if isinstance(input, list) else [input]
    return result

def objOrList(input):
    if isinstance(input, list) and len(input) == 1:
        return input[0]
    else:
        return input

# Preparing input from dynamo to revit
names = tolist(IN[0])
ftids = tolist(IN[1])
toolTips = tolist(IN[2])
guids = tolist(IN[3])
hideWhenNoValue = tolist(IN[4])
userModifiable = tolist(IN[5])
visible = tolist(IN[6])

optionsOut = []

for i in range(0, len(names), 1):
    
    try:
        options = ExternalDefinitionCreationOptions(names[i], ftids[i])
    except:
        optionsOut.append(None)
        continue
    
    try:
        options.Description = toolTips[i]
    except:
        pass
    
    try:
        options.GUID = guids[i]
    except:
        pass
    
    try:
        options.HideWhenNoValue = hideWhenNoValue[i]
    except:
        options.HideWhenNoValue = False
    
    try:
        options.UserModifiable = userModifiable[i]
    except:
        options.UserModifiable = True
    
    try:
        options.Visible = visible[i]
    except:
        options.Visible = True
    
    optionsOut.append(options)

# Preparing output to Dynamo
OUT = objOrList(optionsOut)
# ----------------------------------------
creationOptions = Output(python_script)
