# Dynamo custom node SharedParametersFlat.dyf "© SharedParametersFlat" (Dynamo 2.3.1.11775)
# category: Crumple.Revit.Parameters
# Returns all shared parameters as definition and name, as well as their corresponding group and name.

Refresh = Input(Refresh: bool = true)  # Toggle to refresh
python_script = Python(IN[0]=Refresh)
# ---------- python_script.python (35 lines) ----------
# Made by Gavin Crump
# Free for use
# BIM Guru, www.bimguru.com.au

# Boilerplate text
import clr

clr.AddReference("RevitServices")
import RevitServices
from RevitServices.Persistence import DocumentManager

clr.AddReference("RevitAPI")
import Autodesk 
from Autodesk.Revit.DB import *

# Current doc/app/ui
doc = DocumentManager.Instance.CurrentDBDocument
uiapp = DocumentManager.Instance.CurrentUIApplication 
app = uiapp.Application 

defObjs, defNames, grpObjs, grpNames = [],[],[],[]

file = app.OpenSharedParameterFile()

groups = file.Groups

for group in groups:
	for d in group.Definitions:
		defObjs.append(d)
		defNames.append(d.Name)
		grpObjs.append(group)
		grpNames.append(group.Name)

# Preparing output to Dynamo
OUT = [defObjs, defNames, grpObjs, grpNames]
# ----------------------------------------
code_block = CodeBlock(out=python_script) { out[0]; out[1]; out[2]; out[3]; }
paramDefs = Output(code_block.out0)  # The parameter definitions
paramNames = Output(code_block.out1)  # The names of the parameters
groupDefs = Output(code_block.out2)  # The group definitions
groupNames = Output(code_block.out3)  # The names of the parameter groups
