# Dynamo custom node SharedParametersGrouped.dyf "© SharedParameters.Grouped" (Dynamo 2.12.1.8246)
# category: Crumple.Revit.Query
# Returns the currently available shared parameters, their groups and the external definitions for both.

refresh = Input(refresh: bool = true)  # Toggle to refresh
python_script = Python(IN[0]=refresh)  # IronPython2
# ---------- python_script.python (34 lines) ----------
# Made by Gavin Crump
# Free for use
# BIM Guru, www.bimguru.com.au

# Boilerplate text
import clr

clr.AddReference("RevitServices")
import RevitServices
from RevitServices.Persistence import DocumentManager

# Current doc/app/ui
uiapp = DocumentManager.Instance.CurrentUIApplication 
app = uiapp.Application 

gitem, itemg, itemd, items = [],[],[],[]

file = app.OpenSharedParameterFile()

group = file.Groups

for g in group:
	gitem.append(g.Name)
	itemg.append(g)
for ig in itemg:
	itemd.append(ig.Definitions)
for i in itemd:
	item = []
	for j in i:
		item.append(j.Name)
	items.append(item)

# Preparing output to Dynamo
OUT = gitem,itemg,items,itemd
# ----------------------------------------
code_block = CodeBlock(out=python_script) { par_g = out[0]; def_g = out[1]; par_p = out[2]; def_p = out[3]; }
groupNames = Output(code_block.par_g)  # The names of the parameter groups
groupDefs = Output(code_block.def_g)  # The group definitions
paramNames = Output(code_block.par_p)  # The names of the parameters
paramDefs = Output(code_block.def_p)  # The parameter definitions
