# Dynamo custom node SharedParametersPath.dyf "© SharedParametersPath" (Dynamo 2.3.0.5885)
# category: Crumple.Application.Revit
# Returns the path to the currently active shared parameters file.

Refresh = Input(Refresh: bool = true)  # Toggle to refresh
python_script = Python(IN[0]=Refresh)
# ---------- python_script.python (20 lines) ----------
# Made by Gavin Crump
# Free for use
# BIM Guru, www.bimguru.com.au

# Boilerplate text
import clr

clr.AddReference("RevitServices")
import RevitServices
from RevitServices.Persistence import DocumentManager 

clr.AddReference("RevitAPIUI")
from Autodesk.Revit.UI import *

# Current doc/app/ui
uiapp = DocumentManager.Instance.CurrentUIApplication 
app = uiapp.Application 

# Preparing output to Dynamo
OUT = app.SharedParametersFilename
# ----------------------------------------
filepath = Output(python_script)  # The path to the SP file.
