# Dynamo custom node SharedParametersRepath.dyf "© SharedParameters.Repath" (Dynamo 2.12.1.8246)
# category: Crumple.Revit.Actions
# Given a filepath, will attempt to change the path that the Revit session is drawing its shared parameter file from.

filePath = Input(filePath: var[]..[])
python_script = Python(IN[0]=filePath)  # IronPython2
# ---------- python_script.python (28 lines) ----------
# Made by Gavin Crump
# Free for use
# BIM Guru, www.bimguru.com.au

# Boilerplate text
import clr

clr.AddReference("RevitServices")
import RevitServices
from RevitServices.Persistence import DocumentManager 

# Current doc/app/ui
uiapp = DocumentManager.Instance.CurrentUIApplication 
app = uiapp.Application 

# Preparing input from dynamo to revit
new = IN[0]

#Do some action in a Transaction
existing = uiapp.Application.SharedParametersFilename

try:
	uiapp.Application.SharedParametersFilename = new
except:
	new = existing

# Preparing output to Dynamo
OUT = existing, new
# ----------------------------------------
code_block = CodeBlock(out=python_script) { out[0]; out[1]; }
before = Output(code_block.out0)
after = Output(code_block.out1)
