# Dynamo custom node SheetAddRevisions.dyf "© Sheets.RevisionsAdd" (Dynamo 2.3.0.5885)
# category: Crumple.Revit.Create
# Given a list of sheets, attempt to add the given revisions to each of those sheets.

sheets = Input(sheets: var[]..[])
revisions = Input(revisions: var[]..[])
runMe = Input(runMe: bool = false)
python_script = Python(IN[0]=sheets, IN[1]=revisions, IN[2]=runMe)
# ---------- python_script.python (52 lines) ----------
# Made by Gavin Crump
# Free for use
# BIM Guru, www.bimguru.com.au

# Boilerplate text
import clr

clr.AddReference("RevitServices")
import RevitServices
from RevitServices.Persistence import DocumentManager 
from RevitServices.Transactions import TransactionManager 

clr.AddReference("RevitAPI")
import Autodesk 
from Autodesk.Revit.DB import *

# Current doc/app/ui
doc = DocumentManager.Instance.CurrentDBDocument

# Define list/unwrap list functions
def uwlist(input):
    result = input if isinstance(input, list) else [input]
    return UnwrapElement(result)

# Preparing input from dynamo to revit
sheets     = uwlist(IN[0])
revisions  = uwlist(IN[1])
runMe      = IN[2]

# Do some action in a Transaction
if runMe:
	for s in sheets:
		
		# Get revisions currently on sheets
		sheetRevs = s.GetAdditionalRevisionIds()
		
		# Check if new revisions are on sheet, if not add them
		for r in revisions:
			if r.Id not in sheetRevs:
				sheetRevs.Add(r.Id)
			else:
				continue
	
		# Add the revisions to the sheets
		TransactionManager.Instance.EnsureInTransaction(doc)
		s.SetAdditionalRevisionIds(sheetRevs)
		TransactionManager.Instance.TransactionTaskDone()
		
	OUT = sheets
	
else:
	OUT = "Set runMe to true!"
# ----------------------------------------
sheets_2 = Output(python_script)  # "sheets"
