# Dynamo custom node SheetByNumber.dyf "© SheetByNumber" (Dynamo 2.3.0.5885)
# category: Crumple.Revit.Sheets
# Given a sheet number, return the matching sheet. If no match is found, a message is returned. The node also returns a matches list and a list of indices for non-matches.

numbers = Input(numbers: var[]..[])  # Sheet numbers as strings.
python_script = Python(IN[0]=numbers)
# ---------- python_script.python (47 lines) ----------
# Made by Gavin Crump
# Free for use
# BIM Guru, www.bimguru.com.au

# Boilerplate text
import clr

# Document Manager
clr.AddReference("RevitServices")
import RevitServices
from RevitServices.Persistence import DocumentManager  

# Revit API
clr.AddReference("RevitAPI")
import Autodesk 
from Autodesk.Revit.DB import *

# Current doc
doc = DocumentManager.Instance.CurrentDBDocument

# Inputs, make sure it's a list
numbers = IN[0] if isinstance(IN[0], list) else [IN[0]]

# Container lists for iteration
sht_l, num_l, matches, matches_clean, fails = [], [], [], [], []

# Get all sheets and their numbers
sheets = FilteredElementCollector(doc).OfClass(Autodesk.Revit.DB.ViewSheet).ToElements()

for s in sheets:
	sht_l.append(s)
	num_l.append(s.SheetNumber)

# Find matching sheets, catch the non-matches
for n in numbers:
	try:
		ind = num_l.index(n)
		match = sht_l[ind]
		matches.append(match)
		matches_clean.append(match)
	except:
		ind = numbers.index(n)
		matches.append("No match")
		fails.append(ind)

# Preparing output to Dynamo
OUT = [matches, matches_clean, fails]
# ----------------------------------------
code_block = CodeBlock(x=python_script) { x[0]; x[1]; x[2]; }
sheets = Output(code_block.out0)  # All results, including the failing sheets.
matches_only = Output(code_block.out1)  # Successful results only.
failing_indices = Output(code_block.out2)  # These can be used to filter out the failing results. Feed in these to a 'get item at index' over another list.
