# Dynamo custom node SheetRevisions.dyf "© SheetRevisions" (Dynamo 2.3.1.11775)
# category: Crumple.Revit.Sheets
# Given a sheet, returns all revisions associated with that sheet as elements.
# packages: Crumple 2021.8.17

sheets = Input(sheets: var[]..[])
docOrLink = Input(docOrLink: var[]..[] = null)  # Uses current if none provided. Accepts document or link instance.
getdocument = Custom[© GetDocument](docOrLink=docOrLink)  # package Crumple; If no input is specified or an invalid one is, returns current document. If a link instance is provided, it returns the linked document. If a document is provided it will pass it through.
python_script = Python(IN[0]=sheets, IN[1]=getdocument.document)
# ---------- python_script.python (31 lines) ----------
# Made by Gavin Crump
# Free for use
# BIM Guru, www.bimguru.com.au

# Boilerplate text
import clr

clr.AddReference("RevitAPI")
import Autodesk 
from Autodesk.Revit.DB import *

# Current doc/app/ui
doc = IN[1]

# Define list/unwrap list functions
def uwlist(input):
    result = input if isinstance(input, list) else [input]
    return UnwrapElement(result)

# Preparing input from dynamo to revit
sheet_list = uwlist(IN[0])
sheet_revs = []

# Get revisions per sheet
for s in sheet_list:
	ids = s.GetAdditionalRevisionIds()
	revs = [doc.GetElement(r) for r in ids]
	sheet_revs.append(revs)

# Preparing output to Dynamo
OUT = sheet_revs
# ----------------------------------------
revisions = Output(python_script)
