# Dynamo custom node Sheets.dyf "© Collect.Sheets" (Dynamo 2.3.1.11775)
# category: Crumple.Revit.Query
# Returns all the sheets in a document, with the option to omit any placeholder sheets.
# packages: Crumple 2022.2.13

includePlaceholders = Input(includePlaceholders: bool = true)
docOrLink = Input(docOrLink: var[]..[] = null)  # Uses current if none provided. Accepts document or link instance.
revit_getdocument = Custom[© Revit.GetDocument](docOrLink=docOrLink)  # package Crumple; If no input is specified or an invalid one is, returns current document. If a link instance is provided, it returns the linked document. If a document is provided it will pass it through.
python_script = Python(IN[0]=includePlaceholders, IN[1]=revit_getdocument.document)
# ---------- python_script.python (29 lines) ----------
# Made by Gavin Crump
# Free for use
# BIM Guru, www.bimguru.com.au

# Boilerplate text
import clr

clr.AddReference("RevitAPI")
import Autodesk 
from Autodesk.Revit.DB import *

# Current doc/app/ui
doc = IN[1]

# Preparing input from dynamo to revit
include = IN[0]

# Collect all sheets
sheets = FilteredElementCollector(doc).OfCategory(BuiltInCategory.OST_Sheets).WhereElementIsNotElementType().ToElements()

# Build output
sheetsout = []

for s in sheets:
	if not(s.IsPlaceholder) or include:
		sheetsout.append(s)

# Preparing output to Dynamo
OUT = sheetsout
# ----------------------------------------
sheets = Output(python_script)
