# Dynamo custom node SheetsCleaned.dyf "© SheetsCleaned" (Dynamo 2.3.0.5885)
# category: Crumple.Revit.Selection
# Returns all the sheets in the current document, with the option to omit any placeholder sheets.

includePlaceholders = Input(includePlaceholders: bool = true)
python_script = Python(IN[0]=includePlaceholders)
# ---------- python_script.python (33 lines) ----------
# Made by Gavin Crump
# Free for use
# BIM Guru, www.bimguru.com.au

# Boilerplate text
import clr

clr.AddReference("RevitServices")
import RevitServices
from RevitServices.Persistence import DocumentManager 

clr.AddReference("RevitAPI")
import Autodesk 
from Autodesk.Revit.DB import *

# Current doc/app/ui
doc = DocumentManager.Instance.CurrentDBDocument

# Preparing input from dynamo to revit
include = IN[0]

# Collect all sheets
sheets = FilteredElementCollector(doc).OfCategory(BuiltInCategory.OST_Sheets).WhereElementIsNotElementType().ToElements()

# Build output
sheetsout = []

for s in sheets:
	if not(s.IsPlaceholder) or include:
		sheetsout.append(s)

# Preparing output to Dynamo
OUT = sheetsout
# ----------------------------------------
sheets = Output(python_script)
