# Dynamo custom node SheetsGetByNumber.dyf "© Sheets.GetByNumber" (Dynamo 2.12.1.8246)
# category: Crumple.Revit.Actions
# Given a sheet number, return the matching sheet. If no match is found, a message is returned. The node also returns a matches list and a list of indices for non-matches.
# packages: Crumple 2022.2.13

numbers = Input(numbers: var[]..[])  # Sheet numbers as strings.
docOrLink = Input(docOrLink: var[]..[] = null)  # Uses current if none provided. Accepts document or link instance.
revit_getdocument = Custom[© Revit.GetDocument](docOrLink=docOrLink)  # package Crumple; If no input is specified or an invalid one is, returns current document. If a link instance is provided, it returns the linked document. If a document is provided it will pass it through.
python_script = Python(IN[0]=numbers, IN[1]=revit_getdocument.document)  # IronPython2
# ---------- python_script.python (49 lines) ----------
# Made by Gavin Crump
# Free for use
# BIM Guru, www.bimguru.com.au

# Boilerplate text
import clr 

# Revit API
clr.AddReference("RevitAPI")
import Autodesk 
from Autodesk.Revit.DB import FilteredElementCollector, ViewSheet

# Define list/unwrap list functions
def tolist(input):
	result = input if isinstance(input, list) else [input]
	return result

def objOrList(input, initial = IN[0]):
	if isinstance(initial, list):
		return input
	else:
		return input[0]

# Current doc
doc = IN[1]

# Inputs, make sure it's a list
numbers = tolist(IN[0])

# Container lists for iteration
sheets_out, matched = [],[]

# Get all sheets and their numbers
sheets  = FilteredElementCollector(doc).OfClass(ViewSheet).ToElements()
ex_nums = [s.SheetNumber for s in sheets]

# Find matching sheets, catch the non-matches
for n in numbers:
	if n in ex_nums:
		ind = ex_nums.index(n)
		match = sheets[ind]
		sheets_out.append(match)
		matched.append(True)
	else:
		sheets_out.append(None)
		matched.append(False)

# Preparing output to Dynamo
OUT = objOrList(sheets_out), objOrList(matched)
# ----------------------------------------
code_block = CodeBlock(x=python_script) { x[0]; x[1]; }
sheets = Output(code_block.out0)  # All results, including the failing sheets.
foundSheet = Output(code_block.out1)  # Did we find a match?
