# Dynamo custom node SheetsIsPlaceholder.dyf "© Sheets.IsPlaceholder" (Dynamo 2.3.0.5885)
# category: Crumple.Revit.Query
# Given a list of sheets, returns a boolean as to whether they are placeholders.

sheets = Input(sheets: var[]..[])
python_script = Python(IN[0]=sheets)
# ---------- python_script.python (28 lines) ----------
# Made by Gavin Crump
# Free for use
# BIM Guru, www.bimguru.com.au

# Boilerplate text
import clr

clr.AddReference("RevitAPI")
import Autodesk 
from Autodesk.Revit.DB import *

# Define list/unwrap list functions
def uwlist(input):
    result = input if isinstance(input, list) else [input]
    return UnwrapElement(result)

# Preparing input from dynamo to revit
sheets = uwlist(IN[0])

# Check if placeholder
bools = []

for s in sheets:
	ph = s.IsPlaceholder
	bools.append(ph)

# Preparing output to Dynamo
OUT = bools
# ----------------------------------------
isPlaceholder = Output(python_script)
