# Dynamo custom node SheetsNameFormatted.dyf "© Sheets.NameFormatted" (Dynamo 2.12.1.8246)
# category: Crumple.Revit.Actions
# Given a list of sheets, apply a typical naming convention to them with some optional fields such as prefix and separator.

sheets = Input(sheets: var[]..[])
includePrjNum = Input(includePrjNum: bool = true)
includeRevision = Input(includeRevision: bool = true)
includeName = Input(includeName: bool = true)
python_script = Python(IN[0]=sheets, IN[1]=includePrjNum, IN[2]=includeRevision, IN[3]=includeName)  # IronPython2
# ---------- python_script.python (62 lines) ----------
# Made by Gavin Crump
# Free for use
# BIM Guru, www.bimguru.com.au

# Boilerplate text
import clr

clr.AddReference("RevitAPI")
import Autodesk 
from Autodesk.Revit.DB import FilteredElementCollector, ProjectInfo, ElementId

# Define list/unwrap list functions
def uwlist(input):
    result = input if isinstance(input, list) else [input]
    return UnwrapElement(result)

def objOrList(input, initial = IN[0]):
	if isinstance(initial, list):
		return input
	else:
		return input[0]

# Preparing input from dynamo to revit
sheets      = uwlist(IN[0])
includePrj  = IN[1]
includeRev  = IN[2]
includeName = IN[3]

defaultDoc   = sheets[0].Document
defaultTitle =  defaultDoc.Title

invalidId   = ElementId.InvalidElementId

# Project information
projectInfo = FilteredElementCollector(defaultDoc).OfClass(ProjectInfo).FirstElement()
projectNumber = projectInfo.Number

# Make sheet names
sheetNames = []

for s in sheets:
	if s.Document.Title != defaultTitle:
		tempInfo = FilteredElementCollector(s.Document).OfClass(ProjectInfo).FirstElement()
		prjNum   = tempInfo.Number
	else:
		prjNum = projectNumber
	sn = s.SheetNumber
	if includePrj:
		sn = '{}-{}'.format(prjNum, sn)
	if includeRev:
		revId = s.GetCurrentRevision()
		if revId != invalidId:
			revStr = s.GetRevisionNumberOnSheet(revId)
		else:
			revStr = "-"
		sn = '{} [{}]'.format(sn, revStr)
	if includeName:
		sn = '{} - {}'.format(sn, s.Name)
	sheetNames.append(sn)

# Preparing output to Dynamo
OUT = objOrList(sheets), objOrList(sheetNames)
# ----------------------------------------
code_block = CodeBlock(x=python_script) { x[0]; x[1]; }
sheets_2 = Output(code_block.out0)  # "sheets"
sheetName = Output(code_block.out1)
