# Dynamo custom node SheetsTitleblock.dyf "© Sheets.Titleblock" (Dynamo 2.12.1.8246)
# category: Crumple.Revit.Actions
# Given a sheet or list of sheets, return any titleblocks on that sheet as well as whether the sheet has titleblocks as a boolean.
# packages: Crumple 2022.2.13

sheets = Input(sheets: var[]..[])
docOrLink = Input(docOrLink: var[]..[] = null)  # Uses current if none provided. Accepts document or link instance.
revit_getdocument = Custom[© Revit.GetDocument](docOrLink=docOrLink)  # package Crumple; If no input is specified or an invalid one is, returns current document. If a link instance is provided, it returns the linked document. If a document is provided it will pass it through.
python_script = Python(IN[0]=sheets, IN[1]=revit_getdocument.document)  # IronPython2
# ---------- python_script.python (55 lines) ----------
# Made by Gavin Crump
# Free for use
# BIM Guru, www.bimguru.com.au

# Boilerplate text
import clr

clr.AddReference("RevitAPI")
import Autodesk 
from Autodesk.Revit.DB import ElementId, FilteredElementCollector, BuiltInCategory

# Current doc/app/ui
doc = IN[1]

# Define list/unwrap list functions
def uwlist(input):
	result = input if isinstance(input, list) else [input]
	return UnwrapElement(result)

def objOrList(input, initial = IN[0]):
	if isinstance(initial, list):
		return input
	else:
		return input[0]

# Preparing input from dynamo to revit
sheet_list = uwlist(IN[0])

# Collect all titleblocks in the project
tblocks = FilteredElementCollector(doc).OfCategory(BuiltInCategory.OST_TitleBlocks).ToElements()
tbOvid  = [t.OwnerViewId.IntegerValue.ToString() for t in tblocks]

# Get ttbs on sheets
ttbs_out = []

for s in sheet_list:
	
	sid = s.Id.ToString()
	tbCount = tbOvid.count(sid)
	
	if tbCount == 1:
		ind  = tbOvid.index(sid)
		ttbs = [tblocks[ind]]
	elif tbCount > 1:
		ttbs = []
		for tb, id in zip(tblocks, tbOvid):
			if id == sid:
				ttbs.append(tb)
	else:
		ttbs = []
	
	ttbs_out.append(ttbs)

# Preparing output to Dynamo
OUT = objOrList(ttbs_out)
# ----------------------------------------
titleBlocks = Output(python_script)
