# Dynamo custom node SpaceTypes.dyf "© SpaceTypes" (Dynamo 2.3.0.5885)
# category: Crumple.Revit.Spaces
# Collects all space types as well as their names from the current document.

refresh = Input(refresh: bool = false)  # Toggle to refresh
python_script = Python(IN[0]=refresh)
# ---------- python_script.python (39 lines) ----------
# Made by Gavin Crump
# Free for use
# BIM Guru, www.bimguru.com.au

# Boilerplate text
import clr

clr.AddReference("RevitNodes")
import Revit
clr.ImportExtensions(Revit.Elements)
clr.ImportExtensions(Revit.GeometryConversion)

clr.AddReference("RevitServices")
import RevitServices
from RevitServices.Persistence import DocumentManager 

clr.AddReference("RevitAPI")
from Autodesk.Revit.DB import *
from Autodesk.Revit.DB.Analysis import *

# Current doc/app/ui
doc = DocumentManager.Instance.CurrentDBDocument

# Collect all Space types
spaces = FilteredElementCollector(doc).OfClass(HVACLoadSpaceType).ToElements()

# Prepare empty lists
ids = []

# Find space type Id and convert to element
for s in spaces:
	uw = UnwrapElement(s)
	id_uwr = uw.Id
	id_str = id_uwr.ToString()
	id_int = int(id_str)
	ids.append(id_int)
	
# Outputs
OUT = [spaces, ids]
# ----------------------------------------
code_block = CodeBlock(lst=python_script) { styp = lst[0]; stid = lst[1]; }
space_types = Output(code_block.styp)  # Space types as elements.
name = Element.Name(element=code_block.styp)
type_names = Output(name)  # Type names as strings.
type_ids = Output(code_block.stid)  # Space types ids as integers.
