# Dynamo custom node SpacesAtPoint.dyf "© Spaces.AtPoint" (Dynamo 2.16.2.5624)
# category: Crumple.Revit.Query
# Given a document and points, attempts to return spaces at those points. If a link instance is provided, it will instead try to return spaces inclusive of required link transforms. If a phase is not valid for a linked document and one with the same name cannot be found, the last created phase will be used.
# packages: Crumple 2026.7.1

point = Input(point: var[]..[])
docOrLink = Input(docOrLink: var[]..[] = null)  # Uses current if none provided. Accepts document or link instance.
revit_getdocument = Custom[© Revit.GetDocument](docOrLink=docOrLink)  # package Crumple; If no input is specified or an invalid one is, returns current document. If a link instance is provided, it returns the linked document. If a document is provided it will pass it through.
phase = Input(phase: var[]..[] = null)
python_script = Python(IN[0]=point, IN[1]=revit_getdocument.document, IN[2]=phase, IN[3]=docOrLink)  # CPython3
# ---------- python_script.python (64 lines) ----------
# Made by Gavin Crump
# Free for use
# BIM Guru, www.bimguru.com.au

# Boilerplate text
import clr

clr.AddReference('ProtoGeometry')
from Autodesk.DesignScript.Geometry import *

# Define list/unwrap list functions
def tolist(input):
    result = input if isinstance(input, list) else [input]
    return result

def objOrList(input):
    if isinstance(input, list) and len(input) == 1:
        return input[0]
    else:
        return input

# Current doc/app/ui
points = tolist(IN[0])
doc = IN[1]
docOrLink = UnwrapElement(IN[2])
testPhase = UnwrapElement(IN[3])

# Try to get the transform
try:
    transform = docOrLink.GetTotalTransform().Inverse
except:
    transform = None

# Get all phases and phase names
phases = [p for p in doc.Phases]
phaseNames = [p.Name for p in phases]

# If phase is null, get the last phase
if testPhase is None:
    mainPhase = phases[-1]
# If phase name exists in doc phases, get it
elif testPhase.Name in phaseNames:
    mainPhase = phases[phaseNames.index(testPhase.Name)]
# Otherwise, get the last phase
else:
    mainPhase = phases[-1]

phases.insert(0, mainPhase)

# Get rooms
rooms = []

for pt in points:
    testPt = pt.ToXyz()
    if transform is not None:
        testPt = transform.OfPoint(testPt)
    for p in phases:
        room = doc.GetSpaceAtPoint(testPt, p)
        if room is not None:
            break
    rooms.append(room)

# Preparing output to Dynamo
OUT = objOrList(rooms)
# ----------------------------------------
space = Output(python_script)
