# Dynamo custom node SpacesCreateType.dyf "© Spaces.CreateType" (Dynamo 2.12.1.8246)
# category: Crumple.Revit.Create
# Given a list of names, attempt to create new Space Types. If the name exists already, the Type will be skipped.
# 'run_me' must be set to true.

spaces = Input(spaces: var[]..[])  # A name or list of names for the Space Types.
python_script = Python(IN[0]=spaces)  # IronPython2
# ---------- python_script.python (58 lines) ----------
# Made by Gavin Crump
# Free for use
# BIM Guru, www.bimguru.com.au

# Boilerplate text
import clr

clr.AddReference("RevitNodes")
import Revit
clr.ImportExtensions(Revit.Elements)
clr.ImportExtensions(Revit.GeometryConversion)

clr.AddReference("RevitServices")
import RevitServices
from RevitServices.Persistence import DocumentManager 
from RevitServices.Transactions import TransactionManager 

clr.AddReference("RevitAPI")
import Autodesk
from Autodesk.Revit.DB.Analysis import HVACLoadSpaceType

# Define list/unwrap list functions
def tolist(input):
	result = input if isinstance(input, list) else [input]
	return result

def objOrList(input, initial = IN[0]):
	if isinstance(initial, list):
		return input
	else:
		return input[0]

# Current doc/app/ui
doc = DocumentManager.Instance.CurrentDBDocument

# Preparing input from dynamo to revit
names = tolist(IN[0])

# Do some action in a Transaction
TransactionManager.Instance.EnsureInTransaction(doc)

results, spaceTypes = [], []

for name in names:
	if HVACLoadSpaceType.IsNameUnique(doc, name):
		st_r = HVACLoadSpaceType.Create(doc, name)
		st_d = st_r.ToDSType(False)
		spaceTypes.append(st_d)
		results.append(True)
	else:
		spaceTypes.append(None)
		results.append(False)

# Transaction complete
TransactionManager.Instance.TransactionTaskDone()

# Preparing output to Dynamo
OUT = objOrList(spaceTypes), objOrList(results)
# ----------------------------------------
code_block = CodeBlock(lst=python_script) { st = lst[0]; re = lst[1]; }
spaceTypes = Output(code_block.st)
wasCreated = Output(code_block.re)
