# Dynamo custom node SpacesGetType.dyf "© Spaces.GetType" (Dynamo 2.12.1.8246)
# category: Crumple.Revit.Query
# Gets a Space's Type as well as it's name and Id.

spaces = Input(spaces: var[]..[])  # A space or list of spaces.
python_script = Python(IN[0]=spaces)  # IronPython2
# ---------- python_script.python (31 lines) ----------
# Made by Gavin Crump
# Free for use
# BIM Guru, www.bimguru.com.au

# Boilerplate text
import clr

# Define list/unwrap list functions
def uwlist(input):
	result = input if isinstance(input, list) else [input]
	return UnwrapElement(result)

def objOrList(input, initial = IN[0]):
	if isinstance(initial, list):
		return input
	else:
		return input[0]

# Preparing input from dynamo to revit
elements = uwlist(IN[0])

# Prepare empty lists
spaceTypes = []

# Find space type Id and convert to element
for e in elements:
	spaceType = e.Document.GetElement(e.SpaceTypeId)
	spaceTypes.append(spaceType)

# Preparing output to Dynamo
OUT = objOrList(spaceTypes)
# ----------------------------------------
space_type = Output(python_script)  # As an element.
