# Dynamo custom node StairAddPath.dyf "© Stairs.AddPath" (Dynamo 2.3.0.5885)
# category: Crumple.Revit.Other.Create
# Given a list of stairs, a path type and a view, the node attempts to place a path on each of those stairs in that view. Stairs can only have 1 path placed per view, so will return an error if any already have one applied.

stairs = Input(stairs: var[]..[])
pathtype = Input(pathtype: var)
planView = Input(planView: var)
python_script = Python(IN[0]=stairs, IN[1]=pathtype, IN[2]=planView)
# ---------- python_script.python (46 lines) ----------
# Made by Gavin Crump
# Free for use
# BIM Guru, www.bimguru.com.au

# Boilerplate text
import clr

clr.AddReference("RevitServices")
import RevitServices
from RevitServices.Persistence import DocumentManager 
from RevitServices.Transactions import TransactionManager 

clr.AddReference("RevitAPI")
import Autodesk 
from Autodesk.Revit.DB import *

# Current doc/app/ui
doc = DocumentManager.Instance.CurrentDBDocument

# Define list/unwrap list functions
def uwlist(input):
    result = input if isinstance(input, list) else [input]
    return UnwrapElement(result)

# Preparing input from dynamo to revit
stairs = uwlist(IN[0])
path   = UnwrapElement(IN[1])
view   = UnwrapElement(IN[2])

newpaths = []

# Do some action in a Transaction
TransactionManager.Instance.EnsureInTransaction(doc)

for stair in stairs:
	try:
		stairid = LinkElementId(stair.Id)
		newpath = Autodesk.Revit.DB.Architecture.StairsPath.Create(doc, stairid, path.Id, view.Id)
		newpaths.append(newpath)
	except:
		newpaths.append(None)

TransactionManager.Instance.TransactionTaskDone()

# Preparing output to Dynamo
OUT = newpaths
# ----------------------------------------
stairPaths = Output(python_script)
