# Dynamo custom node StringAlphabet.dyf "© String.Alphabet" (Dynamo 2.16.2.5624)
# category: Crumple.Data.Create
# Generates an upper or lower case alphabet.

upper = Input(upper: bool = false)
code_block = CodeBlock { "a".."z"..1; }
toUpper = String.ToUpper(string=code_block)
if_ = RefactoredIf(test=upper, true=toUpper, false=code_block)
alphabet = Output(if_)
