# Dynamo custom node StringCipherTo.dyf "© String.CipherTo" (Dynamo 2.3.1.11775)
# category: Crumple.Data.Actions
# Encodes strings to a numerical format for encoding or processing their values as numbers. The node can handle upper/lower case and also converts spaces to 0/00. You can proceed with numbers or strings, but numbers will not support padding to 2 digits for later processing back to strings.

code_block = CodeBlock { "a".."z"..1; }
str = Input(str: string = tTypedIdent0)  # Converts alpha characters into their respective numbers. Cipher: 00 = " " (Space) 01 = a/A 02 = b/B 03 = c/C etc... 26 = z/Z
code_block_2 = CodeBlock { "A".."Z"..1; }
code_block_3 = CodeBlock(low=code_block, data=str, upper=code_block_2)
# ---------- code_block_3.designscript (4 lines) ----------
lower = DSCore.List.Insert(low, " ", 0);
ind1 = DSCore.List.IndexOf(lower, data);
ind2 = DSCore.List.IndexOf(upper, data);
comb = ind1 + ind2 + 1;
# ----------------------------------------
string_from_object = FromObject(obj=code_block_3.comb)
code_block_4 = CodeBlock { 2; "0"; }
padLeft = String.PadLeft(str=string_from_object, newWidth=code_block_4.out0, padChars=code_block_4.out1)
strings = Output(padLeft)  # Encoded strings as numerical strings
numbers = Output(string_from_object)  # Encoded strings as numbers
