# Dynamo custom node StringExplode.dyf "© String.Explode" (Dynamo 2.12.1.8246)
# category: Crumple.Data.Create
# Deconstructs a string (or list of strings) into their characters. There is the option to replace spaces with a special character which can be helpful for delimiting or visual ergonomics.

strings = Input(strings: var[]..[])  # Strings for exploding.
charReplace = Input(charReplace: string = " ")  # Optional replacement for spaces once exploded.
python_script = Python(IN[0]=strings, IN[1]=charReplace)  # IronPython2
# ---------- python_script.python (33 lines) ----------
# Made by Gavin Crump
# Free for use
# BIM Guru, www.bimguru.com.au
# Similar to Clockwork, but also allows sub of spaces
# I often found this was my next step to exploding strings

# Define list/unwrap list functions
def tolist(input):
    result = input if isinstance(input, list) else [input]
    return result

def objOrList(input, initial = IN[0]):
	if isinstance(initial, list):
		return input
	else:
		return input[0]

#Declare Input
strings = tolist(IN[0])
sub  = IN[1]

# Function to split strings
def splitChars(string, subStr = sub):
	chars = []
	for c in string:
		if c == "":
			chars.append(subStr)
		else:
			chars.append(c)
	return chars

#Declare Output
OUT = objOrList([splitChars(s) for s in strings])
# ----------------------------------------
stringsOut = Output(python_script)  # Sublists of the exploded characters per string.
