# Dynamo custom node StringFromMatrix.dyf "© String.FromMatrix" (Dynamo 2.16.2.5624)
# category: Crumple.Data.Create
# Joins a matrix of strings into a single string.

lineBreak = Input(lineBreak: string = " ")
delimiter = Input(delimiter: string = " ")
matrix = Input(matrix: string[]..[])
join = String.Join(separator=delimiter, string0=matrix)
join_2 = String.Join(separator=lineBreak, string0=join)
code_block = CodeBlock(x=join_2) { x[0][0]; }
str = Output(code_block)
