# Dynamo custom node StringFromObject.dyf "© String.FromObject" (Dynamo 2.12.1.8246)
# category: Crumple.Data.Create
# Uses the python str() function to convert data types to strings. Unlike 'string from object' this will trim trailing 0's from numbers.

obj = Input(obj: var[]..[])  # Data for conversion.
python_script = Python(IN[0]=obj)  # CPython3
# ---------- python_script.python (34 lines) ----------
# Made by Gavin Crump
# Free for use
# BIM Guru, www.bimguru.com.au

# Define list/unwrap list functions
def tolist(input):
    result = input if isinstance(input, list) else [input]
    return result

def objOrList(input, initial = IN[0]):
	if isinstance(initial, list):
		return input
	else:
		return input[0]

def toString(obj):
    strObj = str(obj)
    if isinstance(obj, int):
        if "." in strObj:
            return obj.split(".")[-1]
        else:
            return strObj
    elif isinstance(obj, float):
        if "." in strObj and strObj[-1] == "0":
            return strObj.rstrip("0")
        else:
            return strObj
    return strObj

# Get inputs
objects = tolist(IN[0])

# Define outputs
OUT = objOrList([toString(o) for o in objects])
# ----------------------------------------
str = Output(python_script)  # Data returned as strings.
