# Dynamo custom node StringFromObject_PY.dyf "© StringFromObject_PY" (Dynamo 2.3.0.5885)
# category: Crumple.String.Generate
# Uses the python str() function to convert data types to strings. Unlike 'string from object' this will trim trailing 0's from numbers.

obj = Input(obj: var[]..[])  # Data for conversion.
python_script = Python(IN[0]=obj)
# ---------- python_script.python (20 lines) ----------
# Made by Gavin Crump
# Free for use
# BIM Guru, www.bimguru.com.au

# Get inputs
items = IN[0] if isinstance(IN[0], list) else [IN[0]]

# Convert to strings
strings = []

for i in items:
	tostr = str(i)
	try:
		ind = tostr.index(".")
		strings.append(tostr[:ind])
	except:
		strings.append(tostr)

# Define outputs
OUT = strings
# ----------------------------------------
str = Output(python_script)  # Data returned as strings.
