# Dynamo custom node StringJoin.dyf "© String.Join" (Dynamo 2.12.1.8246)
# category: Crumple.Data.Create
# Joins a list of strings together, inserting a separating character between each of them. Input must be a list containing a list or lists.

list = Input(list: var[]..[])  # Lists for joining.
sep = Input(sep: string = "")  # Character for insertion.
python_script = Python(IN[0]=list, IN[1]=sep)  # CPython3
# ---------- python_script.python (13 lines) ----------
# Made by Gavin Crump
# Free for use
# BIM Guru, www.bimguru.com.au

# Declare inputs
lst = IN[0]
seps = IN[1]

# Join the list items
str = seps.join(lst)

# Declare output
OUT = str
# ----------------------------------------
strings = Output(python_script)  # Joined Strings.
