# Dynamo custom node StringRevitLegal.dyf "© String.RevitLegal" (Dynamo 2.12.1.8246)
# category: Crumple.Data.Actions
# Finds all illegal characters for a Revit named element and substitutes them with a character.

checkStrings = Input(checkStrings: var[]..[])
replaceChar = Input(replaceChar: string = "")  # Character to replace illegal characters with
python_script = Python(IN[0]=checkStrings, IN[1]=replaceChar)  # IronPython2
# ---------- python_script.python (44 lines) ----------
# Made by Gavin Crump
# Free for use
# BIM Guru, www.bimguru.com.au

# Define list/unwrap list functions
def tolist(input):
    result = input if isinstance(input, list) else [input]
    return result

def objOrList(input, initial = IN[0]):
	if isinstance(initial, list):
		return input
	else:
		return input[0]

# Inputs from Dynamo
strings = tolist(IN[0])
replace = IN[1]

newStrings, stringsChanged = [],[]

CHARS_ILLEGAL = ['\\',':','{','}','[',']','|',';','<','>','?','`','~']

# Function: Replace or remove illegal characters for windows
def legalizeString(string_check):
	# New string to build
	string_legal  = ""
	# Check each character
	for c in string_check:
		if c in CHARS_ILLEGAL:
			string_legal += replace
		else:
			string_legal += c
	# Return new string
	return string_legal, string_check == string_legal

# Legalize strings
for s in strings:
	sl, wc = legalizeString(s)
	newStrings.append(sl)
	stringsChanged.append(wc)

# Output to Dynamo
OUT = objOrList(newStrings), objOrList(stringsChanged)
# ----------------------------------------
code_block = CodeBlock(data=python_script) { data[0]; data[1]; }
legalStrings = Output(code_block.out0)
wasChanged = Output(code_block.out1)
