# Dynamo custom node StringRounded.dyf "© String.Rounded" (Dynamo 2.12.1.8246)
# category: Crumple.Data.Create
# Given a list of numbers with decimal places, round them to a specific length and convert that to a string. More reliable than String.ToObject.

numbers = Input(numbers: var[]..[])  # Data for conversion.
digits = Input(digits: int = 0)  # Rounding digits.
python_script = Python(IN[0]=numbers, IN[1]=digits)  # IronPython2
# ---------- python_script.python (40 lines) ----------
# Made by Gavin Crump
# Free for use
# BIM Guru, www.bimguru.com.au

# Define list/unwrap list functions
def tolist(input):
    result = input if isinstance(input, list) else [input]
    return result

def objOrList(input, initial = IN[0]):
	if isinstance(initial, list):
		return input
	else:
		return input[0]

# Get inputs
items = tolist(IN[0])
n = IN[1]

# Catch all for index greater than 0
if n > 0:
	n += 1
else:
	pass

# Convert to strings
strings = []

for i in items:
	
	tostr = str(i)
	
	if "." in tostr:
		ind = tostr.index(".")+n
		strings.append(tostr[:ind])
	else:
		strings.append(tostr)

# Define outputs
OUT = objOrList(strings)
# ----------------------------------------
str = Output(python_script)  # Data returned as strings.
