# Dynamo custom node StringSplitCaps.dyf (Dynamo 2.3.0.5885)
# category: Crumple.String.Modify
# Splits one or multiple strings into sublists, broken down at each upper case character.

strings = Input(strings: var[]..[])
python_script = Python(IN[0]=strings)
# ---------- python_script.python (22 lines) ----------
# Made by Gavin Crump
# Free for use
# BIM Guru, www.bimguru.com.au

#Import Regex (regular expressions)
import re

#Turn data into a list for iteration
if isinstance(IN[0], list):
	lst = IN[0]
else:
	lst = [IN[0]]

#Empty list, apply regex for capital letters
dataout = []

for str in lst:
	caps = re.findall('[A-Z][^A-Z]*', str)
	dataout.append(caps)

#Define output
OUT = dataout
# ----------------------------------------
output = Output(python_script)
