# Dynamo custom node StringToGuid.dyf "© String.ToGuid" (Dynamo 2.16.2.5624)
# category: Crumple.Application.Create
# Attempts to create a System.Guid from a string. Guid's must be 32 characters long and include 4 dashes.

str = Input(str: string[]..[])
python_script = Python(IN[0]=str)  # CPython3
# ---------- python_script.python (35 lines) ----------
# Made by Gavin Crump
# Free for use
# BIM Guru, www.bimguru.com.au

# Boilerplate text
import clr
import System
from System import Guid

# Define list/unwrap list functions
def tolist(input):
    result = input if isinstance(input, list) else [input]
    return result

def objOrList(input):
    if isinstance(input, list) and len(input) == 1:
        return input[0]
    else:
        return input

# Preparing input from dynamo to revit
strings = tolist(IN[0])

guids, success = [],[]

for s in strings:
    try:
        guids.append(Guid(s))
        success.append(True)
    except:
        guids.append(None)
        success.append(False)

# Preparing output to Dynamo
OUT = objOrList(guids), objOrList(success)
# ----------------------------------------
code_block = CodeBlock(x=python_script) { x[0]; x[1]; }
guid = Output(code_block.out0)
success = Output(code_block.out1)
