# Dynamo custom node StringToMatrix.dyf "© String.ToMatrix" (Dynamo 2.16.2.5624)
# category: Crumple.Data.Create
# Converts a single string into a delimited matrix.

str = Input(str: string)
lineBreak = Input(lineBreak: string = " ")
split = String.Split(string=str, separator0=lineBreak)
delimiter = Input(delimiter: string = " ")
split_2 = String.Split(string=split, separator0=delimiter)
matrix = Output(split_2)
