# Dynamo custom node StringToNumber.dyf "© String.ToNumber" (Dynamo 2.16.2.5624)
# category: Crumple.Data.Create
# Attempts to convert a string to a  number, with an optional failure replacement.

toNumber = String.ToNumber()  # unwired: string
str = Input(str: string)
function_apply = ApplyFunction(function=toNumber, argument0=str)
replaceNulls = Input(replaceNulls: var = null)
isNull = Object.IsNull()  # unwired: object
replaceByCondition = Replace(item=function_apply, replaceWith=replaceNulls, condition=isNull)
number = Output(replaceByCondition)
