# Dynamo custom node SurfacePopulate.dyf "© Surface.Populate" (Dynamo 2.12.1.8246)
# category: Crumple.Geometry.Create
# Distributes a certain number of points randomly across an input surface.

surface = Input(surface: Autodesk.DesignScript.Geometry.Surface)  # Surface to populate.
count = Input(count: int = 1)  # The number of points to generate.
seed = Input(seed: int = 1)  # The seed of randomisation.
python_script = Python(IN[0]=count, IN[1]=seed)  # CPython3
# ---------- python_script.python (26 lines) ----------
# Made by Gavin Crump
# Free for use
# BIM Guru, www.bimguru.com.au

# Import random package
from random import seed
from random import random

# Define inputs
rcount = IN[0]
rseed  = IN[1]

# Set seed
seed(rseed)

# Empty list for values
nums_x, nums_y = [], []

# Generate random values
for r in range(rcount):
	val1, val2 = random(), random()
	nums_x.append(val1)
	nums_y.append(val2)

# Output
OUT = [nums_x, nums_y]
# ----------------------------------------
code_block = CodeBlock(lst=python_script) { u = lst[0]; v = lst[1]; }
pointAtParameter = Surface.PointAtParameter(surface=surface, u=code_block.u, v=code_block.v, lacing=Longest)
points = Output(pointAtParameter)
