# Dynamo custom node SwissSurface.dyf "© Polycurve.Swissify" (Dynamo 2.3.0.5885)
# category: Crumple.Geometry.Create
# Takes a collection of polycurves, finds the encapsulating curve and returns the outermost surface (with holes cut out). The result must be projected to a common plane.

polycurves = Input(polycurves: var[]..[])  # A list of polycurves One polycurve must encompass the others. Polycurves will all be pulled to the lowest total Z value of the curves.
code_block = CodeBlock(geom=polycurves)
# ---------- code_block.designscript (15 lines) ----------
//Flatten incoming curves
gl = DSCore.List.Flatten(geom);

//Find the lowest point of all the curves
bb = Autodesk.BoundingBox.ByGeometry(gl);
bz = (Autodesk.BoundingBox.MinPoint(bb)).Z;
bp = Autodesk.Point.ByCoordinates(0, 0, bz);

//Create plane and pull curves to it
fp = Plane.ByOriginNormal(bp, Vector.ZAxis());
fc = Autodesk.Curve.PullOntoPlane(gl, fp);

//Patch surfaces and areas
sf = Surface.ByPatch(fc);
sa = Surface.Area(sf);
# ----------------------------------------
sortByKey = List.SortByKey(list=code_block.sf, keys=code_block.sa)
code_block_2 = CodeBlock(sf=sortByKey.sorted_list)
# ---------- code_block_2.designscript (6 lines) ----------
//List count - 1
li = DSCore.List.Count(sf)-1;

//Last and the rest
sf[li];
DSCore.List.RemoveItemAtIndex(sf, li);
# ----------------------------------------
difference = Surface.Difference(surface=code_block_2.out1, others=code_block_2.out2)
cheese = Output(difference)  # "cheese: Surface"; The solid portion of the surface.
air = Output(code_block_2.out2)  # "air: Surface"; The empty portion of the surface.
code_block_3 = CodeBlock(sa=sortByKey.sorted_keys)
# ---------- code_block_3.designscript (9 lines) ----------
//List count - 1
li = DSCore.List.Count(sa)-1;

//Last and the rest
sa[li];
rest = DSCore.List.RemoveItemAtIndex(sa, li);

//Total areas
DSCore.Math.Sum(rest);
# ----------------------------------------
cheeseArea = Output(code_block_3.out1)  # "cheeseArea: Area"; The area of the solid portion.
airArea = Output(code_block_3.out3)  # "airArea: Area"; The area of the empty portion.
