# Dynamo custom node TimerCheck.dyf "© Timer.Check" (Dynamo 2.12.1.8246)
# category: Crumple.Script.Query
# Will output a time taken once data has passed through this node, as well as the duration since a given datetime occured. Connect this up to a TimerStart or other TimerCheck nodes to measure the runtime of your scripts!

data_in = Input(data_in: var[]..[] = Empty)  # Data to pass through the node.
time = Input(time: var[]..[])  # Previous time measured to be compared.
python_script = Python(IN[0]=data_in, IN[1]=time)  # CPython3
# ---------- python_script.python (17 lines) ----------
# Made by Gavin Crump
# Free for use
# BIM Guru, www.bimguru.com.au

# Boilerplate text
from datetime import datetime

# Collect input
datain = IN[0]
start  = IN[1]

# Output the time now
now  = datetime.now()
diff = now - start
secs = divmod(diff.total_seconds(), 60)

OUT = [datain, now, secs[1]]
# ----------------------------------------
code_block = CodeBlock(lst=python_script) { data = lst[0]; time = lst[1]; secs = lst[2]; }
data_out = Output(code_block.data)  # Data as it leaves the node
time_2 = Output(code_block.time)  # "time"; The datetime when the data passed through.  Connect this to TimerCheck nodes!
seconds = Output(code_block.secs)  # The time since the last datetime fed into the node, measured in seconds.
