# Dynamo custom node TimerDelay.dyf "© Timer.Delay" (Dynamo 2.12.1.8246)
# category: Crumple.Script.Actions
# Given a duration in seconds and some data, this script will delay that data by the given time. A threshold of 3 seconds is used by default to stop an undesirable number being provided.

data = Input(data: var[]..[])
seconds = Input(seconds: int = 1)
limit = Input(limit: int = 3)
python_script = Python(IN[0]=data, IN[1]=seconds, IN[2]=limit)  # CPython3
# ---------- python_script.python (21 lines) ----------
# Made by Gavin Crump
# Free for use
# BIM Guru, www.bimguru.com.au

# Boilerplate text
import clr
import time

delay = IN[1]
limit = IN[2]

# Wait for a certain amount of time
if delay < limit:
	time.sleep(delay)
	timedout = False
else:
	time.sleep(limit)
	timedout = True

# Preparing output to Dynamo
OUT = [IN[0],timedout]
# ----------------------------------------
code_block = CodeBlock(out=python_script) { out[0]; out[1]; }
data_2 = Output(code_block.out0)  # "data"
timedOut = Output(code_block.out1)
