# Dynamo custom node TimerStart.dyf "© Timer.Start" (Dynamo 2.16.2.5624)
# category: Crumple.Script.Create
# Will output a time that is taken once data has passed through this node. Connect this time up to TimerCheck nodes to measure execution times.

data = Input(data: var[]..[] = Empty)  # Data to pass through the node.
python_script = Python(IN[0]=data)  # CPython3
# ---------- python_script.python (12 lines) ----------
# Made by Gavin Crump
# Free for use
# BIM Guru, www.bimguru.com.au

# Boilerplate text
from datetime import datetime

# Collect input
datain = IN[0]

# Output the time now
OUT = [datain, datetime.now()]
# ----------------------------------------
code_block = CodeBlock(lst=python_script) { data = lst[0]; time = lst[1]; }
data_2 = Output(code_block.data)  # "data"; Data as it leaves the node
time = Output(code_block.time)  # The datetime when the data passed through.  Connect this to TimerCheck nodes!
