# Dynamo custom node UIDropdown.dyf "© UI.DropdownForm" (Dynamo 2.12.1.8246)
# category: Crumple.Script.Create
# Creates a basic dropdown form from a set of keys and values. If cancelled, the form will return nothing (null).

formTitle = Input(formTitle: string = "Please select an item")
keys = Input(keys: var[]..[])  # What the user will see in the form
values = Input(values: var[]..[])  # What will be passed through
python_script = Python(IN[0]=formTitle, IN[1]=keys, IN[2]=values)  # IronPython2
# ---------- python_script.python (121 lines) ----------
# Made by Gavin Crump
# Free for use
# BIM Guru, www.bimguru.com.au

import clr

clr.AddReference("System.Drawing")
clr.AddReference("System.Windows.Forms")

import System
import System.Drawing

from System.Drawing import *
from System.Windows.Forms import *

from collections import namedtuple

# Define list/unwrap list functions
def tolist(input):
    result = input if isinstance(input, list) else [input]
    return result

# Imports from Dynamo
keys      = tolist(IN[1])
values    = tolist(IN[2])
formTitle = IN[0]

formWidth  = 300
formHeight = 100
buttonHeight = 225

# Class for key/value pair
class MyItem():
	def __init__(self, key, value):
		self.Key = key
		self.Value = value

# Make key value pairs
list_of_items = [MyItem(i,j) for i,j in zip(keys, values)] 

# Class for main winform
class MainForm(Form):
	
	# Initialize form object
	def __init__(self):
		# Begin with first value
		self.choice = list_of_items[0].Value
		self.InitializeComponent()
	
	# Make form components
	def InitializeComponent(self):
		
		# Combo box
		self._comboBoxType = System.Windows.Forms.ComboBox()
		self._comboBoxType.Location = System.Drawing.Point(25, 25)
		self._comboBoxType.Size = System.Drawing.Size(formWidth-50, 25)
		self._comboBoxType.DataSource = list_of_items
		self._comboBoxType.DisplayMember = "Key"
		self._comboBoxType.ValueMember = "Value"
		self._comboBoxType.SelectedIndexChanged += self.newItemSelected
		self.Controls.Add(self._comboBoxType)
		
		# Text box
		self.tbox1 = TextBox()
		self.tbox1.Parent = self
		self.tbox1.Text = "test"
		self.tbox1.Location = Point(25,25)
		self.tbox1.Width = 100
		
		# OK button
		btnOk = Button()
		btnOk.Text = "OK"
		btnOk.Anchor = (AnchorStyles.Bottom | AnchorStyles.Right)
		btnOk.Location = Point(105, buttonHeight)
		self.Controls.Add(btnOk)
		btnOk.Click += self.okButtonPressed

		# Cancel button
		btnCancel = Button()
		btnCancel.Text = "Cancel"
		btnCancel.Anchor = (AnchorStyles.Bottom | AnchorStyles.Right)
		btnCancel.Location = Point(185, buttonHeight)
		self.Controls.Add(btnCancel)
		btnCancel.Click += self.cancelButtonPressed
		
		# Draw main form
		self.ClientSize = System.Drawing.Size(formWidth, formHeight)
		self.BringToFront()
		self.CenterToScreen()
		self.FormBorderStyle = FormBorderStyle.FixedSingle
		self.Name = formTitle
		self.Text = formTitle
		self.ResumeLayout(False)
	
	# Event if OK button pressed
	def okButtonPressed(self, sender, args):
		self.Close()
		self.runNextOutput = True

	# Event if OK button pressed
	def cancelButtonPressed(self, sender, args):
		self.choice = None
		self.Close()
		self.runNextOutput = False 

	# Event if dropdown changes
	def newItemSelected(self, sender, e):
		self.choice = sender.SelectedItem.Value
		self.runNextOutput = False

# Show form to the user
objForm = MainForm()
objForm.ShowDialog()

# Return the selected object and if it was cancelled
chosenItem = objForm.choice

if not chosenItem:
	OUT = None, True
else:
	OUT = chosenItem, False
# ----------------------------------------
code_block = CodeBlock(x=python_script) { x[0]; x[1]; }
chosenValue = Output(code_block.out0)
wasCancelled = Output(code_block.out1)
