# Dynamo custom node UIPather.dyf "© UI.ChooseFilePath" (Dynamo 2.12.1.8246)
# category: Crumple.Script.Create
# When runMe is set to true, this node will display a file path dialogue for the user to interact with. The script will remain paused until the input is provided a value.

runMe = Input(runMe: bool = false)  # Set runMe to true.
python_script = Python(IN[0]=runMe)  # CPython3
# ---------- python_script.python (33 lines) ----------
# Repackaged by Gavin Crump
# Free for use
# BIM Guru, www.bimguru.com.au

##based off of code from http://onecore.net/ironpython-using-textbox-widget.htm
##also made possible thanks to the awesome work of Dimitar Venkov, without his examples I wouldn't be able to do any of this.
##built for Dynamo by john pierson

# Boilerplate text
import clr

import sys
import System
clr.AddReference('System.Windows.Forms')
clr.AddReference('System.Drawing')
clr.AddReference('System')

from System.Drawing import Point, Font
from System.Windows.Forms import OpenFileDialog

# Preparing input from dynamo to revit
if IN[0]:
	
	openDialog = OpenFileDialog()
	openDialog.Multiselect = True
	openDialog.Filter = "All files|*.*"
	openDialog.ShowDialog()
	
	OUT = openDialog.FileNames
	
else:
	
	OUT = "set runMe to true!"
# ----------------------------------------
filePath = Output(python_script)  # The nominated file path
