# Dynamo custom node UserPaths.dyf (Dynamo 2.3.0.5885)
# category: Crumple.Application
# This node returns the active username, as well as common user paths including:
# - Desktop
# - My Documents
# - Temp
# - Dynamo Revit (for active build)
# - Dynamo Revit logs (" ")

Drive = Input(Drive: string = "C")
Refresh = Input(Refresh: bool = true)
python_script = Python(IN[0]=Drive, IN[1]=Refresh)
# ---------- python_script.python (28 lines) ----------
# Made by Gavin Crump
# Free for use
# BIM Guru, www.bimguru.com.au

# Boilerplate text
import clr

#Add Dynamo services for its API
clr.AddReference('DynamoRevitDS')
import Dynamo
from System import Environment

# access to the current Dynamo instance and workspace
DynamoCurrent = Dynamo.Applications.DynamoRevit()
DynamoVersion = DynamoCurrent.RevitDynamoModel.Version

drive = IN[0]

user = Environment.UserName

fl = drive + ":\Users\\" + user + "\\"
dt = drive + ":\Users\\" + user + "\Desktop"
md = drive + ":\Users\\" + user + "\Documents"
te = drive + ":\Users\\" + user + "\AppData\Local\Temp"
dr = drive + ":\Users\\" + user + "\AppData\Roaming\Dynamo\Dynamo Revit\\" + DynamoVersion[0:3]
dl = drive + ":\Users\\" + user + "\AppData\Roaming\Dynamo\Dynamo Revit\\" + DynamoVersion[0:3] + "\Logs"

OUT = [user,fl,dt,md,te,dr,dl]
# ----------------------------------------
code_block = CodeBlock(out=python_script) { out[0]; out[1]; out[2]; out[3]; out[4]; out[5]; out[6]; }
username = Output(code_block.out0)
folder = Output(code_block.out1)
Desktop = Output(code_block.out2)
My_Docs = Output(code_block.out3)
Temp = Output(code_block.out4)
Dyn_Rvt = Output(code_block.out5)
Dyn_Logs = Output(code_block.out6)
