# Dynamo custom node VectorDeconstruct.dyf "© Vector.Deconstruct" (Dynamo 2.16.2.5624)
# category: Crumple.Geometry.Query
# Breaks a vector into its X, Y and Z components.

vector = Input(vector: Autodesk.DesignScript.Geometry.Vector[]..[])
code_block = CodeBlock(v=vector) { v.X; v.Y; v.Z; }
x = Output(code_block.out0)
y = Output(code_block.out1)
z = Output(code_block.out2)
