# Dynamo custom node VectorFromString.dyf "© Vector.FromString" (Dynamo 2.12.1.8246)
# category: Crumple.Geometry.Create
# Given a string form of a vector (X = x.xxx, Y = x.xxx, Z = x.xxx), return the equivalent vector. Note that if the original vector was more precise than 3 significant figures, it will be now only accurate to this many.

strings = Input(strings: var[]..[])  # A string or list of strings in a vector based format.
python_script = Python(IN[0]=strings)  # CPython3
# ---------- python_script.python (30 lines) ----------
# Made by Gavin Crump
# Free for use
# BIM Guru, www.bimguru.com.au

# Boilerplate text
import clr

clr.AddReference('ProtoGeometry')
from Autodesk.DesignScript.Geometry import *

# Preparing input from dynamo to revit
strs = IN[0] if isinstance(IN[0], list) else [IN[0]]

vectors = []

# Convert string to vector format
for s in strs:
	xind = s.index('X = ')
	yind = s.index('Y = ')
	zind = s.index('Z = ')
	
	x = float(s[xind+4:xind+9])
	y = float(s[yind+4:yind+9])
	z = float(s[zind+4:zind+9])
	
	v = Vector.ByCoordinates(x,y,z)
	vectors.append(v)

# Preparing output to Dynamo
OUT = vectors
# ----------------------------------------
vectors = Output(python_script)  # Equivalent vectors
