# Dynamo custom node VectorGroupByDirection.dyf "© Vector.GroupByDirection" (Dynamo 2.3.0.5885)
# category: Crumple.Geometry.Actions
# Given a list of vectors (and a list of data), return the data and vectors grouped by their direction.
# packages: Crumple 0.0.1

data = Input(data: var[]..[])  # Parallel data to group based on the vectors. If you do not want to group data, just feed in the same vector list.
vectors = Input(vectors: var[]..[])  # List of vectors to be grouped by.
normalized = Vector.Normalized(vector=vectors)
string_from_object = FromObject(obj=normalized)
groupByKey = List.GroupByKey(list=data@L2, keys=string_from_object@L2)
data_grouped = Output(groupByKey.groups)  # Grouped sets of data.
groupByKey_2 = List.GroupByKey(list=vectors@L2, keys=string_from_object@L2)
vectors_grouped = Output(groupByKey_2.groups)  # Grouped sets of vectors.
vectorFromString = Custom[VectorFromString](strings=groupByKey_2.unique_keys@L2)  # package Crumple; Given a string form of a vector (X = x.xxx, Y = x.xxx, Z = x.xxx), return the equivalent vector. Note that if the original vector was more precise than 3 significant figures, it will be now only accurate to this many.
keys = Output(vectorFromString)  # The vector keys for each group.
