# Dynamo custom node VectorGroupByParallel.dyf "© VectorGroupByParallel" (Dynamo 2.3.0.5885)
# category: Crumple.Geometry.Vectors
# Given a list of vectors (and a list of data) return the data and vectors grouped by their parallelism.

data = Input(data: var[]..[])  # Parallel data to group based on the vectors. If you do not want to group data, just feed in the same vector list.
vectors = Input(vectors: var[]..[])  # List of vectors to be grouped by.
reverse = Vector.Reverse(vector=vectors)
addItemToFront = List.AddItemToFront(item=vectors@L1, list=reverse@L1)
origin = Point.Origin()
translate = Geometry.Translate(geometry=origin, direction=addItemToFront)
code_block = CodeBlock { 1; }
byCoordinates = Point.ByCoordinates(x=code_block, y=code_block, z=code_block)
distanceTo = Geometry.DistanceTo(geometry=translate, other=byCoordinates)
sortByKey = List.SortByKey(list=addItemToFront@L2, keys=distanceTo@L2)
code_block_2 = CodeBlock { 0; }
getItemAtIndex = List.GetItemAtIndex(list=sortByKey.sorted_list@L2, index=code_block_2)
normalized = Vector.Normalized(vector=getItemAtIndex)
string_from_object = FromObject(obj=normalized)
groupByKey = List.GroupByKey(list=data@L2, keys=string_from_object@L2)
data_grouped = Output(groupByKey.groups)  # Grouped sets of data.
groupByKey_2 = List.GroupByKey(list=vectors@L2, keys=string_from_object@L2)
vectors_grouped = Output(groupByKey_2.groups)  # Grouped sets of vectors.
keys = Output(groupByKey_2.unique_keys)  # The vector keys for each group.
