# Dynamo custom node ViewAncestry.dyf "© ViewAncestry" (Dynamo 2.3.1.11775)
# category: Crumple.Revit.Views
# Returns the parent of a view, and the parent of that view, and the.... etc. Will also return if it had any parents, as well as the depth of the view's family tree.

views = Input(views: var[]..[])
python_script = Python(IN[0]=views)
# ---------- python_script.python (58 lines) ----------
# Made by Gavin Crump
# Free for use
# BIM Guru, www.bimguru.com.au

# Boilerplate text
import clr

clr.AddReference("RevitServices")
import RevitServices
from RevitServices.Persistence import DocumentManager 

clr.AddReference("RevitAPI")
import Autodesk 
from Autodesk.Revit.DB import *

# Current doc/app/ui
doc = DocumentManager.Instance.CurrentDBDocument

# Define list/unwrap list functions
def uwlist(input):
    result = input if isinstance(input, list) else [input]
    return UnwrapElement(result)

# Preparing input from dynamo to revit
viewlist  = uwlist(IN[0])
alltrees, alldepths, hasparents = [],[],[]

# Exhaust the lineage
for v in viewlist:
	
	breaker = 0
	checkview = v
	treedepth = 1
	viewtree  = []
	godeeper = True
	
	while godeeper and breaker < 99:
	
		breaker += 1
		
		try:
			parentId  = checkview.get_Parameter(BuiltInParameter.SECTION_PARENT_VIEW_NAME).AsElementId()
			checkview = Document.GetElement(doc, parentId)
			
			if checkview != None:
				treedepth += 1
				viewtree.append(checkview)
			else:
				godeeper = False
		except:
			godeeper = False
	
	alltrees.append(viewtree)
	alldepths.append(treedepth)
	hasparents.append(treedepth > 1)

# Preparing output to Dynamo
OUT = [alltrees, alldepths, hasparents]
# ----------------------------------------
code_block = CodeBlock(out=python_script) { out[0]; out[1]; out[2]; }
ancestry = Output(code_block.out0)
generations = Output(code_block.out1)
hasAncestry = Output(code_block.out2)
