# Dynamo custom node ViewFamilyTypesElevation.dyf "© ViewFamilyTypes.GetByNameElevation" (Dynamo 2.3.1.11775)
# category: Crumple.Revit.Query
# Tries to return an elevation type with the given name, if one exists in the model.

name = Input(name: string = "")
python_script = Python(IN[0]=name)
# ---------- python_script.python (49 lines) ----------
# Made by Gavin Crump
# Free for use
# BIM Guru, www.bimguru.com.au

# Boilerplate text
import clr

clr.AddReference("RevitNodes")
import Revit
clr.ImportExtensions(Revit.Elements)

clr.AddReference("RevitServices")
import RevitServices
from RevitServices.Persistence import DocumentManager 

clr.AddReference("RevitAPI")
import Autodesk 
from Autodesk.Revit.DB import *

# Current doc/app/ui
doc = DocumentManager.Instance.CurrentDBDocument

# Preparing input from dynamo to revit
n = IN[0]

# Get Family View Type
collector = FilteredElementCollector(doc).OfClass(ViewFamilyType).ToElements()

vfts,vfnms = [],[]

# Filter to elevation views only
for i in collector:
	if i.ViewFamily == ViewFamily.Elevation:	
		vfts.append(i)
		vfnms.append(i.ToDSType(True).Name)
	else:
		pass

# Try to get the related name
try:
	i = vfnms.index(n)
	type_out = vfts[i]
	result = True
except:
	type_out = vfts[0]
	result = False

# Preparing output to Dynamo
OUT = [type_out,result]
# ----------------------------------------
code_block = CodeBlock(x=python_script) { x[0]; x[1]; }
viewFamilyType = Output(code_block.out0)
foundMatch = Output(code_block.out1)
