# Dynamo custom node ViewFamilyTypesFamily.dyf "© ViewFamilyTypes.GetByViewType" (Dynamo 2.12.1.8246)
# category: Crumple.Revit.Query
# Returns all view family types of a provided view type or view type name (of the ViewType enumeration).
# packages: Crumple 2022.5.27

viewTypeOrName = Input(viewTypeOrName: var)
docOrLink = Input(docOrLink: var[]..[] = null)  # Uses current if none provided. Accepts document or link instance.
revit_getdocument = Custom[© Revit.GetDocument](docOrLink=docOrLink)  # package Crumple; If no input is specified or an invalid one is, returns current document. If a link instance is provided, it returns the linked document. If a document is provided it will pass it through.
python_script = Python(IN[0]=viewTypeOrName, IN[1]=revit_getdocument.document)  # CPython3
# ---------- python_script.python (27 lines) ----------
# Made by Gavin Crump
# Free for use
# BIM Guru, www.bimguru.com.au

# Boilerplate text
import clr


clr.AddReference("RevitAPI")
import Autodesk 
from Autodesk.Revit.DB import FilteredElementCollector, ViewFamilyType

# Inputs
vf  = str(IN[0])
doc = IN[1]

# Get all vfts
vfts = FilteredElementCollector(doc).OfClass(ViewFamilyType).ToElements()

vfts_out = []

for v in vfts:
	if str(v.ViewFamily) == vf:
		vfts_out.append(v)

# Preparing output to Dynamo
OUT = vfts_out
# ----------------------------------------
viewFamilyTypes = Output(python_script)
name = Element.Name(element=python_script)
names = Output(name)
