# Dynamo custom node ViewFamilyTypesFloorPlan.dyf "© ViewFamilyTypes.GetByNameFloorPlan" (Dynamo 2.16.2.5624)
# category: Crumple.Revit.Query
# Tries to return an floor plan type with the given name, if one exists in the model.
# packages: Crumple 2026.7.1

name = Input(name: string = "")
useDefault = Input(useDefault: bool = true)  # If type not found, use first one.
docOrLink = Input(docOrLink: var[]..[] = null)  # Uses current if none provided. Accepts document or link instance.
revit_getdocument = Custom[© Revit.GetDocument](docOrLink=docOrLink)  # package Crumple; If no input is specified or an invalid one is, returns current document. If a link instance is provided, it returns the linked document. If a document is provided it will pass it through.
python_script = Python(IN[0]=name, IN[1]=useDefault, IN[2]=revit_getdocument.document)  # CPython3
# ---------- python_script.python (63 lines) ----------
# Made by Gavin Crump
# Free for use
# BIM Guru, www.bimguru.com.au

# Boilerplate text
import clr

clr.AddReference("RevitAPI")
import Autodesk 
from Autodesk.Revit.DB import FilteredElementCollector, ViewFamilyType, ViewFamily, BuiltInParameter

# Define list/unwrap list functions
def tolist(input):
    result = input if isinstance(input, list) else [input]
    return result

def objOrList(input, initial = IN[0]):
	if isinstance(initial, list):
		return input
	else:
		return input[0]

# Current doc/app/ui
doc = IN[2]

# Preparing input from dynamo to revit
names    = tolist(IN[0])
useFirst = IN[1]

VIEWFAMILY = ViewFamily.FloorPlan

# Get Family View Type
vfts_all = FilteredElementCollector(doc).OfClass(ViewFamilyType).ToElements()

vfts,vfnms = [],[]

# Filter to 3d views only
for i in vfts_all:
	if i.ViewFamily == VIEWFAMILY:
		vfts.append(i)
		vfnms.append(i.get_Parameter(BuiltInParameter.ALL_MODEL_TYPE_NAME).AsString())
	else:
		pass

vft_first = vfts[0]

typesOut, results = [],[]

# Try to get the related name
for n in names:
	if n in vfnms:
		ind = vfnms.index(n)
		typesOut.append(vfts[ind])
		results.append(True)
	elif useFirst:
		typesOut.append(vft_first)
		results.append(False)
	else:
		typesOut.append(None)
		results.append(False)

# Preparing output to Dynamo
OUT = objOrList(typesOut), objOrList(results)
# ----------------------------------------
code_block = CodeBlock(x=python_script) { x[0]; x[1]; }
viewFamilyType = Output(code_block.out0)
foundMatch = Output(code_block.out1)
