# Dynamo custom node ViewGetPhase.dyf "© Views.Phase" (Dynamo 2.3.1.11775)
# category: Crumple.Revit.Query
# Given a view or list of views, returns the phases applied to those views as elements.
# packages: Crumple 2022.2.13

view = Input(view: var[]..[])
docOrLink = Input(docOrLink: var[]..[] = null)  # Uses current if none provided. Accepts document or link instance.
revit_getdocument = Custom[© Revit.GetDocument](docOrLink=docOrLink)  # package Crumple; If no input is specified or an invalid one is, returns current document. If a link instance is provided, it returns the linked document. If a document is provided it will pass it through.
python_script = Python(IN[0]=view, IN[1]=revit_getdocument.document)
# ---------- python_script.python (32 lines) ----------
# Made by Gavin Crump
# Free for use
# BIM Guru, www.bimguru.com.au

# Boilerplate text
import clr

clr.AddReference("RevitAPI")
import Autodesk 
from Autodesk.Revit.DB import *

# Current doc/app/ui
doc = IN[1]

# Define list/unwrap list functions
def uwlist(input):
    result = input if isinstance(input, list) else [input]
    return UnwrapElement(result)

# Preparing input from dynamo to revit
views = uwlist(IN[0])

phases = []

# Do some action in a Transaction
for v in views:
	phaseid = v.get_Parameter(BuiltInParameter.VIEW_PHASE).AsElementId()
	phase   = v.Document.GetElement(phaseid)
	phases.append(phase)

# Preparing output to Dynamo
OUT = phases
# ----------------------------------------
phase = Output(python_script)
