# Dynamo custom node ViewOpen.dyf "© View.Open" (Dynamo 2.16.2.5624)
# category: Crumple.Revit.Actions
# Opens a Revit view (can also be a sheet).

view = Input(view: var[]..[])
python_script = Python(IN[0]=view)  # CPython3
# ---------- python_script.python (47 lines) ----------
# Made by Gavin Crump
# Free for use
# BIM Guru, www.bimguru.com.au

# Boilerplate text
import clr

clr.AddReference("RevitServices")
import RevitServices
from RevitServices.Persistence import DocumentManager
from RevitServices.Transactions import TransactionManager

# Current doc/app/ui
doc   = DocumentManager.Instance.CurrentDBDocument
uidoc = DocumentManager.Instance.CurrentUIDocument

# Define list/unwrap list functions
def tolist(input):
    result = input if isinstance(input, list) else [input]
    return result

def uwlist(input):
    result = input if isinstance(input, list) else [input]
    return UnwrapElement(result)

def objOrList(input):
    if isinstance(input, list) and len(input) == 1:
        return input[0]
    else:
        return input

views = uwlist(IN[0])
results = []

for v in views:
    
    TransactionManager.Instance.EnsureInTransaction(doc)
    TransactionManager.Instance.ForceCloseTransaction()
    
    try:
        uidoc.RequestViewChange(v)
        results.append(True)
    except:
        results.append(False)

# Preparing output to Dynamo
OUT = objOrList(results)
# ----------------------------------------
success = Output(python_script)
