# Dynamo custom node ViewPlanCreate.dyf "© Views.CreatePlans" (Dynamo 2.3.0.5885)
# category: Crumple.Revit.Create
# Given an even list of levels and names and a view type, this node will create new plan views for those levels and attempt to rename them if a name is available. You can automate the application of view templates by assigning them to the view types in Revit as well. If you feed in a ceiling plan type, it will make a ceiling plan due to how the ViewPlan API works.

levels = Input(levels: var[]..[])
names = Input(names: var[]..[])
viewType = Input(viewType: var[]..[])
python_script = Python(IN[0]=levels, IN[1]=names, IN[2]=viewType)
# ---------- python_script.python (56 lines) ----------
# Made by Gavin Crump
# Free for use
# BIM Guru, www.bimguru.com.au

# Boilerplate text
import clr

clr.AddReference("RevitNodes")
import Revit
clr.ImportExtensions(Revit.Elements)

clr.AddReference("RevitServices")
import RevitServices
from RevitServices.Persistence import DocumentManager 
from RevitServices.Transactions import TransactionManager 

clr.AddReference("RevitAPI")
import Autodesk 
from Autodesk.Revit.DB import *

# Current doc/app/ui
doc = DocumentManager.Instance.CurrentDBDocument

# Define list/unwrap list functions
def tolist(input):
    result = input if isinstance(input, list) else [input]
    return result

def uwlist(input):
    result = input if isinstance(input, list) else [input]
    return UnwrapElement(result)

# Preparing input from dynamo to revit
levels = uwlist(IN[0])
names  = tolist(IN[1])
vtype  = UnwrapElement(IN[2])

viewout,result = [],[]

# Do some action in a Transaction
TransactionManager.Instance.EnsureInTransaction(doc)

for l,n in zip(levels,names):
	view = ViewPlan.Create(doc,vtype.Id,l.Id)
	try:
		view.Name = n
		success = True
	except:
		success = False
	viewout.append(view.ToDSType(False))
	result.append(success)

TransactionManager.Instance.TransactionTaskDone()

# Preparing output to Dynamo
OUT = [viewout, result]
# ----------------------------------------
code_block = CodeBlock(x=python_script) { x[0]; x[1]; }
planViews = Output(code_block.out0)
wasRenamed = Output(code_block.out1)
