# Dynamo custom node ViewSetPhase.dyf "© View.SetPhase" (Dynamo 2.16.2.5624)
# category: Crumple.Revit.Actions
# Given a list of views and a single phase, will set the views phases if possible.

view = Input(view: var[]..[])
phase = Input(phase: var[]..[])
python_script = Python(IN[0]=view, IN[1]=phase)  # CPython3
# ---------- python_script.python (52 lines) ----------
# Made by Gavin Crump
# Free for use
# BIM Guru, www.bimguru.com.au

# Boilerplate text
import clr

clr.AddReference("RevitServices")
import RevitServices
from RevitServices.Persistence import DocumentManager 
from RevitServices.Transactions import TransactionManager 

clr.AddReference("RevitAPI")
import Autodesk 
from Autodesk.Revit.DB import BuiltInParameter

# Current doc/app/ui
doc = DocumentManager.Instance.CurrentDBDocument

# Define list/unwrap list functions
def uwlist(input):
    result = input if isinstance(input, list) else [input]
    return UnwrapElement(result)

def objOrList(input, initial = IN[0]):
	if isinstance(initial, list):
		return input
	else:
		return input[0]

# Preparing input from dynamo to revit
views = uwlist(IN[0])
phase = UnwrapElement(IN[1])

BIP_PHASE = BuiltInParameter.VIEW_PHASE

result = []

# Do some action in a Transaction
TransactionManager.Instance.EnsureInTransaction(doc)

for v in views:
	try:
		v.get_Parameter(BIP_PHASE).Set(phase.Id)
		result.append(True)
	except:
		result.append(False)

TransactionManager.Instance.TransactionTaskDone()

# Preparing output to Dynamo
OUT = objOrList(views), objOrList(result)
# ----------------------------------------
code_block = CodeBlock(out=python_script) { views = out[0]; succs = out[1]; }
view_2 = Output(code_block.views)  # "view"
success = Output(code_block.succs)
