# Dynamo custom node ViewSetSunSettings.dyf "© Views.SetSunSettings" (Dynamo 2.3.0.5885)
# category: Crumple.Revit.Actions
# Given a list of views, apply a datetime and shadow intensity setting to their sun settings (still). You will need to update the shadows on/off setting manually or via a view template.

views = Input(views: var[]..[])  # Provide a view or list of views
datetimes = Input(datetimes: var[]..[])  # Provide a datetime or list of them. Should be same length as views.
intensity = Input(intensity: int = 100)  # Sets shadow intensity. Provide a number between 0 and 100.
ground_planes = Input(ground_planes: Revit.Elements.Level = null)  # Provide a view or list of views
isNull = Object.IsNull(obj=ground_planes)
python_script = Python(IN[0]=views, IN[1]=datetimes, IN[2]=intensity, IN[3]=ground_planes, IN[4]=isNull)
# ---------- python_script.python (75 lines) ----------
# Made by Gavin Crump
# Free for use
# BIM Guru, www.bimguru.com.au

# Credit to Matthew Anderle & Chris Williams for their examples
# DTx Library: https://trello.com/c/mOujiMPA/39-slider-sun-settings

# Boilerplate text
import clr

import System

clr.AddReference("RevitNodes")
import Revit
clr.ImportExtensions(Revit.Elements)
clr.ImportExtensions(Revit.GeometryConversion)

clr.AddReference("RevitServices")
import RevitServices
from RevitServices.Persistence import DocumentManager 
from RevitServices.Transactions import TransactionManager 

clr.AddReference("RevitAPI")
import Autodesk 
from Autodesk.Revit.DB import *

# Current doc/app/ui
doc = DocumentManager.Instance.CurrentDBDocument

# To list function
def tolist(input):
	out = input if isinstance(input, list) else [input]
	return out

# Preparing input from dynamo to revit
views = tolist(IN[0])
times = tolist(IN[1])
shade = IN[2]
level = UnwrapElement(IN[3])
no_gp = IN[4]

# Datetimes set as local
DT_kind = System.DateTimeKind.Local

# Rebuild datetimes list
DT_times = []
for time in times:
	spectime = System.DateTime.SpecifyKind(time, DT_kind)
	DT_times.append(spectime)

# Do some action in a Transaction
TransactionManager.Instance.EnsureInTransaction(doc)

# Transactable actions
views_done = []

for view, time in zip(views, DT_times):
	view_uw  = UnwrapElement(view)
	settings = view_uw.SunAndShadowSettings
	view_uw.ShadowIntensity = 1
	settings.SunAndShadowType = SunAndShadowType.StillImage
	settings.StartDateAndTime = time
	view_uw.ShadowIntensity = shade
	if no_gp:
		settings.UsesGroundPlane = False
	else:
		settings.UsesGroundPlane = True
		settings.GroundPlaneLevelId = level.Id
	views_done.append(view)

# Do some action in a Transaction
TransactionManager.Instance.TransactionTaskDone()

# Preparing output to Dynamo
OUT = [views_done, DT_times]
# ----------------------------------------
code_block = CodeBlock(lst=python_script) { views = lst[0]; dates = lst[1]; }
views_2 = Output(code_block.views)  # "views"; Views updated
datetimes_2 = Output(code_block.dates)  # "datetimes"; Datetimes of updated views
