# Dynamo custom node ViewSheetSetCreate.dyf "© ViewSheetSets.Create" (Dynamo 2.12.1.8246)
# category: Crumple.Revit.Create
# Given a list of views and/or sheets, will create a sheet set for them with the given name. If the set exists by name, it will be recreated.

viewsAndSheets = Input(viewsAndSheets: var[]..[])
name = Input(name: var[]..[])
python_script = Python(IN[0]=viewsAndSheets, IN[1]=name)  # IronPython2
# ---------- python_script.python (81 lines) ----------
# Made by Gavin Crump
# Free for use
# BIM Guru, www.bimguru.com.au

# Boilerplate text
import clr

clr.AddReference("RevitServices")
import RevitServices
from RevitServices.Persistence import DocumentManager 
from RevitServices.Transactions import TransactionManager 

clr.AddReference("RevitAPI")
import Autodesk 
from Autodesk.Revit.DB import FilteredElementCollector, ViewSheetSet, ViewSet, PrintRange

# Current doc/app/ui
doc = DocumentManager.Instance.CurrentDBDocument

# Define list/unwrap list functions
def uwlist(input):
    result = input if isinstance(input, list) else [input]
    return UnwrapElement(result)

def objOrList(input, initial = IN[0]):
	if isinstance(initial, list):
		return input
	else:
		return input[0]

# Preparing input from dynamo to revit
viewsForSet = uwlist(IN[0])
setName     = IN[1]

# Get all sets and their names
allSheetSets     = FilteredElementCollector(doc).OfClass(ViewSheetSet).WhereElementIsNotElementType().ToElements()
allSheetSetNames = [s.Name for s in allSheetSets]

# If the set exists, delete it
if setName in allSheetSetNames:
	# Do some action in a Transaction
	TransactionManager.Instance.EnsureInTransaction(doc)
	# Get and delete the old sheet set
	ind = allSheetSetNames.index(setName)
	vss = allSheetSets[ind]
	doc.Delete(vss.Id)
	# your actions
	TransactionManager.Instance.TransactionTaskDone()

# Create new sheet set
viewSet = ViewSet()
# Add each view to the set
for v in viewsForSet:
	try:
		viewSet.Insert(v)
	except:
		pass

# Set print manager to it
printManager = doc.PrintManager
printManager.PrintRange = PrintRange.Select
newSheetSet = printManager.ViewSheetSetting

# Do some action in a Transaction
TransactionManager.Instance.EnsureInTransaction(doc)
# Set print manager
newSheetSet.CurrentViewSheetSet.Views = viewSet
newSheetSet.SaveAs(setName)
# Finish transaction
TransactionManager.Instance.TransactionTaskDone()

# Get all sets and their names
allSheetSets     = FilteredElementCollector(doc).OfClass(ViewSheetSet).WhereElementIsNotElementType().ToElements()
allSheetSetNames = [s.Name for s in allSheetSets]

# Get new sheet set
ind = allSheetSetNames.index(setName)
viewSheetSet = allSheetSets[ind]

# Preparing output to Dynamo
OUT = viewSheetSet
# ----------------------------------------
viewSheetSet = Output(python_script)
