# Dynamo custom node ViewSheetSetViews.dyf "© ViewSheetSets.Views" (Dynamo 2.12.1.8246)
# category: Crumple.Revit.Other.Query
# Return all views and sheets in the view sheet set(s).

viewSheetSet = Input(viewSheetSet: var[]..[])
python_script = Python(IN[0]=viewSheetSet)  # IronPython2
# ---------- python_script.python (37 lines) ----------
# Made by Gavin Crump
# Free for use
# BIM Guru, www.bimguru.com.au

# Boilerplate text
import clr

clr.AddReference("RevitNodes")
import Revit
clr.ImportExtensions(Revit.Elements)
clr.ImportExtensions(Revit.GeometryConversion)

clr.AddReference("RevitAPI")
import Autodesk 
from Autodesk.Revit.DB import *

# Define list/unwrap list functions
def uwlist(input):
    result = input if isinstance(input, list) else [input]
    return UnwrapElement(result)

def objOrList(input):
    if isinstance(input, list) and len(input) == 1:
        return input[0]
    else:
        return input

# Preparing input from dynamo to revit
sheetSets = uwlist(IN[0])
viewsOut = []

for vss in sheetSets:
	vssViews = [v.ToDSType(True) for v in vss.Views]
	viewsOut.append(vssViews)

# Preparing output to Dynamo
OUT = objOrList(viewsOut)
# ----------------------------------------
views = Output(python_script)
