# Dynamo custom node ViewSheetSetsViews.dyf "© ViewSheetSets.Views" (Dynamo 2.12.1.8246)
# category: Crumple.Revit.Query
# Return all views and sheets in the view sheet set(s).

viewSheetSet = Input(viewSheetSet: var[]..[])
python_script = Python(IN[0]=viewSheetSet)  # CPython3
# ---------- python_script.python (28 lines) ----------
# Made by Gavin Crump
# Free for use
# BIM Guru, www.bimguru.com.au

# Boilerplate text
import clr

# Define list/unwrap list functions
def uwlist(input):
    result = input if isinstance(input, list) else [input]
    return UnwrapElement(result)

def objOrList(input, initial = IN[0]):
	if isinstance(initial, list):
		return input
	else:
		return input[0]

# Preparing input from dynamo to revit
sheetSets = uwlist(IN[0])
viewsOut = []

for vss in sheetSets:
	vssViews = [v for v in vss.Views]
	viewsOut.append(vssViews)

# Preparing output to Dynamo
OUT = objOrList(viewsOut)
# ----------------------------------------
views = Output(python_script)
