# Dynamo custom node ViewportRelatives.dyf "© ViewportRelatives" (Dynamo 2.3.0.5885)
# category: Crumple.Revit.Viewports
# For a viewport, returns the related view and sheet.

viewports = Input(viewports: var[]..[])  # A viewport or list of viewports to retrieve the data from.
python_script = Python(IN[0]=viewports)
# ---------- python_script.python (38 lines) ----------
# Made by Gavin Crump
# Free for use
# BIM Guru, www.bimguru.com.au

# Boilerplate text
import clr

clr.AddReference("RevitNodes")
import Revit
clr.ImportExtensions(Revit.Elements)

clr.AddReference("RevitServices")
import RevitServices
from RevitServices.Persistence import DocumentManager  

clr.AddReference("RevitAPI")
import Autodesk 
from Autodesk.Revit.DB import *

# Current doc/app/ui
doc = DocumentManager.Instance.CurrentDBDocument

# Preparing input from dynamo to revit
vp_d = IN[0] if isinstance(IN[0], list) else [IN[0]]
vp_r = UnwrapElement(vp_d)

# Preparing empty lists
views, sheets = [], []

# Getting viewport view and sheet
for vp in vp_r:
	view  = doc.GetElement(vp.ViewId).ToDSType(True)
	sheet = doc.GetElement(vp.SheetId).ToDSType(True)
	views.append(view)
	sheets.append(sheet)

# Preparing output to Dynamo
OUT = [views, sheets]
# ----------------------------------------
code_block = CodeBlock(lst=python_script) { views = lst[0]; sheet = lst[1]; }
view = Output(code_block.views)  # Parent view of viewport.
sheet = Output(code_block.sheet)  # Parent sheet of viewport.
