# Dynamo custom node ViewportsCreate.dyf "© Viewports.Create" (Dynamo 2.12.1.8246)
# category: Crumple.Revit.Create
# Moves views to sheets based on viewport centres. If less points than views/sheets are provided, it will use longest lacing.

views = Input(views: var[]..[])  # View/sheet count should be the same size/structure.
sheets = Input(sheets: var[]..[])  # View/sheet count should be the same size/structure.
points = Input(points: var[]..[])  # Points will match or be made to match view count.
viewportType = Input(viewportType: var = null)  # Viewport type to be used (optional).
python_script = Python(IN[0]=views, IN[1]=sheets, IN[2]=points, IN[3]=viewportType)  # CPython3
# ---------- python_script.python (109 lines) ----------
# Made by Gavin Crump
# Free for use
# BIM Guru, www.bimguru.com.au

# Boilerplate text
import clr
from System.Collections.Generic import List

clr.AddReference("RevitNodes")
import Revit
clr.ImportExtensions(Revit.Elements)
clr.ImportExtensions(Revit.GeometryConversion)

clr.AddReference("RevitServices")
import RevitServices
from RevitServices.Persistence import DocumentManager 
from RevitServices.Transactions import TransactionManager 

clr.AddReference("RevitAPI")
import Autodesk 
from Autodesk.Revit.DB import FilteredElementCollector, BasePoint, TemporaryViewMode, Viewport, ElementId, Element

# Current doc/app/ui
doc = DocumentManager.Instance.CurrentDBDocument
firstId = FilteredElementCollector(doc).OfClass(BasePoint).FirstElementId()
VIEWMODE_TEMPHIDE = TemporaryViewMode.TemporaryHideIsolate

# Function for unwrapping and forcing lists
def uwlist(input):
	tolist = input if isinstance(input, list) else [input]
	return UnwrapElement(tolist)

def tolist(input):
    result = input if isinstance(input, list) else [input]
    return result

def listpad(lst,count):
	padded = []
	length = len(lst)
	for i in range(0,count):
		if i < length:
			padded.append(lst[i])
		else:
			padded.append(lst[-1])
	return padded

def objOrList(input, initial = IN[0]):
	if isinstance(initial, list):
		return input
	else:
		return input[0]

# Preparing input from dynamo to revit
views  = uwlist(IN[0])
sheets = uwlist(IN[1])
points = listpad(tolist(IN[2]), len(views))
vpType = IN[3]

# Viewport type Id
if vpType:
	vpTypeId = UnwrapElement(vpType).Id
else:
	vpTypeId = None

# Function to create viewport
def viewportCreate(view, sheet, point, typeId = None, myDoc = doc):
	# Convert point
	pt_rvt = point.ToXyz()
	# Isolate the view for the viewport
	view.IsolateElementTemporary(firstId)
	# Place the viewport, change its type
	vp = Viewport.Create(myDoc, sheet.Id, view.Id, pt_rvt)
	if typeId != None:
		# Cpython3 workaround
		idList = List[ElementId](vp.Id)
		Element.ChangeTypeId(myDoc, idList, typeId)
	# Reset temporary isolate
	view.DisableTemporaryViewMode(VIEWMODE_TEMPHIDE)
	# Return viewport
	return vp

# Do some action in a Transaction
TransactionManager.Instance.EnsureInTransaction(doc)
 
viewports, results, outcomes = [],[],[]

for v,s,p in zip(views,sheets,points):

	isUnplaced = Viewport.CanAddViewToSheet(doc, s.Id, v.Id)
	
	if isUnplaced:
		try:
			viewport = viewportCreate(v, s, p, vpTypeId, doc)
			viewports.append(viewport)
			results.append(True)
			outcomes.append("SUCCESS: Viewport placed.")
		except:
			viewports.append(None)
			results.append(False)
			outcomes.append("FAILURE: Viewport could not be placed.")
	else:
		viewports.append(None)
		results.append(False)
		outcomes.append("ERROR: View is already placed.")

TransactionManager.Instance.TransactionTaskDone()

# Preparing output to Dynamo
OUT = [objOrList(o) for o in [viewports, results, outcomes]]
# ----------------------------------------
code_block = CodeBlock(lst=python_script) { vp = lst[0]; rp = lst[1]; oc = lst[2]; }
viewports = Output(code_block.vp)
results = Output(code_block.rp)  # A list of true/false outcomes
outcomes = Output(code_block.oc)  # Detailed messages of outcomes
