# Dynamo custom node ViewportsGetCentre.dyf "© Viewports.GetCentrePoint" (Dynamo 2.12.1.8246)
# category: Crumple.Revit.Query
# Given a viewport or list of viewports, returns their box centrepoint. The node will temporarily hide elements in the viewport view to get the true centrepoint.

viewports = Input(viewports: var[]..[])
python_script = Python(IN[0]=viewports)  # IronPython2
# ---------- python_script.python (57 lines) ----------
# Made by Gavin Crump
# Free for use
# BIM Guru, www.bimguru.com.au

# Boilerplate text
import clr

clr.AddReference("RevitNodes")
import Revit
clr.ImportExtensions(Revit.GeometryConversion)

clr.AddReference("RevitServices")
import RevitServices
from RevitServices.Persistence import DocumentManager
from RevitServices.Transactions import TransactionManager

clr.AddReference("RevitAPI")
import Autodesk 
from Autodesk.Revit.DB import FilteredElementCollector, BasePoint, SubTransaction

# Current doc/app/ui
doc = DocumentManager.Instance.CurrentDBDocument

# Define list/unwrap list functions
def uwlist(input):
    result = input if isinstance(input, list) else [input]
    return UnwrapElement(result)

def objOrList(input, initial = IN[0]):
	if isinstance(initial, list):
		return input
	else:
		return input[0]

# Preparing input from dynamo to revit
viewports = uwlist(IN[0])

# Get vp centres
firstId = FilteredElementCollector(doc).OfClass(BasePoint).FirstElementId()
vp_centres = []

TransactionManager.Instance.EnsureInTransaction(doc)
st = SubTransaction(doc)
st.Start()

for vp in viewports:
	vpView = doc.GetElement(vp.ViewId)
	vpView.IsolateElementTemporary(firstId)
	vpc = vp.GetBoxCenter()
	vp_centres.append(vpc.ToPoint())

st.RollBack()

TransactionManager.Instance.ForceCloseTransaction()

# Preparing output to Dynamo
OUT = objOrList(vp_centres)
# ----------------------------------------
centrePoints = Output(python_script)
