# Dynamo custom node ViewportsRelatives.dyf "© Viewports.Relatives" (Dynamo 2.12.1.8246)
# category: Crumple.Revit.Query
# For a viewport, returns the related view and sheet.

viewports = Input(viewports: var[]..[])  # A viewport or list of viewports to retrieve the data from.
python_script = Python(IN[0]=viewports)  # IronPython2
# ---------- python_script.python (34 lines) ----------
# Made by Gavin Crump
# Free for use
# BIM Guru, www.bimguru.com.au

# Boilerplate text
import clr

# Define list/unwrap list functions
def uwlist(input):
    result = input if isinstance(input, list) else [input]
    return UnwrapElement(result)

def objOrList(input, initial = IN[0]):
	if isinstance(initial, list):
		return input
	else:
		return input[0]

# Preparing input from dynamo to revit
viewports = uwlist(IN[0])

# Preparing empty lists
views, sheets = [], []

# Getting viewport view and sheet
for vp in viewports:
	doc = vp.Document
	view  = doc.GetElement(vp.ViewId)
	sheet = doc.GetElement(vp.SheetId)
	views.append(view)
	sheets.append(sheet)

# Preparing output to Dynamo
OUT = objOrList(views), objOrList(sheets)
# ----------------------------------------
code_block = CodeBlock(lst=python_script) { views = lst[0]; sheet = lst[1]; }
view = Output(code_block.views)  # Parent view of viewport.
sheet = Output(code_block.sheet)  # Parent sheet of viewport.
