# Dynamo custom node Views.dyf "© Collect.Views" (Dynamo 2.3.1.11775)
# category: Crumple.Revit.Query
# Returns all views in a document. Excludes system views, templates, legends and schedule instances.
# packages: Crumple 2022.2.13

docOrLink = Input(docOrLink: var[]..[] = null)  # Uses current if none provided. Accepts document or link instance.
revit_getdocument = Custom[© Revit.GetDocument](docOrLink=docOrLink)  # package Crumple; If no input is specified or an invalid one is, returns current document. If a link instance is provided, it returns the linked document. If a document is provided it will pass it through.
python_script = Python(IN[0]=revit_getdocument.document)
# ---------- python_script.python (31 lines) ----------
# Made by Gavin Crump
# Free for use
# BIM Guru, www.bimguru.com.au

# Boilerplate text
import clr

# Import RevitAPI
clr.AddReference("RevitAPI")
import Autodesk
from Autodesk.Revit.DB import *

# Get the project document.
doc = IN[0]

# Get all views
Views_doc = FilteredElementCollector(doc).OfClass(View).ToElements()

# Create empty lists
View_list = []

# Find views that aren't legends, then non-template
for v in Views_doc:
	vType = v.ViewType
	if vType == ViewType.Legend or vType == ViewType.Schedule or v.IsTemplate or vType == ViewType.DrawingSheet or v.Name == "System Browser" or v.Name == "Project View":
		pass
	else:
		View_list.append(v)

# Output cleaned view lists
OUT = View_list
# ----------------------------------------
views = Output(python_script)  # All views in the current document.
