# Dynamo custom node ViewsAncestry.dyf "© Views.Ancestry" (Dynamo 2.3.1.11775)
# category: Crumple.Revit.Query
# Returns the parent of a view, and the parent of that view, and the.... etc. Will also return if it had any parents, as well as the depth of the view's family tree.
# packages: Crumple 2022.2.13

views = Input(views: var[]..[])
docOrLink = Input(docOrLink: var[]..[] = null)  # Uses current if none provided. Accepts document or link instance.
revit_getdocument = Custom[© Revit.GetDocument](docOrLink=docOrLink)  # package Crumple; If no input is specified or an invalid one is, returns current document. If a link instance is provided, it returns the linked document. If a document is provided it will pass it through.
python_script = Python(IN[0]=views, IN[1]=revit_getdocument.document)
# ---------- python_script.python (54 lines) ----------
# Made by Gavin Crump
# Free for use
# BIM Guru, www.bimguru.com.au

# Boilerplate text
import clr

clr.AddReference("RevitAPI")
import Autodesk 
from Autodesk.Revit.DB import *

# Current doc/app/ui
doc = IN[1]

# Define list/unwrap list functions
def uwlist(input):
    result = input if isinstance(input, list) else [input]
    return UnwrapElement(result)

# Preparing input from dynamo to revit
viewlist  = uwlist(IN[0])
alltrees, alldepths, hasparents = [],[],[]

# Exhaust the lineage
for v in viewlist:
	
	breaker = 0
	checkview = v
	treedepth = 1
	viewtree  = []
	godeeper = True
	
	while godeeper and breaker < 99:
	
		breaker += 1
		
		try:
			parentId  = checkview.get_Parameter(BuiltInParameter.SECTION_PARENT_VIEW_NAME).AsElementId()
			checkview = Document.GetElement(doc, parentId)
			
			if checkview != None:
				treedepth += 1
				viewtree.append(checkview)
			else:
				godeeper = False
		except:
			godeeper = False
	
	alltrees.append(viewtree)
	alldepths.append(treedepth)
	hasparents.append(treedepth > 1)

# Preparing output to Dynamo
OUT = [alltrees, alldepths, hasparents]
# ----------------------------------------
code_block = CodeBlock(out=python_script) { out[0]; out[1]; out[2]; }
ancestry = Output(code_block.out0)
generations = Output(code_block.out1)
hasAncestry = Output(code_block.out2)
