# Dynamo custom node ViewsAndNames.dyf "© ViewsAndNames" (Dynamo 2.3.0.5885)
# category: Crumple.Revit.Selection
# Returns all views and view templates in the model, as well as their names.

code_block = CodeBlock { "Views"; }
byName = Category.ByName(name=code_block)
all_elements_of_category = ElementsOfCategory(Category=byName)
isNull = Object.IsNull(obj=all_elements_of_category)
filterByBoolMask = List.FilterByBoolMask(list=all_elements_of_category, mask=isNull)
isViewTemplate = View.IsViewTemplate(view=filterByBoolMask.out)
filterByBoolMask_2 = List.FilterByBoolMask(list=filterByBoolMask.out, mask=isViewTemplate)
viewlist = Output(filterByBoolMask_2.out)
Refresh = Input(Refresh: bool = true)  # Toggle to refresh
name = Element.Name(element=filterByBoolMask_2.out)
viewnames = Output(name)
templist = Output(filterByBoolMask_2.in)
name_2 = Element.Name(element=filterByBoolMask_2.in)
tempnames = Output(name_2)
