# Dynamo custom node ViewsApplyTemplateByName.dyf "© Views.ApplyTemplateByName" (Dynamo 2.12.1.8246)
# category: Crumple.Revit.Actions
# Given a list of views and a view template name, attempts to find and apply that template. Unlike Dynamo nodes, this process also works with 3D view templates as it runs within Python entirely.

views = Input(views: var[]..[])
templateName = Input(templateName: string = "")
python_script = Python(IN[0]=views, IN[1]=templateName)  # IronPython2
# ---------- python_script.python (81 lines) ----------
# Made by Gavin Crump
# Free for use
# BIM Guru, www.bimguru.com.au

# Boilerplate text
import clr

clr.AddReference("RevitNodes")
import Revit
clr.ImportExtensions(Revit.Elements)

clr.AddReference("RevitServices")
import RevitServices
from RevitServices.Persistence import DocumentManager
from RevitServices.Transactions import TransactionManager

clr.AddReference("RevitAPI")
import Autodesk 
from Autodesk.Revit.DB import FilteredElementCollector, View

# Current doc/app/ui
doc = DocumentManager.Instance.CurrentDBDocument

# Define list/unwrap list functions
def uwlist(input):
    result = input if isinstance(input, list) else [input]
    return UnwrapElement(result)

def objOrList(input, initial = IN[0]):
	if isinstance(initial, list):
		return input
	else:
		return input[0]

# Preparing input from dynamo to revit
views = uwlist(IN[0])
tName = IN[1]

#Get view template
views_all = FilteredElementCollector(doc).OfClass(View).ToElements()

viewTemplates, tempNames = [],[]

for v in views_all:
	if v.IsTemplate:
		viewTemplates.append(v)
		tempNames.append(v.Name)
	else:
		pass

results = []

# Start Transaction
TransactionManager.Instance.EnsureInTransaction(doc)

# Try to find template by name
try:
	i = tempNames.index(tName)
	applyTemp = viewTemplates[i]
	toApply = True
except:
	toApply = False

# Set template if able
for v in views:
	if toApply:
		try:
			doc.Regenerate()
			v.ViewTemplateId = applyTemp.Id
			doc.Regenerate()
			results.append(True)
		except:
			results.append(False)
	else:
		results.append(False)

# End Transaction
TransactionManager.Instance.TransactionTaskDone()

# Preparing output to Dynamo
OUT = objOrList(views), objOrList(results), toApply
# ----------------------------------------
code_block = CodeBlock(x=python_script) { x[0]; x[1]; x[2]; }
views_2 = Output(code_block.out0)  # "views"
success = Output(code_block.out1)
templateFound = Output(code_block.out2)
