# Dynamo custom node ViewsCreateDependents.dyf "© Views.CreateDependents" (Dynamo 2.12.1.8246)
# category: Crumple.Revit.Create
# Given a list of names and a view, will generate a set of dependent views upon that view with those names.

views = Input(views: var[]..[])
dependentNames = Input(dependentNames: var[]..[])
python_script = Python(IN[0]=views, IN[1]=dependentNames)  # IronPython2
# ---------- python_script.python (85 lines) ----------
# Made by Gavin Crump
# Free for use
# BIM Guru, www.bimguru.com.au

# Boilerplate text
import clr


clr.AddReference("RevitServices")
import RevitServices
from RevitServices.Persistence import DocumentManager 
from RevitServices.Transactions import TransactionManager 

clr.AddReference("RevitAPI")
import Autodesk 
from Autodesk.Revit.DB import ViewDuplicateOption

# Current doc/app/ui
doc = DocumentManager.Instance.CurrentDBDocument

# Define list/unwrap list functions
def tolist(input):
    result = input if isinstance(input, list) else [input]
    return result

def uwlist(input):
    result = input if isinstance(input, list) else [input]
    return UnwrapElement(result)

def objOrList(input, initial = IN[0]):
	if isinstance(initial, list):
		return input
	else:
		return input[0]

# Preparing input from dynamo to revit
views  = uwlist(IN[0])
names  = tolist(IN[1])

viewLists, results, outcomes = [],[],[]

# Do some action in a Transaction
TransactionManager.Instance.EnsureInTransaction(doc)

# For each view...
for v in views:
	# List so build
	viewList, result, outcome = [],[],[]
	# For each name...
	for n in names:
		# Try to duplicate as dependent
		try:
			newViewId = v.Duplicate(ViewDuplicateOption.AsDependent)
			newView = doc.GetElement(newViewId)
			viewMade = True
		# Otherwise, failure
		except:
			viewList.append(None)
			result.append(False)
			outcome.append("FAILURE: View cannot be created.")
			viewMade = False
		# If a view was made...
		if viewMade:
			# Try to rename it
			try:
				newView.Name = n
				viewList.append(newView)
				result.append(True)
				outcome.append("SUCCESS: No errors found.")
			# Otherwise, delete it
			except:
				id = newView.Id
				doc.Delete(id)
				viewList.append(None)
				result.append(False)
				outcome.append("ERROR: View name already exists.")
	# Append the lists
	viewLists.append(viewList)
	results.append(result)
	outcomes.append(outcome)
	
TransactionManager.Instance.TransactionTaskDone()

# Preparing output to Dynamo
OUT = [objOrList(o) for o in [viewLists, results, outcomes]]
# ----------------------------------------
code_block = CodeBlock(x=python_script) { x[0]; x[1]; x[2]; }
dependentViews = Output(code_block.out0)
wasCreated = Output(code_block.out1)
outcomes = Output(code_block.out2)
