# Dynamo custom node ViewsCreateElevationBodies.dyf "© Views.CreateElevationBodies" (Dynamo 2.12.1.8246)
# category: Crumple.Revit.Create
# Given a list of points and an elevation view type, will create elevation bodies (without markers) at those points.

points = Input(points: var[]..[])
viewType = Input(viewType: var)
initialScale = Input(initialScale: int = 50)  # The scale to use in 1:X ratio
python_script = Python(IN[0]=points, IN[1]=viewType, IN[2]=initialScale)  # IronPython2
# ---------- python_script.python (55 lines) ----------
# Made by Gavin Crump
# Free for use
# BIM Guru, www.bimguru.com.au

# Boilerplate text
import clr

clr.AddReference("RevitNodes")
import Revit
clr.ImportExtensions(Revit.Elements)
clr.ImportExtensions(Revit.GeometryConversion)

clr.AddReference("RevitServices")
import RevitServices
from RevitServices.Persistence import DocumentManager 
from RevitServices.Transactions import TransactionManager 

clr.AddReference("RevitAPI")
import Autodesk 
from Autodesk.Revit.DB import ElevationMarker

# Current doc/app/ui
doc = DocumentManager.Instance.CurrentDBDocument

# Define list/unwrap list functions
def uwlist(input):
    result = input if isinstance(input, list) else [input]
    return UnwrapElement(result)

def objOrList(input, initial = IN[0]):
	if isinstance(initial, list):
		return input
	else:
		return input[0]

# Preparing input from dynamo to revit
elev_pts = uwlist(IN[0])
vtype    = UnwrapElement(IN[1])
vTypeId  = vtype.Id
scale    = IN[2]

# Make elevation markers
markers = []

TransactionManager.Instance.EnsureInTransaction(doc)

for p in elev_pts:
	elePt = p.ToXyz()
	eleMarker = ElevationMarker.CreateElevationMarker(doc, vTypeId, elePt, scale)
	markers.append(eleMarker)

TransactionManager.Instance.TransactionTaskDone()

# Preparing output to Dynamo
OUT = objOrList(markers)
# ----------------------------------------
elevationMarkers = Output(python_script)
