# Dynamo custom node ViewsCreateElevationBody.dyf "© Views.CreateElevationBody" (Dynamo 2.3.1.11775)
# category: Crumple.Revit.Create
# Given a list of points and an elevation view type, will create elevation bodies (without markers) at those points.

point = Input(point: var[]..[])
viewType = Input(viewType: var = None)
python_script = Python(IN[0]=point, IN[1]=viewType)
# ---------- python_script.python (48 lines) ----------
# Made by Gavin Crump
# Free for use
# BIM Guru, www.bimguru.com.au

# Boilerplate text
import clr

clr.AddReference("RevitNodes")
import Revit
clr.ImportExtensions(Revit.Elements)
clr.ImportExtensions(Revit.GeometryConversion)

clr.AddReference("RevitServices")
import RevitServices
from RevitServices.Persistence import DocumentManager 
from RevitServices.Transactions import TransactionManager 

clr.AddReference("RevitAPI")
import Autodesk 
from Autodesk.Revit.DB import *

# Current doc/app/ui
doc = DocumentManager.Instance.CurrentDBDocument

# Define list/unwrap list functions
def uwlist(input):
    result = input if isinstance(input, list) else [input]
    return UnwrapElement(result)

# Preparing input from dynamo to revit
elev_pts = uwlist(IN[0])
vtype = UnwrapElement(IN[1])

# Make elevation markers
markers = []

TransactionManager.Instance.EnsureInTransaction(doc)

for p in elev_pts:
	elePt = p.ToXyz()
	eleMarker = ElevationMarker.CreateElevationMarker(doc, vtype.Id, elePt, 100)
	rvtMarker = eleMarker.ToDSType(True)
	markers.append(rvtMarker)

TransactionManager.Instance.TransactionTaskDone()

# Preparing output to Dynamo
OUT = markers
# ----------------------------------------
elevationBody = Output(python_script)
