# Dynamo custom node ViewsCreateElevationViews.dyf "© Views.CreateElevationViews" (Dynamo 2.12.1.8246)
# category: Crumple.Revit.Create
# Given elevation bodies and a list or list of lists of indices between 0 and 3, will activate those markers on that body.
# packages: Crumple 2024.3.1

elevationMarkers = Input(elevationMarkers: var[]..[])
indices = Input(indices: var[]..[] = [3, 0, 1, 2])  # Indices to add elevation views to. Can be a list or list of lists, the node will match the structure for you if not the same length. Indices are as follows: 3 = Up 0 = Right 1 = Down 2 = Left
list_graftbyprimary = Custom[© List.GraftByPrimary](primary=elevationMarkers, listA=indices)  # package Crumple; Given a first input, the node will assess how many items it contains (if one, it will make it a list of 1 item). Remaining branches will be forced into a list of lists, where the last branch will be repeated to a longest length as the first list (if one list or item is provided, it will repeat as the list of lists).
python_script = Python(IN[0]=elevationMarkers, IN[1]=list_graftbyprimary.primary, IN[2]=list_graftbyprimary.listA)  # CPython3
# ---------- python_script.python (68 lines) ----------
# Made by Gavin Crump
# Free for use
# BIM Guru, www.bimguru.com.au

# Boilerplate text
import clr

clr.AddReference("RevitServices")
import RevitServices
from RevitServices.Persistence import DocumentManager 
from RevitServices.Transactions import TransactionManager

clr.AddReference("RevitAPI")
import Autodesk 
from Autodesk.Revit.DB import FilteredElementCollector, ViewPlan

# Current doc/app/ui
doc = DocumentManager.Instance.CurrentDBDocument

curViewId = FilteredElementCollector(doc).WhereElementIsNotElementType().OfClass(ViewPlan).FirstElementId()

# Define list/unwrap list functions
def objOrList(input, initial = IN[0]):
	if isinstance(initial, list):
		return input
	else:
		return input[0]

# Preparing input from dynamo to revit
elev_bodies  = UnwrapElement(IN[1])
elev_indices = IN[2]

# List to append
elevations_list, results, outcomes = [],[],[]

# Start a transaction
TransactionManager.Instance.EnsureInTransaction(doc)

for eb, inds in zip(elev_bodies, elev_indices):
	# Lists
	elevations, result, outcome = [],[],[]
	# For each index...
	for i in inds:
		# If it is available...
		if eb.IsAvailableIndex(i):
			# Try to make elevation
			try:
				elevationView = eb.CreateElevation(doc, curViewId, i)
				elevations.append(elevationView)
				result.append(True)
				outcome.append("SUCCESS: Elevation added.")
			except:
				elevations.append(None)
				result.append(False)
				outcome.append("FAILURE: View not added.")
		else:
			elevations.append(None)
			result.append(False)
			outcome.append("ERROR: Index is not available.")
	# Append outcomes
	elevations_list.append(elevations)
	results.append(result)
	outcomes.append(outcome)

TransactionManager.Instance.TransactionTaskDone()

# Preparing output to Dynamo
OUT = [objOrList(o) for o in [elevations_list, results, outcomes]]
# ----------------------------------------
code_block = CodeBlock(x=python_script) { x[0]; x[1]; x[2]; }
elevationViews = Output(code_block.out0)
results = Output(code_block.out1)
outcomes = Output(code_block.out2)
