# Dynamo custom node ViewsCreatePlans.dyf "© Views.CreatePlans" (Dynamo 2.12.1.8246)
# category: Crumple.Revit.Create
# Given an even list of levels and names and a view type, this node will create new plan views for those levels and attempt to rename them if a name is available. You can automate the application of view templates by assigning them to the view types in Revit as well. If you feed in a ceiling plan type, it will make a ceiling plan due to how the ViewPlan API works.

levels = Input(levels: var[]..[])
names = Input(names: var[]..[])
viewType = Input(viewType: var[]..[])
python_script = Python(IN[0]=levels, IN[1]=names, IN[2]=viewType)  # IronPython2
# ---------- python_script.python (65 lines) ----------
# Made by Gavin Crump
# Free for use
# BIM Guru, www.bimguru.com.au

# Boilerplate text
import clr

clr.AddReference("RevitServices")
import RevitServices
from RevitServices.Persistence import DocumentManager 
from RevitServices.Transactions import TransactionManager 

clr.AddReference("RevitAPI")
import Autodesk 
from Autodesk.Revit.DB import ViewPlan

# Current doc/app/ui
doc = DocumentManager.Instance.CurrentDBDocument

# Define list/unwrap list functions
def tolist(input):
    result = input if isinstance(input, list) else [input]
    return result

def uwlist(input):
    result = input if isinstance(input, list) else [input]
    return UnwrapElement(result)

def objOrList(input, initial = IN[0]):
	if isinstance(initial, list):
		return input
	else:
		return input[0]

# Preparing input from dynamo to revit
levels = uwlist(IN[0])
names  = tolist(IN[1])
vtype  = UnwrapElement(IN[2])
vtypeId = vtype.Id

views, result, outcome = [],[],[]

# Do some action in a Transaction
TransactionManager.Instance.EnsureInTransaction(doc)

# For each level and name...
for l, n in zip(levels, names):
	# Make a new plan
	view = ViewPlan.Create(doc, vtypeId, l.Id)
	# Try to rename it
	try:
		view.Name = n
		views.append(view)
		result.append(True)
		outcome.append("SUCCESS: View created.")
	except:
		doc.Delete(view.Id)
		views.append(None)
		result.append(False)
		outcome.append("ERROR: Name is not unique.")

TransactionManager.Instance.TransactionTaskDone()

# Preparing output to Dynamo
OUT = [objOrList(o) for o in [views, result, outcome]]
# ----------------------------------------
code_block = CodeBlock(x=python_script) { x[0]; x[1]; x[2]; }
planViews = Output(code_block.out0)
results = Output(code_block.out1)
outcomes = Output(code_block.out2)
