# Dynamo custom node ViewsDependents.dyf "© Views.Dependents" (Dynamo 2.3.1.11775)
# category: Crumple.Revit.Query
# For a view, returns any dependent views it has as well as whether it has any.

views = Input(views: var[]..[])
python_script = Python(IN[0]=views)
# ---------- python_script.python (35 lines) ----------
# Boilerplate text
import clr

clr.AddReference("RevitServices")
import RevitServices
from RevitServices.Persistence import DocumentManager 

clr.AddReference("RevitAPI")
import Autodesk 
from Autodesk.Revit.DB import *

# Current doc/app/ui
doc = DocumentManager.Instance.CurrentDBDocument

# Define list/unwrap list functions
def uwlist(input):
    result = input if isinstance(input, list) else [input]
    return UnwrapElement(result)

# Preparing input from dynamo to revit
viewlist = uwlist(IN[0])
childlist,haschildren = [],[]

# Do some action in a Transaction
for v in viewlist:
	childIds = v.GetDependentViewIds()
	children = []
	for i in childIds:
		vc = Document.GetElement(doc, i)
		children.append(vc)
	childlist.append(children)
	haschildren.append(len(children) > 0)

# Preparing output to Dynamo
OUT = [childlist, haschildren]
# ----------------------------------------
code_block = CodeBlock(x=python_script) { x[0]; x[1]; }
dependentViews = Output(code_block.out0)
hasDependents = Output(code_block.out1)
