# Dynamo custom node ViewsGetCropBox.dyf "© Views.GetCropBox" (Dynamo 2.12.1.8246)
# category: Crumple.Revit.Actions
# Returns the curves of a view's cropbox (even if not visible/active). Also returns whether the cropbox is currently visible and active as booleans.

views = Input(views: var[]..[])  # Views to retrieve the crop boxes of.
python_script = Python(IN[0]=views)  # IronPython2
# ---------- python_script.python (45 lines) ----------
# Made by Gavin Crump
# Free for use
# BIM Guru, www.bimguru.com.au

# Boilerplate text
import clr

clr.AddReference('ProtoGeometry')
from Autodesk.DesignScript.Geometry import *

clr.AddReference("RevitNodes")
import Revit
clr.ImportExtensions(Revit.Elements)
clr.ImportExtensions(Revit.GeometryConversion)

# Define list/unwrap list functions
def uwlist(input):
    result = input if isinstance(input, list) else [input]
    return UnwrapElement(result)

def objOrList(input, initial = IN[0]):
	if isinstance(initial, list):
		return input
	else:
		return input[0]

# Preparing input from dynamo to revit
views = uwlist(IN[0])

# Preparing empty lists
crops, active, visible = [],[],[]

# Getting view level
for v in views:
	active.append(v.CropBoxActive)
	visible.append(v.CropBoxVisible)
	crop = v.GetCropRegionShapeManager().GetCropShape()
	if len(crop) > 0:
		edges = [c.ToProtoType() for c in crop[0]]
		crops.append(edges)
	else:
		crops.append(None)
		
# Preparing output to Dynamo
OUT = [objOrList(o) for o in [crops, active, visible]]
# ----------------------------------------
code_block = CodeBlock(lst=python_script) { cbxs = lst[0]; cbac = lst[1]; cbvs = lst[2]; }
curves = Output(code_block.cbxs)  # The Dynamo curves of the view's crop box.
active = Output(code_block.cbac)  # Is the crop box active.
visible = Output(code_block.cbvs)  # Is the crop box visible.
