# Dynamo custom node ViewsInSheetSet.dyf "© Sheetsets.Views" (Dynamo 2.3.0.5885)
# category: Crumple.Revit.Other.Query
# Given a sheet set, returns all views and sheets combined as well as separated.

sheetSets = Input(sheetSets: var[]..[])
python_script = Python(IN[0]=sheetSets)
# ---------- python_script.python (46 lines) ----------
# Made by Gavin Crump
# Free for use
# BIM Guru, www.bimguru.com.au

# Boilerplate text
import clr

clr.AddReference("RevitNodes")
import Revit
clr.ImportExtensions(Revit.Elements)

clr.AddReference("RevitAPI")
import Autodesk 
from Autodesk.Revit.DB import *

# Define list/unwrap list functions
def uwlist(input):
    result = input if isinstance(input, list) else [input]
    return UnwrapElement(result)

# Preparing input from dynamo to revit
sheetsets = uwlist(IN[0])
allsetviews, allsheets, allviews = [],[],[]

# Do some action in a Transaction
for set in sheetsets:

	setall, setsheets, setviews = [],[],[]
	
	for v in set.Views:
		
		dsview = v.ToDSType(True)
		
		setall.append(dsview)
		
		if hasattr(v, "SheetNumber"):
			setsheets.append(dsview)
		else:
			setviews.append(dsview)
			
	allsetviews.append(setall)
	allsheets.append(setsheets)
	allviews.append(setviews)

# Preparing output to Dynamo
OUT = [allsetviews, allsheets, allviews]
# ----------------------------------------
code_block = CodeBlock(out=python_script) { out[0]; out[1]; out[2]; }
all = Output(code_block.out0)
sheetsOnly = Output(code_block.out1)
viewsOnly = Output(code_block.out2)
