# Dynamo custom node ViewsLevel.dyf "© Views.Level" (Dynamo 2.12.1.8246)
# category: Crumple.Revit.Query
# Returns the associated level of a view (if it has one), as well as a boolean mask to remove views without levels after.

views = Input(views: var[]..[])  # View or list of views to return the level of.
python_script = Python(IN[0]=views)  # IronPython2
# ---------- python_script.python (40 lines) ----------
# Made by Gavin Crump
# Free for use
# BIM Guru, www.bimguru.com.au

# Boilerplate text
import clr

clr.AddReference("RevitAPI")
import Autodesk 
from Autodesk.Revit.DB import *

# Define list/unwrap list functions
def uwlist(input):
    result = input if isinstance(input, list) else [input]
    return UnwrapElement(result)

def objOrList(input, initial = IN[0]):
	if isinstance(initial, list):
		return input
	else:
		return input[0]

# Preparing input from dynamo to revit
views = uwlist(IN[0])

# Preparing empty lists
levels, bools = [], []

# Getting view level
for v in views:
	lvl  = v.GenLevel
	if lvl:
		levels.append(lvl)
		bools.append(True)
	else:
		levels.append(None)
		bools.append(False)

# Preparing output to Dynamo
OUT = objOrList(levels), objOrList(bools)
# ----------------------------------------
code_block = CodeBlock(lst=python_script) { lvls = lst[0]; bols = lst[1]; }
levels = Output(code_block.lvls)  # Levels of the views.
hasLevel = Output(code_block.bols)  # Does the view have a level.
