# Dynamo custom node ViewsOverrideCrop.dyf "© Views.OverrideCrop" (Dynamo 2.12.1.8246)
# category: Crumple.Revit.Actions
# Overrides the crop boundary of provided views to a given thickness. Note that this only works for elevation views due to Revit limitations.

views = Input(views: var[]..[])
weight = Input(weight: int = 5)
python_script = Python(IN[0]=views, IN[1]=weight)  # CPython3
# ---------- python_script.python (52 lines) ----------
# Made by Gavin Crump
# Free for use
# BIM Guru, www.bimguru.com.au

# Boilerplate text
import clr

clr.AddReference("RevitServices")
import RevitServices
from RevitServices.Persistence import DocumentManager 
from RevitServices.Transactions import TransactionManager 

clr.AddReference("RevitAPI")
import Autodesk 
from Autodesk.Revit.DB import OverrideGraphicSettings, View, ElementId

# Current doc/app/ui
doc = DocumentManager.Instance.CurrentDBDocument

# Define list/unwrap list functions
def uwlist(input):
    result = input if isinstance(input, list) else [input]
    return UnwrapElement(result)

def objOrList(input, initial = IN[0]):
	if isinstance(initial, list):
		return input
	else:
		return input[0]

# Preparing input from dynamo to revit
views = uwlist(IN[0])
thickness = IN[1]

settings = OverrideGraphicSettings().SetProjectionLineWeight(thickness)
outcomes = []

# Do some action in a Transaction
TransactionManager.Instance.EnsureInTransaction(doc)

for v in views:
	cropBoxId = ElementId(v.Id.IntegerValue - 1)
	try:
		v.SetElementOverrides(cropBoxId, settings)
		outcomes.append(True)
	except:
		outcomes.append(False)

TransactionManager.Instance.TransactionTaskDone()

# Preparing output to Dynamo
OUT = objOrList(outcomes)
# ----------------------------------------
overridden = Output(python_script)
