# Dynamo custom node ViewsParent.dyf "© Views.Parent" (Dynamo 2.3.1.11775)
# category: Crumple.Revit.Query
# For a view, return it's next related parent view if any. Will only retrieve one level above (even if it's parent has a parent etc.).
# packages: Crumple 2022.2.13

views = Input(views: var[]..[])
docOrLink = Input(docOrLink: var[]..[] = null)  # Uses current if none provided. Accepts document or link instance.
revit_getdocument = Custom[© Revit.GetDocument](docOrLink=docOrLink)  # package Crumple; If no input is specified or an invalid one is, returns current document. If a link instance is provided, it returns the linked document. If a document is provided it will pass it through.
python_script = Python(IN[0]=views, IN[1]=revit_getdocument.document)
# ---------- python_script.python (36 lines) ----------
# Boilerplate text
import clr

clr.AddReference("RevitAPI")
import Autodesk 
from Autodesk.Revit.DB import *

# Current doc/app/ui
doc = IN[1]

# Define list/unwrap list functions
def uwlist(input):
    result = input if isinstance(input, list) else [input]
    return UnwrapElement(result)

# Preparing input from dynamo to revit
viewlist  = uwlist(IN[0])
parentlist, hasparent, onlyparents = [],[],[]

# Do some action in a Transaction
for v in viewlist:
	try:
		parentId = v.get_Parameter(BuiltInParameter.SECTION_PARENT_VIEW_NAME).AsElementId()
		parentEl = Document.GetElement(doc, parentId)
		parentlist.append(parentEl)
		if parentEl != None:
			onlyparents.append(parentEl)
			hasparent.append(True)
		else:
			hasparent.append(False)
	except:
		parentlist.append(None)
		hasparent.append(False)

# Preparing output to Dynamo
OUT = [parentlist, hasparent, onlyparents]
# ----------------------------------------
code_block = CodeBlock(x=python_script) { x[0]; x[1]; x[2]; }
parentView = Output(code_block.out0)
hasParent = Output(code_block.out1)
onlyParents = Output(code_block.out2)
