# Dynamo custom node ViewsPhase.dyf "© Views.Phase" (Dynamo 2.12.1.8246)
# category: Crumple.Revit.Query
# Given a view or list of views, returns the phases applied to those views as elements.

views = Input(views: var[]..[])
python_script = Python(IN[0]=views)  # IronPython2
# ---------- python_script.python (40 lines) ----------
# Made by Gavin Crump
# Free for use
# BIM Guru, www.bimguru.com.au

# Boilerplate text
import clr

clr.AddReference("RevitAPI")
import Autodesk 
from Autodesk.Revit.DB import *

# Define list/unwrap list functions
def uwlist(input):
    result = input if isinstance(input, list) else [input]
    return UnwrapElement(result)

def objOrList(input, initial = IN[0]):
	if isinstance(initial, list):
		return input
	else:
		return input[0]

# Preparing input from dynamo to revit
views = uwlist(IN[0])

BIP_PHASE = BuiltInParameter.VIEW_PHASE
phases = []

# Do some action in a Transaction
for v in views:
	doc = v.Document
	try:
		phaseid = v.get_Parameter(BIP_PHASE).AsElementId()
		phase   = doc.GetElement(phaseid)
	except:
		phase = None
	phases.append(phase)

# Preparing output to Dynamo
OUT = objOrList(phases)
# ----------------------------------------
phase = Output(python_script)
