# Dynamo custom node ViewsPrimary.dyf "© Views.Primary" (Dynamo 2.12.1.8246)
# category: Crumple.Revit.Query
# For a dependent view, return it's primary view, as well as if it has one.

view = Input(view: var[]..[])
python_script = Python(IN[0]=view)  # CPython3
# ---------- python_script.python (33 lines) ----------
# Made by Gavin Crump
# Free for use
# BIM Guru, www.bimguru.com.au

# Boilerplate text
import clr

# Define list function
def uwlist(input):
    result = input if isinstance(input, list) else [input]
    return UnwrapElement(result)

def objOrList(input, initial = IN[0]):
	if isinstance(initial, list):
		return input
	else:
		return input[0]

# Preparing input from dynamo to revit
viewlist = uwlist(IN[0])
parentlist,hasparent = [],[]

# Find the parents
for v in viewlist:
	parent = v.Document.GetElement(v.GetPrimaryViewId())
	parentlist.append(parent)
	if parent == None:
		hasparent.append(False)
	else:
		hasparent.append(True)

# Preparing output to Dynamo
OUT = objOrList(parentlist), objOrList(hasparent)
# ----------------------------------------
code_block = CodeBlock(x=python_script) { x[0]; x[1]; }
primaryView = Output(code_block.out0)
hasPrimary = Output(code_block.out1)
