# Dynamo custom node ViewsRemoveViewTemplate.dyf "© Views.RemoveViewTemplate" (Dynamo 2.16.2.5624)
# category: Crumple.Revit.Actions
# Removes any view templates assigned to the provided views.

views = Input(views: var[]..[])
python_script = Python(IN[0]=views)  # CPython3
# ---------- python_script.python (52 lines) ----------
# Made by Gavin Crump
# Free for use
# BIM Guru, www.bimguru.com.au

# Boilerplate text
import clr

clr.AddReference("RevitServices")
import RevitServices
from RevitServices.Persistence import DocumentManager 
from RevitServices.Transactions import TransactionManager 

clr.AddReference("RevitAPI")
import Autodesk 
from Autodesk.Revit.DB import ElementId

# Current doc/app/ui
doc = DocumentManager.Instance.CurrentDBDocument

# Define list/unwrap list functions
def uwlist(input):
    result = input if isinstance(input, list) else [input]
    return UnwrapElement(result)

def objOrList(input):
    if isinstance(input, list) and len(input) == 1:
        return input[0]
    else:
        return input

# Preparing input from dynamo to revit
views = uwlist(IN[0])

# Do some action in a Transaction
removed = []

TransactionManager.Instance.EnsureInTransaction(doc)

for v in views:
    if v.ViewTemplateId == ElementId.InvalidElementId:
        removed.append(True)
    else:
        try:
            v.ViewTemplateId = ElementId.InvalidElementId
            removed.append(True)
        except:
            removed.append(False)

TransactionManager.Instance.TransactionTaskDone()

# Preparing output to Dynamo
OUT = objOrList(removed)
# ----------------------------------------
success = Output(python_script)
