# Dynamo custom node ViewsSectionBox.dyf "© Views.SectionBox" (Dynamo 2.12.1.8246)
# category: Crumple.Revit.Actions
# Returns the section box of any view as a bounding box in Dynamo. Does not support section boxes with rotations applied to them (will return the original section box before rotation), and will actually return a bounding box even if a view doesn't have one applied. Use with care!

views = Input(views: var[]..[])
python_script = Python(IN[0]=views)  # IronPython2
# ---------- python_script.python (74 lines) ----------
# Made by Gavin Crump
# Credit to Amy Williams for sharing a majority of this code
# https://forum.dynamobim.com/t/bounding-box-of-section-box-min-max-pts-z-values-dont-correspond-with-model-elevation/15776
# Free for use
# BIM Guru, www.bimguru.com.au

# Boilerplate text
import clr

clr.AddReference("RevitNodes")
import Revit
clr.ImportExtensions(Revit.Elements)
clr.ImportExtensions(Revit.GeometryConversion)

clr.AddReference("RevitServices")
import RevitServices
from RevitServices.Persistence import DocumentManager 
from RevitServices.Transactions import TransactionManager 

clr.AddReference("RevitAPI")
import Autodesk 
from Autodesk.Revit.DB import BoundingBoxXYZ, XYZ

# Current doc/app/ui
doc = DocumentManager.Instance.CurrentDBDocument

# Define list/unwrap list functions
def uwlist(input):
    result = input if isinstance(input, list) else [input]
    return UnwrapElement(result)

def objOrList(input, initial = IN[0]):
	if isinstance(initial, list):
		return input
	else:
		return input[0]

# Preparing input from dynamo to revit
viewlist = uwlist(IN[0])
boxlist, result = [], []

# Get section boxes
TransactionManager.Instance.EnsureInTransaction(doc)

for view in viewlist:
	try:
		sectionbox = view.GetSectionBox()
		proceed = True
	except:
		proceed = False
	if proceed:
		transform = sectionbox.Transform
		sboxoriginx = transform.Origin.X
		sboxoriginy = transform.Origin.Y
		sboxoriginz = transform.Origin.Z
		minx = sectionbox.Min.X + sboxoriginx
		maxx = sectionbox.Max.X + sboxoriginx
		miny = sectionbox.Min.Y + sboxoriginy
		maxy = sectionbox.Max.Y + sboxoriginy
		minz = sectionbox.Min.Z + sboxoriginz
		maxz = sectionbox.Max.Z + sboxoriginz
		bbox = BoundingBoxXYZ()
		bbox.Min = XYZ((minx), (miny), (minz))
		bbox.Max = XYZ((maxx), (maxy), (maxz))
		tsectionbox = bbox.ToProtoType()
		boxlist.append(tsectionbox)
	else:
		boxlist.append(None)
	result.append(proceed)

TransactionManager.Instance.TransactionTaskDone()

# Send bounding boxes back
OUT = objOrList(boxlist), objOrList(result)
# ----------------------------------------
code_block = CodeBlock(out=python_script) { boxes  = out[0]; result = out[1]; }
boundingBox = Output(code_block.boxes)
hasBox = Output(code_block.result)
