# Dynamo custom node ViewsSetCropBox.dyf "© Views.SetCropBox" (Dynamo 2.12.1.8246)
# category: Crumple.Revit.Actions
# Given a view and one polycurve, sets the boundary of that views crop to the curves of that polycurve. Will not accept multiple polycurves or a list of curves.

views = Input(views: var[]..[])
polyCurves = Input(polyCurves: var[]..[])
showCrop = Input(showCrop: bool = false)
python_script = Python(IN[0]=views, IN[1]=polyCurves, IN[2]=showCrop)  # CPython3
# ---------- python_script.python (77 lines) ----------
# Made by Gavin Crump
# Free for use
# BIM Guru, www.bimguru.com.au

# Boilerplate text
import clr

clr.AddReference('ProtoGeometry')
from Autodesk.DesignScript.Geometry import *

clr.AddReference("RevitNodes")
import Revit
clr.ImportExtensions(Revit.Elements)
clr.ImportExtensions(Revit.GeometryConversion)

clr.AddReference("RevitServices")
import RevitServices
from RevitServices.Persistence import DocumentManager 
from RevitServices.Transactions import TransactionManager 

clr.AddReference("RevitAPI")
import Autodesk 
from Autodesk.Revit.DB import CurveLoop

# Current doc/app/ui
doc = DocumentManager.Instance.CurrentDBDocument

# Define list/unwrap list functions
def tolist(input):
    result = input if isinstance(input, list) else [input]
    return result

def uwlist(input):
    result = input if isinstance(input, list) else [input]
    return UnwrapElement(result)

def objOrList(input, initial = IN[0]):
	if isinstance(initial, list):
		return input
	else:
		return input[0]

# Preparing input from dynamo to revit
views   = uwlist(IN[0])
pcurves = tolist(IN[1])
visible = IN[2]

results, viewout = [],[]

# Deconstruct curves and set the view crops
for v,pc in zip(views,pcurves):

	regionManager = v.GetCropRegionShapeManager()
	
	curves_pc = PolyCurve.Curves(pc)
	curves_rv = [c.ToRevitType() for c in curves_pc]
	
	curveloop = CurveLoop()
	for c in curves_rv:
		curveloop.Append(c)

	TransactionManager.Instance.EnsureInTransaction(doc)
	try:
		v.CropBoxVisible = visible
		if v.CropBoxActive == False:
			v.CropBoxActive  = True
		regionManager.SetCropShape(curveloop)
		results.append(True)
	except:
	   results.append(False)
	
	TransactionManager.Instance.TransactionTaskDone()
	
	viewout.append(v)

# Preparing output to Dynamo
OUT = objOrList(viewout),objOrList(results)
# ----------------------------------------
code_block = CodeBlock(x=python_script) { x[0]; x[1]; }
views_2 = Output(code_block.out0)  # "views"
wasSet = Output(code_block.out1)
