# Dynamo custom node ViewsSetSunSettings.dyf "🐍 Views.SetSunSettings" (Dynamo 2.12.1.8246)
# category: Crumple.IronPython.Actions
# Given a list of views, apply a datetime and shadow intensity setting to their sun settings (still). You will need to update the shadows on/off setting manually or via a view template.

views = Input(views: var[]..[])  # Provide a view or list of views
dateTimes = Input(dateTimes: var[]..[])  # Provide a datetime or list of them. Should be same length as views.
intensity = Input(intensity: int = 100)  # Sets shadow intensity. Provide a number between 0 and 100.
groundPlane = Input(groundPlane: Revit.Elements.Level = null)  # Provide a view or list of views
isNull = Object.IsNull(object=groundPlane)
python_script = Python(IN[0]=views, IN[1]=dateTimes, IN[2]=intensity, IN[3]=groundPlane, IN[4]=isNull)  # IronPython2
# ---------- python_script.python (82 lines) ----------
# Made by Gavin Crump
# Free for use
# BIM Guru, www.bimguru.com.au

# Credit to Matthew Anderle & Chris Williams for their examples
# DTx Library: https://trello.com/c/mOujiMPA/39-slider-sun-settings

# Boilerplate text
import clr

import System

clr.AddReference("RevitNodes")
import Revit
clr.ImportExtensions(Revit.Elements)
clr.ImportExtensions(Revit.GeometryConversion)

clr.AddReference("RevitServices")
import RevitServices
from RevitServices.Persistence import DocumentManager 
from RevitServices.Transactions import TransactionManager 

clr.AddReference("RevitAPI")
import Autodesk 
from Autodesk.Revit.DB import SunAndShadowType

# Current doc/app/ui
doc = DocumentManager.Instance.CurrentDBDocument

# Define list/unwrap list functions
def tolist(input):
    result = input if isinstance(input, list) else [input]
    return result

def uwlist(input):
    result = input if isinstance(input, list) else [input]
    return UnwrapElement(result)

def objOrList(input, initial = IN[0]):
	if isinstance(initial, list):
		return input
	else:
		return input[0]

# Preparing input from dynamo to revit
views = uwlist(IN[0])
times = tolist(IN[1])
shade = IN[2]
level = UnwrapElement(IN[3])
no_gp = IN[4]

# Datetimes set as local
DT_kind = System.DateTimeKind.Local

# Rebuild datetimes list
DT_times = []

for time in times:
	spectime = System.DateTime.SpecifyKind(time, DT_kind)
	DT_times.append(spectime)

# Do some action in a Transaction
TransactionManager.Instance.EnsureInTransaction(doc)

# Transactable actions
for view, time in zip(views, DT_times):
	settings = view.SunAndShadowSettings
	view.ShadowIntensity = 1
	settings.SunAndShadowType = SunAndShadowType.StillImage
	settings.StartDateAndTime = time
	view.ShadowIntensity = shade
	if no_gp:
		settings.UsesGroundPlane = False
	else:
		settings.UsesGroundPlane = True
		settings.GroundPlaneLevelId = level.Id

# Do some action in a Transaction
TransactionManager.Instance.TransactionTaskDone()

# Preparing output to Dynamo
OUT = objOrList(views), objOrList(DT_times)
# ----------------------------------------
code_block = CodeBlock(lst=python_script) { views = lst[0]; dates = lst[1]; }
views_2 = Output(code_block.views)  # "views"; Views updated
dateTimes_2 = Output(code_block.dates)  # "dateTimes"; Datetimes of updated views
