# Dynamo custom node ViewsSheet.dyf "© Views.Sheet" (Dynamo 2.12.1.8246)
# category: Crumple.Revit.Query
# Returns the first sheet a view is found on, if any.

views = Input(views: var[]..[])  # View or list of views.
python_script = Python(IN[0]=views)  # IronPython2
# ---------- python_script.python (65 lines) ----------
# Made by Gavin Crump
# Free for use
# BIM Guru, www.bimguru.com.au

# Boilerplate text
import clr

clr.AddReference("RevitAPI")
import Autodesk 
from Autodesk.Revit.DB import FilteredElementCollector, ViewSheet

clr.AddReference("RevitServices")
import RevitServices
from RevitServices.Persistence import DocumentManager

# Current doc
curDoc   = DocumentManager.Instance.CurrentDBDocument
curTitle = curDoc.Title

# Collect all sheets
sheets = FilteredElementCollector(curDoc).OfClass(ViewSheet).ToElements()
sheetNums = [s.SheetNumber for s in sheets]

# Define list/unwrap list functions
def uwlist(input):
    result = input if isinstance(input, list) else [input]
    return UnwrapElement(result)

def objOrList(input, initial = IN[0]):
	if isinstance(initial, list):
		return input
	else:
		return input[0]

# Preparing input from dynamo to revit
views = uwlist(IN[0])

# Get data
view_sheets, view_sheeted = [],[]

for v in views:
	# Get document
	doc = v.Document
	docTitle = doc.Title
	# If not same, change sheets
	if docTitle == curTitle:
		checkSheets = sheets
		checkSheetNums = sheetNums
	else:
		checkSheets = FilteredElementCollector(doc).OfClass(ViewSheet).ToElements()
		checkSheetNums = [s.SheetNumber for s in sheets]
	# Get sheet number
	par = v.LookupParameter("Sheet Number")
	val = par.AsString()
	# Get the sheet if it matches
	if val in checkSheetNums:
		ind = checkSheetNums.index(val)
		view_sheets.append(checkSheets[ind])
		view_sheeted.append(True)
	else:
		view_sheets.append(None)
		view_sheeted.append(False)

# Preparing output to Dynamo
OUT = objOrList(view_sheets), objOrList(view_sheeted)
# ----------------------------------------
code_block = CodeBlock(x=python_script) { x[0]; x[1]; }
sheets = Output(code_block.out0)
isOnSheet = Output(code_block.out1)
