# Dynamo custom node ViewsToSheets_ByPoint.dyf "© Viewports.CreateByPoint" (Dynamo 2.3.0.5885)
# category: Crumple.Revit.Create
# Moves views to sheets based on viewport centres. The node expects 1 point only, and will source this for all view placement.

views = Input(views: var[]..[])  # View/sheet count should be the same size/structure.
sheets = Input(sheets: var[]..[])  # View/sheet count should be the same size/structure.
point = Input(point: var[]..[])  # One point only. This will be used for all view placement.
python_script = Python(IN[0]=views, IN[1]=sheets, IN[2]=point)
# ---------- python_script.python (65 lines) ----------
# Made by Gavin Crump
# Free for use
# BIM Guru, www.bimguru.com.au

# Boilerplate text
import clr

import sys
sys.path.append('C:\Program Files (x86)\IronPython 2.7\Lib')

import System
from System import Array
from System.Collections.Generic import *

clr.AddReference("RevitNodes")
import Revit
clr.ImportExtensions(Revit.Elements)
clr.ImportExtensions(Revit.GeometryConversion)

clr.AddReference("RevitServices")
import RevitServices
from RevitServices.Persistence import DocumentManager 
from RevitServices.Transactions import TransactionManager 

clr.AddReference("RevitAPI")
import Autodesk 
from Autodesk.Revit.DB import *

# Current doc/app/ui
doc = DocumentManager.Instance.CurrentDBDocument

# Function for unwrapping and forcing lists
def uwlist(input):
	tolist = input if isinstance(input, list) else [input]
	unwrap = UnwrapElement(tolist)
	return unwrap

# Preparing input from dynamo to revit
views   = uwlist(IN[0])
sheets  = uwlist(IN[1])
pointin = UnwrapElement(IN[2])
point   = pointin.ToXyz()

viewports = []
report = []

# Do some action in a Transaction
TransactionManager.Instance.EnsureInTransaction(doc)

for v,s in zip(views,sheets):

	isUnplaced = Viewport.CanAddViewToSheet(doc, s.Id, v.Id)
	
	if isUnplaced:
		report.append("")
		vp = Viewport.Create(doc, s.Id, v.Id, point)
		viewports.append(vp)
	else:
		report.append("View is already placed.")
		viewports.append(None)

TransactionManager.Instance.TransactionTaskDone()

# Preparing output to Dynamo
OUT = [viewports, report]
# ----------------------------------------
code_block = CodeBlock(lst=python_script) { vp = lst[0]; rp = lst[1]; }
viewports = Output(code_block.vp)  # All results, including views that failed to place. These are most likely already on a sheet.
report = Output(code_block.rp)  # A result of whether the viewport was successfully placed.  No news = good news!
