# Dynamo custom node WaitFor.dyf "© Flow.WaitFor" (Dynamo 2.3.0.5885)
# category: Crumple.Script.Actions
# Tells the first input to wait for the second input to arrive, then passes on the first input. Really useful for scripts which have branching paths that rely on their outputs to carry each other forward.
# Quite a few custom packages have a 'passthrough' or 'waitfor' node. I use these all the time, so find it useful to have them contained in this package also.

data = Input(data: var[]..[])  # Data to pass through
waitFor = Input(waitFor: var[]..[])  # Data to wait for until the upper stream can be passed.
code_block = CodeBlock(data=data, waitfor=waitFor) { [data,waitfor][0]; }
data_2 = Output(code_block)  # "data"; Passed through data
