# Dynamo custom node WallsCurtainGridCount.dyf "© Walls.CurtainGridCount" (Dynamo 2.12.1.8246)
# category: Crumple.Revit.Query
# Returns the horizontal and vertical grid counts for curtain walls. Note that sometimes the parameter does not match the model for spacing based rules!

curtainWall = Input(curtainWall: var[]..[])  # Revit curtain wall instance.
parameters = Element.Parameters(element=curtainWall)
name = Parameter.Name(parameter=parameters)
code_block = CodeBlock(name=name) { name == "Number"; }
filterByBoolMask = List.FilterByBoolMask(list=parameters, mask=code_block)
string_from_object = FromObject(obj=filterByBoolMask.in)
code_block_2 = CodeBlock { 0; 9; }
remove = String.Remove(string=string_from_object, startIndex=code_block_2.out0, count=code_block_2.out1)
toNumber = String.ToNumber(string=remove)
firstItem = List.FirstItem(list=toNumber@L2)
hCount = Output(firstItem)  # Grid count.
lastItem = List.LastItem(list=toNumber@L2)
vCount = Output(lastItem)  # Grid count.
