# Dynamo custom node WarningElements.dyf "© WarningElements" (Dynamo 2.3.0.5885)
# category: Crumple.Revit.Warnings
# Returns the element(s) associated with the provided warning.

warning = Input(warning: var[]..[])
python_script = Python(IN[0]=warning)
# ---------- python_script.python (32 lines) ----------
# Made by Gavin Crump
# Free for use
# BIM Guru, www.bimguru.com.au

# Boilerplate text
import clr

clr.AddReference("RevitServices")
import RevitServices
from RevitServices.Persistence import DocumentManager

# Current doc/app/ui
doc = DocumentManager.Instance.CurrentDBDocument

# Define list/unwrap list functions
def uwlist(input):
    result = input if isinstance(input, list) else [input]
    return UnwrapElement(result)

# Preparing input from dynamo to revit
warnings  = uwlist(IN[0])

failingIds, failingElements = [],[]

# Get messages
for w in warnings:
	ids = w.GetFailingElements()
	elements = [doc.GetElement(i) for i in ids]
	failingElements.append(elements)

# Preparing output to Dynamo
OUT = failingElements
# ----------------------------------------
elements = Output(python_script)
