# Dynamo custom node WarningMessage.dyf "© Warnings.Message" (Dynamo 2.3.0.5885)
# category: Crumple.Revit.Other.Query
# Given a warning element in Revit db format, will return the message associated with that warning in a generic string format.

warning = Input(warning: var[]..[])
python_script = Python(IN[0]=warning)
# ---------- python_script.python (24 lines) ----------
# Made by Gavin Crump
# Free for use
# BIM Guru, www.bimguru.com.au

# Boilerplate text
import clr

# Define list/unwrap list functions
def uwlist(input):
    result = input if isinstance(input, list) else [input]
    return UnwrapElement(result)

# Preparing input from dynamo to revit
warnings  = uwlist(IN[0])

messages = []

# Get messages
for w in warnings:
	message = w.GetDescriptionText().ToString()
	messages.append(message)

# Preparing output to Dynamo
OUT = messages
# ----------------------------------------
message = Output(python_script)
