# Dynamo custom node WarningsMessage.dyf "© Warnings.Message" (Dynamo 2.12.1.8246)
# category: Crumple.Revit.Query
# Given a warning element in Revit db format, will return the message associated with that warning in a generic string format.

warning = Input(warning: var[]..[])
python_script = Python(IN[0]=warning)  # IronPython2
# ---------- python_script.python (30 lines) ----------
# Made by Gavin Crump
# Free for use
# BIM Guru, www.bimguru.com.au

# Boilerplate text
import clr

# Define list/unwrap list functions
def uwlist(input):
    result = input if isinstance(input, list) else [input]
    return UnwrapElement(result)

def objOrList(input, initial = IN[0]):
	if isinstance(initial, list):
		return input
	else:
		return input[0]

# Preparing input from dynamo to revit
warnings  = uwlist(IN[0])

messages = []

# Get messages
for w in warnings:
	message = w.GetDescriptionText().ToString()
	messages.append(message)

# Preparing output to Dynamo
OUT = objOrList(messages)
# ----------------------------------------
message = Output(python_script)
