# Dynamo custom node WarningsRelatedElements.dyf "© Warnings.RelatedElements" (Dynamo 2.12.1.8246)
# category: Crumple.Revit.Query
# Returns the element(s) associated with the provided warning.
# packages: Crumple 2024.3.1

warning = Input(warning: var[]..[])
docOrLink = Input(docOrLink: var[]..[] = null)  # Uses current if none provided. Accepts document or link instance.
revit_getdocument = Custom[© Revit.GetDocument](docOrLink=docOrLink)  # package Crumple; If no input is specified or an invalid one is, returns current document. If a link instance is provided, it returns the linked document. If a document is provided it will pass it through.
python_script = Python(IN[0]=warning, IN[1]=revit_getdocument.document)  # IronPython2
# ---------- python_script.python (32 lines) ----------
# Made by Gavin Crump
# Free for use
# BIM Guru, www.bimguru.com.au

# Boilerplate text
import clr

# Define list/unwrap list functions
def uwlist(input):
    result = input if isinstance(input, list) else [input]
    return UnwrapElement(result)

def objOrList(input, initial = IN[0]):
	if isinstance(initial, list):
		return input
	else:
		return input[0]

# Preparing input from dynamo to revit
warnings  = uwlist(IN[0])
doc = IN[1]

failingIds, failingElements = [],[]

# Get messages
for w in warnings:
	ids = w.GetFailingElements()
	elements = [doc.GetElement(i) for i in ids]
	failingElements.append(elements)

# Preparing output to Dynamo
OUT = objOrList(failingElements)
# ----------------------------------------
elements = Output(python_script)
