# Dynamo custom node WebLMGTFY.dyf "© Web.LMGTFY" (Dynamo 2.12.1.8246)
# category: Crumple.Application.Actions
# ChatGPT for dummies.

query = Input(query: string)
runMe = Input(runMe: bool = false)
python_script = Python(IN[0]=query, IN[1]=runMe)  # IronPython2
# ---------- python_script.python (19 lines) ----------
# Made by Gavin Crump
# Free for use
# BIM Guru, www.bimguru.com.au

# Boilerplate text
import os
import webbrowser

# Open URL
if IN[1]:
    try:
        no_spaces = IN[0].replace("+", " ")
        new_path  = 'https://www.google.com/search?q='
        webbrowser.open(new_path + no_spaces)
        OUT = "URL Opened."
    except:
        OUT = "Invalid query."
else:
	OUT = "Set runMe to True!"
# ----------------------------------------
result = Output(python_script)
