# Dynamo custom node WebUrlOpen.dyf "© Web.UrlOpen" (Dynamo 2.12.1.8246)
# category: Crumple.Application.Actions
# Given a URL, will attempt to open in the default web browser used by Windows.

url = Input(url: var[]..[])
runMe = Input(runMe: bool = false)
python_script = Python(IN[0]=url, IN[1]=runMe)  # IronPython2
# ---------- python_script.python (32 lines) ----------
# Made by Gavin Crump
# Free for use
# BIM Guru, www.bimguru.com.au

# Boilerplate text
import os

# Define list/unwrap list functions
def tolist(input):
    result = input if isinstance(input, list) else [input]
    return result

def objOrList(input, initial = IN[0]):
	if isinstance(initial, list):
		return input
	else:
		return input[0]

def openUrl(url):
	try:
		os.system("start \"\" " + url)
		return True
	except:
		return False

# Open URL
urls = tolist(IN[0])

if IN[1]:
	OUT = objOrList([openUrl(u) for u in urls])
else:
	OUT = "Set runMe to True!"
# ----------------------------------------
result = Output(python_script)
