# Dynamo custom node WindowsClipboardReceive.dyf "© Windows.ClipboardReceive" (Dynamo 2.16.2.5624)
# category: Crumple.Application.Actions
# Attempts to retrieve the current data on the clipboard.

refresh = Input(refresh: bool = True)
python_script = Python(IN[0]=refresh)  # CPython3
# ---------- python_script.python (21 lines) ----------
import clr
import System
from System.Threading import Thread, ThreadStart
clr.AddReference("System.Windows.Forms")

clipboardcontents = '###'

def GetText():
    def thread_proc():
        global clipboardcontents
        clipboardcontents = System.Windows.Forms.Clipboard.GetText()
    t = Thread(ThreadStart(thread_proc))
    t.ApartmentState = System.Threading.ApartmentState.STA
    t.Start()
    t.Join()

try:
	GetText()
	OUT = [clipboardcontents, True]
except:
	OUT = ["", False]
# ----------------------------------------
code_block = CodeBlock(data=python_script) { data[0]; data[1]; }
stringReceived = Output(code_block.out0)
success = Output(code_block.out1)
