# Dynamo custom node WindowsClipboardSend.dyf "© Windows.ClipboardSend" (Dynamo 2.12.1.8246)
# category: Crumple.Application.Actions
# Attempts to send data to the clipboard.

dataToCopy = Input(dataToCopy: var)
python_script = Python(IN[0]=dataToCopy)  # CPython3
# ---------- python_script.python (22 lines) ----------
# Boilerplate
import clr
import System
from System.Threading import Thread, ThreadStart
clr.AddReference("System.Windows.Forms")

# Define function
def SetText(text):
    def thread_proc():
        System.Windows.Forms.Clipboard.SetText(text)
    t = Thread(ThreadStart(thread_proc))
    t.ApartmentState = System.Threading.ApartmentState.STA
    t.Start()

try:
	if IN[0] != "" and IN[0] != None:
		SetText(IN[0])
		OUT = True
	else:
		OUT = False
except:
	OUT = False
# ----------------------------------------
success = Output(python_script)
