# Dynamo custom node WindowsDesktop.dyf "© Windows.Desktop" (Dynamo 2.16.2.5624)
# category: Crumple.Application.Query
# This node returns the active username, as well as a path to the user's Desktop.

refresh = Input(refresh: bool = true)  # Toggle to refresh
python_script = Python(IN[0]=refresh)  # CPython3
# ---------- python_script.python (10 lines) ----------
# Made by Gavin Crump
# Free for use
# BIM Guru, www.bimguru.com.au
# Thanks to Sean Page for suggesting the os package

# Boilerplate text
import clr
import os

OUT = os.path.normpath(os.path.expanduser('~/Desktop'))
# ----------------------------------------
directoryPath = Output(python_script)  # The active user's desktop path
