# Dynamo custom node WindowsDirectoryContents.dyf "© Windows.DirectoryContents" (Dynamo 2.12.1.8246)
# category: Crumple.Application.Query
# Be aware there is an OOTB node that can do this, but I wanted to add this to the package so others can see how to use a Python method as a starter block in other scripts.

directoryPath = Input(directoryPath: string)
searchString = Input(searchString: string = "")
deepSearch = Input(deepSearch: bool = false)
python_script = Python(IN[0]=directoryPath, IN[1]=searchString, IN[2]=deepSearch)  # CPython3
# ---------- python_script.python (29 lines) ----------
# Made by Gavin Crump
# Free for use
# BIM Guru, www.bimguru.com.au

# Boilerplate text
import clr
from System.IO import Directory, SearchOption

# Preparing input from dynamo to revit
dir = IN[0]
searchstring = IN[1]
alldirectories = IN[2]

foundfiles = []

# Search directory contents
if Directory.Exists(dir):
	if alldirectories:
		dirfiles = Directory.GetFiles(dir, ".", SearchOption.AllDirectories)
	else:
		dirfiles = Directory.GetFiles(dir, ".", SearchOption.TopDirectoryOnly)
	for file in dirfiles:
		if searchstring not in file:
			continue
		else:
			foundfiles.append(file)
	OUT = foundfiles
else:
	OUT = []
# ----------------------------------------
filePaths = Output(python_script)
