# Dynamo custom node WindowsEmailSend.dyf "© Windows.EmailSend 🐍" (Dynamo 2.3.1.11775)
# category: Crumple.Application.Create
# Given Outlook is open, this node will attempt to send an email to a list of recipients with a subject and body.

to = Input(to: var[]..[])
subject = Input(subject: string = "Subject")
body = Input(body: string = "")
python_script = Python(IN[0]=to, IN[1]=subject, IN[2]=body)
# ---------- python_script.python (34 lines) ----------
# Made by Gavin Crump
# Free for use
# BIM Guru, www.bimguru.com.au

# Boilerplate text
import clr
clr.AddReference("Microsoft.Office.Interop.Outlook")
from System.Runtime.InteropServices import Marshal

# Define list/unwrap list functions
def tolist(input):
    result = input if isinstance(input, list) else [input]
    return result

# Collect inputs
targets = tolist(IN[0])

# Build email and send items

try:
	mail= Marshal.GetActiveObject("Outlook.Application").CreateItem(0)

	for t in targets:
		mail.Recipients.Add(t)

	mail.Subject = IN[1]
	mail.Body = IN[2]
	mail.Send();
	wasSent = True
	
except:
	wasSent = False

OUT = wasSent
# ----------------------------------------
wasSent = Output(python_script)
