# Dynamo custom node WindowsFileSize.dyf "© Windows.FileSize" (Dynamo 2.12.1.8246)
# category: Crumple.Application.Query
# For given file objects, returns their size in bytes, kilobytes and megabytes.

filePaths = Input(filePaths: var[]..[])
python_script = Python(IN[0]=filePaths)  # CPython3
# ---------- python_script.python (25 lines) ----------
# Made by Gavin Crump
# Free for use
# BIM Guru, www.bimguru.com.au

# Boilerplate text
import clr
import os

# Define list/unwrap list functions
def tolist(input):
    result = input if isinstance(input, list) else [input]
    return result

files = tolist(IN[0])
bytes = []
kbytes = []
mbytes = []

for file in files:
	size = os.path.getsize(file)
	bytes.append(float(size))
	kbytes.append(size/1024)
	mbytes.append(size/1048576)
	
OUT = (bytes,kbytes,mbytes)
# ----------------------------------------
code_block = CodeBlock(x=python_script) { x[0]; x[1]; x[2]; }
bytes = Output(code_block.out0)
kiloBytes = Output(code_block.out1)
megaBytes = Output(code_block.out2)
