# Dynamo custom node WindowsPrinters.dyf "© Windows.Printers" (Dynamo 2.12.1.8246)
# category: Crumple.Application.Query
# Returns all print driver names installed on the machine.

refresh = Input(refresh: bool = true)
python_script = Python(IN[0]=refresh)  # IronPython2
# ---------- python_script.python (13 lines) ----------
# Made by Gavin Crump
# Free for use
# BIM Guru, www.bimguru.com.au

# Boilerplate text
import clr
clr.AddReference('System.Drawing')

import System
from System import Drawing

# Preparing output to Dynamo
OUT = list(Drawing.Printing.PrinterSettings.InstalledPrinters)
# ----------------------------------------
printerNames = Output(python_script)
