# Dynamo custom node WindowsReplaceFileName.dyf "© Windows.ReplaceFileName" (Dynamo 2.16.2.5624)
# category: Crumple.Application.Actions
# Given a file path, substitutes the file name of that path with a given name (keeping the extension regardless).

filePath = Input(filePath: string[]..[])
directoryName = FileSystem.DirectoryName(path=filePath)
newName = Input(newName: string[]..[])
fileExtension = FileSystem.FileExtension(path=filePath)
code_block = CodeBlock(dn=directoryName, fn=newName, ex=fileExtension) { dn + "\\" + fn + ex; }
newPath = Output(code_block)
