# Dynamo custom node WindowsTempFiles.dyf "© Windows.TempFiles" (Dynamo 2.12.1.8246)
# category: Crumple.Application.Query
# This node returns the active username, as well as a path to the user's Temp files.

refresh = Input(refresh: bool = true)  # Toggle to refresh
python_script = Python(IN[0]=refresh)  # CPython3
# ---------- python_script.python (15 lines) ----------
# Made by Gavin Crump
# Free for use
# BIM Guru, www.bimguru.com.au
# Thanks to Sean Page for suggesting the os package

# Boilerplate text
import clr
import os

user = os.environ.get('USERNAME')
fl = os.environ.get('USERPROFILE')

te = fl + "\AppData\Local\Temp"

OUT = [user,te]
# ----------------------------------------
code_block = CodeBlock(out=python_script) { out[0]; out[1]; }
username = Output(code_block.out0)  # The active user's name
directoryPath = Output(code_block.out1)  # The active user's temporary files path
