# Dynamo custom node WindowsUserNames.dyf "© Windows.UserNames" (Dynamo 2.12.1.8246)
# category: Crumple.Application.Query
# This node returns the users Windows and Revit user names.

refresh = Input(refresh: bool = true)  # Toggle to refresh
python_script = Python(IN[0]=refresh)  # CPython3
# ---------- python_script.python (25 lines) ----------
# Made by Gavin Crump
# Free for use
# BIM Guru, www.bimguru.com.au
# Thanks to Sean Page for suggesting the os package

# Boilerplate text
import clr
import os

clr.AddReference("RevitServices")
import RevitServices
from RevitServices.Persistence import DocumentManager 

clr.AddReference("RevitAPIUI")
from Autodesk.Revit.UI import *

# Current doc/app/ui
uiapp = DocumentManager.Instance.CurrentUIApplication 
app = uiapp.Application 

# Obtain usernames
user_w = os.environ.get('USERNAME')
user_r = app.Username

OUT = [user_w, user_r]
# ----------------------------------------
code_block = CodeBlock(lst=python_script) { user_w = lst[0]; user_r = lst[1]; }
windows = Output(code_block.user_w)  # Windows user name
revit = Output(code_block.user_r)  # Revit user name
