# Dynamo custom node WindowsUserPaths.dyf "© Windows.UserPaths" (Dynamo 2.3.0.5885)
# category: Crumple.Application.Query
# This node returns the active username, as well as common user paths including:
# - Desktop
# - My Documents
# - Temp
# - Dynamo Revit (for active build)
# - Dynamo Revit logs (" ")

Refresh = Input(Refresh: bool = true)  # Toggle to refresh
python_script = Python(IN[0]=Refresh)
# ---------- python_script.python (28 lines) ----------
# Made by Gavin Crump
# Free for use
# BIM Guru, www.bimguru.com.au
# Thanks to Sean Page for suggesting the os package

# Boilerplate text
import clr
import os

#Add Dynamo services for its API
clr.AddReference('DynamoRevitDS')
import Dynamo
from System import Environment

# access to the current Dynamo instance and workspace
DynamoCurrent = Dynamo.Applications.DynamoRevit()
DynamoVersion = DynamoCurrent.RevitDynamoModel.Version

user = os.environ.get('USERNAME')
fl = os.environ.get('USERPROFILE')

dt = fl + "\Desktop"
md = fl + "\Documents"
te = fl + "\AppData\Local\Temp"
dr = fl + "\AppData\Roaming\Dynamo\Dynamo Revit\\" + DynamoVersion[0:3]
dl = fl + "\AppData\Roaming\Dynamo\Dynamo Revit\\" + DynamoVersion[0:3] + "\Logs"

OUT = [user,fl,dt,md,te,dr,dl]
# ----------------------------------------
code_block = CodeBlock(out=python_script) { out[0]; out[1]; out[2]; out[3]; out[4]; out[5]; out[6]; }
username = Output(code_block.out0)  # The active user's name
folder = Output(code_block.out1)  # The active user's user folder path
Desktop = Output(code_block.out2)  # The active user's Desktop path
My_Docs = Output(code_block.out3)  # The active user's My Documents path
Temp = Output(code_block.out4)  # The active user's Temporary Files path
Dyn_Rvt = Output(code_block.out5)  # The active user's Dynamo path
Dyn_Logs = Output(code_block.out6)  # The active user's Dynamo logs path
