# Dynamo custom node Worksets.dyf "© Collect.Worksets" (Dynamo 2.3.1.11775)
# category: Crumple.Revit.Query
# Returns all user worksets and their names in a document.
# packages: Crumple 2022.2.13

docOrLink = Input(docOrLink: var[]..[] = null)  # Uses current if none provided. Accepts document or link instance.
revit_getdocument = Custom[© Revit.GetDocument](docOrLink=docOrLink)  # package Crumple; If no input is specified or an invalid one is, returns current document. If a link instance is provided, it returns the linked document. If a document is provided it will pass it through.
python_script = Python(IN[0]=revit_getdocument.document)
# ---------- python_script.python (28 lines) ----------
# Made by Gavin Crump
# Free for use
# BIM Guru, www.bimguru.com.au

# Boilerplate text
import clr

clr.AddReference("RevitAPI")
import Autodesk 
from Autodesk.Revit.DB import *

# Current doc/app/ui
doc = IN[0]

# Collect all worksets
collector = FilteredWorksetCollector(doc)
worksets  = collector.OfKind(WorksetKind.UserWorkset).ToWorksets()

# Ensure iterable
if not hasattr(worksets, "__iter__"):
    worksets = [worksets]

# Get Workset names
names = []
[names.append(w.Name) for w in worksets]

# Output
OUT = [worksets, names]
# ----------------------------------------
code_block = CodeBlock(x=python_script) { worksets = x[0]; names    = x[1]; }
worksets = Output(code_block.worksets)  # User worksets
names = Output(code_block.names)  # User workset names (as strings).
