# Dynamo custom node WorksetsCreate.dyf "© Worksets.Create" (Dynamo 2.12.1.8246)
# category: Crumple.Revit.Create
# Attempts to create worksets given a provided name. Will return whether it was successful in each case, as well as the new workset's Id where it was (and a null where it wasn't).

names = Input(names: var[]..[])
python_script = Python(IN[0]=names)  # IronPython2
# ---------- python_script.python (61 lines) ----------
# Made by Gavin Crump
# Free for use
# BIM Guru, www.bimguru.com.au

# Boilerplate text
import clr

clr.AddReference("RevitServices")
import RevitServices
from RevitServices.Persistence import DocumentManager 
from RevitServices.Transactions import TransactionManager 

clr.AddReference("RevitAPI")
import Autodesk 
from Autodesk.Revit.DB import FilteredWorksetCollector, WorksetKind, Workset

# Current doc/app/ui
doc = DocumentManager.Instance.CurrentDBDocument

# Define list/unwrap list functions
def tolist(input):
    result = input if isinstance(input, list) else [input]
    return result

def objOrList(input, initial = IN[0]):
	if isinstance(initial, list):
		return input
	else:
		return input[0]

# Preparing input from dynamo to revit
new_names = tolist(IN[0])

worksets_out, bools = [],[]

# If document is workshared...
if doc.IsWorkshared:
	# Do some action in a Transaction
	TransactionManager.Instance.EnsureInTransaction(doc)
	# Collect workset names
	worksets = FilteredWorksetCollector(doc).OfKind(WorksetKind.UserWorkset).ToWorksets()
	ex_names = [w.Name for w in worksets]
	# For each workset...
	for n in new_names:
		if n not in ex_names:
			workset = Workset.Create(doc, n)
			worksets_out.append(workset)
			bools.append(True)
		else:
			worksets_out.append(None)
			bools.append(False)
	# Close transaction
	TransactionManager.Instance.TransactionTaskDone()
# Otherwise we return nothing
else:
	for n in new_names:
		worksets_out.append(None)
		bools.append(False)

# Preparing output to Dynamo
OUT = objOrList(worksets_out), objOrList(bools)
# ----------------------------------------
code_block = CodeBlock(out=python_script) { wkst  = out[0]; bools = out[1]; }
worksets = Output(code_block.wkst)
wasCreated = Output(code_block.bools)
