# Dynamo custom node WorksetsIsolateInView.dyf "© Worksets.IsolateInView" (Dynamo 2.12.1.8246)
# category: Crumple.Revit.Actions
# Given a list of views and a list of worksets or workset names, attempts to isolate them all in those views.

views = Input(views: var[]..[])  # View or list of views to isolate the worksets in.
worksets = Input(worksets: var[]..[])  # List of worksets and/or workset names to isolate.
python_script = Python(IN[0]=views, IN[1]=worksets)  # IronPython2
# ---------- python_script.python (94 lines) ----------
# Made by Gavin Crump
# Free for use
# BIM Guru, www.bimguru.com.au

# Boilerplate text
import clr

clr.AddReference("RevitServices")
import RevitServices
from RevitServices.Persistence import DocumentManager 
from RevitServices.Transactions import TransactionManager 

clr.AddReference("RevitAPI")
import Autodesk 
from Autodesk.Revit.DB import WorksetVisibility, FilteredWorksetCollector, WorksetKind

# Current doc/app/ui
doc = DocumentManager.Instance.CurrentDBDocument

# Define list/unwrap list functions
def uwlist(input):
    result = input if isinstance(input, list) else [input]
    return UnwrapElement(result)

def objOrList(input, initial = IN[0]):
	if isinstance(initial, list):
		return input
	else:
		return input[0]

# Preparing input from dynamo to revit
views    = uwlist(IN[0])
worksets = uwlist(IN[1])

# Constants
WORKSETS_HIDDEN = WorksetVisibility.Hidden
WORKSETS_SHOW   = WorksetVisibility.Visible
WORKSET_USER    = WorksetKind.UserWorkset

# Get worksets
worksets_all = FilteredWorksetCollector(doc).\
			   OfKind(WorksetKind.UserWorkset).\
			   ToWorksets()

workset_names = [w.Name for w in worksets_all]

# Try to get all worksets if not from their names
worksets_final = []

# For each input...
for w in worksets:
	# If it's a name, and it exists...
	if w in workset_names:
		# Get the workset, append it
		ind = workset_names.index(w)
		worksets_final.append(worksets_all[ind])
	else:
		# Otherwise, make sure it's a user workset
		try:
			if w.Kind == WORKSET_USER:
				worksets_final.append(w)
		except:
			pass

worksetNames_final = [w.Name for w in worksets_final]

# Function to turn off worksets in view if not given name
def view_worksetsOffButList(view, worksetNames, worksets = worksets_all):
	worksetFound = []
	# For each workset in all worksets
	for ws in worksets:
		# If it's name is match, show it
		if ws.Name in worksetNames:
			view.SetWorksetVisibility(ws.Id , WORKSETS_SHOW)
			worksetFound.append(True)
		# Otherwise, hide it
		else:
			view.SetWorksetVisibility(ws.Id , WORKSETS_HIDDEN)
	# Return if we found it
	return True

# Do some action in a Transaction
outcomes = []

TransactionManager.Instance.EnsureInTransaction(doc)

for v in views:
	outcome = view_worksetsOffButList(v, worksetNames_final)
	outcomes.append(outcome)

TransactionManager.Instance.TransactionTaskDone()

# Preparing output to Dynamo
OUT = objOrList(outcomes)
# ----------------------------------------
wasRun = Output(python_script)
