# Dynamo custom node WorksetsRename.dyf "© Worksets.Rename" (Dynamo 2.12.1.8246)
# category: Crumple.Revit.Actions
# Will attempt to rename a workset to a newly provided name. If the workset cannot be renamed, a null value will be returned as well as a success report.

worksets = Input(worksets: var[]..[])
names = Input(names: var[]..[])
python_script = Python(IN[0]=worksets, IN[1]=names)  # IronPython2
# ---------- python_script.python (55 lines) ----------
# Made by Gavin Crump
# Free for use
# BIM Guru, www.bimguru.com.au

# Boilerplate text
import clr

clr.AddReference("RevitAPI")
import Autodesk 
from Autodesk.Revit.DB import WorksetTable

clr.AddReference('RevitServices')
import RevitServices
from RevitServices.Persistence import DocumentManager
from RevitServices.Transactions import TransactionManager

# Define list/unwrap list functions
def tolist(input):
    result = input if isinstance(input, list) else [input]
    return result

def uwlist(input):
    result = input if isinstance(input, list) else [input]
    return UnwrapElement(result)

def objOrList(input, initial = IN[0]):
	if isinstance(initial, list):
		return input
	else:
		return input[0]

# Current doc/app/ui
doc = DocumentManager.Instance.CurrentDBDocument

# Preparing input from dynamo to revit
wkst_ele = uwlist(IN[0])
wkst_nam = tolist(IN[1])

# Do some action in a Transaction
TransactionManager.Instance.EnsureInTransaction(doc)

bools = []

for w,n in zip(wkst_ele, wkst_nam):
	try:
		WorksetTable.RenameWorkset(doc, w.Id, "__" + n)
		WorksetTable.RenameWorkset(doc, w.Id, n)
		bools.append(True)
	except:
		bools.append(False)
	
TransactionManager.Instance.TransactionTaskDone()

# Preparing output to Dynamo
OUT = objOrList(wkst_ele), objOrList(bools)
# ----------------------------------------
code_block = CodeBlock(data=python_script) { wksts = data[0]; bools = data[1]; }
worksets_2 = Output(code_block.wksts)  # "worksets"
wasRenamed = Output(code_block.bools)
