# Dynamo custom node FamilyDocLoadFromPath.dyf "🐍 FamilyDoc.LoadPaths" (Dynamo 2.12.1.8246)
# category: Crumple.IronPython.Actions
# Attempts to load families from the given file paths to the current document.
# packages: Crumple 2022.5.27

filePaths = Input(filePaths: var[]..[])
targetDocument = Input(targetDocument: var[]..[] = null)  # Uses current if none provided. Accepts document.
revit_getdocument = Custom[© Revit.GetDocument](docOrLink=targetDocument)  # package Crumple; If no input is specified or an invalid one is, returns current document. If a link instance is provided, it returns the linked document. If a document is provided it will pass it through.
overwriteValues = Input(overwriteValues: bool = false)
overwriteComponents = Input(overwriteComponents: bool = false)  # If true, components will be sourced will be sourced from the loading document.
python_script = Python(IN[0]=filePaths, IN[1]=revit_getdocument.document, IN[2]=overwriteValues, IN[3]=overwriteComponents)  # IronPython2
# ---------- python_script.python (87 lines) ----------
# Made by Gavin Crump
# Free for use
# BIM Guru, www.bimguru.com.au

# Boilerplate text
import clr

clr.AddReference("RevitServices")
import RevitServices
from RevitServices.Transactions import TransactionManager 

clr.AddReference("RevitAPI")
import Autodesk 
from Autodesk.Revit.DB import *

# Load options
optValues = IN[2]
optFamily = IN[3]

# Class: Interface for loading families, use project families
class FamilyOptionsProject(IFamilyLoadOptions):
	# If family is found, overwrite the options
	def OnFamilyFound(self, familyInUse, overwriteParameterValues):
		if optValues:
			overwriteParameterValues = True
		else:
			overwriteParameterValues = False
		return True
	# If shared family is found, overwrite the options
	def OnSharedFamilyFound(self, sharedFamily, familyInUse, source, overwriteParameterValues):
		if optValues:
			overwriteParameterValues = True
		else:
			overwriteParameterValues = False
		if optFamily:
			source = FamilySource.Family
		else:		
			source = FamilySource.Project
		return True

# Define list/unwrap list functions
def tolist(input):
    result = input if isinstance(input, list) else [input]
    return result

def nameFromPath(filePath):
	fileName = filePath.split("/")[-1]
	fileName = fileName.split('\\')[-1]
	return fileName.replace(".rfa", "")

# Current doc/app/ui
paths = tolist(IN[0])
doc = IN[1]

# Collect all sheets
fams_doc     = FilteredElementCollector(doc).OfClass(Family).WhereElementIsNotElementType().ToElements()
famNames = [f.Name for f in fams_doc]

loadOptions = FamilyOptionsProject()

# Do some action in a Transaction
fams, wasLoaded, wasUpdated = [],[],[]

TransactionManager.Instance.EnsureInTransaction(doc)

for path in paths:
	famName = nameFromPath(path)
	try:
		res, fam = doc.LoadFamily(path, loadOptions)
		if not fam:
			if famName in famNames:
				ind = famNames.index(famName)
				fam = fams_doc[ind]
			else:
				fam = None
		fams.append(fam)
		wasLoaded.append(True)
		wasUpdated.append(res)
	except:
		fams.append(None)
		wasLoaded.append(True)
		wasUpdated.append(False)

TransactionManager.Instance.TransactionTaskDone()

# Preparing output to Dynamo
OUT = fams, wasLoaded, wasUpdated
# ----------------------------------------
code_block = CodeBlock(out=python_script) { out[0]; out[1]; out[2]; }
families = Output(code_block.out0)
wasLoaded = Output(code_block.out1)
wasUpdated = Output(code_block.out2)
