# Dynamo custom node SelectionByCategories.dyf "🐍 Selection.ByCategories" (Dynamo 2.12.1.8246)
# category: Crumple.IronPython.Create
# Given a list of categories, this node will prompt the user to select elements in the document limited to those categories.

categories = Input(categories: var[]..[])
runMe = Input(runMe: bool = False)
python_script = Python(IN[0]=categories, IN[1]=runMe)  # IronPython2
# ---------- python_script.python (70 lines) ----------
# Made by Gavin Crump
# Free for use
# BIM Guru, www.bimguru.com.au

# Boilerplate text
import clr

import System
from System.Collections.Generic import List

clr.AddReference("RevitServices")
import RevitServices
from RevitServices.Persistence import DocumentManager 

clr.AddReference("RevitAPI")
clr.AddReference("RevitAPIUI")

import Autodesk
from  Autodesk.Revit.DB import ElementId
from  Autodesk.Revit.UI import Selection
from  Autodesk.Revit.UI.Selection import ISelectionFilter

# Current doc/app/ui
doc = DocumentManager.Instance.CurrentDBDocument
uiapp = DocumentManager.Instance.CurrentUIApplication 
uidoc = uiapp.ActiveUIDocument

# Force list function
def uwlist(input):
    result = input if isinstance(input, list) else [input]
    return UnwrapElement(result)

# Preparing input from dynamo to revit
category = uwlist(IN[0])
runMe = IN[1]

if runMe:
	# Make selection filter class
	class selectionfilter(ISelectionFilter):
		def __init__(self,category):
			self.category = category
		def AllowElement(self,element):
			if element.Category.Name in [c.Name for c in self.category]:
				return True
			else:
				return False

	# Create selection filter
	selfilt = selectionfilter(category)
	sel = uidoc.Selection.PickObjects(Selection.ObjectType.Element,selfilt)

	# Lists for appending/adding
	elementIds = List[ElementId]()
	elements = []

# Try to get elements for selection
for s in sel:
	try:
		id = s.ElementId
		el = doc.GetElement(id)
		elements.append(el)
		elementIds.Add(id)
	except:
		pass

# Select the elements
selection = uidoc.Selection.SetElementIds(elementIds)

# Preparing output to Dynamo
OUT = elements
# ----------------------------------------
elements = Output(python_script)
