# Dynamo custom node UIDropdown.dyf "🐍 UI.DropdownForm" (Dynamo 2.12.1.8246)
# category: Crumple.IronPython.Create
# Creates a basic dropdown form from a set of keys and values. If cancelled, the form will return nothing (null).

formTitle = Input(formTitle: string = "Please select an item")
keys = Input(keys: var[]..[])  # What the user will see in the form
values = Input(values: var[]..[])  # What will be passed through
formWidth = Input(formWidth: int = 400)
formHeight = Input(formHeight: int = 120)
python_script = Python(IN[0]=formTitle, IN[1]=keys, IN[2]=values, IN[3]=formWidth, IN[4]=formHeight)  # IronPython2
# ---------- python_script.python (137 lines) ----------
# Made by Gavin Crump
# Free for use
# BIM Guru, www.bimguru.com.au

# Thanks for the tips and example Cyril!
# https://github.com/Cyril-Pop/IronPython-Samples/blob/master/WinForms/combobox%2BDataBinding%20with%20DataTable.py

import clr

clr.AddReference("System.Drawing")
clr.AddReference("System.Windows.Forms")

import System
import System.Drawing

from System.Drawing import *
from System.Windows.Forms import *

from collections import namedtuple

# Define list/unwrap list functions
def tolist(input):
    result = input if isinstance(input, list) else [input]
    return result

# Imports from Dynamo
form_title  = IN[0]
keys        = tolist(IN[1])
values      = tolist(IN[2])
form_width  = IN[3]
form_height = IN[4]

# Class for key/value pair
class MyItem():
	def __init__(self, key, value):
		self.Key = key
		self.Value = value

# Make key value pairs
list_of_items = [MyItem(i,j) for i,j in zip(keys, values)] 

# Class for main winform
class MainForm(Form):
	
	# Initialize form object
	def __init__(self, list_elements, title, formWidth, formHeight):
		# Begin with first value
		self.list_elements = list_elements
		self.title  = title
		self.formWidth = formWidth
		self.formHeight = formHeight
		self.choice = list_of_items[0].Value
		self.InitializeComponent()
	
	# Make form components
	def InitializeComponent(self):
		
		# Add buttons
		self._comboBox = System.Windows.Forms.ComboBox()
		self._buttonCancel = System.Windows.Forms.Button()
		self._buttonOK = System.Windows.Forms.Button()
		self.SuspendLayout()
		
		# Combo box
		self._comboBox.Anchor = System.Windows.Forms.AnchorStyles.Top | System.Windows.Forms.AnchorStyles.Left | System.Windows.Forms.AnchorStyles.Right
		self._comboBox.Location = System.Drawing.Point(20, 20)
		self._comboBox.Size = System.Drawing.Size(self.formWidth - 40, 21)
		self._comboBox.DataSource = self.list_elements
		self._comboBox.DisplayMember = "Key"
		self._comboBox.ValueMember = "Value"
		self._comboBox.SelectedIndexChanged += self.ComboBox1SelectedIndexChanged
		
		# OK button
		self._buttonOK.Anchor = System.Windows.Forms.AnchorStyles.Bottom | System.Windows.Forms.AnchorStyles.Right
		self._buttonOK.Location = System.Drawing.Point(self.formWidth-180, self.formHeight-50)
		self._buttonOK.Name = "buttonOK"
		self._buttonOK.Size = System.Drawing.Size(80, 25)
		self._buttonOK.TabIndex = 1
		self._buttonOK.Text = "OK"
		self._buttonOK.UseVisualStyleBackColor = True
		self._buttonOK.Click += self.ButtonOKClick

		# Cancel button
		self._buttonCancel.Anchor =  System.Windows.Forms.AnchorStyles.Bottom | System.Windows.Forms.AnchorStyles.Right
		self._buttonCancel.Location = System.Drawing.Point(self.formWidth-100, self.formHeight-50)
		self._buttonCancel.Name = "buttonCancel"
		self._buttonCancel.Size = System.Drawing.Size(80, 25)
		self._buttonCancel.TabIndex = 1
		self._buttonCancel.Text = "Cancel"
		self._buttonCancel.UseVisualStyleBackColor = True
		self._buttonCancel.Click += self.ButtonCancelClick
		
		# Draw main form
		self.ClientSize = System.Drawing.Size(self.formWidth, self.formHeight)
		self.MinimumSize = self.ClientSize + System.Drawing.Size(20, 20)
		self.Controls.Add(self._comboBox)
		self.Controls.Add(self._buttonOK)
		self.Controls.Add(self._buttonCancel)
		self.ControlBox = False
		self.SizeGripStyle = System.Windows.Forms.SizeGripStyle.Show
		self.Name = "MainForm"
		self.Text = self.title
		self.BringToFront()
		self.CenterToScreen()
		# self.FormBorderStyle = FormBorderStyle.FixedSingle
		self.ResumeLayout(False)

	# Event if dropdown changes
	def ComboBox1SelectedIndexChanged(self, sender, e):
		self.choice = sender.SelectedItem.Value

	# Event if OK button pressed
	def ButtonOKClick(self, sender, e):
		self.Close()
		self.runNextOutput = True 

	# Event if OK button pressed
	def ButtonCancelClick(self, sender, e):
		self.choice = None
		self.Close()
		self.runNextOutput = False

# Show form to the user
objForm = MainForm(list_of_items,
				   title = form_title,
				   formWidth = form_width,
				   formHeight = form_height)

objForm.ShowDialog()

# Return the selected object and if it was cancelled
chosenItem = objForm.choice

if not chosenItem:
	OUT = None, True
else:
	OUT = chosenItem, False
# ----------------------------------------
code_block = CodeBlock(x=python_script) { x[0]; x[1]; }
chosenValue = Output(code_block.out0)
wasCancelled = Output(code_block.out1)
