# Dynamo custom node ViewsFromSun.dyf "🐍 Views.FromSun" (Dynamo 2.12.1.8246)
# category: Crumple.IronPython.Create
# Given a list of sun directions, view names and a 3D view type this node will create views from the sun. If a view already exists by name, it will be returned but not updated.

origin = Point.Origin()
sunDirections = Input(sunDirections: Autodesk.DesignScript.Geometry.Vector[]..[])
reverse = Vector.Reverse(vector=sunDirections)
code_block = CodeBlock { 1; }
translate = Geometry.Translate(geometry=origin, direction=reverse, distance=code_block)
viewNames = Input(viewNames: string[]..[])
byEyePointAndTarget = AxonometricView.ByEyePointAndTarget(eyePoint=translate, target=origin, name=viewNames)
code_block_2 = CodeBlock { "Type"; }
viewType = Input(viewType: var)
setParameterByName = Element.SetParameterByName(element=byEyePointAndTarget, parameterName=code_block_2, value=viewType)
viewsFromSun = Output(setParameterByName)
