# Dynamo custom node IfThenElse.dyf (Dynamo 2.3.0.5885)
# category: Crumple.Math.Logic
# A simple if/then/else logic gate. If true, you get the 'then' input, otherwise you get the 'else' input. Unlike the OOTB 'If' node, this one allows differing list sizes.

If = Input(If: bool = true)
Then = Input(Then: var[]..[])
Else = Input(Else: var[]..[])
python_script = Python(IN[0]=If, IN[1]=Then, IN[2]=Else)
# ---------- python_script.python (9 lines) ----------
# Made by Gavin Crump
# Free for use
# BIM Guru, www.bimguru.com.au

#Code
if IN[0]:
	OUT = IN[1]
else:
	OUT = IN[2]
# ----------------------------------------
Output = Output(python_script)
