# Dynamo custom node ListForce.dyf (Dynamo 2.3.0.5885)
# category: Crumple.List.Generate
# A basic node to check if the input is in the form of a list, and if not it forces it to become one. This simple python script is useful for incorporation into larger scripts for iterating.

Item = Input(Item: var[]..[])
python_script = Python(IN[0]=Item)
# ---------- python_script.python (9 lines) ----------
# Made by Gavin Crump
# Free for use
# BIM Guru, www.bimguru.com.au

#Code
if isinstance(IN[0], list):
	OUT = IN[0]
else:
	OUT = [IN[0]]
# ----------------------------------------
List = Output(python_script)
