# Dynamo graph Sample.dyn "Demonstration" (Dynamo 2.3.0.5885)
# packages: Crumple 0.0.1

python_script = Python()  # graph input
# ---------- python_script.python (3 lines) ----------
import clr
from System import Environment
OUT = Environment.UserName
# ----------------------------------------
sessionData = Custom[SessionData]()  # package Crumple; This node returns values about the current session, useful for tracking scripts! Username, Revit file name/path and Dynamo script name (for 2.X versions) are returned.
dateTimeFormatted = Custom[DateTimeFormatted]()  # package Crumple; A typical date time format for the current time, as well as date prefix and time suffix fields. These are typically useful for appending to file names generated via Dynamo.
code_block = CodeBlock { true; 1..3..1; 1..4..1; }
ifThenElse = Custom[IfThenElse](If=code_block.out0, Then=code_block.out1, Else=code_block.out2)  # package Crumple; A simple if/then/else logic gate. If true, you get the 'then' input, otherwise you get the 'else' input. Unlike the OOTB 'If' node, this one allows differing list sizes.
code_block_2 = CodeBlock()
# ---------- code_block_2.designscript (2 lines) ----------
[5,
[5]];
# ----------------------------------------
listForce = Custom[ListForce](Item=code_block_2@L2)  # package Crumple; A basic node to check if the input is in the form of a list, and if not it forces it to become one. This simple python script is useful for incorporation into larger scripts for iterating.
code_block_3 = CodeBlock()
# ---------- code_block_3.designscript (5 lines) ----------
[["headers"],
[1,2,3],
[4,5,6],
[7,8,9]];
1;
# ----------------------------------------
listKickFlip = Custom[ListKickFlip](Data=code_block_3.out0, Kick=code_block_3.out1)  # package Crumple; Drops a certain number of rows from the front a list, then transposes it. Handy for pre-processing Excel data!
crumple = Custom[Crumple]()  # package Crumple; About the package.
