# Dynamo graph Crumple_AddParameters.dyn (Dynamo 2.12.1.8246)
# packages: Crumple 2024.3.1

# group: Get Excel guidance data
excel_file_path = Filename("C:\Users\Gavin\Desktop\Family_AddParameters.xlsx")  # graph input
code_block = CodeBlock { "Data"; }
excel_import = Custom[© Excel.Import](filePath=excel_file_path, sheetName=code_block)  # package Crumple; Imports a 2D matrix of data from an existing Excel file path from a given worksheet name. If a worksheet does not exist by that name it will take the data from the first worksheet instead. Credit to Cyril Poupin for most of the Python code (details in node body).
list_kickflip = Custom[© List.KickFlip](data=excel_import.dataRows)  # package Crumple; Drops a certain number of rows from the front a list, then transposes it. Handy for pre-processing Excel data!
code_block_2 = CodeBlock(IN=list_kickflip) { parNames = IN[0]; grpTypes = IN[1]; parGrps  = IN[2]; isInst   = IN[3] == "YES"; }

# group: Get parameters
flow_relay = Custom[© Flow.Relay](data=code_block_2.parNames)  # package Crumple; Passes data forward.
sharedparameters_flat = Custom[© SharedParameters.Flat]()  # package Crumple; Returns all shared parameters as definition and name, as well as their corresponding group and name.
indexOf = List.IndexOf(list=sharedparameters_flat.paramNames, element=flow_relay)
code_block_3 = CodeBlock(relay=flow_relay, i=indexOf) { relay; i != -1; }
filterByBoolMask = List.FilterByBoolMask(list=code_block_3.relay, mask=code_block_3.out1)
parameters_not_found = Watch(filterByBoolMask.out)  # graph output
filterByBoolMask_2 = List.FilterByBoolMask(list=indexOf, mask=code_block_3.out1)
getItemAtIndex = List.GetItemAtIndex(list=sharedparameters_flat.paramDefs, index=filterByBoolMask_2.in)

# group: Open family documents
directory_path = Directory("C:\Users\Gavin\Desktop\New folder\Added")
code_block_4 = CodeBlock { ".rfa"; false; }
windows_directorycontents = Custom[© Windows.DirectoryContents](directoryPath=directory_path, searchString=code_block_4.out0, deepSearch=code_block_4.out1)  # package Crumple; Be aware there is an OOTB node that can do this, but I wanted to add this to the package so others can see how to use a Python method as a starter block in other scripts.
windows_filterbackups = Custom[© Windows.FilterBackups](filePaths=windows_directorycontents)  # package Crumple; Given a filepath or list of filepaths, separate out any backup file paths.
familydoc_open = Custom[© FamilyDoc.Open](filePaths=windows_filterbackups.validPaths)  # package Crumple; Given a file path to a family, attempts to open that document in the background in Revit if possible. Should not be used for regular models/templates.

# group: Get parameter groups
revit_version = Custom[© Revit.Version]()  # package Crumple; Returns the build information about the active Revit session.
code_block_5 = CodeBlock(v=revit_version.version) { v > 2021; }
parameters_grouptypeidbyname = Custom[© Parameters.GroupTypeIdByName](names=code_block_2.grpTypes)  # package Crumple; Given a name or list of names of group type ids, returns them if found.
parameters_bipgbyname = Custom[© Parameters.BIPGbyName](names=code_block_2.parGrps)  # package Crumple; Given a string or list of strings, return the corresponding BuiltIn Parameter Group.
flow_ifthenelse = Custom[© Flow.IfThenElse](If=code_block_5, Then=parameters_grouptypeidbyname, Else=parameters_bipgbyname)  # package Crumple; A simple if/then/else logic gate. If true, you get the 'then' input, otherwise you get the 'else' input. Unlike the OOTB 'If' node, this one allows differing list sizes.

flow_relay_2 = Custom[© Flow.Relay](data=code_block_2.isInst)
flow_relay_3 = Custom[© Flow.Relay](data=flow_relay_2)

# group: Filter values
list_cullmany = Custom[© List.CullMany](listA=flow_ifthenelse, mask=code_block_3.out1, listB=flow_relay_3)  # package Crumple; Filters up to three lists in parallel. Handy for reducing space that multiple boolean masks occupy otherwise.

# group: Add parameters, report the outcomes
familydoc_addsharedparameters = Custom[© FamilyDoc.AddSharedParameters](familyDocs=familydoc_open.familyDocs, exDefLists=getItemAtIndex, parGroupLists=list_cullmany.listA, isInstanceLists=list_cullmany.listB)  # package Crumple; Given a family document or list of them, attempts to create shared parameters in them. Input structures should be in the form of one sub-list per family document, in a list (but the node will try to create this data structure if not, as well as repeat the last list if they are shorter than the family document list).
familydoc_closeandsave = Custom[© FamilyDoc.CloseAndSave](familyDocs=familydoc_addsharedparameters.familyDocs)  # package Crumple; Attempts to close a family document or list of family documents, and save the families in the process to their current location.
code_block_6 = CodeBlock(par=filterByBoolMask.in) { par + " not be added to "; }
familydoc_title = Custom[© FamilyDoc.Title](familyDocs=familydoc_open.familyDocs)  # package Crumple; Returns the title of a family document in the unwrapped state. Can be used in conjunction with nodes like 'FamilyDocOpen'.
add = code_block_6@L2 + familydoc_title@L1  # lacing=Longest
filterByBoolMask_3 = List.FilterByBoolMask(list=add@L3, mask=familydoc_addsharedparameters.resultLists@L3, lacing=Longest)

# group: Output to user
flatten = List.Flatten(list=filterByBoolMask_3.out)
errors_encountered_if_any = Watch(flatten)  # graph output
