# Dynamo graph Crumple_BatchExportDwg.dyn "Crumple_BatchExportDWG" (Dynamo 2.12.1.8246)
# packages: Crumple 2024.3.1

# group: Core export settings
collect_sheets = Custom[© Collect.Sheets]()  # package Crumple; Returns all the sheets in a document, with the option to omit any placeholder sheets.
sheets_nameformatted = Custom[© Sheets.NameFormatted](sheets=collect_sheets)  # package Crumple; Given a list of sheets, apply a typical naming convention to them with some optional fields such as prefix and separator.
directory_path = Directory("C:\Users\Gavin\Downloads")
revit_createdwgexportoptions = Custom[© Revit.CreateDwgExportOptions]()  # package Crumple; Creates a DWG export options object, or retrieves one with the given name if found in the document.
confirm_export = BoolSelector(true)  # graph input

# group: Export to DWG
revit_exporttodwg = Custom[© Revit.ExportToDwg](directoryPath=directory_path, viewsOrSheets=sheets_nameformatted.sheets, fileNames=sheets_nameformatted.sheetName, dwgExportOptions=revit_createdwgexportoptions.dwgExportOptions, runMe=confirm_export)  # package Crumple; Given a list of views and/or sheets as well as various related settings, attempts to export them to DWG using the provided settings.

# group: Outputs for user
filterByBoolMask = List.FilterByBoolMask(list=sheets_nameformatted.sheetName, mask=revit_exporttodwg.wasExported)
printed = Watch(filterByBoolMask.in)  # graph output
not_printed = Watch(filterByBoolMask.out)  # graph output
