# Dynamo graph Crumple_BatchExportPdf.dyn (Dynamo 2.12.1.8246)
# packages: Crumple 2024.3.1

# group: Core settings for export
collect_sheets = Custom[© Collect.Sheets]()  # package Crumple; Returns all the sheets in a document, with the option to omit any placeholder sheets.
sheets_nameformatted = Custom[© Sheets.NameFormatted](sheets=collect_sheets)  # package Crumple; Given a list of sheets, apply a typical naming convention to them with some optional fields such as prefix and separator.
string_windowslegal = Custom[© String.WindowsLegal](checkStrings=sheets_nameformatted.sheetName)  # package Crumple; Finds all illegal characters for a windows named element and substitutes them with a replacement.
save_files_to_directory = Directory("C:\Users\Gavin\Downloads")  # graph input
revit_exportoptionspdf = Custom[© Revit.ExportOptionsPdf]()  # package Crumple; Provides a list of options to be used in conjunction with the ExportPDF node. Works in Revit 2022 and later.

# group: Export to PDF
flow_relay = Custom[© Flow.Relay](data=string_windowslegal.legalStrings)  # package Crumple; Passes data forward.
revit_exporttopdf = Custom[© Revit.ExportToPdf](directoryPath=save_files_to_directory, sheets=sheets_nameformatted.sheets, fileNames=string_windowslegal.legalStrings, options=revit_exportoptionspdf)  # package Crumple; Given a list of sheets, names, directory and export options this node will batch export PDF files. Requires Revit 2022 or higher to work.

# group: Outputs
filterByBoolMask = List.FilterByBoolMask(list=flow_relay, mask=revit_exporttopdf.wasExported)
exported_successfully = Watch(filterByBoolMask.in)  # graph output
exported_unsuccessfully = Watch(filterByBoolMask.out)  # graph output
