# Dynamo graph Crumple_BatchPrintPdf.dyn "Crumple_BatchPrintPDF" (Dynamo 2.12.1.8246)
# packages: Crumple 2024.3.1

# group: Core print settings
collect_sheets = Custom[© Collect.Sheets]()  # package Crumple; Returns all the sheets in a document, with the option to omit any placeholder sheets.
sheets_nameformatted = Custom[© Sheets.NameFormatted](sheets=collect_sheets)  # package Crumple; Given a list of sheets, apply a typical naming convention to them with some optional fields such as prefix and separator.
directory_path = Directory("C:\Users\Gavin\Downloads")
collect_printsettings = Custom[© Collect.PrintSettings]()  # package Crumple; Returns all print settings in the provided document and their names.
print_setting_name = StringInput("Default")  # graph input
code_block = CodeBlock(settingNames=collect_printsettings.settingNames, n=print_setting_name, settings=collect_printsettings.printSettings)
# ---------- code_block.designscript (6 lines) ----------
// Get print setting by name
ind = List.IndexOf(settingNames, n);
ind == -1 ? "Not found" : settings[ind];

// Printer name
"PDF24";
# ----------------------------------------
confirm_print = BoolSelector(true)  # graph input

# group: Print to PDF
revit_printtopdf = Custom[© Revit.PrintToPdf](directoryPath=directory_path, viewsOrSheets=sheets_nameformatted.sheets, fileNames=sheets_nameformatted.sheetName, printSetting=code_block.out1, printerName=code_block.out2, runMe=confirm_print)  # package Crumple; Given a list of views and/or sheets as well as various related settings, attempts to print them to PDF. You will need to select and adjust a suitable print driver in order to supress 'save as' dialogues and other potential interruptions the print driver may cause by default. Our suggestion is PDF24, which provides options to prevent dialogues from appearing.

# group: Outputs for user
filterByBoolMask = List.FilterByBoolMask(list=sheets_nameformatted.sheetName, mask=revit_printtopdf.wasPrinted)
printed = Watch(filterByBoolMask.in)  # graph output
not_printed = Watch(filterByBoolMask.out)  # graph output
