# Dynamo graph Crumple_FamilyDoc_AddParameters.dyn "FamilyDoc_AddParameters" (Dynamo 2.16.2.5624)
# packages: Crumple 2024.4.3

# group: Basic directory collection workflow
string = StringInput("C:\Users\Gavin\Documents\GitHub\Crumple\Script samples\_Testing\R23\Families\Add params")
code_block = CodeBlock { ".rfa"; false; }
windows_directorycontents = Custom[© Windows.DirectoryContents](directoryPath=string, searchString=code_block.out0, deepSearch=code_block.out1)  # package Crumple; Be aware there is an OOTB node that can do this, but I wanted to add this to the package so others can see how to use a Python method as a starter block in other scripts.
windows_filterbackups = Custom[© Windows.FilterBackups](filePaths=windows_directorycontents)  # package Crumple; Given a filepath or list of filepaths, separate out any backup file paths.
revit_getfileversions = Custom[© Revit.GetFileVersions](filePaths=windows_filterbackups.validPaths)  # package Crumple; Given a file path or list of file paths, attempts to return their version as an integer.
revit_version = Custom[© Revit.Version]()  # package Crumple; Returns the build information about the active Revit session.
eq = revit_getfileversions == revit_version.version
filterByBoolMask = List.FilterByBoolMask(list=windows_filterbackups.validPaths, mask=eq)
familydoc_open = Custom[© FamilyDoc.Open](filePaths=filterByBoolMask.in)  # package Crumple; Given a file path to a family, attempts to open that document in the background in Revit if possible. Should not be used for regular models/templates.

# group: Get Excel guidance data
excel_file_path = Filename("Excel\Crumple_AddParameters.xlsx")  # graph input
code_block_2 = CodeBlock { "Data"; }
excel_read = Custom[© Excel.Read 🐼](filePath=excel_file_path, workSheetNames=code_block_2)  # package Crumple; Given a excel file path, will attempt to read its contents using the pandas library. If your pandas is not valid or found, nothing will be returned.
list_kickflip = Custom[© List.KickFlip](data=excel_read.dataMatrix)  # package Crumple; Drops a certain number of rows from the front a list, then transposes it. Handy for pre-processing Excel data!
code_block_3 = CodeBlock(IN=list_kickflip) { parNames = IN[0]; grpTypes = IN[1]; parGrps  = IN[2]; isInst   = IN[3] == "YES"; }

# group: Get parameters
sharedparameters_flat = Custom[© SharedParameters.Flat]()  # package Crumple; Returns all shared parameters as definition and name, as well as their corresponding group and name.
indexOf = List.IndexOf(list=sharedparameters_flat.paramNames, element=code_block_3.parNames)
list_trytogetitematindex = Custom[© List.TryToGetItemAtIndex](lst=sharedparameters_flat.paramDefs, index=indexOf)  # package Crumple; Attempts to get an item at an index of a list, and replaces it with a specified object if it is not found.
parameters_grouptypeidbyname = Custom[© Parameters.GroupTypeIdByName](names=code_block_3.grpTypes)  # package Crumple; Given a name or list of names of group type ids, returns them if found.

# group: Add parameters, report the outcomes
familydoc_addsharedparameters = Custom[© FamilyDoc.AddSharedParameters](familyDocs=familydoc_open.familyDocs, exDefLists=list_trytogetitematindex.item, parGroupLists=parameters_grouptypeidbyname.groupTypeIds, isInstanceLists=code_block_3.isInst)  # package Crumple; Given a family document or list of them, attempts to create shared parameters in them. Input structures should be in the form of one sub-list per family document, in a list (but the node will try to create this data structure if not, as well as repeat the last list if they are shorter than the family document list).
report = Watch(familydoc_addsharedparameters.outcomeLists)  # graph output
familydoc_closeandsave = Custom[© FamilyDoc.CloseAndSave](familyDocs=familydoc_addsharedparameters.familyDocs)  # package Crumple; Attempts to close a family document or list of family documents, and save the families in the process to their current location.
