# Dynamo graph Crumple_FamilyDoc_GetParameterValues.dyn "FamilyDoc_GetParameterValues" (Dynamo 2.16.2.5624)
# packages: Crumple 2024.4.3

# group: Basic directory collection workflow
string = StringInput("C:\Users\Gavin\Documents\GitHub\Crumple\Script samples\_Testing\R23\Families\Get set")
code_block = CodeBlock { ".rfa"; false; }
windows_directorycontents = Custom[© Windows.DirectoryContents](directoryPath=string, searchString=code_block.out0, deepSearch=code_block.out1)  # package Crumple; Be aware there is an OOTB node that can do this, but I wanted to add this to the package so others can see how to use a Python method as a starter block in other scripts.
windows_filterbackups = Custom[© Windows.FilterBackups](filePaths=windows_directorycontents)  # package Crumple; Given a filepath or list of filepaths, separate out any backup file paths.
revit_getfileversions = Custom[© Revit.GetFileVersions](filePaths=windows_filterbackups.validPaths)  # package Crumple; Given a file path or list of file paths, attempts to return their version as an integer.
revit_version = Custom[© Revit.Version]()  # package Crumple; Returns the build information about the active Revit session.
eq = revit_getfileversions == revit_version.version
filterByBoolMask = List.FilterByBoolMask(list=windows_filterbackups.validPaths, mask=eq)
familydoc_open = Custom[© FamilyDoc.Open](filePaths=filterByBoolMask.in)  # package Crumple; Given a file path to a family, attempts to open that document in the background in Revit if possible. Should not be used for regular models/templates.

# group: Get family parameter values by types
familydoc_getparameters = Custom[© FamilyDoc.GetParameters](familyDocs=familydoc_open.familyDocs)  # package Crumple; Given a family document or list of them, returns all parameters and their properties in those documents. You can provide optionally provide parameter names to get just those parameters.
familydoc_gettypes = Custom[© FamilyDoc.GetTypes](familyDocs=familydoc_getparameters.familyDocs)  # package Crumple; Given a family document or list of documents, returns all types in that document and their names. You can provide optionally provide type names to get just those types.
flatten = List.Flatten(list=familydoc_getparameters.parameterLists)
familyparam_name = Custom[© FamilyParam.Name](familyParams=flatten)  # package Crumple; Given a family parameter of list of them, return the parameter names. Use @L2 levels for list of list processing.
uniqueItems = List.UniqueItems(list=familyparam_name)
sort = List.Sort(list=uniqueItems)
familydoc_getparametervalues = Custom[© FamilyDoc.GetParameterValues](familyDocs=familydoc_gettypes.familyDocs, nameOrParamLists=sort, nameOrTypeLists=familydoc_gettypes.typeLists)  # package Crumple; Given a family document of list of them, attempts to get all parameter values of the provided types or type names.
familydoc_valuesreport = Custom[© FamilyDoc.ValuesReport](familyDocs=familydoc_getparametervalues.familyDocs, paramLists=familydoc_getparametervalues.paramLists, valLists=familydoc_getparametervalues.valueLists, typeLists=familydoc_gettypes.typeLists)  # package Crumple; Given the outputs of the family types and parmaeter values nodes, puts together an Excel valid data structure. Elements will be converted to Name/Id syntax.

# group: Write report to directory
code_block_2 = CodeBlock(dp=string) { dp + "\\ParameterValues.xlsx"; "Values"; }
excel_write = Custom[© Excel.Write 🐼](filePath=code_block_2.out0, workSheetNames=code_block_2.out1, dataMatrices=familydoc_valuesreport)  # package Crumple; Given a file path, sheet(s) and data matrice(s) attempts to write them to those worksheets. If a file does not exist at the path one will be created. If pandas is not found or valid, an error will be returned.
flow_waitfor = Custom[© Flow.WaitFor](data=familydoc_getparametervalues.familyDocs, waitFor=excel_write.success)  # package Crumple; Tells the first input to wait for the second input to arrive, then passes on the first input. Really useful for scripts which have branching paths that rely on their outputs to carry each other forward. Quite a few custom packages have a 'passthrough' or 'waitfor' node. I use these all the time, so find it useful to have them contained in this package also.

# group: Report the outcomes
report = Watch(excel_write.errorReport)  # graph output
familydoc_closewithoutsave = Custom[© FamilyDoc.CloseWithoutSave](familyDocs=flow_waitfor)  # package Crumple; Attempts to close a family document or list of family documents, without saving them.
