# Dynamo graph Crumple_FamilyDoc_RemoveParameters.dyn "FamilyDoc_RemoveParameters" (Dynamo 2.16.2.5624)
# packages: Crumple 2024.4.3

# group: Basic directory collection workflow
string = StringInput("C:\Users\Gavin\Documents\GitHub\Crumple\Script samples\_Testing\R23\Families\Remove params")
code_block = CodeBlock { ".rfa"; false; }
windows_directorycontents = Custom[© Windows.DirectoryContents](directoryPath=string, searchString=code_block.out0, deepSearch=code_block.out1)  # package Crumple; Be aware there is an OOTB node that can do this, but I wanted to add this to the package so others can see how to use a Python method as a starter block in other scripts.
windows_filterbackups = Custom[© Windows.FilterBackups](filePaths=windows_directorycontents)  # package Crumple; Given a filepath or list of filepaths, separate out any backup file paths.
revit_getfileversions = Custom[© Revit.GetFileVersions](filePaths=windows_filterbackups.validPaths)  # package Crumple; Given a file path or list of file paths, attempts to return their version as an integer.
revit_version = Custom[© Revit.Version]()  # package Crumple; Returns the build information about the active Revit session.
eq = revit_getfileversions == revit_version.version
filterByBoolMask = List.FilterByBoolMask(list=windows_filterbackups.validPaths, mask=eq)
familydoc_open = Custom[© FamilyDoc.Open](filePaths=filterByBoolMask.in)  # package Crumple; Given a file path to a family, attempts to open that document in the background in Revit if possible. Should not be used for regular models/templates.

# group: Remove parameters by name if present
code_block_2 = CodeBlock()
# ---------- code_block_2.designscript (5 lines) ----------
["Keynote",
"BG_DIM_Width1",
"BG_DIM_Depth1",
"BG_DIM_Height1",
"N/A"];
# ----------------------------------------
familydoc_getparameters = Custom[© FamilyDoc.GetParameters](familyDocs=familydoc_open.familyDocs, nameLists=code_block_2)  # package Crumple; Given a family document or list of them, returns all parameters and their properties in those documents. You can provide optionally provide parameter names to get just those parameters.
familydoc_removeparameters = Custom[© FamilyDoc.RemoveParameters](familyDocs=familydoc_getparameters.familyDocs, nameOrParamLists=familydoc_getparameters.parameterLists)  # package Crumple; Given a family document or list of them, attempts to remove parameters in them. Input structures should be in the form of one sub-list per family document, in a list (but the node will try to create this data structure if not, as well as repeat the last list if they are shorter than the family document list).

# group: Add parameters, report the outcomes
outcomes = Watch(familydoc_removeparameters.outcomeLists)  # graph output
familydoc_closeandsave = Custom[© FamilyDoc.CloseAndSave](familyDocs=familydoc_removeparameters.familyDocs)  # package Crumple; Attempts to close a family document or list of family documents, and save the families in the process to their current location.
