# Dynamo graph Crumple_FamilyDoc_ReplaceParameters.dyn "FamilyDoc_ReplaceParameters" (Dynamo 2.16.2.5624)
# packages: Crumple 2024.4.3

# group: Basic directory collection workflow
string = StringInput("C:\Users\Gavin\Documents\GitHub\Crumple\Script samples\_Testing\R23\Families\Replace params")
code_block = CodeBlock { ".rfa"; false; }
windows_directorycontents = Custom[© Windows.DirectoryContents](directoryPath=string, searchString=code_block.out0, deepSearch=code_block.out1)  # package Crumple; Be aware there is an OOTB node that can do this, but I wanted to add this to the package so others can see how to use a Python method as a starter block in other scripts.
windows_filterbackups = Custom[© Windows.FilterBackups](filePaths=windows_directorycontents)  # package Crumple; Given a filepath or list of filepaths, separate out any backup file paths.
revit_getfileversions = Custom[© Revit.GetFileVersions](filePaths=windows_filterbackups.validPaths)  # package Crumple; Given a file path or list of file paths, attempts to return their version as an integer.
revit_version = Custom[© Revit.Version]()  # package Crumple; Returns the build information about the active Revit session.
eq = revit_getfileversions == revit_version.version
filterByBoolMask = List.FilterByBoolMask(list=windows_filterbackups.validPaths, mask=eq)
familydoc_open = Custom[© FamilyDoc.Open](filePaths=filterByBoolMask.in)  # package Crumple; Given a file path to a family, attempts to open that document in the background in Revit if possible. Should not be used for regular models/templates.

# group: Get Excel guidance data
excel_file_path = Filename("Excel\Crumple_ReplaceParameters.xlsx")  # graph input
code_block_2 = CodeBlock { "Data"; }
excel_read = Custom[© Excel.Read 🐼](filePath=excel_file_path, workSheetNames=code_block_2)  # package Crumple; Given a excel file path, will attempt to read its contents using the pandas library. If your pandas is not valid or found, nothing will be returned.
list_kickflip = Custom[© List.KickFlip](data=excel_read.dataMatrix)  # package Crumple; Drops a certain number of rows from the front a list, then transposes it. Handy for pre-processing Excel data!
code_block_3 = CodeBlock(IN=list_kickflip) { findPars = IN[0]; replPars = IN[1]; }

familydoc_getparameters = Custom[© FamilyDoc.GetParameters](familyDocs=familydoc_open.familyDocs, nameLists=code_block_3.findPars)  # package Crumple; Given a family document or list of them, returns all parameters and their properties in those documents. You can provide optionally provide parameter names to get just those parameters.

# group: Get parameters
sharedparameters_flat = Custom[© SharedParameters.Flat]()  # package Crumple; Returns all shared parameters as definition and name, as well as their corresponding group and name.
indexOf = List.IndexOf(list=sharedparameters_flat.paramNames, element=code_block_3.replPars)
list_trytogetitematindex = Custom[© List.TryToGetItemAtIndex](lst=sharedparameters_flat.paramDefs, index=indexOf)  # package Crumple; Attempts to get an item at an index of a list, and replaces it with a specified object if it is not found.

familydoc = Custom[© FamilyDoc.ReplaceWithSharedParameters](familyDocs=familydoc_getparameters.familyDocs, parLists=familydoc_getparameters.parameterLists, exDefLists=list_trytogetitematindex.item)  # package Crumple; Given a family document or list of documents, as well as family parameters and shared parameter definitions, this node will attempt to replace the parameters.

# group: Add parameters, report the outcomes
outcomes = Watch(familydoc.outcomeLists)  # graph output
familydoc_closeandsave = Custom[© FamilyDoc.CloseAndSave](familyDocs=familydoc.familyDocs)  # package Crumple; Attempts to close a family document or list of family documents, and save the families in the process to their current location.
