# Dynamo graph Crumple_FamilyDoc_SaveFromProject.dyn "Crumple_SaveFromProject" (Dynamo 2.16.2.5624)
# packages: Crumple 2024.4.3

# group: Get first 15 families
collect_families = Custom[© Collect.Families]()  # package Crumple; Returns all families in the document. Families are sorted into user created, inplace and internal.
shuffle = List.Shuffle(list=collect_families.userCreated)
code_block = CodeBlock { 15; }
takeItems = List.TakeItems(list=shuffle, amount=code_block)

# group: Process file paths
windows_desktop = Custom[© Windows.Desktop]()  # package Crumple; This node returns the active username, as well as a path to the user's Desktop.
family_categoryname = Custom[© Family.CategoryName](families=takeItems)  # package Crumple; Returns the category name a family is associated with.
name = Element.Name(element=takeItems)
code_block_2 = CodeBlock(dp=windows_desktop, cat=family_categoryname, n=name) { dirs = dp + "\\Families\\" + cat + "\\" + n + ".rfa"; }

family_saveas = Custom[© Family.SaveAs](families=takeItems, filePaths=code_block_2)  # package Crumple; Saves families in the current document to the given file paths.
