# Dynamo graph Crumple_FamilyDoc_SetParameterValues.dyn "FamilyDoc_SetParameterValues" (Dynamo 2.16.2.5624)
# packages: Crumple 2024.4.3

# group: Basic directory collection workflow
string = StringInput("C:\Users\Gavin\Documents\GitHub\Crumple\Script samples\_Testing\R23\Families\Get set")
code_block = CodeBlock { ".rfa"; false; }
windows_directorycontents = Custom[© Windows.DirectoryContents](directoryPath=string, searchString=code_block.out0, deepSearch=code_block.out1)  # package Crumple; Be aware there is an OOTB node that can do this, but I wanted to add this to the package so others can see how to use a Python method as a starter block in other scripts.
windows_filterbackups = Custom[© Windows.FilterBackups](filePaths=windows_directorycontents)  # package Crumple; Given a filepath or list of filepaths, separate out any backup file paths.
revit_getfileversions = Custom[© Revit.GetFileVersions](filePaths=windows_filterbackups.validPaths)  # package Crumple; Given a file path or list of file paths, attempts to return their version as an integer.
revit_version = Custom[© Revit.Version]()  # package Crumple; Returns the build information about the active Revit session.
eq = revit_getfileversions == revit_version.version
filterByBoolMask = List.FilterByBoolMask(list=windows_filterbackups.validPaths, mask=eq)
familydoc_open = Custom[© FamilyDoc.Open](filePaths=filterByBoolMask.in)  # package Crumple; Given a file path to a family, attempts to open that document in the background in Revit if possible. Should not be used for regular models/templates.

# group: Read report
code_block_2 = CodeBlock(dp=string) { dp + "\\ParameterValues.xlsx"; "Values"; }
excel_read = Custom[© Excel.Read 🐼](filePath=code_block_2.out0, workSheetNames=code_block_2.out1)  # package Crumple; Given a excel file path, will attempt to read its contents using the pandas library. If your pandas is not valid or found, nothing will be returned.

# group: Set values and close/report
familydoc_reporttovalues = Custom[© FamilyDoc.ReportToValues](familyDocs=familydoc_open.familyDocs, report=excel_read.dataMatrix)  # package Crumple; Given an input from the typical valuesreport structure, attempts to prepare this data into its equivalent data structure for a SetValues node. Missing values will become nulls and Blank values will become empty strings.
familydoc_setparametervalues = Custom[© FamilyDoc.SetParameterValues](familyDocs=familydoc_reporttovalues.familyDocs, nameOrParamLists=familydoc_reporttovalues.paramLists, nameOrTypeLists=familydoc_reporttovalues.typeLists, valueLists=familydoc_reporttovalues.valLists)  # package Crumple; Given a list of family documents, parmeters, types and value lists by type the node will attempt to set the parameter values. ElementId based values should be provided in the form of elements (not Ids) respective to the family document. For best results, combine this with the ReportToValues node.
familydoc_closeandsave = Custom[© FamilyDoc.CloseAndSave](familyDocs=familydoc_setparametervalues.familyDocs)  # package Crumple; Attempts to close a family document or list of family documents, and save the families in the process to their current location.
report = Watch(familydoc_setparametervalues.outcomeLists)  # graph output
