# Dynamo graph Crumple_FamilyDoc_ValuesToExcel.dyn "Crumple_GetParameterValues" (Dynamo 2.16.2.5624)
# packages: Crumple 2024.4.3

# group: Open family documents
directory_path = Directory("C:\Users\Gavin\Desktop\Families\Directory")
code_block = CodeBlock { ".rfa"; false; }
windows_directorycontents = Custom[© Windows.DirectoryContents](directoryPath=directory_path, searchString=code_block.out0, deepSearch=code_block.out1)  # package Crumple; Be aware there is an OOTB node that can do this, but I wanted to add this to the package so others can see how to use a Python method as a starter block in other scripts.
windows_filterbackups = Custom[© Windows.FilterBackups](filePaths=windows_directorycontents)  # package Crumple; Given a filepath or list of filepaths, separate out any backup file paths.
familydoc_open = Custom[© FamilyDoc.Open](filePaths=windows_filterbackups.validPaths)  # package Crumple; Given a file path to a family, attempts to open that document in the background in Revit if possible. Should not be used for regular models/templates.

flow_relay = Custom[© Flow.Relay](data=directory_path)  # package Crumple; Passes data forward.

# group: Inputs
missing_values = StringInput("<N/A>")  # graph input
blank_values = StringInput("<Blank>")
by_rows = BoolSelector(true)

# group: Get parameter values report for Excel
familydoc_getparameters = Custom[© FamilyDoc.GetParameters](familyDocs=familydoc_open.familyDocs)  # package Crumple; Given a family document or list of them, returns all parameters and their properties in those documents. You can provide optionally provide parameter names to get just those parameters.
familydoc_gettypes = Custom[© FamilyDoc.GetTypes](familyDocs=familydoc_open.familyDocs)  # package Crumple; Given a family document or list of documents, returns all types in that document and their names. You can provide optionally provide type names to get just those types.
familydoc_getparametervalues = Custom[© FamilyDoc.GetParameterValues](familyDocs=familydoc_getparameters.familyDocs, nameOrParamLists=familydoc_getparameters.parameterLists, nameOrTypeLists=familydoc_gettypes.typeLists)  # package Crumple; Given a family document of list of them, attempts to get all parameter values of the provided types or type names.
familydoc_valuesreport = Custom[© FamilyDoc.ValuesReport](familyDocs=familydoc_getparametervalues.familyDocs, paramLists=familydoc_getparametervalues.paramLists, valLists=familydoc_getparametervalues.valueLists, typeLists=familydoc_gettypes.typeLists, valueMissingStr=missing_values, valueBlankStr=blank_values, byRows=by_rows)  # package Crumple; Given the outputs of the family types and parmaeter values nodes, puts together an Excel valid data structure. Elements will be converted to Name/Id syntax.

# group: Write the report to a new Excel file
code_block_2 = CodeBlock(dp=flow_relay, data=familydoc_valuesreport) { dp + "\\familyValuesExport.xlsx"; "Data"; data; }
excel_write = Custom[© Excel.Write 🐼](filePath=code_block_2.out0, workSheetNames=code_block_2.out1, dataMatrices=code_block_2.data)  # package Crumple; Given a file path, sheet(s) and data matrice(s) attempts to write them to those worksheets. If a file does not exist at the path one will be created. If pandas is not found or valid, an error will be returned.

# group: Close family documents
flow_waitfor = Custom[© Flow.WaitFor](data=familydoc_getparametervalues.familyDocs, waitFor=familydoc_valuesreport)  # package Crumple; Tells the first input to wait for the second input to arrive, then passes on the first input. Really useful for scripts which have branching paths that rely on their outputs to carry each other forward. Quite a few custom packages have a 'passthrough' or 'waitfor' node. I use these all the time, so find it useful to have them contained in this package also.
familydoc_closewithoutsave = Custom[© FamilyDoc.CloseWithoutSave](familyDocs=flow_waitfor)  # package Crumple; Attempts to close a family document or list of family documents, without saving them.
