# Dynamo graph Crumple_ImpExp_BatchExportDwg.dyn "ImpExp_BatchExportDwg" (Dynamo 2.16.2.5624)
# packages: Crumple 2024.4.3

# group: Settings
windows_desktop = Custom[© Windows.Desktop]()  # package Crumple; This node returns the active username, as well as a path to the user's Desktop.
code_block = CodeBlock(dp=windows_desktop) { dp + "\\Export"; }
collect_sheets = Custom[© Collect.Sheets]()  # package Crumple; Returns all the sheets in a document, with the option to omit any placeholder sheets.
code_block_2 = CodeBlock { 5; }
takeItems = List.TakeItems(list=collect_sheets, amount=code_block_2)
sheets_nameformatted = Custom[© Sheets.NameFormatted](sheets=takeItems)  # package Crumple; Given a list of sheets, apply a typical naming convention to them with some optional fields such as prefix and separator.
string_windowslegal = Custom[© String.WindowsLegal](checkStrings=sheets_nameformatted.sheetName)  # package Crumple; Finds all illegal characters for a windows named element and substitutes them with a replacement.
revit_exportoptionsdwg = Custom[© Revit.ExportOptionsDwg]()  # package Crumple; Creates a DWG export options object, or retrieves one with the given name if found in the document.
code_block_3 = CodeBlock { true; }

# group: Export to DWG
revit_exporttodwg = Custom[© Revit.ExportToDwg](directoryPath=code_block, viewsAndSheets=sheets_nameformatted.sheets, fileNames=string_windowslegal.legalStrings, dwgExportOptions=revit_exportoptionsdwg.dwgExportOptions, runMe=code_block_3)  # package Crumple; Given a list of views and/or sheets as well as various related settings, attempts to export them to DWG using the provided settings.
filterByBoolMask = List.FilterByBoolMask(list=revit_exporttodwg.filePaths, mask=revit_exporttodwg.success)
failed_to_export = Watch(filterByBoolMask.out)  # graph output
