# Dynamo graph Crumple_ImpExp_BatchPrintPdf.dyn (Dynamo 2.16.2.5624)
# packages: Crumple 2024.4.3

# group: Settings
windows_desktop = Custom[© Windows.Desktop]()  # package Crumple; This node returns the active username, as well as a path to the user's Desktop.
code_block = CodeBlock(dp=windows_desktop) { dp + "\\Export"; }
collect_sheets = Custom[© Collect.Sheets]()  # package Crumple; Returns all the sheets in a document, with the option to omit any placeholder sheets.
code_block_2 = CodeBlock { 5; }
takeItems = List.TakeItems(list=collect_sheets, amount=code_block_2)
sheets_nameformatted = Custom[© Sheets.NameFormatted](sheets=takeItems)  # package Crumple; Given a list of sheets, apply a typical naming convention to them with some optional fields such as prefix and separator.
string_windowslegal = Custom[© String.WindowsLegal](checkStrings=sheets_nameformatted.sheetName)  # package Crumple; Finds all illegal characters for a windows named element and substitutes them with a replacement.
collect_printsettings = Custom[© Collect.PrintSettings]()  # package Crumple; Returns all print settings in the provided document and their names.
firstItem = List.FirstItem(list=collect_printsettings.printSettings)
printer_name = StringInput("PDF Writer - bioPDF")  # graph input
code_block_3 = CodeBlock { true; }

# group: Print to PDF
revit_printtopdf = Custom[© Revit.PrintToPdf](directoryPath=code_block, viewsAndSheets=sheets_nameformatted.sheets, fileNames=string_windowslegal.legalStrings, printSetting=firstItem, printerName=printer_name, runMe=code_block_3)  # package Crumple; Given a list of views and/or sheets as well as various related settings, attempts to print them to PDF. You will need to select and adjust a suitable print driver in order to supress 'save as' dialogues and other potential interruptions the print driver may cause by default. Our suggestion is PDF24, which provides options to prevent dialogues from appearing.
filterByBoolMask = List.FilterByBoolMask(list=revit_printtopdf.filePaths, mask=revit_printtopdf.success)
failed_to_export = Watch(filterByBoolMask.out)  # graph output
