# Dynamo graph Crumple_LoadFamiliesFromPaths.dyn (Dynamo 2.12.1.8246)
# packages: Crumple 2024.3.1

# group: Open family documents
directory_path = Directory("C:\Users\Gavin\Desktop\Families\Directory")
code_block = CodeBlock { ".rfa"; false; }
windows_directorycontents = Custom[© Windows.DirectoryContents](directoryPath=directory_path, searchString=code_block.out0, deepSearch=code_block.out1)  # package Crumple; Be aware there is an OOTB node that can do this, but I wanted to add this to the package so others can see how to use a Python method as a starter block in other scripts.
windows_filterbackups = Custom[© Windows.FilterBackups](filePaths=windows_directorycontents)  # package Crumple; Given a filepath or list of filepaths, separate out any backup file paths.

familydoc_loadfrompath = Custom[© FamilyDoc.LoadFromPath](filePaths=windows_filterbackups.validPaths)  # package Crumple; Attempts to load families from the given file paths to the current document.

# group: Report failures (ignore errors)
filterByBoolMask = List.FilterByBoolMask(list=windows_filterbackups.validPaths, mask=familydoc_loadfrompath.wasLoaded)
failed_to_load_families = Watch(filterByBoolMask.out)  # graph output
