# Dynamo graph Crumple_SetParameterValues.dyn (Dynamo 2.12.1.8246)
# packages: Crumple 2024.3.1

# group: Open family documents
directory_path = Directory("C:\Users\Gavin\Desktop\New folder\ValuesSet")
code_block = CodeBlock { ".rfa"; false; }
windows_directorycontents = Custom[© Windows.DirectoryContents](directoryPath=directory_path, searchString=code_block.out0, deepSearch=code_block.out1)  # package Crumple; Be aware there is an OOTB node that can do this, but I wanted to add this to the package so others can see how to use a Python method as a starter block in other scripts.
windows_filterbackups = Custom[© Windows.FilterBackups](filePaths=windows_directorycontents)  # package Crumple; Given a filepath or list of filepaths, separate out any backup file paths.
familydoc_open = Custom[© FamilyDoc.Open](filePaths=windows_filterbackups.validPaths)  # package Crumple; Given a file path to a family, attempts to open that document in the background in Revit if possible. Should not be used for regular models/templates.

# group: Get Excel report
excel_file_path = Filename("New folder\ValuesSet\familyValuesImport.xlsx")  # graph input
code_block_2 = CodeBlock { "Data"; }
excel_import = Custom[© Excel.Import](filePath=excel_file_path, sheetName=code_block_2)  # package Crumple; Imports a 2D matrix of data from an existing Excel file path from a given worksheet name. If a worksheet does not exist by that name it will take the data from the first worksheet instead. Credit to Cyril Poupin for most of the Python code (details in node body).
missing_values = StringInput("<N/A>")  # graph input
blank_values = StringInput("<Blank>")

familydoc_reporttovalues = Custom[© FamilyDoc.ReportToValues](familyDocs=familydoc_open.familyDocs, report=excel_import.dataRows, valueMissingStr=missing_values, valueBlankStr=blank_values)  # package Crumple; Given an input from the typical valuesreport structure, attempts to prepare this data into its equivalent data structure for a SetValues node. Missing values will become nulls and Blank values will become empty strings.

# group: Close family documents
flow_waitfor = Custom[© Flow.WaitFor](data=familydoc_open.familyDocs, waitFor=familydoc_reporttovalues.familyDocs)  # package Crumple; Tells the first input to wait for the second input to arrive, then passes on the first input. Really useful for scripts which have branching paths that rely on their outputs to carry each other forward. Quite a few custom packages have a 'passthrough' or 'waitfor' node. I use these all the time, so find it useful to have them contained in this package also.
familydoc_closewithoutsave = Custom[© FamilyDoc.CloseWithoutSave](familyDocs=flow_waitfor)  # package Crumple; Attempts to close a family document or list of family documents, without saving them.
