# Dynamo graph Crumple_RemoveParameters.dyn (Dynamo 2.12.1.8246)
# packages: Crumple 2024.3.1

# group: Open family documents
directory_path = Directory("C:\Users\Gavin\Desktop\Families\Directory")
code_block = CodeBlock { ".rfa"; false; }
windows_directorycontents = Custom[© Windows.DirectoryContents](directoryPath=directory_path, searchString=code_block.out0, deepSearch=code_block.out1)  # package Crumple; Be aware there is an OOTB node that can do this, but I wanted to add this to the package so others can see how to use a Python method as a starter block in other scripts.
windows_filterbackups = Custom[© Windows.FilterBackups](filePaths=windows_directorycontents)  # package Crumple; Given a filepath or list of filepaths, separate out any backup file paths.
familydoc_open = Custom[© FamilyDoc.Open](filePaths=windows_filterbackups.validPaths)  # package Crumple; Given a file path to a family, attempts to open that document in the background in Revit if possible. Should not be used for regular models/templates.

# group: Remove parameters by name if present
code_block_2 = CodeBlock()
# ---------- code_block_2.designscript (5 lines) ----------
["Keynote",
"BG_DIM_Width1",
"BG_DIM_Depth1",
"BG_DIM_Height1",
"N/A"];
# ----------------------------------------
familydoc_getparameters = Custom[© FamilyDoc.GetParameters](familyDocs=familydoc_open.familyDocs, nameLists=code_block_2)  # package Crumple; Given a family document or list of them, returns all parameters and their properties in those documents. You can provide optionally provide parameter names to get just those parameters.
familydoc_removeparameters = Custom[© FamilyDoc.RemoveParameters](familyDocs=familydoc_open.familyDocs, nameOrParamLists=familydoc_getparameters.parameterLists)  # package Crumple; Given a family document or list of them, attempts to remove parameters in them. Input structures should be in the form of one sub-list per family document, in a list (but the node will try to create this data structure if not, as well as repeat the last list if they are shorter than the family document list).

# group: Add parameters, report the outcomes
familydoc_closeandsave = Custom[© FamilyDoc.CloseAndSave](familyDocs=familydoc_removeparameters.familyDocs)  # package Crumple; Attempts to close a family document or list of family documents, and save the families in the process to their current location.

# group: Report failures (ignore errors)
flatten = List.Flatten(list=familydoc_removeparameters.outcomeLists)
code_block_3 = CodeBlock { "FAILURE"; true; }
startsWith = String.StartsWith(string=flatten, searchFor=code_block_3.out0, ignoreCase=code_block_3.out1)
filterByBoolMask = List.FilterByBoolMask(list=flatten, mask=startsWith)
failed_to_set_values = Watch(filterByBoolMask.in)  # graph output
