# Dynamo graph Crumple_SaveFromProject.dyn (Dynamo 2.12.1.8246)
# packages: Crumple 2024.4.3

# group: Collect all families
collect_families = Custom[© Collect.Families]()  # package Crumple; Returns all families in the document. Families are sorted into user created, inplace and internal.

save_to_directory = Directory("C:\Users\Gavin\Desktop\Families")  # graph input

# group: Process file paths
family_categoryname = Custom[© Family.CategoryName](families=collect_families.userCreated)  # package Crumple; Returns the category name a family is associated with.
name = Element.Name(element=collect_families.userCreated)
code_block = CodeBlock(dp=save_to_directory, cat=family_categoryname, n=name) { dirs = dp + "\\" + cat + "\\" + n + ".rfa"; }

family_saveas = Custom[© Family.SaveAs](families=collect_families.userCreated, filePaths=code_block)  # package Crumple; Saves families in the current document to the given file paths.
