# Dynamo graph Crumple_SetParameterValues.dyn (Dynamo 2.12.1.8246)
# packages: Crumple 2024.3.1, Crumple 2024.4.3

# group: Open family documents
directory_path = Directory("C:\Users\Gavin\Desktop\Families\Directory")
code_block = CodeBlock { ".rfa"; false; }
windows_directorycontents = Custom[© Windows.DirectoryContents](directoryPath=directory_path, searchString=code_block.out0, deepSearch=code_block.out1)  # package Crumple; Be aware there is an OOTB node that can do this, but I wanted to add this to the package so others can see how to use a Python method as a starter block in other scripts.
windows_filterbackups = Custom[© Windows.FilterBackups](filePaths=windows_directorycontents)  # package Crumple; Given a filepath or list of filepaths, separate out any backup file paths.
familydoc_open = Custom[© FamilyDoc.Open](filePaths=windows_filterbackups.validPaths)  # package Crumple; Given a file path to a family, attempts to open that document in the background in Revit if possible. Should not be used for regular models/templates.

# group: Get Excel report
excel_file_path = Filename("..\..\..\..\Desktop\Families\Directory\familyValuesImport.xlsx")  # graph input
code_block_2 = CodeBlock { "Data"; }
excel_import = Custom[🐍 Excel.Import](filePath=excel_file_path, sheetName=code_block_2)  # package Crumple; Imports a 2D matrix of data from an existing Excel file path from a given worksheet name. If a worksheet does not exist by that name it will take the data from the first worksheet instead. Credit to Cyril Poupin for most of the Python code (details in node body).
missing_values = StringInput("<N/A>")  # graph input
blank_values = StringInput("<Blank>")

# group: Process report, set values
familydoc_reporttovalues = Custom[© FamilyDoc.ReportToValues](familyDocs=familydoc_open.familyDocs, report=excel_import.dataRows, valueMissingStr=missing_values, valueBlankStr=blank_values)  # package Crumple; Given an input from the typical valuesreport structure, attempts to prepare this data into its equivalent data structure for a SetValues node. Missing values will become nulls and Blank values will become empty strings.
familydoc_setparametervalues = Custom[© FamilyDoc.SetParameterValues](familyDocs=familydoc_reporttovalues.familyDocs, nameOrParamLists=familydoc_reporttovalues.paramLists, nameOrTypeLists=familydoc_reporttovalues.typeLists, valueLists=familydoc_reporttovalues.valLists)  # package Crumple; Given a list of family documents, parmeters, types and value lists by type the node will attempt to set the parameter values. ElementId based values should be provided in the form of elements (not Ids) respective to the family document. For best results, combine this with the ReportToValues node.

# group: Close docs
familydoc_closeandsave = Custom[© FamilyDoc.CloseAndSave](familyDocs=familydoc_setparametervalues.familyDocs)  # package Crumple; Attempts to close a family document or list of family documents, and save the families in the process to their current location.

# group: Report failures (ignore errors)
flatten = List.Flatten(list=familydoc_setparametervalues.outcomeLists)
code_block_3 = CodeBlock { "FAILURE"; true; }
startsWith = String.StartsWith(string=flatten, searchFor=code_block_3.out0, ignoreCase=code_block_3.out1)
filterByBoolMask = List.FilterByBoolMask(list=flatten, mask=startsWith)
failed_to_set_values = Watch(filterByBoolMask.in)  # graph output
