# Dynamo graph 1_AddParameters.dyn (Dynamo 2.17.1.4055)
# packages: Crumple 2024.3.1, Crumple 2024.4.2

# group: Open family documents
directory_path = Directory("C:\Users\Gavin\Desktop\Family files\1 - Add parameters")
code_block = CodeBlock { ".rfa"; false; }
windows_directorycontents = Custom[© Windows.DirectoryContents](directoryPath=directory_path, searchString=code_block.out0, deepSearch=code_block.out1)  # package Crumple; Be aware there is an OOTB node that can do this, but I wanted to add this to the package so others can see how to use a Python method as a starter block in other scripts.
windows_filterbackups = Custom[© Windows.FilterBackups](filePaths=windows_directorycontents)  # package Crumple; Given a filepath or list of filepaths, separate out any backup file paths.
familydoc_open = Custom[© FamilyDoc.Open](filePaths=windows_filterbackups.validPaths)  # package Crumple; Given a file path to a family, attempts to open that document in the background in Revit if possible. Should not be used for regular models/templates.

# group: Get Excel guidance data
excel_file_path = Filename("Excel\1_AddParameters.xlsx")  # graph input
code_block_2 = CodeBlock { "Data"; }
excel_import = Custom[© Excel.Import](filePath=excel_file_path, sheetName=code_block_2)  # package Crumple; Imports a 2D matrix of data from an existing Excel file path from a given worksheet name. If a worksheet does not exist by that name it will take the data from the first worksheet instead. Credit to Cyril Poupin for most of the Python code (details in node body).
list_kickflip = Custom[© List.KickFlip](data=excel_import.dataRows)  # package Crumple; Drops a certain number of rows from the front a list, then transposes it. Handy for pre-processing Excel data!
code_block_3 = CodeBlock(IN=list_kickflip) { parNames = IN[0]; }

# group: Get parameters
sharedparameters_flat = Custom[© SharedParameters.Flat]()  # package Crumple; Returns all shared parameters as definition and name, as well as their corresponding group and name.
flow_relay = Custom[© Flow.Relay](data=code_block_3)  # package Crumple; Passes data forward.
indexOf = List.IndexOf(list=sharedparameters_flat.paramNames, element=flow_relay)
code_block_4 = CodeBlock(i=indexOf) { i != -1; }
filterByBoolMask = List.FilterByBoolMask(list=indexOf, mask=code_block_4)
getItemAtIndex = List.GetItemAtIndex(list=sharedparameters_flat.paramDefs, index=filterByBoolMask.in)

# group: Filter data by parameters found
filterByBoolMask_2 = List.FilterByBoolMask(list=list_kickflip@L2, mask=code_block_4@L2, lacing=Longest)
code_block_5 = CodeBlock(IN=filterByBoolMask_2.in) { grpTypes = IN[1]; parGrps  = IN[2]; isInst   = IN[3] == "YES"; formulae = IN[4]; }

# group: Get parameter groups
revit_version = Custom[© Revit.Version]()  # package Crumple; Returns the build information about the active Revit session.
code_block_6 = CodeBlock(v=revit_version.version) { v > 2021; }
parameters_grouptypeidbyname = Custom[© Parameters.GroupTypeIdByName](names=code_block_5.grpTypes)  # package Crumple; Given a name or list of names of group type ids, returns them if found.
parameters_bipgbyname = Custom[© Parameters.BIPGbyName](names=code_block_5.parGrps)  # package Crumple; Given a string or list of strings, return the corresponding BuiltIn Parameter Group.
flow_ifthenelse = Custom[© Flow.IfThenElse](If=code_block_6, Then=parameters_grouptypeidbyname, Else=parameters_bipgbyname)  # package Crumple; A simple if/then/else logic gate. If true, you get the 'then' input, otherwise you get the 'else' input. Unlike the OOTB 'If' node, this one allows differing list sizes.
code_block_7 = CodeBlock(isInst=code_block_5.isInst, formulae=code_block_5.formulae) { isInst; formulae; }

# group: Add parameters, report the outcomes
familyDocAddSharedParameters = Custom[FamilyDocAddSharedParameters](familyDocs=familydoc_open.familyDocs, exDefLists=getItemAtIndex, parGroupLists=flow_ifthenelse, isInstanceLists=code_block_7.isInst)  # package Crumple; Given a family document or list of them, attempts to create shared parameters in them. Input structures should be in the form of one sub-list per family document, in a list (but the node will try to create this data structure if not, as well as repeat the last list if they are shorter than the family document list).
familydoc_setformulae = Custom[© FamilyDoc.SetFormulae](familyDocs=familyDocAddSharedParameters.familyDocs, nameOrParamLists=familyDocAddSharedParameters.parameterLists, formulaeLists=code_block_7.formulae)  # package Crumple; Given a list of family documents, parmeters, and formula lists the node will attempt to set the parameter formulae.
familydoc_closeandsave = Custom[© FamilyDoc.CloseAndSave](familyDocs=familydoc_setformulae.familyDocs)  # package Crumple; Attempts to close a family document or list of family documents, and save the families in the process to their current location.

# group: Report failures (ignore errors)
flatten = List.Flatten(list=familyDocAddSharedParameters.outcomeLists)
code_block_8 = CodeBlock { "FAILURE"; true; }
startsWith = String.StartsWith(string=flatten, searchFor=code_block_8.out0, ignoreCase=code_block_8.out1)
filterByBoolMask_3 = List.FilterByBoolMask(list=flatten, mask=startsWith)
failed_to_add = Watch(filterByBoolMask_3.in)  # graph output

# group: Report failures (ignore errors)
flatten_2 = List.Flatten(list=familydoc_setformulae.outcomeLists)
code_block_9 = CodeBlock { "FAILURE"; true; }
startsWith_2 = String.StartsWith(string=flatten_2, searchFor=code_block_9.out0, ignoreCase=code_block_9.out1)
filterByBoolMask_4 = List.FilterByBoolMask(list=flatten_2, mask=startsWith_2)
failed_to_set_formulae = Watch(filterByBoolMask_4.in)  # graph output
