# Dynamo graph ImpExp_BatchExportPdf.dyn (Dynamo 2.16.2.5624)
# packages: Crumple 2024.4.3

# group: Settings
windows_desktop = Custom[© Windows.Desktop]()  # package Crumple; This node returns the active username, as well as a path to the user's Desktop.
code_block = CodeBlock(dp=windows_desktop) { dp + "\\Export"; }
collect_sheets = Custom[© Collect.Sheets]()  # package Crumple; Returns all the sheets in a document, with the option to omit any placeholder sheets.
code_block_2 = CodeBlock { 5; }
takeItems = List.TakeItems(list=collect_sheets, amount=code_block_2)
sheets_nameformatted = Custom[© Sheets.NameFormatted](sheets=takeItems)  # package Crumple; Given a list of sheets, apply a typical naming convention to them with some optional fields such as prefix and separator.
string_windowslegal = Custom[© String.WindowsLegal](checkStrings=sheets_nameformatted.sheetName)  # package Crumple; Finds all illegal characters for a windows named element and substitutes them with a replacement.
revit_exportoptionspdf = Custom[© Revit.ExportOptionsPdf]()  # package Crumple; Provides a list of options to be used in conjunction with the ExportPDF node. Works in Revit 2022 and later.

# group: Export to PDF
revit_exporttopdf = Custom[© Revit.ExportToPdf](directoryPath=code_block, sheets=sheets_nameformatted.sheets, fileNames=string_windowslegal.legalStrings, options=revit_exportoptionspdf)  # package Crumple; Given a list of sheets, names, directory and export options this node will batch export PDF files. Requires Revit 2022 or higher to work.
filterByBoolMask = List.FilterByBoolMask(list=revit_exporttopdf.filePaths, mask=revit_exporttopdf.success)
failed_to_export = Watch(filterByBoolMask.out)  # graph output
