# Dynamo graph FamilyDoc_BulkUpgrade.dyn (Dynamo 3.4.1.7055)
# packages: Crumple 2024.4.3

# group: Get family documents in directory, remove backups
string = StringInput("C:\Users\Gavin\Documents\GitHub\Crumple\Script samples\Basic operations\R26\Families")
code_block = CodeBlock { ".rfa"; false; }
windows_directorycontents = Custom[© Windows.DirectoryContents](directoryPath=string, searchString=code_block.out0, deepSearch=code_block.out1)  # package Crumple; Be aware there is an OOTB node that can do this, but I wanted to add this to the package so others can see how to use a Python method as a starter block in other scripts.
windows_filterbackups = Custom[© Windows.FilterBackups](filePaths=windows_directorycontents)  # package Crumple; Given a filepath or list of filepaths, separate out any backup file paths.

# group: Filter to lower file formats only
revit_getfileversions = Custom[© Revit.GetFileVersions](filePaths=windows_filterbackups.validPaths)  # package Crumple; Given a file path or list of file paths, attempts to return their version as an integer.
revit_version = Custom[© Revit.Version]()  # package Crumple; Returns the build information about the active Revit session.
lt = revit_getfileversions < revit_version.version
filterByBoolMask = List.FilterByBoolMask(list=windows_filterbackups.validPaths, mask=lt)

# group: Open and close, that's it!
familydoc_open = Custom[© FamilyDoc.Open](filePaths=filterByBoolMask.in)  # package Crumple; Given a file path to a family, attempts to open that document in the background in Revit if possible. Should not be used for regular models/templates.
familydoc_title = Custom[© FamilyDoc.Title](familyDocs=familydoc_open.familyDocs)  # package Crumple; Returns the title of a family document in the unwrapped state. Can be used in conjunction with nodes like 'FamilyDocOpen'.
flow_waitfor = Custom[© Flow.WaitFor](data=familydoc_open.familyDocs, waitFor=familydoc_title)  # package Crumple; Tells the first input to wait for the second input to arrive, then passes on the first input. Really useful for scripts which have branching paths that rely on their outputs to carry each other forward. Quite a few custom packages have a 'passthrough' or 'waitfor' node. I use these all the time, so find it useful to have them contained in this package also.
familydoc_closeandsave = Custom[© FamilyDoc.CloseAndSave](familyDocs=flow_waitfor)  # package Crumple; Attempts to close a family document or list of family documents, and save the families in the process to their current location.

upgraded_successfully = Watch(familydoc_title)  # graph output
