# Dynamo graph FamilyDoc_OpenClose.dyn (Dynamo 3.4.1.7055)
# packages: Crumple 2024.4.3

# group: Basic directory collection workflow
string = StringInput("C:\Users\Gavin\Documents\GitHub\Crumple\Script samples\Basic operations\R26\Families")
code_block = CodeBlock { ".rfa"; false; }
windows_directorycontents = Custom[© Windows.DirectoryContents](directoryPath=string, searchString=code_block.out0, deepSearch=code_block.out1)  # package Crumple; Be aware there is an OOTB node that can do this, but I wanted to add this to the package so others can see how to use a Python method as a starter block in other scripts.
windows_filterbackups = Custom[© Windows.FilterBackups](filePaths=windows_directorycontents)  # package Crumple; Given a filepath or list of filepaths, separate out any backup file paths.
revit_getfileversions = Custom[© Revit.GetFileVersions](filePaths=windows_filterbackups.validPaths)  # package Crumple; Given a file path or list of file paths, attempts to return their version as an integer.
revit_version = Custom[© Revit.Version]()  # package Crumple; Returns the build information about the active Revit session.
eq = revit_getfileversions == revit_version.version
filterByBoolMask = List.FilterByBoolMask(list=windows_filterbackups.validPaths, mask=eq)

# group: Add in a null, test family open and parameters get
code_block_2 = CodeBlock { 0; null; }
familydoc_open = Custom[© FamilyDoc.Open](filePaths=filterByBoolMask.in)  # package Crumple; Given a file path to a family, attempts to open that document in the background in Revit if possible. Should not be used for regular models/templates.
addItemToFront = List.AddItemToFront(item=code_block_2.out1, list=familydoc_open.familyDocs)
familydoc_getparameters = Custom[© FamilyDoc.GetParameters](familyDocs=addItemToFront)  # package Crumple; Given a family document or list of them, returns all parameters and their properties in those documents. You can provide optionally provide parameter names to get just those parameters.

# group: Get types, get parameter values
familydoc_gettypes = Custom[© FamilyDoc.GetTypes](familyDocs=familydoc_getparameters.familyDocs)  # package Crumple; Given a family document or list of documents, returns all types in that document and their names. You can provide optionally provide type names to get just those types.
familydoc_getparametervalues = Custom[© FamilyDoc.GetParameterValues](familyDocs=familydoc_getparameters.familyDocs, nameOrParamLists=familydoc_getparameters.parameterLists, nameOrTypeLists=familydoc_gettypes.typeLists)  # package Crumple; Given a family document of list of them, attempts to get all parameter values of the provided types or type names.

# group: Test various flat list property nodes
familydoc_title = Custom[© FamilyDoc.Title](familyDocs=familydoc_getparametervalues.familyDocs)  # package Crumple; Returns the title of a family document in the unwrapped state. Can be used in conjunction with nodes like 'FamilyDocOpen'.
code_block_3 = CodeBlock { null; }
flatten = List.Flatten(list=familydoc_getparametervalues.paramLists)
addItemToFront_2 = List.AddItemToFront(item=code_block_3, list=flatten)
familyparam_formulae = Custom[© FamilyParam.Formulae](familyParams=addItemToFront_2)  # package Crumple; For a family parameter of list of them, returns their formula if any.
familyparam_isinstance = Custom[© FamilyParam.IsInstance](familyParams=addItemToFront_2)  # package Crumple; For a family parameter or list of them, return if the parameters are instance based.
familyparam_isshared = Custom[© FamilyParam.IsShared](familyParams=addItemToFront_2)  # package Crumple; For a family parameter or list of them, return if the parameters are shared.
familyparam_name = Custom[© FamilyParam.Name](familyParams=addItemToFront_2)  # package Crumple; Given a family parameter of list of them, return the parameter names. Use @L2 levels for list of list processing.
familyparam_parametergroup = Custom[© FamilyParam.ParameterGroup](familyParams=addItemToFront_2)  # package Crumple; For a family parameter of list of them, returns their parmater groups. If using Revit 2022+ the node will return ForgeTypeIds instead.
familyparam_storagetype = Custom[© FamilyParam.StorageType](familyParams=addItemToFront_2)  # package Crumple; For a family parameter or list of them, return their storage types.
code_block_4 = CodeBlock { null; }
flatten_2 = List.Flatten(list=familydoc_gettypes.typeLists)
addItemToFront_3 = List.AddItemToFront(item=code_block_4, list=flatten_2)
familytype_name = Custom[© FamilyType.Name](familyTypes=addItemToFront_3)  # package Crumple; For a family type or list of family types, returns the type names.
list_create = List.Create(item0=familydoc_title, item1=familyparam_formulae.formulae, item2=familyparam_isinstance, item3=familyparam_isshared, item4=familyparam_name, item5=familyparam_parametergroup.parameterGroups, item6=familyparam_storagetype.storageTypes, item7=familytype_name)

# group: Close family docs
flow_waitfor = Custom[© Flow.WaitFor](data=familydoc_getparametervalues.familyDocs, waitFor=list_create)  # package Crumple; Tells the first input to wait for the second input to arrive, then passes on the first input. Really useful for scripts which have branching paths that rely on their outputs to carry each other forward. Quite a few custom packages have a 'passthrough' or 'waitfor' node. I use these all the time, so find it useful to have them contained in this package also.
code_block_5 = CodeBlock { true; }
familydoc_close = Custom[© FamilyDoc.Close](familyDocs=flow_waitfor, saveOption=code_block_5)  # package Crumple; Given documents in the unwrapped state, attempts to close then with the option to save them (applies to all documents, one input expected, not a list).
