# Dynamo custom node Delay.dyf (Dynamo 2.3.0.5885)
# category: Crumple.Script.Flow
# This node will hold up data flow for a specified number of seconds. Use with care, and be aware of how data will start/stop on alternate branches of your scripts!

data = Input(data: var[]..[])  # Data to delay
seconds = Input(seconds: double = 0)  # Time to delay (in seconds).
python_script = Python(IN[0]=data, IN[1]=seconds)
# ---------- python_script.python (16 lines) ----------
# Made by Gavin Crump
# Free for use
# BIM Guru, www.bimguru.com.au

# Boilerplate text
import time

# Preparing input from dynamo to revit
data  = IN[0]
delay = IN[1]

# Delayed data
time.sleep(delay)

# Preparing output to Dynamo
OUT = data
# ----------------------------------------
data_2 = Output(python_script)  # "data"; Data after the delay.
