# Dynamo custom node ListKickFlip.dyf (Dynamo 2.3.0.5885)
# category: Crumple.List.Organize
# Drops a certain number of rows from the front a list, then transposes it. Handy for pre-processing Excel data!

Data = Input(Data: var[]..[])
Kick = Input(Kick: int = 1)
code_block = CodeBlock(list=Data, amount=Kick) { data = DSCore.List.DropItems(list, amount); data_t = DSCore.List.Transpose(data); }
Flip = Output(code_block.data_t)  # "Flip!"
