# Dynamo custom node SurfaceClampZ.dyf (Dynamo 2.3.0.5885)
# category: Crumple.Geometry.Surfaces
# Given a lower and upper parameter between -1 and 1, return all surfaces with a normal Z value in that range.

surfaces = Input(surfaces: var[]..[])
code_block = CodeBlock { 0.5; }
normalAtParameter = Surface.NormalAtParameter(surface=surfaces, u=code_block, v=code_block)
lower_limit = Input(lower_limit: double = 0.5)
upper_limit = Input(upper_limit: double = 1)
code_block_2 = CodeBlock(testvec=normalAtParameter, low_lim=lower_limit, high_lim=upper_limit) { vecz = testvec.Z; lower = vecz >= low_lim; upper = vecz <= high_lim; lower && upper; }
filterByBoolMask = List.FilterByBoolMask(list=surfaces, mask=code_block_2.out3)
surfaces_2 = Output(filterByBoolMask.in)  # "surfaces"
