# Dynamo custom node ViewsToSheets.dyf (Dynamo 2.3.0.5885)
# category: Crumple.Revit.Views
# Moves views to sheets based on viewport centres. If you provide less points than views, the node will source the last point in the list for the remainder (so you can use 1 point for a 'longest' lacing effect).

views = Input(views: var[]..[])  # View count should match sheet count.
sheets = Input(sheets: var[]..[])  # Sheet count should match view count.
points = Input(points: var[]..[])  # Points will be sourced to match the number of views provided.
python_script = Python(IN[0]=views, IN[1]=sheets, IN[2]=points)
# ---------- python_script.python (76 lines) ----------
# Made by Gavin Crump
# Free for use
# BIM Guru, www.bimguru.com.au

# Boilerplate text
import clr

import sys
sys.path.append('C:\Program Files (x86)\IronPython 2.7\Lib')

import System
from System import Array
from System.Collections.Generic import *

clr.AddReference("RevitNodes")
import Revit
clr.ImportExtensions(Revit.Elements)
clr.ImportExtensions(Revit.GeometryConversion)

clr.AddReference("RevitServices")
import RevitServices
from RevitServices.Persistence import DocumentManager 
from RevitServices.Transactions import TransactionManager 

clr.AddReference("RevitAPI")
import Autodesk 
from Autodesk.Revit.DB import *

# Current doc/app/ui
doc = DocumentManager.Instance.CurrentDBDocument

# Preparing input from dynamo to revit
viewlist  = IN[0] if isinstance(IN[0], list) else [IN[0]]
sheetlist = IN[1] if isinstance(IN[1], list) else [IN[1]]
pointlist = IN[2] if isinstance(IN[2], list) else [IN[2]]

# Find how many fewer points there are than views
viewcount  = len(viewlist)
pointcount = len(pointlist)
difference = viewcount-pointcount

# Fill the points list to match the number of views
pointsadd = [pointlist[-1]]*difference
pointsfix = pointlist + pointsadd

# Unwrap elements
views  = []
sheets = []
points = []

for v in viewlist:
	views.append(UnwrapElement(v))
for s in sheetlist:
	sheets.append(UnwrapElement(s))
for p in pointsfix:
	points.append(UnwrapElement(p).ToXyz())

# Do some action in a Transaction
TransactionManager.Instance.EnsureInTransaction(doc)

viewports = []
for v,s,p in zip(views,sheets,points):
	try:
		vp = Viewport.Create(doc, s.Id, v.Id, p)
		viewports.append(vp)
	except:
		viewports.append("View already placed!")

TransactionManager.Instance.TransactionTaskDone()

# Output and Changing element to Dynamo for export
# <element>.ToDSType(True), #Not created in script, mark as Revit-owned
# <element>.ToDSType(False) #Created in script, mark as non-Revit-owned

# Preparing output to Dynamo
OUT = viewports
# ----------------------------------------
viewports = Output(python_script)  # All results, including views that failed to place. These are most likely already on a sheet.
