# Dynamo custom node ViewsToSheets_ByPoints.dyf (Dynamo 2.3.0.5885)
# category: Crumple.Revit.Views
# Moves views to sheets based on viewport centres. The node expects the same number of points as views/sheets to be provided.

views = Input(views: var[]..[])  # View/sheet/point count should be the same size/structure.
sheets = Input(sheets: var[]..[])  # View/sheet/point count should be the same size/structure.
points = Input(points: var[]..[])  # View/sheet/point count should be the same size/structure.
python_script = Python(IN[0]=views, IN[1]=sheets, IN[2]=points)
# ---------- python_script.python (57 lines) ----------
# Made by Gavin Crump
# Free for use
# BIM Guru, www.bimguru.com.au

# Boilerplate text
import clr

import sys
sys.path.append('C:\Program Files (x86)\IronPython 2.7\Lib')

import System
from System import Array
from System.Collections.Generic import *

clr.AddReference("RevitNodes")
import Revit
clr.ImportExtensions(Revit.Elements)
clr.ImportExtensions(Revit.GeometryConversion)

clr.AddReference("RevitServices")
import RevitServices
from RevitServices.Persistence import DocumentManager 
from RevitServices.Transactions import TransactionManager 

clr.AddReference("RevitAPI")
import Autodesk 
from Autodesk.Revit.DB import *

# Current doc/app/ui
doc = DocumentManager.Instance.CurrentDBDocument

# Function for unwrapping and forcing lists
def uwlist(input):
	tolist = input if isinstance(input, list) else [input]
	unwrap = UnwrapElement(tolist)
	return unwrap

# Preparing input from dynamo to revit
views  = uwlist(IN[0])
sheets = uwlist(IN[1])
points = uwlist(IN[2])

# Do some action in a Transaction
TransactionManager.Instance.EnsureInTransaction(doc)

viewports = []
for v,s,p in zip(views,sheets,points):
	try:
		vp = Viewport.Create(doc, s.Id, v.Id, p.ToXyz())
		viewports.append(vp)
	except:
		viewports.append("View already placed!")

TransactionManager.Instance.TransactionTaskDone()

# Preparing output to Dynamo
OUT = viewports
# ----------------------------------------
viewports = Output(python_script)  # All results, including views that failed to place. These are most likely already on a sheet.
